# Grasshopper definition LARGERslicer - Head (Robot, DXR25).gh (Grasshopper 1.0.9)
# plug-ins: LARGERslicer

# ---- group: 01. PART AND PRINT SETTINGS
# LARGER.slicer
# HEAD  -  ROBOT: KUKA KR120 WITH WEBER ADDITIVE DXR25 (AE20 EXTRUDER), FH MUENSTER CELL
# The head of the 2024 Ginger print, for the robot: non-planar spiral, tool vertical
# INSTRUCTIONS: INSTRUCTIONS
# 
# 1  'Head' is the NurbsHead model, 1.75 x its size (174 mm high), cut flat at the neck, standing on the bed of the FH Muenster cell at X 650, Y 250 (bed coordinates, Work Base = bed corner). There the robot reaches every point without collision. For your own part: replace 'Head' (in mm, standing on Z 0 of the bed).
# 
# 2  Print Settings: 3 mm flat nozzle, bead 5 mm, layer 1.5 mm (2 mm is the nozzle's usual layer; 1.5 mm keeps the beads under chin and nose on the bead below), 30 mm/s, Min Speed 1 mm/s. Machine Profile: Weber Additive DXR25 on a robot (factor 1.128, P1).
# 
# 3  Slice, Guide Mode 'Follow the part': the layers follow the wall from the neck to the crown, the tool stays vertical. One wall, one spiral, Min Layer Time 25 s.
# 
# 4  Read Path Check, then the Report of Robot Program: reach, axis ranges, axis speed and the collision check (robot, tool, printed part, bed, fence and room).
# 
# 5  Move the slider 'Simulation' or click Play on Robot Simulation: the robot runs the print in the Rhino viewport.
# 
# 6  Set the temperatures for your material on Machine Settings, then click 'Save DXR' on the DXR Generator. The file goes to the Desktop (DXR_..._Head_...dxr).
# 
# The robot could also print the head with the tool square to the layers; this example keeps the tool vertical like the Ginger One, so both files print the same layers.
# 01. PART AND PRINT SETTINGS
# The head, the DXR25 profile and the bead: 5 mm wide, 1.5 mm high, 30 mm/s.
head = Brep(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)
machine = MachineProfile(Preset=3)  # -> MachineProfile, Info
printset = PrintSettings(
    BeadWidth=5,
    LayerHeight=1.5,
    Speed=30,
    Flow=1,
    Overlap=0.15,
    MinRadius=0,
    Resolution=2,
    FilamentDiameter=0,
    MinSpeed=1,
    MaxSpeed=200,
    Preview=False,
    MachineProfile=machine.MachineProfile,
    Density=1.25,
    FirstLayerHeight=0,
    Nozzle=0,
    FirstLayerSpeed=0,
    SpeedMmS=True)

# ---- group: 02. SLICE ALONG THE PART, ONE SPIRAL
# 02. SLICE ALONG THE PART, ONE SPIRAL
# Layers follow the wall, tool vertical. One wall, spiral, Min Layer Time 25 s, skirt, brim of 3 beads and exit.
slice = Slice(
    Geometry=head,
    Settings=printset,
    Plane=PlaneXY(0, 0, 0),
    Angle=0,
    GuideMode=2,
    ToolAxis=0,
    StartEndLayers=0,
    LARGER_Background=True)  # -> Layers, Contours, Info
walls = Walls(Layers=slice.Layers, Settings=printset, Count=1, Position=0)  # -> Layers, Contours, Info
contpath = ContinuousPath(
    Layers=walls.Layers,
    Settings=printset,
    Mode=0,
    SeamGap=0,
    Bridge=True,
    SeamMode=0,
    MinLayerTime=25,
    MaxVolumeRate=0,
    ShortLapTime=0,
    LARGER_Background=True)  # -> Toolpath, Info
startend = StartAndEnd(Toolpath=contpath.Toolpath, SkirtLoops=1, SkirtDistance=0, ExitLength=50, ExitLift=20, ExitFlow=0, Brim=1, BrimLoops=3)  # -> Toolpath, Info

# ---- group: 04. ROBOT CELL
# 04. ROBOT CELL
# The FH Muenster cell: KUKA KR120 R2700-2 on its pedestal, AE20 extruder (TCP -460, 3, 108, 46 kg), bed, fence and room.
cell_geo = CellGeometry(Walls=False, Fence=True, Cell=0, Export=False)  # -> Environment, Bed, RobotBase, WorkBase, Info
robot = Robot(Base=cell_geo.RobotBase)  # -> Robot, Info, Meshes
tool = RobotTool(Name="AE20_Extruder", TCP=PlaneYZ(-460, 3, 108), Weight=46, Centroid=Point(-61, -28, 113))  # -> Tool, Info
cell = RobotCell(Robot=robot.Robot, Tool=tool.Tool, WorkBase=cell_geo.WorkBase, BaseName="Bed", Environment=cell_geo.Environment)  # -> Cell, Info

# ---- group: 05. ROBOT PROGRAM AND DXR
# 05. ROBOT PROGRAM AND DXR
# Reach and collision check, then the DXR file for the Weber DXR. Click 'Save DXR'.
part_name = Panel("Head")
program = RobotProgram(
    Toolpath=startend.Toolpath,
    Cell=cell.Cell,
    Turn=0,
    Name=part_name,
    Check=True,
    Pose=0,
    Save=False,
    CollisionPoses=500,
    CheckCollisions=True,
    Clearance=10,
    ShowCell=False,
    LARGER_Background=True)  # -> RobotPath, Extrusion, Feed, KRL, OK, Report, Axes, Unreachable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
robot_report = Panel(program.Report)
machine_2 = MachineSettings(BedTemperature=60, NozzleTemperature=200, CoolingFan=50)  # -> MachineSettings, Info
dxr_gen = DXRGenerator(
    RobotPath=program.RobotPath,
    Extrusion=program.Extrusion,
    Speed=program.Feed,
    MachineSettings=machine_2.MachineSettings,
    File=program.FileName,
    Save=False)  # -> DXR, Info

# ---- group: 06. ROBOT SIMULATION
# 06. ROBOT SIMULATION
# Move the slider or click Play: the robot runs the print in the viewport.
simulation_0_start_1_end = Slider(0.5, range=0..1)
simulate = RobotSimulation(Program=program.Program, Time=simulation_0_start_1_end, Play=False, FilmLength=30, ShowCell=False)  # -> Robot, Axes, TCP, Move, Seconds, Info, External, Printed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

# ---- group: 03. PATH CHECK
# 03. PATH CHECK
# Every bead on the bead below, no crossings, layer times.
check = PathCheck(Toolpath=startend.Toolpath, MaxOffset=0, MinLayerTime=0)  # -> OK, Report, Unsupported, Offset, Crossings, LayerTimes
path_check = Panel(check.Report)
