# Grasshopper definition LARGERslicer - Non Planar Head (Ginger).gh (Grasshopper 1.0.9)
# plug-ins: LARGERslicer

# ---- group: 01 PART AND PRINT SETTINGS (4 mm bead, 2 mm layers)
your_part = Brep(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)
# LARGER.slicer  -  NON-PLANAR HEAD (GINGER ONE, KLIPPER)
# Non-planar layers that follow the part itself, no guide surface. The nozzle stays vertical (no A/B axes).
# Every layer lies at the same share of the way up the wall, so the overhang side gets layers of even thickness.
# The extrusion follows the vertical gap to the layer below. Non-Planar Check measures it and checks the head.
# INSTRUCTIONS: 1  Replace 'Your part' with your own part: standing on the bed (Z 0), in mm, closed or open.
# 2  Slice: Guide stays empty, Guide Mode = Follow the part (no guide).
# 3  Read Path Check and Non-Planar Check. Set the head of your Ginger (tip radius, cone angle and length, head radius).
# 4  Machine: Ginger One (Klipper), material and bed temperature go into START_PRINT. E is a volume (x 1.0): confirm with the Ginger's Klipper rotation_distance.
# 5  Click 'Save G-code' on Machine G-code.
printset = PrintSettings(
    BeadWidth=4,
    LayerHeight=2,
    Speed=50,
    Flow=1,
    Overlap=0.15,
    MinRadius=0,
    Resolution=2,
    FilamentDiameter=0,
    MinSpeed=5,
    MaxSpeed=200,
    Preview=False,
    Density=1.25,
    FirstLayerHeight=0,
    Nozzle=0,
    FirstLayerSpeed=25,
    SpeedMmS=True)

# ---- group: 02 NON-PLANAR LAYERS FROM THE PART (no guide)
slice = Slice(
    Geometry=your_part,
    Settings=printset,
    Plane=PlaneXY(0, 0, 0),
    Angle=0,
    GuideMode=2,
    ToolAxis=1,
    StartEndLayers=0,
    LARGER_Background=True)  # -> Layers, Contours, Info
slice_info = Panel(slice.Info)
walls = Walls(Layers=slice.Layers, Settings=printset, Count=1, Position=0)  # -> Layers, Contours, Info

# ---- group: 03 ONE CONTINUOUS LINE (spiral, brim, exit lift)
contpath = ContinuousPath(
    Layers=walls.Layers,
    Settings=printset,
    Mode=0,
    SeamGap=0,
    Bridge=True,
    SeamMode=0,
    MinLayerTime=0,
    MaxVolumeRate=330,
    ShortLapTime=0,
    LARGER_Background=True)  # -> Toolpath, Info
startend = StartAndEnd(Toolpath=contpath.Toolpath, SkirtLoops=1, SkirtDistance=0, ExitLength=50, ExitLift=20, ExitFlow=0, Brim=1, BrimLoops=3)  # -> Toolpath, Info

# ---- group: 04 CHECKS (slim head: r0 4, 30 deg, cone 60, head 40)
check = PathCheck(Toolpath=startend.Toolpath, MaxOffset=0, MinLayerTime=0)  # -> OK, Report, Unsupported, Offset, Crossings, LayerTimes
np_check = NonPlanarCheck(Toolpath=startend.Toolpath, TipRadius=4, ConeAngle=30, ConeLength=60, HeadRadius=40, Pose=1, LARGER_Background=True)  # -> OK, Report, BeadHeight, BadHeights, Collisions, Head
path_check = Panel(check.Report)
non_planar_check = Panel(np_check.Report)

# ---- group: 05 GINGER ONE (KLIPPER) G-CODE (PLA, bed 90)
machine = Machine(Machine=2, Save=False, Material="PLA", BedTemperature=90, Kind=0)  # -> Machine, Definition, Info, Model
g_code = MachineGCode(Toolpath=startend.Toolpath, Machine=machine.Machine, Name="Vase", Save=False)  # -> GCode, Info, FileName, Model, Simulation
g_code_info = Panel(g_code.Info)
simulate = PrinterSimulation(Toolpath=g_code.Simulation, Pose=0.6, Play=False, FilmLength=20, CheckCollisions=True)  # -> Model, Printed, Tip, Info, Seconds, Colliding, Collisions
