# Grasshopper definition Weber DXR20 FH Münster Robot System.gh (Grasshopper 1.0.8)
# plug-ins: Robots, Pufferfish, Human, opennest_2 Info, Sasquatch

geometry = Geometry(<brep referenced from the Rhino model>)

# ---- group: Multiple Input Geometries
geometry_2 = Geometry(<brep referenced from the Rhino model>)
brep_join = BrepJoin(Breps=graft(geometry_2))  # -> Breps, Closed
solid_union = SolidUnion(Breps=flatten(brep_join.Breps))

# ----
geometry_3 = Geometry(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)
point = Point(Point(-9.657679484, -8.480290249, 96.52359572))

# ---- group: Move Point
unit_z = UnitZ(Factor=Slider(500, range=0..1000))
move = Move(Geometry=point, Motion=unit_z)  # -> Geometry, Transform

# ---- group: Settings
layer_thickness = Slider(4, range=0..10)
layer_height = Slider(2, range=0..10)
brim_height = Slider(0.9, range=0..2)

# ---- group: Create Surface
curve = Curve([<curve referenced from the Rhino model> x3])  # disabled
xz_plane = XZPlane(Origin=Point(0, 0, 0))  # disabled
area = Area(Geometry=curve)  # -> Area, Centroid; disabled
curve_plane = CurvePlane(Curve=curve, Plane=xz_plane)  # -> Points, ParamsC, ParamsP; disabled
deconstruct = Deconstruct(Point=curve_plane.Points)  # -> XComponent, YComponent, ZComponent; disabled
sort_list = SortList(Keys=deconstruct.XComponent, ValuesValuesA=curve_plane.Points, ValuesA=curve_plane.ParamsC)  # -> Keys, ValuesValuesA, ValuesA; disabled
list_item = ListItem(List=sort_list.ValuesA, Index=0, Wrap=True)  # disabled
seam = Seam(Curve=curve, Seam=flatten(list_item))  # disabled
loft = Loft(Curves=seam, Options={Adjust=False, Closed=False, LoftEnds=0, LoftSimp=0, LoftType=0, Rebuild=10, Refit=0.01})  # disabled

# ----
number_slider = Slider(0.1, range=0..0.1)  # disabled

number_slider_2 = Slider(1, range=0..100)  # disabled
geometry_4 = Geometry(<subd referenced from the Rhino model>)  # disabled
unit_z_2 = UnitZ(Factor=1)  # disabled

number_slider_3 = Slider(0.5, range=0..1)  # disabled

# ---- group: Clean Aligned Contoures
cluster = Cluster(S=solid_union, P=move.Geometry, D=layer_height)

# ----
geometry_5 = Geometry(cluster)

# ---- group: Create Non Planar Curves
number_of_points = Slider(200, range=0..1000)
cluster_2 = Cluster_2(curve=cluster, count=number_of_points, B=layer_height)

# ----
curve_2 = Curve(cluster)
spiral_v3_1 = SpiralV3(curve=curve_2)
polyline = PolyLine(Vertices=spiral_v3_1, Closed=False)

# ---- group: Smooth Curves
smooth_polyline = SmoothPolyline(Polyline=cluster, Strength=Slider(0, range=0..1), Times=Slider(30, range=0..30))

# ---- group: TCP
point_2 = Point(Point(-4.726012166, 439.9464662, 68.43566272))

# ---- group: Extruder
mesh = Mesh(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)

# ----
cluster_3 = Cluster(S=geometry_4, P=move.Geometry, D=number_slider_3)  # disabled

list = RobotsLibrary(
    {"MSAKR120_R2700_2 (missing)": "MSAKR120_R2700_2", "KR120_R2700_2", "UR3e", "UR5e", "UR10e", "UR16e", "UR3", "UR5", "UR10", "UR20", "UR30"}, selected="KR120_R2700_2",
    Type=0)
load_robot_system = LoadRobotSystem(Name=list, Base=PlaneXY(0, 0, 0))

mesh_join = MeshJoin(Meshes=flatten(mesh))

weight_in_kg = Slider(20, range=0..100)
name = Panel("AE20_Extruder")
xz_plane_2 = XZPlane(Origin=point_2)
xz_plane_3 = XZPlane(Origin=Point(0, 0, 0))
create_tool = CreateTool(Name=name, TCP=xz_plane_2, Weight=weight_in_kg, Mesh=mesh_join)  # -> Tool, TCP

# ---- group: Other Geometries / Buildplate
mesh_2 = Mesh(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)

# ---- group: Glas
geometry_6 = Geometry([<brep referenced from the Rhino model> x8])
custom_preview = CustomPreview(Geometry=geometry_6, Material=ColourSwatch(SwatchColor=RGBA(191, 191, 191, 21)))

# ---- group: Zaun
geometry_7 = Geometry([<brep referenced from the Rhino model> x93])
custom_preview_2 = CustomPreview(Geometry=geometry_7, Material=ColourSwatch(SwatchColor=RGBA(181, 181, 181, 131)))

# ---- group: Other Geometries / Robot Booster Frame (Foundation)
geometry_8 = Geometry(<brep referenced from the Rhino model>)

# ---- group: Boden
rectangle = Rectangle({Plane=PlaneXY(928.6274705, -298.4351476, -163.6683056), Size=Domain2(u=-2653.297612..2653.297612, v=-1769.819738..1769.819738)})
surface = Surface(rectangle)
custom_preview_3 = CustomPreview(Geometry=surface, Material=ColourSwatch(SwatchColor=RGBA(245, 245, 245, 232)))

# ---- group: Other Geometries
custom_preview_4 = CustomPreview(Geometry=mesh_2, Material=ColourSwatch(SwatchColor=RGBA(168, 168, 168, 212)))
custom_preview_5 = CustomPreview(Geometry=geometry_8, Material=ColourSwatch(SwatchColor=RGBA(191, 191, 191, 101)))

# ----
remove_last_item = RemoveLastItem(List=cluster_3, NumberOfItems=1)  # disabled

# ---- group: Optimize Non Planar Curves
cluster_4 = Cluster_3(curve=smooth_polyline, B=layer_height)

# ----
point_3 = Point(<point referenced from the Rhino model>)

# ---- group: Create Surface
loft_2 = Loft(
    Curves=remove_last_item,
    Options={Adjust=False, Closed=False, LoftEnds=0, LoftSimp=1, LoftType=0, Rebuild=1000, Refit=0.01})  # disabled

# ----
surface_2 = Surface(loft_2)  # disabled
geometry_9 = Geometry(surface_2)  # disabled

# ---- group: Create Non Planar Curves
geometry_10 = Geometry(<surface referenced from the Rhino model>)  # disabled
brep_join_2 = BrepJoin(Breps=geometry_9)  # -> Breps, Closed; disabled
merge_faces = MergeFaces(Brep=flatten(brep_join_2.Breps))  # -> Breps, Before, After; disabled
surface_3 = Surface(merge_faces.Breps)  # disabled
bounding_box = BoundingBox(Content=surface_3, Plane=PlaneXY(0, 0, 0))  # -> Box, Box_2; disabled
rebuild_surface = RebuildSurface(Surface=merge_faces.Breps)  # disabled
deconstruct_box = DeconstructBox(Box=bounding_box.Box)  # -> Plane, X, Y, Z; disabled
deconstruct_domain = DeconstructDomain(Domain=deconstruct_box.Z)  # -> Start, End; disabled
division = Division(A=deconstruct_domain.End, B=layer_height)  # disabled
range = Range(Domain=Domain(0, 1), Steps=division)  # disabled
construct_point = ConstructPoint(XCoordinate=range, YCoordinate=0, ZCoordinate=0)  # disabled
iso_curve = IsoCurve(Surface=reparameterize(surface_3), UVPoint=construct_point)  # -> UIsocurve, VIsocurve; disabled

# ---- group: Spiralize Points
spiral_v3_1_2 = SpiralV3(curve=cluster_4)  # -> reverse(spiralized_points)

# ---- group: Create Brim
first_bottom_layers = Slider(1, range=0..10)
infill_bottom_layers = Slider(10, range=0..10)
flip_brim_direction = BooleanToggle(True)
path_manager = PathManager(L=cluster_4, i=infill_bottom_layers, i_2=first_bottom_layers, N=layer_thickness, gate=flip_brim_direction)

# ---- group: Clean up Path for Seam opening / Control Stop Point
number_slider_4 = Slider(106, range=0..1000)
number_slider_5 = Slider(30, range=0..100)
negative = Negative(Value=number_slider_4)

# ----
curve_3 = Curve(iso_curve.VIsocurve)  # disabled
cluster_5 = Cluster_10(curves=curve_3)  # disabled

# ---- group: Clean up Path for Seam opening
cluster_6 = Cluster_5(tree=spiral_v3_1_2, guide=spiral_v3_1_2, x_component=negative, y_component=number_slider_4, z_component=number_slider_5)

# ----
remove_last_item_2 = RemoveLastItem(List=cluster_5, NumberOfItems=1)  # disabled
number_slider_6 = Slider(52, range=0..100)  # disabled

# ---- group: Open Seam
lenght_end = Slider(0, range=0..100)
length_start = Slider(1.1, range=0..10)
polyline_2 = PolyLine(Vertices=cluster_6, Closed=False)
multiplication = Multiplication(A=layer_height, B=length_start)
open_seam = OpenSeam(curve=polyline_2, lenght_start=multiplication, lenght_end=lenght_end)  # -> polyline_3, polyline_4

# ----
list_item_2 = ListItem(List=cluster_5, Index=number_slider_6, Wrap=True)  # disabled

# ---- group: Move Brim
cluster_7 = Cluster_4(geometry=path_manager, A=layer_height, B=brim_height)

# ---- group: Environment
geometry_11 = Geometry([<extrusion referenced from the Rhino model>, <brep referenced from the Rhino model> x2, <extrusion referenced from the Rhino model> x2])

# ----
mesh_3 = Mesh(geometry_11)

# ---- group: Position on Printbed
position_on_printbed = Slider(200, range=0..1000)
cluster_8 = Cluster_7(
    d1=cluster_7,
    d2=open_seam.polyline_4,
    x_coordinate=position_on_printbed,
    y_coordinate=position_on_printbed,
    z_coordinate=brim_height)

# ---- group: Mulitply Prints
multiply_print_objects = Slider(1, range=0..10)
cluster_9 = Cluster_8(geometry=cluster_8, count=multiply_print_objects)  # -> data, tree

# ---- group: Layer Height Points Calculation
cluster_10 = Cluster_6(w=layer_thickness, item=cluster_7, relay=open_seam.polyline_3)

# ---- group: Feedrate and Layerheight Calculation
cluster_11 = Cluster_9(data=brim_height, curve=cluster_7, relay=cluster_10, relay_2=multiply_print_objects, layers=open_seam.polyline_3)  # -> layerheight, feedrate

# ---- group: gCode Machine
bed_temperature = Slider(90, range=0..100)
travel_feed_rate = Slider(10000, range=0..10000)
max_mm3_s = Slider(330, range=0..1000)
flow = Slider(100, range=0..100)
gcode_v11_beta = GCODEV11BETA(
    curve_2=cluster_9.data,
    material="PLA",
    bed_temperature=bed_temperature,
    curve=cluster_9.tree,
    feed_rate=cluster_11.feedrate,
    layer_height=cluster_11.layerheight,
    layer_thickness=layer_thickness,
    flow=flow,
    travel_feed_rate=travel_feed_rate,
    A=max_mm3_s,
    start_code="/Users/moritz/Downloads/#14 UNIKAT/SLICERS/START-END CODE/bedlevel_startcode_v13.gcode",
    end_code="/Users/moritz/Downloads/#14 UNIKAT/SLICERS/START-END CODE/end code v1.3.gcode",
    name="Robo Test Head",
    write=Button(),
    gcode_folder="/Users/moritz/Downloads/Untitled")  # -> polyline, gcode_klipper, gcode_marlin, number_of_points, estimated_time, estimated_mass_grams

# ----
md_slider = MDSlider(
    SliderMode=0,
    slider_value=Point(0.2395765723, 0, 0.5),
    x_domain=Domain(0, 1),
    y_domain=Domain(0, 1),
    z_domain=Domain(0, 1))
rectangle_2 = Rectangle({Plane=PlaneXY(1597.48891, 58.18789673, 48.45534624), Size=Domain2(u=-401.5..401.5, v=-601.5..601.5)})
evaluate_surface = EvaluateSurface(Surface=reparameterize(rectangle_2), Point=md_slider)  # -> Point, Normal, UDirection, VDirection, Frame
point_4 = Point(Point(1399.64671, 553.3309121, 48.45534624))
end_points = EndPoints(Curve=gcode_v11_beta.polyline)  # -> Start, End
move_to_point = MoveToPoint(Geometry=gcode_v11_beta.polyline, PointA=end_points.Start, PointB=point_4)  # -> Moved, Vector, Transform

# ---- group: Text Write
# LARGER.simulation
# LARGE FORMAT 3D PRINTING SIMULATION
# BY MORITZ WESSELER - FH MÜNSTER 2025
# 
# Inspired by Ginger.Addive
# 
# Further Contributors
panel = Panel("""PARAMETRIC
solutions""")
text = Text(Location=evaluate_surface.Point, Text=panel, Size=Slider(102, range=0..1000), Font="Space Grotesk")

group = Group(Geometry=text)
rotate = Rotate(Geometry=group, Angle=degrees(Slider(90, range=0..100)), Plane=evaluate_surface.Point)  # -> Geometry, Transform
ungroup = Ungroup(Group=rotate.Geometry)

# ---- group: 3D Printer Preview
printer_preview = PrinterPreview()  # -> wireframe, surface_2
thickness_layers = Slider(2.5, range=0..10)
custom_preview_6 = CustomPreview(Geometry=printer_preview.surface_2, Material=ColourSwatch(SwatchColor=RGB(130, 122, 122)))
custom_preview_lineweights = CustomPreviewLineweights(
    Geometry=printer_preview.wireframe,
    Shader=ColourSwatch(SwatchColor=RGB(38, 38, 38)),
    Thickness=thickness_layers,
    Absolute=False)

# ---- group: Point Check. If 3 same numbers, evereything is fine
list_length = ListLength(List=[cluster_11.layerheight, cluster_11.feedrate])
panel_2 = Panel([gcode_v11_beta.number_of_points, list_length])

# ----
show_path = PathShower(relay=gcode_v11_beta.polyline, B=Slider(0, range=0..1))

panel_3 = Panel(gcode_v11_beta.gcode_klipper)
panel_4 = Panel(gcode_v11_beta.gcode_marlin)

panel_5 = Panel(gcode_v11_beta.estimated_time)
panel_6 = Panel(gcode_v11_beta.estimated_mass_grams)

curve_4 = Curve(move_to_point.Moved)
divide_distance = DivideDistance(Curve=curve_4, Distance=Slider(10, range=0..10))  # -> flatten(Points), Tangents, Parameters
yz_plane = YZPlane(Origin=Point(0, 0, 0))

list_item_3 = ListItem(List=divide_distance.Points, Index=Slider(-1, range=-1..1), Wrap=True)
unit_z_3 = UnitZ(Factor=Slider(65, range=0..100))
move_2 = Move(Geometry=list_item_3, Motion=unit_z_3)  # -> Geometry, Transform

list_item_4 = ListItem(List=divide_distance.Points, Index=0, Wrap=True)
unit_z_4 = UnitZ(Factor=Slider(79, range=0..100))
move_3 = Move(Geometry=list_item_4, Motion=unit_z_4)  # -> Geometry, Transform

merge = Merge(Data1=move_3.Geometry, Data2=divide_distance.Points, Data3=point_3)

plane = Plane(merge)
flip_plane = FlipPlane(Plane=plane, FlipX=False, FlipY=False, FlipZ=True)  # -> Flipped, ResultBoolean
rotate_plane = RotatePlane(Plane=plane, Angle=degrees(Slider(-126, range=-360..360)))  # -> flatten(Plane)
rotate_3d = Rotate3D(Geometry=rotate_plane, Angle=degrees(Slider(0, range=0..100)), Center=rotate_plane, Axis=yz_plane)  # -> Geometry, Transform

speed_mm_s = Slider(100, range=0..100)
list_2 = FlagFields({"Shoulder": 1, "Elbow": 2, "Wrist": 4}, selected=[])
list_3 = ValueList({"Joint", "Linear"}, selected="Joint")
create_target = CreateTarget(Plane=rotate_3d.Geometry, RobConf=list_2, Motion=list_3, Tool=create_tool.Tool, Speed=speed_mm_s, IsCartesian=True)

create_program = CreateProgram(Name="DefaultProgram", RobotSystem=load_robot_system, Targets=create_target, StepSize=1)  # -> Program, Code, Duration, Warnings, Errors
check_collisions = CheckCollisions(
    Program=create_program.Program,
    FirstSet=7,
    SecondSet=4,
    Environment=mesh_3,
    EnvironmentPlane=-1,
    LinearStepSize=100,
    AngularStepSize=0.7853981634)  # -> CollisionFound, TargetIndex, CollidedMeshes
panel_7 = Panel(create_program.Code)
panel_8 = Panel(create_program.Duration)
panel_9 = Panel(create_program.Errors)

program_simulation = ProgramSimulation(Program=create_program.Program, Time=Slider(0.994, range=0..1), Normalized=True)  # -> SystemMeshes, JointRotations, Plane, Index, Time, Program, Errors

panel_10 = Panel(check_collisions.CollisionFound)

# ---- group: Robot Booster Frame (Foundation)
geometry_12 = Geometry(program_simulation.SystemMeshes)

# ----
custom_preview_7 = CustomPreview(Geometry=geometry_12, Material=ColourSwatch(SwatchColor=RGB(5, 2, 2)))

deconstruct_program_targets = DeconstructProgramTargets(Program=program_simulation.Program)  # -> Planes, Joints, Configuration, DeltaTime

list_item_5 = ListItem(List=deconstruct_program_targets.Planes, Index=Slider(7, range=0..10), Wrap=True)  # -> flatten(Item)
split_list = SplitList(List=list_item_5, Index=program_simulation.Index)  # -> ListA, ListB
interpolate = Interpolate(Vertices=flatten(split_list.ListA), Degree=3, Periodic=False, KnotStyle=1)  # -> Curve, Length, Domain

custom_preview_lineweights_2 = CustomPreviewLineweights(
    Geometry=interpolate.Curve,
    Shader=ColourSwatch(SwatchColor=RGB(255, 178, 0)),
    Thickness=Slider(8.2, range=0.1..100),
    Absolute=False)

# ==== cluster PathShower: fa vedere il percorso
relay = ClusterInput()
B = ClusterInput()
len = Length(Curve=relay)
multiplication = Multiplication(A=len, B=B)
ext = ExtendCurve(Curve=relay, Type=0, Start=0, End=expr("-x", multiplication))
C = ClusterOutput(ext)

# ==== cluster PathManager
L = ClusterInput()
i = ClusterInput()
i_2 = ClusterInput()
N = ClusterInput()
split = SplitList(List=flatten(L), Index=i)  # -> ListA, ListB
cpl = CurvePlanarizer(Curve=split.ListA)  # -> PlanarCurve, Plane, Deviation
split_2 = SplitList(List=cpl.PlanarCurve, Index=i_2)  # -> graft(ListA), ListB
area = Area(Geometry=split_2.ListA)  # -> Area, Centroid
crv_cp = CurveClosestPoint(Point=area.Centroid, Curve=split_2.ListA)  # -> Point, Parameter, Distance
division = Division(A=crv_cp.Distance, B=N)
series = Series(Start=Slider(0.1, range=0..1), Step=N, Count=Slider(8, range=0..10))
polyoffset = PolylineOffset(
    Polylines=split_2.ListA,
    Distance=series,
    Plane=Plane(origin=(0, 0, 0), x=(0, 0, 0), y=(0, 0, 0)),
    Tolerance=0.01,
    ClosedFillet=1,
    OpenFillet=1,
    Miter=2)  # -> flatten(Contour), Holes
end = EndPoints(Curve=split_2.ListA)  # -> Start, End
crv = Curve(flatten(polyoffset.Contour))
cir = Circle(Plane=PlaneXY(0, 0, 0), Radius=Slider(19, range=0..100))
number_slider = Slider(2, range=0..10)
brim = AlignCurveSeams(Curves=crv, Guide=end.Start, Snap=False, Iterative=True)  # -> Aligned, Points, R
curve_filter = CurveFilter(crv=brim.Aligned, B=cir)  # -> flatten(A)
open_seam = OPENSEAM(C=curve_filter, lenght_start=number_slider, lenght_end=number_slider)
gate = ClusterInput()
flip_curve = FlipCurve(Curve=open_seam)  # -> Curve, Flag
stream_filter = StreamFilter(Gate=gate, Stream0=flip_curve.Curve, Stream1=open_seam)
connect = ConnectCurves(Curves=stream_filter, Continuity=0, Close=False, Bulge=1)
topoly = CurveToPolyline(Curve=connect, ToleranceDistance=Slider(0.2, range=0..1), ToleranceAngle=0)  # -> Polyline, Segments
P = ClusterOutput(topoly.Polyline)

# ==== cluster SpiralV3
curve = ClusterInput()
curve_2 = Curve(flatten(curve))
lastdex = LastIndex(List=curve_2)
shift = ShiftList(List=curve_2, Shift=1, Wrap=True)
item = ListItem(List=curve_2, Index=lastdex, Wrap=True)
lastdex_2 = LastIndex(List=curve_2)
item_2 = ListItem(List=curve_2, Index=0, Wrap=True)
item_3 = ListItem(List=curve_2, Index=lastdex_2, Wrap=True)
lastdex_3 = LastIndex(List=shift)
ins = InsertItems(List=curve_2, Item=item_2, Indices=Slider(0, range=0..100), Wrap=True)
ins_2 = InsertItems(List=curve_2, Item=item_3, Indices=lastdex_2, Wrap=True)
replace = ReplaceItems(List=shift, Item=item, Indices=lastdex_3, Wrap=False)
cp = ControlPoints(Curve=ins_2)  # -> Points, Weights, Knots
removeduplicatepts = RemoveDuplicatePts(Points=cp.Points, Tolerance=0.01)
list_item = ListItem(List=ins_2, Index=0, Wrap=True)
removeduplicatelines = RemoveDuplicateLines(Tolerance=0.01)
lng = ListLength(List=removeduplicatepts)
crv_cp = CurveClosestPoint(Point=removeduplicatepts, Curve=graft(ins))  # -> Point, Parameter, Distance
ln = Line(StartPoint=removeduplicatepts, EndPoint=crv_cp.Point)
range = Range(Domain=Domain(0, 1), Steps=expr("x-1", lng))
vec2pt = Vector2Pt(PointA=removeduplicatepts, PointB=crv_cp.Point, Unitize=False)  # -> Vector, Length
multiplication = Multiplication(A=vec2pt.Vector, B=range)
move = Move(Geometry=removeduplicatepts, Motion=multiplication)  # -> SpiralizedPoints, Transform
spiralized_points = ClusterOutput(move.SpiralizedPoints)

# ==== cluster GCODEV11BETA: GCODE PER KLIPPER
layer_thickness = ClusterInput()
layer_height = ClusterInput()
feed_rate = ClusterInput()
flow = ClusterInput()
marlin_0_21_klipper_1 = Slider(0.21, range=0..1)
curve = ClusterInput()
cross_section = Multiplication(LayerHeight=layer_height, LayerThickness=layer_thickness)
control_points = ControlPoints(Curve=curve)  # -> flatten(Points), Weights, Knots
explode = Explode(Curve=curve, Recursive=True)  # -> Segments, Vertices
multiplication = Multiplication(A=cross_section, B=marlin_0_21_klipper_1)
pcent = Percentage(Number=multiplication, Percent=flow)
length = Length(Curve=explode.Segments)
pline = PolyLine(Vertices=control_points.Points, Closed=False)
deconstruct = Deconstruct(Point=control_points.Points)  # -> XComponent, YComponent, ZComponent
polyline = ClusterOutput(pline)
insert_items = InsertItems(List=length, Item="0", Indices="0", Wrap=True)  # -> flatten(List)
travel_feed_rate = ClusterInput()
A = ClusterInput()
multiplication_2 = Multiplication(A=A, B=marlin_0_21_klipper_1)
multiplication_3 = Multiplication(A=insert_items, Multiplier1=pcent)
curve_2 = ClusterInput()
number_slider = Slider(100, range=0..100)
control_points_2 = ControlPoints(Curve=curve_2)  # -> Points, Weights, Knots
equals = Equality(ExtrusionRate=multiplication_3, SecondNumber=Slider(0, range=0..100))  # -> Equality, Inequality
trim = TrimTree(Tree=control_points_2.Points, Depth=1)
lng = ListLength(List=trim)
multiplication_4 = Multiplication(A=lng, B=Slider(0.18127, range=0..1))
multiplication_5 = Multiplication(A=lng, B=Slider(1, range=0..1))
multiplication_6 = Multiplication(FeedRate=feed_rate, B=equals.Inequality)
panel = Panel("""M107
M106 S140""")
multiplication_7 = Multiplication(TravelFeedRate=travel_feed_rate, B=equals.Equality)
subtraction = Subtraction(A=multiplication_5, B=Slider(2, range=0..10))
multiplication_8 = Multiplication(MaxMm3S=multiplication_2, B=Slider(60, range=0..100))
int = Integer(multiplication_4)
item = ListItem(List=trim, Index=multiplication_4, Wrap=True)
mm3_m = Multiplication(A=multiplication_6, B=multiplication)
int_2 = Integer(subtraction)
merge = Merge(Data1=int_2, Data2=int)
larger = LargerThan(FirstNumber=mm3_m, SecondNumber=multiplication_8)  # -> LargerThan, OrEqualTo
panel_2 = Panel(merge)
mm2 = Dispatch(List=multiplication, DispatchPattern=larger.LargerThan)  # -> ListA, ListB
dispatch = Dispatch(List=multiplication_6, DispatchPattern=larger.LargerThan)  # -> ListA, ListB
division = Division(A=multiplication_8, B=mm2.ListA)
weave = Weave(Pattern=larger.LargerThan, Stream0=dispatch.ListB, Stream1=division, NullGaps=False)
feed_rate_2 = Addition(A=multiplication_7, B=weave)
bed_temperature = ClusterInput()
concatenate = Concatenate(
    FragmentH="G1",
    FragmentG=" F",
    FragmentJ=feed_rate_2,
    FragmentA=" X",
    FragmentB=deconstruct.XComponent,
    FragmentC=" Y",
    FragmentD=deconstruct.YComponent,
    FragmentE=" Z",
    FragmentF=deconstruct.ZComponent,
    FragmentI=" E",
    FragmentK=multiplication_3)
unflatten = UnflattenTree(Tree=concatenate, Guide=trim)
ins = InsertItems(List=unflatten, Item=panel, Indices=merge, Wrap=True)
material = ClusterInput()
extremums = MinMax(Number=feed_rate_2)  # -> Minimum, Maximum
subtraction_2 = Subtraction(A=bed_temperature, B=Slider(10, range=0..10))
addition = Addition(A=bed_temperature, B=Slider(20, range=0..100))
panel_3 = Panel(" KAMP_LEVELING=0 PURGE_LAYER_HEIGHT=2 PURGE_PARKING_SPEED=12000 PURGE_LENGHT=300 PURGE_SPEED=500 PURGE_MATERIAL_QUANTITY=3000")
concat = Concatenate(FragmentA=" BED_TEMPERATURE=", BEDTEMPERATURE=bed_temperature)
concat_2 = Concatenate(FragmentA=" BED_TEMPERATURE_MIN=", BEDTEMPERATURE=subtraction_2)
concat_3 = Concatenate(FragmentA=" BED_TEMPERATURE_MAX=", BEDTEMPERATURE=addition)
concat_4 = Concatenate(FragmentA=" MATERIAL=", FragmentB=material)
extremums_2 = MinMax(Number=deconstruct.ZComponent)  # -> Minimum, Maximum
mm3 = Multiplication(A=insert_items, B=multiplication)
pcent_2 = Percentage(Number=flatten(feed_rate_2), Percent=Slider(100, range=0..1000))
g_cm3 = Slider(1.24, range=0..10)
ma = MassAddition(Input=mm3)  # -> Mm3TOTALI, PartialResults
addition_2 = Addition(A=extremums_2.Maximum, ZHope=Slider(30, range=0..100))
division_2 = Division(A=flatten(insert_items), B=pcent_2)
number_slider_2 = Slider(0, range=0..100)
concat_5 = Concatenate(A="START_PRINT", MATERIAL=concat_4, BED_TEMPERATURE=concat, B=concat_2, C=concat_3, D=panel_3)
z_raise = Concatenate(FragmentA="G1", FragmentB=" F", FragmentC=Slider(2000, range=0..10000), FragmentD=" Z", FragmentE=addition_2)
start_code = ClusterInput()
ma_2 = MassAddition(Input=division_2)  # -> Result, PartialResults
end_code = ClusterInput()
cm3 = Division(A=ma.Mm3TOTALI, B=Slider(1000, range=0..1000))
g = Multiplication(A=cm3, B=g_cm3)
time = ConstructTime(Hour=number_slider_2, Minute=ma_2.Result, Second=number_slider_2)
start_code_2 = FilePath(start_code)
end_code_2 = FilePath(end_code)
estimated_time = ClusterOutput(time)
file = ReadFile(File=start_code_2, PerLineParse=True)
file_2 = ReadFile(File=end_code_2, PerLineParse=True)
estimated_mass_grams = ClusterOutput(g)
merge_2 = Merge(Data1=flatten(concat_5), Data2=flatten(ins), Data3=flatten(z_raise), Data4=flatten("END_PRINT"))
merge_3 = Merge(Data1=flatten(file), Data2=flatten(ins), Data3=flatten(z_raise), Data4=flatten(file_2))

# ---- group: Number of Points
list_length = ListLength(List=ins)
list_length_2 = ListLength(List=panel)
subtraction_3 = Subtraction(A=list_length, B=list_length_2)
number_of_points = ClusterOutput(subtraction_3)

# ----
desired_file_extension = Panel(".gcode")
gcode_klipper = ClusterOutput(merge_2)
gcode_folder = ClusterInput()
name = ClusterInput()
write = ClusterInput()
gcode_marlin = ClusterOutput(merge_3)
gcode_folder_2 = FilePath(gcode_folder)
panel_4 = Panel(gcode_folder_2)
data = Data(merge_3)
python = FileCreator(Folder=panel_4, name=name, ext=desired_file_extension, lines=data, write=write)  # inputs lines: list, write: Boolean
# ---------- python: Python ----------
__author__ = "Matteo Lomaglio"
__version__ = "2022.06.23"


import os

file =Folder + name + ext


if write:
    filePath = open(file, "w") # Open the file
    for line in lines: # Iterate through lines
        filePath.write(line + "\n") # Write separate lines
    filePath.close() # Close the file
# ---------- end python ----------

# ==== cluster PrinterPreview: Printer Preview

# ---- group: Drucker / Drucker Settings
highth_in_mm = Slider(1000, range=0..1000)
width_in_mm = Slider(1000, range=0..1000)
length_in_mm = Slider(1000, range=0..1000)
number_slider = Slider(100, range=0..100)
number_slider_2 = Slider(100, range=0..100)
point = Point(Point(0, 0, 0))
construct_point = ConstructPoint(XCoordinate=length_in_mm, YCoordinate=width_in_mm, ZCoordinate=0)
unit_z = UnitZ(Factor=highth_in_mm)
rectangle_2pt = Rectangle2Pt(Plane=PlaneXY(0, 0, 0), PointA=point, PointB=construct_point, Radius=0)  # -> Rectangle, Length
extrude = Extrude(Base=rectangle_2pt.Rectangle, Direction=unit_z)

# ---- group: Drucker
# PRINTER PREVIEW
deconstruct_brep = DeconstructBrep(Brep=rectangle_2pt.Rectangle)  # -> Faces, Edges, Vertices
surface = Surface(rectangle_2pt.Rectangle)

list_item = ListItem(List=deconstruct_brep.Vertices, Index=Slider(3, range=0..10), Wrap=True)

# ---- group: Drucker / Move Z
unit_z_2 = UnitZ(Factor=Slider(850, range=0..1000))
move = Move(Geometry=list_item, Motion=unit_z_2)  # -> Geometry, Transform

# ---- group: Drucker / Display
center_box = CenterBox(Base=move.Geometry, X=Slider(10, range=0..1000), Y=Slider(80, range=0..1000), Z=Slider(40, range=0..1000))

# ---- group: Drucker / Move Z
unit_y = UnitY(Factor=Slider(130, range=0..1000))
negative = Negative(Value=unit_y)
move_2 = Move(Geometry=center_box, Motion=negative)  # -> Geometry, Transform

# ---- group: Drucker / Drucker Settings (continued)
brep_wireframe = BrepWireframe(Brep=[move_2.Geometry, extrude], Density=-1)

# ----
wireframe = ClusterOutput(brep_wireframe)
surface_2 = ClusterOutput(surface)

# ==== cluster Cluster
S = ClusterInput()
P = ClusterInput()
D = ClusterInput()
contour = Contour(Shape=S, Point=P, Direction=Vector(0, 0, 1), Distance=D)

# ---- group: Choose Correct Curves
sort = SortList(Keys=contour, ValuesA=contour)  # -> Keys, reverse(ValuesA)
join_curves = JoinCurves(Curves=sort.ValuesA, Preserve=False)  # -> flatten(Curves)
item = ListItem(List=join_curves, Index=0, Wrap=True)

# ---- group: Polyline from Curve
number_slider = Slider(0.1, range=0..0.1)
topoly = CurveToPolyline(Curve=join_curves, ToleranceDistance=number_slider, ToleranceAngle=number_slider)  # -> flatten(Polyline), Segments

# ---- group: Guide
cir = Circle(Plane=PlaneXY(0, 0, 0), Radius=1)

# ---- group: Sort and Align Curves I
flip = FlipCurve(Curve=topoly.Polyline, Guide=cir)  # -> Curve, Flag
join_curves_2 = JoinCurves(Curves=flip.Curve, Preserve=False)
close_curve = CloseCurve(Curve=join_curves_2, Tolerance=Slider(0.9, range=0..1))  # -> flatten(ClosedCurve)
alicrvseams = AlignCurveSeams(Curves=join_curves_2, Guide=cir, Snap=False, Iterative=True)  # -> Aligned, Points, R

# ---- group: Sort and Align Curves II
area = Area(Geometry=alicrvseams.Aligned)  # -> Area, Centroid
deconstruct = Deconstruct(Point=area.Centroid)  # -> XComponent, YComponent, ZComponent
sort_list = SortList(Keys=deconstruct.ZComponent, ValuesValuesA=join_curves_2)  # -> Keys, ValuesValuesA

# ----
values_a = ClusterOutput(sort_list.ValuesValuesA)

# ---- group: Check if Seam Points Align
end_points = EndPoints(Curve=alicrvseams.Aligned)  # -> Start, End

# ==== cluster Cluster_2
curve = ClusterInput()
count = ClusterInput()

# ---- group: Precision Devide Points
divide_curve = DivideCurve(Curve=curve, Count=count, Kinks=False)  # -> Points, Tangents, Parameters

# ----
B = ClusterInput()

# ---- group: Make it non Planar
flip_matrix = FlipMatrix(Data=divide_curve.Points)
polyline = PolyLine(Vertices=flip_matrix, Closed=False)
sort_list = SortList(Keys=flatten(polyline), ValuesValuesA=flatten(polyline))  # -> Keys, ValuesValuesA
list_item = ListItem(List=reverse(sort_list.ValuesValuesA), Index=0, Wrap=True)
length = Length(Curve=list_item)
division = Division(A=length, B=B)
divide_curve_2 = DivideCurve(Curve=polyline, Count=division, Kinks=False)  # -> Points, Tangents, Parameters
flip_matrix_2 = FlipMatrix(Data=divide_curve_2.Points)
polyline_2 = PolyLine(Vertices=flip_matrix_2, Closed=True)

# ----
polyline_3 = ClusterOutput(polyline_2)

# ==== cluster Cluster_3
curve = ClusterInput()
B = ClusterInput()

# ---- group: Opimize Non Planar
divide_curve = DivideCurve(Curve=curve, Count=Slider(200, range=0..1000), Kinks=False)  # -> Points, Tangents, Parameters
flip_matrix = FlipMatrix(Data=divide_curve.Points)
polyline = PolyLine(Vertices=flip_matrix, Closed=False)
sort_list = SortList(Keys=flatten(polyline), ValuesValuesA=flatten(polyline))  # -> Keys, ValuesValuesA
list_item = ListItem(List=reverse(sort_list.ValuesValuesA), Index=0, Wrap=True)
length = Length(Curve=list_item)
division = Division(A=length, B=B)
divide_curve_2 = DivideCurve(Curve=polyline, Count=division, Kinks=False)  # -> Points, Tangents, Parameters
flip_matrix_2 = FlipMatrix(Data=divide_curve_2.Points)
polyline_2 = PolyLine(Vertices=flip_matrix_2, Closed=True)

# ---- group: Optimize Non Planar 2
length_2 = Length(Curve=polyline_2)
division_2 = Division(A=length_2, B=B)
addition = Addition(A=division_2, B=Slider(10, range=0..10))

divide_curve_3 = DivideCurve(Curve=polyline_2, Count=addition, Kinks=False)  # -> Points, Tangents, Parameters
polyline_3 = PolyLine(Vertices=divide_curve_3.Points, Closed=True)  # -> flatten(Polyline)

# ----
polyline_4 = ClusterOutput(polyline_3)

# ==== cluster Cluster_4
A = ClusterInput()
B = ClusterInput()
geometry = ClusterInput()

# ---- group: Move and Guide Brim
subtraction = Subtraction(A=A, B=B)
unit_z = UnitZ(Factor=subtraction)
negative = Negative(Value=unit_z)
move = Move(Geometry=geometry, Motion=negative)  # -> Geometry, Transform
flip_curve = FlipCurve(Curve=move.Geometry)  # -> Curve, Flag

# ----
curve = ClusterOutput(flip_curve.Curve)

# ==== cluster Cluster_5
tree = ClusterInput()
x_component = ClusterInput()
y_component = ClusterInput()
z_component = ClusterInput()
guide = ClusterInput()

# ---- group: Weiß nicht ganz genau was hier passier
flatten_tree = FlattenTree(Tree=tree, Path="{0}")
last_index = LastIndex(List=flatten_tree)
list_item = ListItem(List=flatten_tree, Index=last_index, Wrap=True)

number_slider = Slider(160, range=0..1000)
number_slider_2 = Slider(30, range=0..100)
vector_xyz = VectorXYZ(XComponent=x_component, YComponent=y_component, ZComponent=z_component)  # -> Vector, Length
move = Move(Geometry=list_item, Motion=vector_xyz.Vector)  # -> Geometry, Transform

replace_items = ReplaceItems(List=flatten_tree, Item=move.Geometry, Indices=last_index, Wrap=False)
unflatten_tree = UnflattenTree(Tree=replace_items, Guide=guide)

# ----
tree_2 = ClusterOutput(unflatten_tree)

# ==== cluster Cluster_6
relay = ClusterInput()
item = ClusterInput()

shift_list = ShiftList(List=flatten(relay), Shift=-1, Wrap=True)
replace_items = ReplaceItems(List=shift_list, Item=item, Indices=Slider(0, range=0..100), Wrap=False)
control_points = ControlPoints(Curve=relay)  # -> Points, Weights, Knots
unflatten_tree = UnflattenTree(Tree=replace_items, Guide=relay)
curve_closest_point = CurveClosestPoint(Point=control_points.Points, Curve=unflatten_tree)  # -> Point, Parameter, Distance
line = Line(StartPoint=control_points.Points, EndPoint=curve_closest_point.Point)
panel = Panel(curve_closest_point.Distance)

w = ClusterInput()

vector_2pt = Vector2Pt(PointA=control_points.Points, PointB=curve_closest_point.Point, Unitize=False)  # -> Vector, Length
deconstruct_vector = DeconstructVector(Vector=vector_2pt.Vector)  # -> XComponent, YComponent, ZComponent
vector_xyz = VectorXYZ(XComponent=deconstruct_vector.XComponent, YComponent=deconstruct_vector.YComponent, ZComponent=0)  # -> Vector, Length
angle = Angle(VectorA=vector_2pt.Vector, VectorB=vector_xyz.Vector)  # -> Angle, Reflex
expression = Expression(a=angle.Angle, h=curve_closest_point.Distance, w=w, Expression="(h/w)*(1-sin(a))*((w/h)-cos(a))")
degrees = Degrees(Radians=angle.Angle)
replace_nulls = ReplaceNulls(Items=expression, Replacements=Slider(0, range=0..100))  # -> Items, Count
subtraction = Subtraction(A=Slider(1, range=0..1), B=replace_nulls.Items)
panel_2 = Panel(subtraction)
extremums = MinMax(Number=flatten(subtraction))  # -> Minimum, Maximum
multiplication = Multiplication(A=curve_closest_point.Distance, B=subtraction)

result = ClusterOutput(multiplication)

# ==== cluster OpenSeam
curve = ClusterInput()
lenght_start = ClusterInput()
lenght_end = ClusterInput()

# ---- group: Open Seam
open_seam = OPENSEAM(C=curve, lenght_start=lenght_start, lenght_end=lenght_end)

# ----
control_points = ControlPoints(Curve=open_seam)  # -> Points, Weights, Knots

# ---- group: Closed Curves
polyline = PolyLine(Vertices=flatten(control_points.Points), Closed=False)

# ---- group: Open Curves Seam
polyline_2 = PolyLine(Vertices=control_points.Points, Closed=False)

# ----
polyline_3 = ClusterOutput(polyline_2)
polyline_4 = ClusterOutput(polyline)

# ==== cluster Cluster_7
d1 = ClusterInput()
d2 = ClusterInput()
x_coordinate = ClusterInput()
y_coordinate = ClusterInput()
z_coordinate = ClusterInput()

merge = Merge(Data1=flatten(d1), Data2=flatten(d2))
clean_tree = CleanTree(RemoveNulls=True, RemoveInvalid=True, RemoveEmpty=True, Tree=merge)
bounding_box = BoundingBox(Content=clean_tree, Plane=PlaneXY(0, 0, 0), UnionBox=True)  # -> Box, Box_2
deconstruct_brep = DeconstructBrep(Brep=bounding_box.Box)  # -> Faces, Edges, Vertices
construct_point = ConstructPoint(XCoordinate=x_coordinate, YCoordinate=y_coordinate, ZCoordinate=z_coordinate)
list_item = ListItem(List=deconstruct_brep.Vertices, Index=0, Wrap=True)
move_to_point = MoveToPoint(Geometry=clean_tree, PointA=list_item, PointB=construct_point)  # -> Moved, Vector, Transform

moved = ClusterOutput(move_to_point.Moved)

# ==== cluster Cluster_8
geometry = ClusterInput()
count = ClusterInput()

number_slider = Slider(281, range=0..1000)
vector_xyz = VectorXYZ(XComponent=number_slider, YComponent=number_slider, ZComponent=0)  # -> Vector, Length
linear_array = LinearArray(Geometry=geometry, Direction=vector_xyz.Vector, Count=count)  # -> Geometry, Transform
flip_matrix = FlipMatrix(Data=linear_array.Geometry)
flatten_tree = FlattenTree(Tree=flip_matrix, Path="{0}")

data = ClusterOutput(flip_matrix)
tree = ClusterOutput(flatten_tree)

# ==== cluster Cluster_9
relay = ClusterInput()
relay_2 = ClusterInput()
curve = ClusterInput()

control_points = ControlPoints(Curve=curve)  # -> Points, Weights, Knots
list_length = ListLength(List=flatten(control_points.Points))

layers = ClusterInput()
data = ClusterInput()

# ---- group: Calculation Layertime and Feedrate / First Layer Feedrate
first_layers_feedrate = Slider(1500, range=0..10000)
repeat_data = RepeatData(Data=first_layers_feedrate, Length=list_length)  # -> flatten(Data)

# ---- group: Calculation Layertime and Feedrate
layer_time = LayerTime(relay=layers)
list_length_2 = ListLength(List=relay)
repeat_data_2 = RepeatData(Data=layer_time, Length=list_length_2)  # -> flatten(Data)
merge = Merge(Data1=repeat_data, Data2=repeat_data_2)

# ---- group: First Layer Heights
repeat_data_3 = RepeatData(Data=data, Length=list_length)

# ----
merge_2 = Merge(Data1=flatten(repeat_data_3), Data2=flatten(relay))
panel = Panel(merge_2)

last_index = LastIndex(List=merge_2)
replace_items = ReplaceItems(List=merge_2, Item=Slider(0, range=0..100), Indices=last_index, Wrap=False)
duplicate_data = DuplicateData(Data=replace_items, Number=relay_2, Order=True)

duplicate_data_2 = DuplicateData(Data=merge, Number=relay_2, Order=True)
feedrate = ClusterOutput(duplicate_data_2)
layerheight = ClusterOutput(duplicate_data)

# ==== cluster Cluster_10
curves = ClusterInput()
curve = Curve(curves)

# ---- group: Choose Correct Curves
join_curves = JoinCurves(Curves=curves, Preserve=False)
item = ListItem(List=join_curves, Index=0, Wrap=True)

# ---- group: Polyline from Curve
number_slider = Slider(0.1, range=0..0.1)
topoly = CurveToPolyline(Curve=item, ToleranceDistance=number_slider, ToleranceAngle=number_slider)  # -> flatten(Polyline), Segments

# ---- group: Guide
cir = Circle(Plane=PlaneXY(0, 0, 0), Radius=1)

# ---- group: Sort and Align Curves I
flip = FlipCurve(Curve=topoly.Polyline, Guide=cir)  # -> Curve, Flag
join_curves_2 = JoinCurves(Curves=flip.Curve, Preserve=False)
close_curve = CloseCurve(Curve=join_curves_2, Tolerance=Slider(0.3, range=0..1))
alicrvseams = AlignCurveSeams(Curves=close_curve, Guide=cir, Snap=False, Iterative=True)  # -> Aligned, Points, R

# ---- group: Sort and Align Curves II
end_points = EndPoints(Curve=alicrvseams.Aligned)  # -> Start, End
deconstruct = Deconstruct(Point=end_points.End)  # -> XComponent, YComponent, ZComponent
sort_list = SortList(Keys=deconstruct.ZComponent, ValuesValuesA=alicrvseams.Aligned)  # -> Keys, ValuesValuesA

# ----
values_a = ClusterOutput(sort_list.ValuesValuesA)

# ---- group: Check if Seam Points Align
end_points_2 = EndPoints(Curve=sort_list.ValuesValuesA)  # -> Start, End

# ==== cluster OPENSEAM
lenght_start = ClusterInput()
lenght_end = ClusterInput()
C = ClusterInput()
G = ClusterInput()
neg = Negative(LenghtStart=lenght_start)
neg_2 = Negative(LenghtEnd=lenght_end)
alicrvseams = AlignCurveSeams(Curves=C, Guide=G, Snap=False, Iterative=True)  # -> Aligned, Points, R
seam = Seam(Curve=reparameterize(alicrvseams.Aligned), Seam=Slider(0, range=0..100))
ext = ExtendCurve(Curve=seam, Type=0, Start=neg, End=neg_2)
C_2 = ClusterOutput(ext)

# ==== cluster CurveFilter: elimina le curve sotto una certa lunghezza
crv = ClusterInput()
crv_2 = Curve(crv)
B = ClusterInput()
len = Length(Curve=crv_2)
larger = LargerThan(FirstNumber=len, SecondNumber=B)  # -> LargerThan, OrEqualTo
dispatch = Dispatch(List=crv_2, DispatchPattern=larger.LargerThan)  # -> ListA, ListB
A = ClusterOutput(dispatch.ListA)

# ==== cluster LayerTime
relay = ClusterInput()
flatten = FlattenTree(Tree=relay, Path="{0}")
extremums = MinMax(Number=flatten(flatten))  # -> Minimum, Maximum
layer_time_s = Slider(35, range=0..100)
number_slider = Slider(40, range=0..100)
dom = ConstructDomain(DomainStart=extremums.Minimum, DomainEnd=extremums.Maximum)
slideindom = SlideWithinDomain(Domain=dom, Factor=Slider(0.7464, range=0..1))
len = Length(Curve=flatten)
larger = LargerThan(FirstNumber=len, SecondNumber=slideindom)  # -> LargerThan, OrEqualTo
dispatch = Dispatch(List=flatten, DispatchPattern=larger.LargerThan)  # -> ListA, ListB
crv = Curve(dispatch.ListB)
crv_2 = Curve(dispatch.ListA)
subtraction = Subtraction(A=number_slider, B=layer_time_s)
lng = ListLength(List=crv_2)
series = Series(Start=layer_time_s, Step=1, Count=subtraction)
repeat = RepeatData(Data=layer_time_s, Length=lng)
lastdex = LastIndex(List=repeat)
lng_2 = ListLength(List=series)
lng_3 = ListLength(List=series)
rev = ReverseList(List=series)
series_2 = Series(Start=lastdex, Step=expr("-1", 1), Count=lng_2)
series_3 = Series(Start=0, Step=1, Count=lng_3)
merge = Merge(Data1=rev, Data2=rev)
merge_2 = Merge(Data1=series_3, Data2=series_2)
replace = ReplaceItems(List=repeat, Item=merge, Indices=merge_2, Wrap=False)
len_2 = Length(Curve=crv_2)
len_3 = Length(Curve=crv)
division = Division(A=replace, B=60)
division_2 = Division(A=number_slider, B=60)
division_3 = Division(A=len_2, B=division)  # -> flatten(Result)
division_4 = Division(A=len_3, B=division_2)  # -> flatten(Result)
weave = Weave(Pattern=larger.LargerThan, Stream0=division_4, Stream1=division_3, NullGaps=False)
unflatten = UnflattenTree(Tree=weave, Guide=relay)
T = ClusterOutput(unflatten)
