# Grasshopper definition LARGERslicer Multiaxial Weber Robot.gh (Grasshopper 1.0.8)
# plug-ins: Robots, LARGERslicer

# ---- group: Example Surface
# LARGER.slicer
# NON PLANAR LARGE FORMAT 3D PRINTING ALGORITHM
# BY CLAUDIO SCHRÖDER AND MORITZ WESSELER - FH MÜNSTER 2025
# 
# Inspired by Ginger.Addive
# 
# Further Contributors
# 1. INPUT SURFACE HERE
# 
# [Set one Surface]
geo = Geometry(<surface referenced from the Rhino model>)
geo_2 = Geometry(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)

# ---- group: Input and connect your Surface here
# The PATH MAKER only
# supporrts one untrimmed
# Surface right now!
geometry = Geometry(<brep referenced from the Rhino model>)

# ---- group: Example Open Brep
geo_3 = Geometry(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)

# ----
# OVERHANG ANALYZER
# BUGS: Time Is not Correct because Robot Speed and print speed Differs
# Feature Ideas: Faster Preview
# 
# 
# Join Slice and generate Button
# Requested Plugins: Required Plugins [Please Remove Dependencies!]:
# 
# Clipper Components
# Sasquatsch
# Lunchbox
# Heteroptera
# Wombat
overhang_preview = OverhangPreview()

# ---- group: Brep to Surface (Flat Top)
cluster = Cluster_2()  # disabled

# ----
non_planar_end = BooleanToggle(False)
spiralize = BooleanToggle(True)
skirt = BooleanToggle(False)
# 3D PRINT PLANE PATH MAKER
first_layer_height = Slider(2, range=0..10)
layer_width = Slider(3.5, range=0..15)
layer_height = Slider(2, range=0..10)
resolution = Slider(1, range=0..10)
skirt_distance = Slider(100, range=0..100)
skirt_length = Slider(200, range=0..1000)
first_layer_speed_mm_s = Slider(30, range=0..100)
print_speed_mm_s = Slider(30, range=0..100)
minimum_layer_time_s = Slider(30, range=0..100)

# ----
# MOVE POSITIONS
# Seam
md_slider = MDSlider(SliderMode=0, slider_value=Point(1, 1, 0.5), x_domain=Domain(0, 1), y_domain=Domain(0, 1), z_domain=Domain(0, 1))
# Object
md_slider_2 = MDSlider(
    SliderMode=0,
    slider_value=Point(0.81750926, 0.3091946744, 0.5),
    x_domain=Domain(0, 1),
    y_domain=Domain(0, 1),
    z_domain=Domain(0, 1))
# Skirt Point
md_slider_3 = MDSlider(
    SliderMode=0,
    slider_value=Point(1, 0.5365936902, 0.5),
    x_domain=Domain(0, 1),
    y_domain=Domain(0, 1),
    z_domain=Domain(0, 1))

# ----
# SLICE AND GENERATE DATA
# 1. Slice
accept_geometry = BooleanToggle(True)

# ----
# Preview is super slow! Deactivate Preview!
path = Path(
    surface=geo,
    first_layer_height=first_layer_height,
    layer_heigth=layer_height,
    layer_width=layer_width,
    resolution=resolution,
    skirt_distance=skirt_distance,
    skirt_lenght=skirt_length,
    non_planar_end=non_planar_end,
    spiralize=spiralize,
    first_layer_speed_mm_s=first_layer_speed_mm_s,
    print_speed_mm_s=print_speed_mm_s,
    minimum_layer_time_s=minimum_layer_time_s,
    calculate_path=accept_geometry,
    seam_position=md_slider,
    single_position_on_printbed=md_slider_2,
    skirt_point=md_slider_3)  # -> data_5, f_values_2, e_values_2, planes_2

bed_temperature = Slider(60, range=0..100)
nozzle_temperature = Slider(230, range=0..1000)
cooling_fan = Slider(33, range=0..100)
machine = MachineSettings(BedTemperature=bed_temperature, NozzleTemperature=nozzle_temperature, CoolingFan=cooling_fan)  # -> MachineSettings, SettingsInfo

robot_speed_mm_s = Slider(30, range=0..100)
robot_path = RobotPath(speed=robot_speed_mm_s, robot_planes=path.planes_2)  # -> robot_code, program

# ----
# PREVIEW ROBOT MOVEMENT
preview_slider = Slider(0.459, range=0..1)
program_simulation = ProgramSimulation(Program=robot_path.program, Time=preview_slider, Normalized=True)  # -> SystemMeshes, JointRotations, Plane, Index, Time, Program, Errors

# ---- group: Boden
# ROBOT AND CAGE GEOMETRY PREVIEWS
geo_4 = Geometry(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)
preview = CustomPreview(Geometry=geo_4, Material=ColourSwatch(SwatchColor=RGBA(245, 245, 245, 232)))

# ---- group: Glas
geo_5 = Geometry([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])
preview_2 = CustomPreview(Geometry=geo_5, Material=ColourSwatch(SwatchColor=RGBA(191, 191, 191, 21)))

# ---- group: Letter
geo_6 = Geometry([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])
preview_3 = CustomPreview(Geometry=geo_6, Material=ColourSwatch(SwatchColor=RGB(0, 0, 0)))

# ---- group: Other Geometries / Buildplate
mesh = Mesh(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)

# ---- group: Other Geometries / Robot Booster Frame (Foundation)
geo_7 = Geometry(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)

# ----
# PREVIEW ROBOT PATH
# False for Fast Robot Preview!
path_preview = BooleanToggle(True)
cluster_2 = Cluster(preview_toggle=path_preview, programm=program_simulation.Program, index=program_simulation.Index)

# ---- group: Other Geometries
preview_4 = CustomPreview(Geometry=mesh, Material=ColourSwatch(SwatchColor=RGBA(168, 168, 168, 212)))
preview_5 = CustomPreview(Geometry=geo_7, Material=ColourSwatch(SwatchColor=RGBA(191, 191, 191, 101)))

# ----
dxr_generator = DXRGenerator(
    RobotPath=robot_path.robot_code,
    ExtrusionAmount=path.e_values_2,
    PrintSpeed=path.f_values_2,
    MachineSettings=machine.MachineSettings)  # -> DXRFile, ProcessInfo

# ----
# DXR CODE MAKER
print_time = Panel(path.data_5)
panel = Panel(dxr_generator.DXRFile)

# ----
# SAVE DXR TO DESKTOP
# 3. Save
save_dxr_to_desktop = Button()
file_name = Panel("NonPlanarPrint")
save_cluster = SaveCluster(lines=dxr_generator.DXRFile, file_name=file_name, write=save_dxr_to_desktop)

# ---- group: Walls
geo_8 = Geometry([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])
preview_6 = CustomPreview(Geometry=geo_8, Material=ColourSwatch(SwatchColor=RGB(255, 255, 255)))

# ---- group: Zaun
geo_9 = Geometry([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])
preview_7 = CustomPreview(Geometry=geo_9, Material=ColourSwatch(SwatchColor=RGBA(181, 181, 181, 131)))

# ==== cluster RobotPath: Creates the Robot Path from Planes

# ---- group: Center of Mass
construct_point = ConstructPoint(
    XCoordinate=Slider(-61, range=-200..200),
    YCoordinate=Slider(-28, range=-200..200),
    ZCoordinate=Slider(113, range=-200..200))
point = Point(construct_point)

# ----
construct_point_2 = ConstructPoint(
    XCoordinate=Slider(-460, range=-500..500),
    YCoordinate=Slider(3, range=-500..500),
    ZCoordinate=Slider(108, range=-500..500))

robot_planes = ClusterInput()  # Insert Planes for Robot here

flatten = FlattenTree(Tree=robot_planes, Path="{0}")
plane = Plane(flatten)
yz_plane = YZPlane(Origin=Point(0, 0, 0))
rotate_3d = Rotate3D(Geometry=plane, Angle=degrees(Slider(0, range=-45..45)), Center=plane, Axis=yz_plane)  # -> Geometry, Transform

name = Panel("AE20_Extruder")
mesh = Mesh(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)
mesh_join = MeshJoin(Meshes=flatten(mesh))
weight_in_kg = Slider(46, range=0..100)
yz_plane_2 = YZPlane(Origin=construct_point_2)
create_tool = CreateTool(Name=name, TCP=yz_plane_2, Weight=weight_in_kg, Centroid=point, Mesh=mesh_join)  # -> Tool, TCP

panel = Panel(rotate_3d.Geometry)
pt = Point(Point(651.5, -1447.999985, 211.1069061))

list = RobotsLibrary(
    {"UR3e", "UR5e", "UR10e", "UR16e", "UR3", "UR5", "UR10", "UR20", "UR30", "KR120_R2700_2"}, selected="KR120_R2700_2",
    Type=0)
load_robot_system = LoadRobotSystem(Name=list, Base=pt)

speed = ClusterInput()

list_2 = FlagFields({"Shoulder": 1, "Elbow": 2, "Wrist": 4}, selected="Wrist")
list_3 = ValueList({"Joint", "Linear"}, selected="Joint")
create_target = CreateTarget(Plane=rotate_3d.Geometry, RobConf=list_2, Motion=list_3, Tool=create_tool.Tool, Speed=speed, IsCartesian=True)

create_program = CreateProgram(Name="DXRCODE", RobotSystem=load_robot_system, Targets=create_target, StepSize=1)  # -> Program, Code, Duration, Warnings, Errors
robot_code = ClusterOutput(create_program.Code)  # Robot Code with Toolpath
program = ClusterOutput(create_program.Program)
panel_2 = Panel(create_program.Warnings)

check_collisions = CheckCollisions(
    Program=create_program.Program,
    FirstSet=7,
    SecondSet=4,
    EnvironmentPlane=-1,
    LinearStepSize=100,
    AngularStepSize=0.7853981634)  # -> CollisionFound, TargetIndex, CollidedMeshes
panel_3 = Panel(check_collisions.CollisionFound)

# ==== cluster OverhangPreview: Overhang Preview
geometry = ClusterInput()  # Input Geometry for Overhang Detection

# ----
# visualize overhang
meshsubd = MeshFromSubD(SubD=geometry, Density=4)
number_slider = Slider(500, range=0..1000)
mesh = Mesh(meshsubd)
X = UnitX(Factor=number_slider)
Y = UnitY(Factor=number_slider)
move = Move(Geometry=mesh, Motion=X)  # -> Geometry, Transform
demesh = DeconstructMesh(Mesh=move.Geometry)  # -> Vertices, Faces, Colours, Normals
Z = UnitZ(Factor=1)
X_2 = UnitX(Factor=1)
Y_2 = UnitY(Factor=1)
dprod = DotProduct(VectorA=demesh.Normals, VectorB=Z, Unitize=invert(False))
abs = Absolute(Value=dprod)
gradient = Gradient(
    LowerLimit=0,
    UpperLimit=Slider(0.707, range=0..1),
    Parameter=abs,
    stops=[0: RGB(0, 142, 0), 0.5: RGB(254, 251, 0), 1: RGB(255, 127, 0)])
conmesh = ConstructMesh(Vertices=demesh.Vertices, Faces=demesh.Faces, Colours=gradient)

# ==== cluster Path: Path Creator
first_layer_speed_mm_s = ClusterInput()
minimum_layer_time_s = ClusterInput()
first_layer_height = ClusterInput()
print_speed_mm_s = ClusterInput()
surface = ClusterInput()
calculate_path = ClusterInput()  # Press Button to Calculate Values
non_planar_end = ClusterInput()
skirt_distance = ClusterInput()
layer_heigth = ClusterInput()
layer_width = ClusterInput()
skirt_lenght = ClusterInput()
resolution = ClusterInput()
spiralize = ClusterInput()

stream_freeze_gate = StreamFreezeGate(PassingSwitch=True, Freeze=True, Hold=True)
stream_freeze_gate_2 = StreamFreezeGate(PassingSwitch=calculate_path, Freeze=False, Hold=False)
stream_freeze_gate_3 = StreamFreezeGate(PassingSwitch=calculate_path, Freeze=False, Hold=False)
stream_freeze_gate_4 = StreamFreezeGate(PassingSwitch=calculate_path, Freeze=False, Hold=False)
stream_freeze_gate_5 = StreamFreezeGate(PassingSwitch=calculate_path, Freeze=False, Hold=False)
stream_freeze_gate_6 = StreamFreezeGate(PassingSwitch=calculate_path, Freeze=True, Hold=False)
stream_freeze_gate_7 = StreamFreezeGate(PassingSwitch=calculate_path, Freeze=False, Hold=False)
stream_freeze_gate_8 = StreamFreezeGate(PassingSwitch=calculate_path, Freeze=False, Hold=False)
stream_freeze_gate_9 = StreamFreezeGate(PassingSwitch=calculate_path, Freeze=False, Hold=False)
stream_freeze_gate_10 = StreamFreezeGate(PassingSwitch=calculate_path, Freeze=False, Hold=False)
stream_freeze_gate_11 = StreamFreezeGate(PassingSwitch=calculate_path, Freeze=False, Hold=False)
stream_freeze_gate_12 = StreamFreezeGate(PassingSwitch=calculate_path, Freeze=False, Hold=False)

stream_filter = StreamFilter(Gate=calculate_path, Stream1=surface)
relay = Relay([relay, first_layer_height])
relay_2 = Relay([relay_2, layer_heigth])
relay_3 = Relay([relay_3, layer_width])
relay_4 = Relay([relay_4, resolution])
relay_5 = Relay([relay_5, skirt_distance])
relay_6 = Relay([relay_6, skirt_lenght])
relay_7 = Relay([relay_7, non_planar_end])
relay_8 = Relay([relay_8, spiralize])
relay_9 = Relay([relay_9, first_layer_speed_mm_s])
relay_10 = Relay([relay_10, print_speed_mm_s])
relay_11 = Relay([relay_11, minimum_layer_time_s])

# ----
# Non Planar Contour (Isocurves)
panel = Panel("100")  # disabled
range = Range(Domain=Domain(0, 1), Steps=panel)  # disabled
debox = DeconstructBox(Box=stream_filter)  # -> Plane, X, Y, Z; disabled
paramsrfiso = ParameterSurfaceIsocurve(Surface=stream_filter, Parameter=range, Direction=True)  # disabled
len = Length(Curve=paramsrfiso)  # disabled
panel_2 = Panel("-10000")  # disabled
sort = SortList(Keys=len, ValuesA=paramsrfiso)  # -> Keys, reverse(ValuesA); disabled
X = UnitX(Factor=panel_2)  # disabled
item = ListItem(List=sort.ValuesA, Index=0, Wrap=True)  # disabled
yz = YZPlane(Origin=X)  # disabled
project = Project(Geometry=item, Plane=yz)  # -> Geometry, Transform; disabled
len_2 = Length(Curve=project.Geometry)  # disabled
division = Division(A=len_2, B=relay_2)  # disabled
divide = DivideCurve(Curve=project.Geometry, Count=division, Kinks=False)  # -> Points, Tangents, Parameters; disabled
X_2 = UnitX(Factor=1)  # disabled
project_2 = ProjectPoint(Point=divide.Points, Direction=X_2, Geometry=item)  # -> Point, Index; disabled
srf_cp = SurfaceClosestPoint(Point=project_2.Point, Surface=stream_filter)  # -> Point, UVPoint, Distance; disabled
iso = IsoCurve(Surface=stream_filter, UVPoint=srf_cp.UVPoint)  # -> UIsocurve, VIsocurve; disabled
crv = Curve(flatten(iso.VIsocurve))  # disabled

range_2 = Range(Domain=Domain(0, 1), Steps="100")
paramsrfiso_2 = ParameterSurfaceIsocurve(Surface=stream_filter, Parameter=range_2, Direction=invert(True))
area = Area(Geometry=paramsrfiso_2)  # -> Area, Centroid
nurbs = NurbsCurve(Vertices=area.Centroid, Degree=3, Periodic=False)  # -> Curve, Length, Domain
len_3 = Length(Curve=nurbs.Curve)
division_2 = Division(A=len_3, B=relay_2)
x_minus_one = XMinusOne(NumberX=division_2)
range_3 = Range(Domain=Domain(0, 1), Steps=x_minus_one)
paramsrfiso_3 = ParameterSurfaceIsocurve(Surface=stream_filter, Parameter=range_3, Direction=invert(True))

single_position_on_printbed = ClusterInput()

# ---- group: position object on build plate
# position on build plate
# (single print)
group = Group(Geometry=paramsrfiso_3)
geo = Geometry(group)
center = Center(Geometry=geo, forall=True, referenceAll=2)  # -> Center, Dimension
rectangle = Rectangle(Plane=PlaneXY(0, 0, 0), XSize="1200", YSize="800", Radius=0)  # -> Rectangle, Length
evalsrf = EvaluateSurface(Surface=reparameterize(rectangle.Rectangle), SinglePositionOnPrintbed=single_position_on_printbed)  # -> Point, Normal, UDirection, VDirection, Frame
Z = UnitZ(Factor="1200")
extr = Extrude(Base=rectangle.Rectangle, Direction=Z)
wires = BrepWireframe(Brep=extr, Density=-1)
move2pt = MoveToPoint(Geometry=geo, PointA=center.Center, PointB=evalsrf.Point)  # -> Moved, Vector, Transform

# ----
# position on build plate
# (multiple prints)
number_slider = Slider(150, range=0..1000)  # disabled
number_slider_2 = Slider(3, range=0..10)  # disabled
number_slider_3 = Slider(4, range=0..100)  # disabled
neg = Negative(Value=number_slider)  # disabled
offset = OffsetCurve(Curve=rectangle.Rectangle, Distance=neg, Corners=1)  # disabled
sdivide = DivideSurface(Surface=offset, UCount=number_slider_2, VCount=number_slider_2)  # -> Points, Normals, Parameters; disabled
split = SplitList(List=flatten(sdivide.Points), Index=number_slider_3)  # -> graft(ListA), ListB; disabled
number_slider_4 = Slider(50, range=0..100)  # disabled
flip = FlipMatrix(Data=sdivide.Points)  # disabled
X_3 = UnitX(Factor=number_slider_4)  # disabled
item_2 = ListItem(List=flip, Index=0, Wrap=True)  # disabled
move = Move(Geometry=split.ListA, Motion=X_3)  # -> Geometry, Transform; disabled
move2pt_2 = MoveToPoint(Geometry=flatten(move2pt.Moved), PointB=move.Geometry)  # -> Moved, Vector, Transform; disabled
ungroup = Ungroup(Group=move2pt_2.Moved)  # -> simplify(Geometry); disabled

# ---- group: multiple parts
# Switch
filter = StreamFilter(Gate=0, Stream0=move2pt.Moved, Stream1=ungroup)
ungroup_2 = Ungroup(Group=filter)

# ----
seam_position = ClusterInput()

# ---- group: position seam
# seam position
brec = BoundingRectangle(Geometry=ungroup_2, Plane=PlaneXY(0, 0, 0), Axis=0, Slide=0, Union=True)  # -> Bounding, DimensionX, DimensionY
evalsrf_2 = EvaluateSurface(Surface=reparameterize(brec.Bounding), SeamPosition=seam_position)  # -> Point, Normal, UDirection, VDirection, Frame
alicrvseams = AlignCurveSeams(Curves=ungroup_2, Guide=evalsrf_2.Point, Snap=False, Iterative=True)  # -> Aligned, Points, R
item_3 = ListItem(List=alicrvseams.Aligned, Index=0, Wrap=True)
flip_2 = FlipCurve(Curve=alicrvseams.Aligned, Guide=item_3)  # -> Curve, Flag

# ----
skirt_point = ClusterInput()
stream_freeze_gate_13 = StreamFreezeGate(PassingSwitch=calculate_path, Freeze=True, Hold=True)  # -> simplify(Data)

# ---- group: Visualize
# 3D Preview (Slow)
division_3 = Division(A=relay_3, B=2)  # disabled

# ----
# Non Planar End
number_slider_5 = Slider(30, range=0..100)
filter_2 = StreamFilter(Gate=relay_7, Stream1=flip_2.Curve)
division_4 = Division(A=number_slider_5, B=relay_2)
series = Series(Start="1", Step=1, Count=division_4)
neg_2 = Negative(Value=series)
item_4 = ListItem(List=filter_2, Index=0, Wrap=True)  # -> Item1, Item
item_5 = ListItem(List=filter_2, Index=neg_2, Wrap=True)
divide_2 = DivideCurve(Curve=item_4.Item1, Count="3", Kinks=False)  # -> Points, Tangents, Parameters
explode = Explode(Curve=item_5, Recursive=True)  # -> Segments, Vertices
move_2 = Move(Motion=Vector(0, 0, 10))  # -> Geometry, Transform
bnd = Bounds(Numbers=flatten(series))
pull = PullPoint(Point=explode.Vertices, Geometry=divide_2.Points, ClosestOnly=True)  # -> ClosestPoint, Distance, Index
remap = RemapNumbers(Value=series, Source=bnd, Target=Domain(0, 1))  # -> Mapped, Clipped
graph = GraphMapper(remap.Mapped, x0=0, x1=1, y0=0, y1=1, container_name="Sine", Equation_px=[0, 1], Equation_py=[1, 0])
number_slider_6 = Slider(0.5, range=0..100)
bnd_2 = Bounds(Numbers=pull.Distance)
remap_2 = RemapNumbers(Value=pull.Distance, Source=bnd_2, Target=Domain(0, 1))  # -> Mapped, Clipped
neg_3 = Negative(Value=number_slider_6)
graph_2 = GraphMapper(remap_2.Mapped, x0=0, x1=1, y0=0, y1=1, container_name="Sine", Equation_px=[0, 1], Equation_py=[0, 1])
dom = ConstructDomain(DomainStart=neg_3, DomainEnd=number_slider_6)
remap_3 = RemapNumbers(Value=graph_2, Source=Domain(0, 1), Target=dom)  # -> Mapped, Clipped
multiplication = Multiplication(A=remap_3.Mapped, B=graft(graph))
Z_2 = UnitZ(Factor=multiplication)
move_3 = Move(Geometry=explode.Vertices, Motion=Z_2)  # -> Geometry, Transform

pline = PolyLine(Vertices=move_3.Geometry, Closed=invert(False))
cull_i = CullIndex(List=filter_2, Indices=neg_2, Wrap=True)

crv_2 = Curve(flatten(pline))

merge = Merge(Data1=flatten(cull_i), Data2=reverse(flatten(crv_2)))

# ---- group: non planar end
# Switch
filter_3 = StreamFilter(Gate=relay_7, Stream0=flip_2.Curve, Stream1=merge)

# ---- group: open seam
crv_3 = Curve(filter_3)
cull_i_2 = CullIndex(List=crv_3, Indices="0", Wrap=True)
crv_4 = Curve(crv_3)
neg_4 = Negative(Value=relay_2)
ext = ExtendCurve(Curve=crv_4, Type=0, Start="0", End=neg_4)

# ---- group: generate points (resolution)
len_4 = Length(Curve=ext)
division_5 = Division(A=len_4, B=relay_4)
divide_3 = DivideCurve(Curve=ext, Count=division_5, Kinks=False)  # -> simplify(Points), Tangents, Parameters
pline_2 = PolyLine(Vertices=divide_3.Points, Closed=False)  # -> flatten(Polyline)

# ---- group: generate skirt
# Generate Skirt
item_6 = ListItem(List=pline_2, Index=0, Wrap=True)
brec_2 = BoundingRectangle(Geometry=item_6, Plane=PlaneXY(0, 0, 0), Axis=0, Slide=0, Union=True)  # -> Bounding, DimensionX, DimensionY
end = EndPoints(Curve=item_6)  # -> Start, End
offset_2 = OffsetCurve(Curve=brec_2.Bounding, Distance=relay_5, Corners=1)
evalsrf_3 = EvaluateSurface(Surface=reparameterize(offset_2), SkirtPoint=skirt_point)  # -> Point, Normal, UDirection, VDirection, Frame
alicrvseams_2 = AlignCurveSeams(Curves=offset_2, Guide=evalsrf_3.Point, Snap=False, Iterative=True)  # -> Aligned, Points, R
neg_5 = Negative(Value="1")
ext_2 = ExtendCurve(Curve=alicrvseams_2.Aligned, Type=0, Start=neg_5, End="0")
end_2 = EndPoints(Curve=ext_2)  # -> Start, End
number_slider_7 = Slider(20, range=0..100)
ln = Line(StartPoint=end.Start, EndPoint=end_2.End)
join = JoinCurves(Curves=[ln, ext_2], Preserve=False)
len_5 = Length(Curve=join)
subtraction = Subtraction(A=len_5, B=relay_6, C=number_slider_7)
neg_6 = Negative(Value=subtraction)
neg_7 = Negative(Value=number_slider_7)
panel_3 = Panel("0")
ext_3 = ExtendCurve(Curve=join, Type=0, Start=neg_6, End=neg_7)
fillet = Fillet(Curve=ext_3, Radius=number_slider_7)
len_6 = Length(Curve=ext_3)
division_6 = Division(A=len_6, B=Slider(10, range=0..10))
divide_4 = DivideCurve(Curve=ext_3, Count=division_6, Kinks=False)  # -> Points, Tangents, Parameters
pline_3 = PolyLine(Vertices=divide_4.Points, Closed=False)

# ---- group: generate points (resolution)
len_7 = Length(Curve=ext)
division_7 = Division(A=len_7, B=relay_4)
divide_5 = DivideCurve(Curve=ext, Count=division_7, Kinks=False)  # -> simplify(Points), Tangents, Parameters
pline_4 = PolyLine(Vertices=divide_5.Points, Closed=False)  # -> flatten(Polyline)

# ---- group: split off first and last layer
# split off first + last layer
filter_4 = StreamFilter(Gate=relay_8, Stream1=pline_4)
explode_2 = Explode(Curve=filter_4, Recursive=True)  # -> Segments, Vertices
tstat = TreeStatistics(Tree=explode_2.Vertices)  # -> Paths, Length, Count
panel_4 = Panel("""0
-1""")
item_7 = ListItem(List=tstat.Paths, Index=panel_4, Wrap=True)
cull_i_3 = CullIndex(List=tstat.Paths, Indices=panel_4, Wrap=True)
branch = TreeBranch(Tree=explode_2.Vertices, Path=item_7, MaintainPaths=True)
branch_2 = TreeBranch(Tree=explode_2.Vertices, Path=cull_i_3, MaintainPaths=True)

# ----
# spiralize vertically
item_8 = ListItem(List=branch_2, Index=0, Wrap=True)  # -> Item1, Item
tstat_2 = TreeStatistics(Tree=item_8.Item1)  # -> Paths, Length, Count
tstat_3 = TreeStatistics(Tree=item_8.Item)  # -> Paths, Length, Count
cull_i_4 = CullIndex(List=tstat_2.Paths, Indices="0", Wrap=True)
cull_i_5 = CullIndex(List=tstat_3.Paths, Indices="-1", Wrap=True)
branch_3 = TreeBranch(Tree=item_8.Item1, Path=cull_i_4, MaintainPaths=False)
branch_4 = TreeBranch(Tree=item_8.Item, Path=cull_i_5, MaintainPaths=True)
pdecon = Deconstruct(Point=branch_3)  # -> XComponent, YComponent, ZComponent
pdecon_2 = Deconstruct(Point=branch_4)  # -> XComponent, YComponent, ZComponent
subtraction_2 = Subtraction(A=pdecon.ZComponent, B=pdecon_2.ZComponent)

lng = ListLength(List=branch_2)
range_4 = Range(Domain=subtraction_2, Steps=lng)
division_8 = Division(A=relay_2, B=2)
subtraction_3 = Subtraction(A=range_4, B=division_8)
Z_3 = UnitZ(Factor=subtraction_3)
cull_i_6 = CullIndex(List=Z_3, Indices="-1", Wrap=True)
move_4 = Move(Geometry=branch_2, Motion=cull_i_6)  # -> Geometry, Transform

# ---- group: move first layer
# height adjustment
# first and last layer
tstat_4 = TreeStatistics(Tree=branch)  # -> Paths, Length, Count
dispatch = Dispatch(List=tstat_4.Paths, DispatchPattern=[True, False])  # -> ListA, ListB
branch_5 = TreeBranch(Tree=branch, Path=dispatch.ListA, MaintainPaths=True)
branch_6 = TreeBranch(Tree=branch, Path=dispatch.ListB, MaintainPaths=True)

# ----
addition = Addition(A=relay_2, B=division_8)
neg_8 = Negative(Value=division_8)

# ---- group: move first layer (continued)
Z_4 = UnitZ(Factor=neg_8)
move_5 = Move(Geometry=branch_6, Motion=Z_4)  # -> Geometry, Transform
merge_2 = Merge(Data1=branch_5, Data2=move_5.Geometry)

# ----
merge_3 = Merge(Data1=simplify(merge_2), Data2=simplify(move_4.Geometry))  # -> simplify(Result)
tstat_5 = TreeStatistics(Tree=merge_3)  # -> Paths, Length, Count
cull_i_7 = CullIndex(List=tstat_5.Paths, Indices="0", Wrap=True)
item_9 = ListItem(List=tstat_5.Paths, Index="0", Wrap=True)
branch_7 = TreeBranch(Tree=merge_3, Path=cull_i_7, MaintainPaths=True)
branch_8 = TreeBranch(Tree=merge_3, Path=item_9, MaintainPaths=True)

# ----
# spiralize horizontally
item_10 = ListItem(List=branch_7, Index=0, Wrap=True)  # -> Item1, Item
tstat_6 = TreeStatistics(Tree=item_10.Item)  # -> Paths, Length, Count
tstat_7 = TreeStatistics(Tree=item_10.Item)  # -> Paths, Length, Count
cull_i_8 = CullIndex(List=tstat_6.Paths, Indices="0", Wrap=True)
cull_i_9 = CullIndex(List=tstat_7.Paths, Indices="-1", Wrap=True)
branch_9 = TreeBranch(Tree=item_10.Item, Path=cull_i_8, MaintainPaths=False)
branch_10 = TreeBranch(Tree=item_10.Item, Path=cull_i_9, MaintainPaths=True)
vec2pt = Vector2Pt(PointA=branch_9, PointB=branch_10, Unitize=False)  # -> Vector, Length
devec = DeconstructVector(Vector=vec2pt.Vector)  # -> XComponent, YComponent, ZComponent
vec = VectorXYZ(XComponent=devec.XComponent, YComponent=devec.YComponent, ZComponent=0)  # -> Vector, Length
rev = Reverse(Vector=vec.Vector)

data = Data(branch_7)

# ---- group: spiralize
branch_11 = TreeBranch(Tree=branch_7, Path=cull_i_9, MaintainPaths=True)
lng_2 = ListLength(List=data)
range_5 = Range(Domain=vec.Length, Steps=lng_2)
amp = Amplitude(Vector=rev, Amplitude=range_5)
cull_i_10 = CullIndex(List=amp, Indices="-1", Wrap=True)
move_6 = Move(Geometry=data, Motion=cull_i_10)  # -> Geometry, Transform

# ----
merge_4 = Merge(Data1=simplify(branch_8), Data2=simplify(move_6.Geometry))
pline_5 = PolyLine(Vertices=merge_4, Closed=False)  # -> flatten(Polyline)

# ---- group: spiralize
# Switch
filter_5 = StreamFilter(Gate=relay_8, Stream0=pline_2, Stream1=pline_5)

# ----
# generate toolpath points
entwine = Entwine(Branch00=pline_3, Branch01=filter_5, FlattenInputs=True)
len_8 = Length(Curve=entwine)
explode_3 = Explode(Curve=entwine, Recursive=True)  # -> Segments, Vertices
division_9 = Division(A=len_8, B=relay_4)
cull_i_11 = CullIndex(List=explode_3.Vertices, Indices="0", Wrap=True)
divide_6 = DivideCurve(Curve=entwine, Count=division_9, Kinks=False)  # -> simplify(Points), Tangents, Parameters

# ----
# orient to first layer height
center_2 = Center(Geometry=flatten(cull_i_11), forall=True, referenceAll=2)  # -> Center, Dimension
Z_5 = UnitZ(Factor=relay)
project_3 = Project(Geometry=center_2.Center, Plane=PlaneXY(0, 0, 0))  # -> Geometry, Transform
move_7 = Move(Geometry=project_3.Geometry, Motion=Z_5)  # -> Geometry, Transform
orient = Orient(Geometry=cull_i_11, Source=center_2.Center, Target=move_7.Geometry)  # -> Geometry, Transform
clean = CleanTree(RemoveNulls=True, RemoveInvalid=True, RemoveEmpty=False, Tree=orient.Geometry)

# ----
# DAM
dam = DataDam(BufferDelay=10000000, BufferMode=1)  # -> simplify(DataA)
pline_6 = PolyLine(Vertices=flatten(clean), Closed=False)

data_2 = Data(simplify(clean))

pline_7 = PolyLine(Vertices=data_2, Closed=False)
len_9 = Length(Curve=pline_7)

tstat_8 = TreeStatistics(Tree=data_2)  # -> Paths, Length, Count
cull_i_12 = CullIndex(List=tstat_8.Paths, Indices="0", Wrap=True)
item_11 = ListItem(List=tstat_8.Paths, Index=0, Wrap=True)
branch_12 = TreeBranch(Tree=data_2, Path=item_11, MaintainPaths=True)
branch_13 = TreeBranch(Tree=data_2, Path=cull_i_12, MaintainPaths=True)
xy = XYPlane(Origin=branch_12)

filter_6 = StreamFilter(Gate=relay_8, Stream1=cull_i_11)
pline_8 = PolyLine(Vertices=filter_6, Closed=False)

lng_3 = ListLength(List=flatten(pline_7))
repeat = RepeatData(Data=relay_10, Length=lng_3)
panel_5 = Panel("""0
1""")
replace = ReplaceItems(List=repeat, Item=relay_9, Indices=panel_5, Wrap=False)
unflatten = UnflattenTree(Tree=replace, Guide=pline_7)

pt = Point(branch_13)
cull_i_13 = CullIndex(List=pt, Indices="-1", Wrap=True)
cull_i_14 = CullIndex(List=pt, Indices="0", Wrap=True)
vec2pt_2 = Vector2Pt(PointA=cull_i_13, PointB=cull_i_14, Unitize=False)  # -> Vector, Length
vdisex = VectorDisplayEx(Point=cull_i_13, Vector=vec2pt_2.Vector, Colour=RGB(0, 0, 0), Width=2)
pl = ConstructPlane(Origin=pt, XAxis=vec2pt_2.Vector, YAxis=Vector(0, 1, 0))
trim = TrimTree(Tree=pl, Depth=1)

range_6 = Range(Domain=Domain(0, 1), Steps="1")
paramloftmsh = ParameterLoftMesh(
    Sections=pline_2,
    ParametersU=range_6,
    ParametersV=range_6,
    Weighted=False,
    Lengths=invert(False),
    Angle=0,
    Closed=False,
    Triangulate=False)
mesh = Mesh(paramloftmsh)
meshcp = MeshClosestPoint(Point=branch_13, Mesh=mesh)  # -> Point, Index, Parameter
meval = MeshEval(Mesh=mesh, Parameter=meshcp.Parameter)  # -> Point, Normal, Colour
cull_i_15 = CullIndex(List=branch_13, Indices="0", Wrap=True)
cull_i_16 = CullIndex(List=branch_13, Indices="-1", Wrap=True)
vec2pt_3 = Vector2Pt(PointA=cull_i_16, PointB=cull_i_15, Unitize=False)  # -> Vector, Length
vdisex_2 = VectorDisplayEx(Point=branch_13, Vector=vec2pt_3.Vector, Colour=RGB(0, 0, 0), Width=2)
pl_2 = ConstructPlane(Origin=Point(0, 0, 0), XAxis=meval.Normal, YAxis=vec2pt_3.Vector)
vdisex_3 = VectorDisplayEx(Point=branch_13, Vector=pl_2, Colour=RGB(0, 0, 0), Width=2)
xy_2 = XYPlane(Origin=trim)
orient_2 = OrientDirection(Geometry=xy_2, PointA=xy_2, DirectionA=xy_2, PointB=xy_2, DirectionB=pl_2)  # -> Geometry, Transform
twn2plns = TweenTwoPlanes(PlaneA=xy_2, PlaneB=orient_2.Geometry, Factor=Slider(1, range=0..1), Quaternion=True)
vdisex_4 = VectorDisplayEx(Point=branch_13, Vector=twn2plns, Colour=RGB(0, 0, 0), Width=2)

# ----
# calculate speeds for min. layer time
division_10 = Division(A=len_9, B=unflatten)
data_3 = Data(flatten(division_10))
smaller = SmallerThan(FirstNumber=data_3, SecondNumber=relay_11)  # -> SmallerThan, OrEqualTo
dispatch_2 = Dispatch(List=flatten(data_3), DispatchPattern=smaller.SmallerThan)  # -> ListA, ListB
lng_4 = ListLength(List=dispatch_2.ListA)
repeat_2 = RepeatData(Data=relay_11, Length=lng_4)
weave = Weave(Pattern=smaller.SmallerThan, Stream0=dispatch_2.ListB, Stream1=repeat_2, NullGaps=False)
unflatten_2 = UnflattenTree(Tree=weave, Guide=division_10)
division_11 = Division(A=len_9, B=unflatten_2)
panel_6 = Panel(division_11)

# ----
# Non Planar Target Planes
merge_5 = Merge(Data1=xy, Data2=twn2plns)

multiplication_2 = Multiplication(A=division_11, B="60")
round = Round(Number=multiplication_2)  # -> Nearest, Floor, Ceiling

# ----
# estimate print time
panel_7 = Panel("60")
division_12 = Division(A=len_9, B=division_11)
division_13 = Division(A=division_12, B=panel_7)
division_14 = Division(A=division_13, B=panel_7)
ma = MassAddition(Input=flatten(division_14))  # -> Result, PartialResults
smtime = ConstructSmoothTime(Days=0, Hours=ma.Result, Minutes=0, Seconds=0)

# ---- group: Travel Move Extrusion
trim_2 = TrimTree(Tree=data_2, Depth=1)
bool = Boolean(True)
lng_5 = ListLength(List=trim_2)
repeat_3 = RepeatData(Data=bool, Length=lng_5)
panel_8 = Panel("0")
replace_2 = ReplaceItems(List=repeat_3, Item=panel_8, Indices=panel_8, Wrap=False)
unflatten_3 = UnflattenTree(Tree=replace_2, Guide=data_2)

# ----
lng_6 = ListLength(List=data_2)
repeat_4 = RepeatData(Data=round.Nearest, Length=lng_6)
item_12 = ListItem(List=repeat_4, Index=0, Wrap=True)
panel_9 = Panel(item_12)

stream_freeze_gate_14 = StreamFreezeGate(Data=smtime, PassingSwitch=calculate_path, Freeze=True, Hold=True)
data_4 = Data(smtime)

# ---- group: Travel Move Speed
equals = Equality(FirstNumber=unflatten_3, SecondNumber=panel_8)  # -> Equality, Inequality
dispatch_3 = Dispatch(List=unflatten_3, DispatchPattern=equals.Equality)  # -> ListA, ListB
multiplication_3 = Multiplication(A=Slider(200, range=0..1000), B="60")
index = ItemIndex(List=unflatten_3, Item=dispatch_3.ListA)
replace_3 = ReplaceItems(List=repeat_4, Item=multiplication_3, Indices=index, Wrap=False)

# ----
data_5 = ClusterOutput(data_4)
stream_freeze_gate_15 = StreamFreezeGate(Data=replace_3, PassingSwitch=calculate_path, Freeze=True, Hold=True)
data_6 = Data(replace_3)

# ---- group: Visualize
pline_9 = PolyLine(Vertices=data_2, Closed=invert(False))  # disabled
number_slider_8 = Slider(6, range=0..10)  # disabled
number_slider_9 = Slider(1.1, range=0..10)  # disabled
number_slider_10 = Slider(10, range=0..100)  # disabled
range_7 = Range(Domain=Domain(0, 1), Steps=number_slider_8)  # disabled
multiplication_4 = Multiplication(A=division_3, B=number_slider_9)  # disabled
parampipemsh = ParameterPipeMesh(
    Curve=graft(pline_9),
    Radius=multiplication_4,
    ParametersU=[0, 0.1, 0.2, 0.3, 0.4, 0.5, 0.6, 0.7, 0.8, 0.9, 1],
    ParametersV=range_7,
    Weighted=False,
    Lengths=False,
    Angle=number_slider_10,
    Rotation=0,
    EndType=0,
    Triangulate=False)  # disabled
wbcatmullclark = WeaverbirdsCatmullClarkSubdivision(MeshCurves=parampipemsh, Level=1, SmoothNakedEdges=1)  # -> reverse(flatten(OutputMeshCurves)); disabled
division_15 = Division(A=relay_2, B=relay_3)  # disabled
center_3 = Center(Geometry=wbcatmullclark)  # -> Center, Dimension; disabled
scale_nu = ScaleNU(Geometry=wbcatmullclark, Plane=center_3.Center, ScaleX=1, ScaleY=1, ScaleZ=division_15)  # -> Geometry, Transform; disabled
preview = CustomPreview(
    Geometry=wbcatmullclark,
    Material={diffuse=RGB(228, 178, 227), emission=RGB(68, 53, 68), shine=0.5, specular=RGB(255, 254, 255), transparency=0})  # disabled

lng_7 = ListLength(List=scale_nu.Geometry)  # disabled
series_2 = Series(Start=0, Step=1, Count=lng_7)  # disabled
gradient = Gradient(LowerLimit=0, UpperLimit=lng_7, Parameter=series_2, stops=[0.376: RGB(255, 255, 255), 1: RGB(255, 98, 98)])  # disabled
preview_2 = CustomPreview(Geometry=scale_nu.Geometry, Material=reverse(gradient))  # disabled

# ----
tstat_9 = TreeStatistics(Tree=pline_8)  # -> Paths, Length, Count

tstat_10 = TreeStatistics(Tree=filter_6)  # -> Paths, Length, Count
lastdex = LastIndex(List=tstat_10.Paths)

# ----
# Spiralize E-value
panel_10 = Panel("2")
merge_6 = Merge(Data1=panel_10, Data2=lastdex)  # -> flatten(Result)

subtraction_4 = Subtraction(A=merge_6, B="1")
item_13 = ListItem(List=tstat_9.Paths, Index=flatten(subtraction_4), Wrap=True)
branch_14 = TreeBranch(Tree=pline_8, Path=item_13, MaintainPaths=True)

item_14 = ListItem(List=tstat_10.Paths, Index=flatten(merge_6), Wrap=True)
branch_15 = TreeBranch(Tree=filter_6, Path=item_14, MaintainPaths=True)

crv_cp = CurveClosestPoint(Point=branch_15, Curve=branch_14)  # -> Point, Parameter, Distance
vec2pt_4 = Vector2Pt(PointA=branch_15, PointB=crv_cp.Point, Unitize=False)  # -> Vector, Length
devec_2 = DeconstructVector(Vector=vec2pt_4.Vector)  # -> XComponent, YComponent, ZComponent
vec_2 = VectorXYZ(XComponent=0, YComponent=0, ZComponent=devec_2.ZComponent)  # -> Vector, Length

cull_i_17 = CullIndex(List=tstat_10.Paths, Indices=merge_6, Wrap=True)
branch_16 = TreeBranch(Tree=filter_6, Path=cull_i_17, MaintainPaths=True)
lng_8 = ListLength(List=branch_16)
repeat_5 = RepeatData(Data=relay_2, Length=lng_8)
trim_3 = TrimTree(Tree=repeat_5, Depth=1)
merge_7 = Merge(Data1=vec_2.Length, Data2=trim_3)

# ---- group: first layer e-value
tstat_11 = TreeStatistics(Tree=merge_7)  # -> Paths, Length, Count
panel_11 = Panel("""0
1""")
item_15 = ListItem(List=tstat_11.Paths, Index=panel_11, Wrap=True)
cull_i_18 = CullIndex(List=tstat_11.Paths, Indices=panel_11, Wrap=True)
branch_17 = TreeBranch(Tree=merge_7, Path=item_15, MaintainPaths=True)
branch_18 = TreeBranch(Tree=merge_7, Path=cull_i_18, MaintainPaths=True)
lng_9 = ListLength(List=branch_17)
repeat_6 = RepeatData(Data=relay, Length=lng_9)
trim_4 = TrimTree(Tree=repeat_6, Depth=1)
merge_8 = Merge(Data1=trim_4, Data2=branch_18)

# ---- group: inspect
number_slider_11 = Slider(2, range=0..10)
tstat_12 = TreeStatistics(Tree=merge_8)  # -> Paths, Length, Count
neg_9 = Negative(Value=number_slider_11)
item_16 = ListItem(List=tstat_12.Paths, Index=number_slider_11, Wrap=True)
branch_19 = TreeBranch(Tree=merge_8, Path=item_16, MaintainPaths=True)
panel_12 = Panel(branch_19)

# ---- group: E-Values / Generate Extrusion Values
panel_13 = Panel(relay_2)
filter_7 = StreamFilter(Gate=relay_8, Stream0=panel_13, Stream1=merge_8)
panel_14 = Panel(relay_3)
panel_15 = Panel(relay_4)
constant_factor_ginger = Panel("0.2")
height = Multiplication(ConstantFactor=Slider(1, range=0..1), LayerHeight=filter_7, LayerWidth=panel_14, TravelMoveBoolean=unflatten_3)  # -> simplify(Result)

# ----
stream_freeze_gate_16 = StreamFreezeGate(Data=height, PassingSwitch=calculate_path, Freeze=True, Hold=True)
data_7 = Data(height)

data_8 = Data(flatten(merge_5))
lastdex_2 = LastIndex(List=flatten(data_8))
item_17 = ListItem(List=flatten(data_8), Index=lastdex_2, Wrap=True)
Z_6 = UnitZ(Factor=Slider(200, range=0..200))

xy_3 = XYPlane(Origin=item_17)
f_values = Data(flatten(data_6))
e_values = Data(flatten(data_7))

move_8 = Move(Geometry=xy_3, Motion=Z_6)  # -> Geometry, Transform
replace_4 = ReplaceItems(List=data_8, Item=move_8.Geometry, Indices=lastdex_2, Wrap=False)
unflatten_4 = UnflattenTree(Tree=replace_4, Guide=merge_5)

stream_freeze_gate_17 = StreamFreezeGate(Data=unflatten_4, PassingSwitch=calculate_path, Freeze=True, Hold=True)
data_9 = Data(unflatten_4)
f_values_2 = ClusterOutput(f_values)
planes = Data(data_9)
planes_2 = ClusterOutput(planes)
e_values_2 = ClusterOutput(e_values)

# ==== cluster SaveCluster: Save Cluster
file_name = ClusterInput()
write = ClusterInput()
lines = ClusterInput()

py3 = Python3Script()  # -> out, timestamp
# ---------- py3: Python ----------
"""
Timestamp Komponente mit automatischer Aktualisierung
Outputs:
    timestamp: String
"""

import datetime
import Grasshopper

# Aktuelle Zeit
now = datetime.datetime.now()

# Timestamp Format
timestamp = now.strftime("%y%m%d%H%M_")

# Automatische Neuberechnung
ghdoc = ghenv.Component.OnPingDocument()
ghdoc.ScheduleSolution(1000, lambda doc: ghenv.Component.ExpireSolution(False))
# ---------- end py3 ----------
join = TextJoin(Text="/DXR_")
join_2 = TextJoin(Text=flatten([join, py3.timestamp, file_name]))  # -> flatten(Result)
desired_file_extension = Panel(".dxr")
desktop_filepath = DesktopFilepath()
py3_2 = Python3Script(Folder=desktop_filepath, name=join_2, ext=desired_file_extension, lines=lines, write=write)  # inputs Folder: String, name: String, ext: String, lines: list of String, write: Boolean
# ---------- py3_2: Python ----------
__author__ = "Moritz Wesseler"
__version__ = "2024.10.23"


import os

file =Folder + name + ext


if write:
    filePath = open(file, "w") # Open the file
    for line in lines: # Iterate through lines
        filePath.write(line + "\n") # Write separate lines
    filePath.close() # Close the file
__author__ = "Moritz Wesseler"
__version__ = "2024.10.23"

import os

# Angenommen, Folder, name, ext und lines kommen von deinen Grasshopper-Inputs
file_path = os.path.join(Folder, name + ext)

if write:
    # Datei mit Kontextmanager öffnen – schließt automatisch
    # encoding angeben, um Unicode-Probleme zu vermeiden
    with open(file_path, "w", encoding="utf-8") as f:
        for line in lines:
            # f-String für saubere Zeilenumbrüche
            f.write(f"{line}\n")
# ---------- end py3_2 ----------

# ==== cluster Cluster
index = ClusterInput()

preview_toggle = ClusterInput()
programm = ClusterInput()
programm_2 = Data(programm)
stream_filter = StreamFilter(PreviewToggle=preview_toggle, Stream1=programm_2)
deconstruct_program_targets = DeconstructProgramTargets(Program=stream_filter)  # -> Planes, Joints, Configuration, DeltaTime

list_item = ListItem(List=deconstruct_program_targets.Planes, Index=Slider(7, range=0..10), Wrap=True)  # -> flatten(Item)
split_list = SplitList(List=list_item, Index=index)  # -> ListA, ListB
interpolate = Interpolate(Vertices=flatten(split_list.ListA), Degree=3, Periodic=False, KnotStyle=1)  # -> Curve, Length, Domain

pline = PolyLine(Vertices=split_list.ListA, Closed=False)

custom_preview_lineweights = CustomPreviewLineweights(Geometry=pline, Shader=ColourSwatch(SwatchColor=RGB(255, 162, 0)), Thickness=Slider(2, range=0.1..100), Absolute=False)

# ==== cluster Cluster_2
brep = ClusterInput()

# ---- group: Create Surface from Polysurface or Open Brep
unit_z = UnitZ(Factor=1)
contour = Contour(Shape=brep, Point=Point(0, 0, 0), Direction=unit_z, Distance=Slider(3, range=0..10))  # -> flatten(Contours)
fillet = Fillet(Curve=contour, Radius=Slider(0.2, range=0..1))
loft = Loft(Curves=flatten(fillet), Options={Adjust=False, Closed=False, LoftEnds=0, LoftSimp=0, LoftType=0, Rebuild=10, Refit=0.01})
surface_output = ClusterOutput(loft)

# ==== cluster DesktopFilepath: # Grasshopper Python Component: # This script finds the current user's Desktop folder path cross-platform # and outputs it as the variable 'desktopPath'.
desktop_filepath = Python3Script()  # -> desktopPath
# ---------- desktop_filepath: Python ----------
import os
from pathlib import Path

# Grasshopper Python Component:
# This script finds the current user's Desktop folder path cross-platform
# and outputs it as the variable 'desktopPath'.

# Function to detect Desktop folder
def get_desktop_path():
    # Get home directory
    home = Path.home()
    # Common desktop folder names in various languages
    candidates = ["Desktop", "Schreibtisch", "Escritorio", "Bureau"]
    for name in candidates:
        desk = home / name
        if desk.exists() and desk.is_dir():
            return str(desk)
    # Fallback: return home directory
    return str(home)

# Output variable for Grasshopper
desktopPath = get_desktop_path()

# Print or output desktopPath to Grasshopper
print(f"Desktop path detected: {desktopPath}")
# ---------- end desktop_filepath ----------
desktoppath = ClusterOutput(desktop_filepath)
