# Grasshopper definition Schalungen Skript.gh (Grasshopper 1.0.8)

# ---- group: Maße
brettsträkre = Slider(10, range=0..100)
export_auf_desktop = Button()
höhe = Slider(100, range=0..1000)
länge = Slider(900, range=0..1000)
# Maße Eingeben
breite = Slider(200, range=0..1000)

# ---- group: Grundrechteck
rectangle = Rectangle(Plane=PlaneXY(0, 0, 0), XSize=breite, YSize=länge, Radius=0)  # -> Rectangle, Length

# ----
python_3_script = Python3Script(laenge=breite, breite=länge, hoehe=höhe, staerke=brettsträkre, export_starten=export_auf_desktop)  # -> out, bretter_3d, bretter_flat, stueckliste, pdf_datei, protokoll, mass_kurven, mass_texte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; inputs laenge: Double, breite: Double, hoehe: Double, staerke: Double, abstand: Double, exportordner: String, dateiname: String, export_starten: Boolean
# ---------- python_3_script: Python ----------
"""
GHPython: 5-Bretter Flat-Layout + PDF-Export + Stueckliste

INPUTS:
    laenge          : float  (Innenmass X)
    breite          : float  (Innenmass Y)
    hoehe           : float  (Innenmass Z)
    staerke         : float  (Materialdicke)
    abstand         : float  (Abstand zwischen flach ausgelegten Brettern, default 20)
    exportordner    : str    (optional; default Desktop)
    dateiname       : str    (optional; default PSYYYYMMDD_HHMMSS)
    export_starten  : bool   (default False)

OUTPUTS:
    bretter_3d      : Brep [List]   (zusammengebaut, oben offen, 5 Teile)
    bretter_flat    : Brep [List]   (flach in XY ausgelegt, ohne Ueberlappung)
    mass_kurven     : Curve [List]  (einfache Bemaßungslinien fuer Rhino)
    mass_texte      : TextDot [List] (Maßtexte je Brett)
    stueckliste     : Text [List]
    pdf_datei       : str
    stueckliste_pdf : str
    protokoll       : Text [List]
    parameter_namen : Text [List]
    parameter_werte : Generic [List]
"""

import os
import datetime
import System
import Rhino
import Rhino.Geometry as rg


# GH input fallbacks
laenge = globals().get("laenge", None)
breite = globals().get("breite", None)
hoehe = globals().get("hoehe", None)
staerke = globals().get("staerke", None)
abstand = globals().get("abstand", None)
exportordner = globals().get("exportordner", None)
dateiname = globals().get("dateiname", None)
export_starten = globals().get("export_starten", None)

bretter_3d = []
bretter_flat = []
mass_kurven = []
mass_texte = []
stueckliste = []
pdf_datei = ""
stueckliste_pdf = ""
protokoll = []
parameter_namen = []
parameter_werte = []


def to_bool(value, default=False):
    if value is None:
        return default
    if isinstance(value, bool):
        return value
    if isinstance(value, (int, float)):
        return value != 0
    s = str(value).strip().lower()
    if s in ("1", "true", "yes", "y", "on", "ja"):
        return True
    if s in ("0", "false", "no", "n", "off", "nein"):
        return False
    return default


def collapse_whitespace(text):
    if text is None:
        return ""
    return " ".join(str(text).split())


def sanitize_token(value, fallback=""):
    raw = fallback if value is None or str(value).strip() == "" else str(value).strip()
    invalid = set(System.IO.Path.GetInvalidFileNameChars())
    chars = []
    for c in raw:
        chars.append("_" if c in invalid else c)
    return collapse_whitespace("".join(chars).strip())


def resolve_export_folder(user_folder):
    if user_folder is not None and str(user_folder).strip() != "":
        return os.path.abspath(str(user_folder)), False

    desktop = System.Environment.GetFolderPath(System.Environment.SpecialFolder.Desktop)
    return os.path.abspath(str(desktop)), True


def build_base_name(custom_name):
    if custom_name is not None and str(custom_name).strip() != "":
        return sanitize_token(custom_name, "PanelLayout")
    return "MSA" + datetime.datetime.now().strftime("%Y%m%d_%H%M%S")


def create_export_run_folder(base_folder, base_name):
    run_folder = os.path.join(base_folder, sanitize_token(base_name, "Export"))
    if not os.path.exists(run_folder):
        os.makedirs(run_folder)
        return run_folder

    i = 1
    while True:
        candidate = os.path.join(base_folder, "{}_{}".format(sanitize_token(base_name, "Export"), str(i).zfill(2)))
        if not os.path.exists(candidate):
            os.makedirs(candidate)
            return candidate
        i += 1


def make_box(x0, y0, z0, x1, y1, z1):
    plane = rg.Plane.WorldXY
    box = rg.Box(
        plane,
        rg.Interval(min(x0, x1), max(x0, x1)),
        rg.Interval(min(y0, y1), max(y0, y1)),
        rg.Interval(min(z0, z1), max(z0, z1)),
    )
    b = box.ToBrep()
    return b if b and b.IsValid else None


def add_rhino_dimensions(panel, dim_curves, dim_texts, dim_offset):
    x0 = panel["x"]
    y0 = panel["y"]
    x1 = panel["x"] + panel["l"]
    y1 = panel["y"] + panel["b"]

    # X-Maß unterhalb
    y_dim = y0 - dim_offset
    dim_curves.append(rg.LineCurve(rg.Point3d(x0, y0, 0), rg.Point3d(x0, y_dim, 0)))
    dim_curves.append(rg.LineCurve(rg.Point3d(x1, y0, 0), rg.Point3d(x1, y_dim, 0)))
    dim_curves.append(rg.LineCurve(rg.Point3d(x0, y_dim, 0), rg.Point3d(x1, y_dim, 0)))
    dim_texts.append(rg.TextDot("L={:.1f} mm".format(panel["l"]), rg.Point3d((x0 + x1) * 0.5, y_dim - 0.25 * dim_offset, 0)))

    # Y-Maß links
    x_dim = x0 - dim_offset
    dim_curves.append(rg.LineCurve(rg.Point3d(x0, y0, 0), rg.Point3d(x_dim, y0, 0)))
    dim_curves.append(rg.LineCurve(rg.Point3d(x0, y1, 0), rg.Point3d(x_dim, y1, 0)))
    dim_curves.append(rg.LineCurve(rg.Point3d(x_dim, y0, 0), rg.Point3d(x_dim, y1, 0)))
    dim_texts.append(rg.TextDot("B={:.1f} mm".format(panel["b"]), rg.Point3d(x_dim - 0.6 * dim_offset, (y0 + y1) * 0.5, 0)))


def _pdf_safe_line(text):
    s = str(text)
    s = (s
         .replace("ä", "ae").replace("ö", "oe").replace("ü", "ue")
         .replace("Ä", "Ae").replace("Ö", "Oe").replace("Ü", "Ue")
         .replace("ß", "ss"))
    s = s.replace("\\", "\\\\").replace("(", "\\(").replace(")", "\\)")
    return s.encode("cp1252", "replace").decode("cp1252")


def write_text_lines_pdf(path, title, lines_in):
    page_w = 595
    page_h = 842
    left = 40
    top = page_h - 42
    line_h = 13

    lines = []
    lines.append("BT /F2 12 Tf 1 0 0 1 {} {} Tm ({}) Tj ET".format(left, top, _pdf_safe_line(title)))
    lines.append("BT /F1 8 Tf 1 0 0 1 {} {} Tm ({}) Tj ET".format(
        left,
        top - 16,
        _pdf_safe_line(datetime.datetime.now().strftime("%Y-%m-%d %H:%M:%S")),
    ))
    lines.append("0.6 w {} {} m {} {} l S 1 w".format(left, top - 21, page_w - left, top - 21))

    y = top - 40
    for t in lines_in:
        if y < 36:
            break
        lines.append("BT /F1 8 Tf 1 0 0 1 {} {} Tm ({}) Tj ET".format(left, y, _pdf_safe_line(t)))
        y -= line_h

    obj = {}
    next_id = 1
    cat = next_id; next_id += 1
    pages = next_id; next_id += 1
    f1 = next_id; next_id += 1
    f2 = next_id; next_id += 1
    page = next_id; next_id += 1
    content = next_id; next_id += 1

    obj[f1] = "<< /Type /Font /Subtype /Type1 /BaseFont /Helvetica >>"
    obj[f2] = "<< /Type /Font /Subtype /Type1 /BaseFont /Helvetica-Bold >>"

    stream = "\n".join(lines)
    obj[content] = "<< /Length {} >>\nstream\n{}\nendstream".format(len(stream.encode("cp1252", "replace")), stream)
    obj[page] = (
        "<< /Type /Page /Parent {} 0 R /MediaBox [0 0 {} {}] "
        "/Resources << /Font << /F1 {} 0 R /F2 {} 0 R >> >> /Contents {} 0 R >>"
    ).format(pages, page_w, page_h, f1, f2, content)
    obj[pages] = "<< /Type /Pages /Kids [ {} 0 R ] /Count 1 >>".format(page)
    obj[cat] = "<< /Type /Catalog /Pages {} 0 R >>".format(pages)

    out = ["%PDF-1.4\n"]
    offsets = [0]
    for oid in range(1, next_id):
        offsets.append(sum(len(p.encode("cp1252", "replace")) for p in out))
        out.append("{} 0 obj\n{}\nendobj\n".format(oid, obj.get(oid, "<< >>")))

    xref_pos = sum(len(p.encode("cp1252", "replace")) for p in out)
    out.append("xref\n")
    out.append("0 {}\n".format(next_id))
    out.append("0000000000 65535 f \n")
    for oid in range(1, next_id):
        out.append("{:010d} 00000 n \n".format(offsets[oid]))

    out.append("trailer\n")
    out.append("<< /Size {} /Root {} 0 R >>\n".format(next_id, cat))
    out.append("startxref\n")
    out.append("{}\n".format(xref_pos))
    out.append("%%EOF\n")

    with open(path, "wb") as f:
        for part in out:
            f.write(part.encode("cp1252", "replace"))

    return path


def write_layout_pdf(path, title, flat_panels):
    """
    Zeichnet das Flat-Layout als 2D-Rechtecke inkl. X/Y-Bemassung pro Brett.
    flat_panels: List[dict] mit keys {name, x, y, l, b}
    """
    page_w = 842
    page_h = 595
    left = 28
    right = page_w - 28
    top = page_h - 30
    bottom = 36

    # Bounding Box des Layouts
    min_x = min(p["x"] for p in flat_panels)
    min_y = min(p["y"] for p in flat_panels)
    max_x = max(p["x"] + p["l"] for p in flat_panels)
    max_y = max(p["y"] + p["b"] for p in flat_panels)

    lw = max(1.0, max_x - min_x)
    lh = max(1.0, max_y - min_y)

    avail_w = max(10.0, right - left)
    avail_h = max(10.0, top - bottom - 40)
    scale = min(avail_w / lw, avail_h / lh) * 0.88

    ox = left + (avail_w - lw * scale) * 0.5 - min_x * scale
    oy = bottom + 18 + (avail_h - lh * scale) * 0.5 - min_y * scale

    def tx(xv):
        return ox + xv * scale

    def ty(yv):
        return oy + yv * scale

    lines = []

    # Kopf
    lines.append("BT /F2 12 Tf 1 0 0 1 {} {} Tm ({}) Tj ET".format(left, page_h - 22, _pdf_safe_line(title)))
    lines.append("BT /F1 8 Tf 1 0 0 1 {} {} Tm ({}) Tj ET".format(
        left,
        page_h - 35,
        _pdf_safe_line(datetime.datetime.now().strftime("%Y-%m-%d %H:%M:%S")),
    ))
    lines.append("0.6 w {} {} m {} {} l S 1 w".format(left, page_h - 40, right, page_h - 40))

    # Zeichnung + Bemaßung pro Panel
    for p in flat_panels:
        x0 = tx(p["x"])
        y0 = ty(p["y"])
        x1 = tx(p["x"] + p["l"])
        y1 = ty(p["y"] + p["b"])

        # Rechteck
        lines.append("0.6 w")
        lines.append("{:.2f} {:.2f} m {:.2f} {:.2f} l {:.2f} {:.2f} l {:.2f} {:.2f} l h S".format(x0, y0, x1, y0, x1, y1, x0, y1))

        # Name innen
        lines.append("BT /F1 7 Tf 1 0 0 1 {:.2f} {:.2f} Tm ({}) Tj ET".format(
            x0 + 4,
            y1 - 12,
            _pdf_safe_line(p["name"]),
        ))

        # X-Bemaßung unterhalb
        dim_off = max(18.0, p.get("dim_offset", 20.0))
        y_dim = y0 - dim_off
        lines.append("0.35 w")
        lines.append("{:.2f} {:.2f} m {:.2f} {:.2f} l S".format(x0, y0, x0, y_dim))
        lines.append("{:.2f} {:.2f} m {:.2f} {:.2f} l S".format(x1, y0, x1, y_dim))
        lines.append("{:.2f} {:.2f} m {:.2f} {:.2f} l S".format(x0, y_dim, x1, y_dim))
        lines.append("BT /F1 6.5 Tf 1 0 0 1 {:.2f} {:.2f} Tm ({}) Tj ET".format(
            (x0 + x1) * 0.5 - 16,
            y_dim - 12,
            _pdf_safe_line("{:.1f} mm".format(p["l"])),
        ))

        # Y-Bemaßung links
        x_dim = x0 - dim_off
        lines.append("{:.2f} {:.2f} m {:.2f} {:.2f} l S".format(x0, y0, x_dim, y0))
        lines.append("{:.2f} {:.2f} m {:.2f} {:.2f} l S".format(x0, y1, x_dim, y1))
        lines.append("{:.2f} {:.2f} m {:.2f} {:.2f} l S".format(x_dim, y0, x_dim, y1))
        lines.append("BT /F1 6.5 Tf 1 0 0 1 {:.2f} {:.2f} Tm ({}) Tj ET".format(
            x_dim - 30,
            (y0 + y1) * 0.5 - 3,
            _pdf_safe_line("{:.1f}".format(p["b"])),
        ))

    # Footer
    footer = "(c) MSA Münster School of Architecture"
    lines.append("0.4 w {} {} m {} {} l S 1 w".format(left, bottom - 8, right, bottom - 8))
    lines.append("BT /F1 7 Tf 1 0 0 1 {} {} Tm ({}) Tj ET".format(left, bottom - 20, _pdf_safe_line(footer)))

    # PDF Objekte
    obj = {}
    next_id = 1
    cat = next_id; next_id += 1
    pages = next_id; next_id += 1
    f1 = next_id; next_id += 1
    f2 = next_id; next_id += 1
    page = next_id; next_id += 1
    content = next_id; next_id += 1

    obj[f1] = "<< /Type /Font /Subtype /Type1 /BaseFont /Helvetica >>"
    obj[f2] = "<< /Type /Font /Subtype /Type1 /BaseFont /Helvetica-Bold >>"

    stream = "\n".join(lines)
    obj[content] = "<< /Length {} >>\nstream\n{}\nendstream".format(len(stream.encode("cp1252", "replace")), stream)
    obj[page] = (
        "<< /Type /Page /Parent {} 0 R /MediaBox [0 0 {} {}] "
        "/Resources << /Font << /F1 {} 0 R /F2 {} 0 R >> >> /Contents {} 0 R >>"
    ).format(pages, page_w, page_h, f1, f2, content)
    obj[pages] = "<< /Type /Pages /Kids [ {} 0 R ] /Count 1 >>".format(page)
    obj[cat] = "<< /Type /Catalog /Pages {} 0 R >>".format(pages)

    out = ["%PDF-1.4\n"]
    offsets = [0]

    for oid in range(1, next_id):
        offsets.append(sum(len(p.encode("cp1252", "replace")) for p in out))
        out.append("{} 0 obj\n{}\nendobj\n".format(oid, obj.get(oid, "<< >>")))

    xref_pos = sum(len(p.encode("cp1252", "replace")) for p in out)
    out.append("xref\n")
    out.append("0 {}\n".format(next_id))
    out.append("0000000000 65535 f \n")
    for oid in range(1, next_id):
        out.append("{:010d} 00000 n \n".format(offsets[oid]))

    out.append("trailer\n")
    out.append("<< /Size {} /Root {} 0 R >>\n".format(next_id, cat))
    out.append("startxref\n")
    out.append("{}\n".format(xref_pos))
    out.append("%%EOF\n")

    with open(path, "wb") as f:
        for part in out:
            f.write(part.encode("cp1252", "replace"))

    return path


try:
    L_in = float(laenge) if laenge is not None else 1000.0
    B_in = float(breite) if breite is not None else 600.0
    H_in = float(hoehe) if hoehe is not None else 400.0
    T = float(staerke) if staerke is not None else 19.0
    GAP = float(abstand) if abstand is not None else 20.0

    run_export = to_bool(export_starten, False)

    # Grundvalidierung
    if L_in <= 0 or B_in <= 0 or H_in <= 0 or T <= 0:
        raise Exception("laenge, breite, hoehe und staerke muessen > 0 sein.")
    if GAP < 0:
        raise Exception("abstand darf nicht negativ sein.")

    parameter_namen = [
        "layout.innen_laenge",
        "layout.innen_breite",
        "layout.innen_hoehe",
        "layout.staerke",
        "layout.abstand",
        "layout.teile",
    ]
    parameter_werte = [L_in, B_in, H_in, T, GAP, 5]

    # Innenmaße als Eingabe.
    # Oben offene Schalung (kein Deckel), aber vorne und hinten geschlossen.
    # Regel: Das parallele Paar Seite links/rechts ist vorne+hinten jeweils um T laenger.
    # 5 Teile: Boden, Seite links/rechts, Frontwand, Rueckwand
    parts = [
        {"name": "Boden",        "l": L_in + 2.0 * T, "b": B_in + 2.0 * T, "t": T},
        {"name": "Seite links",  "l": L_in + 2.0 * T, "b": H_in, "t": T},
        {"name": "Seite rechts", "l": L_in + 2.0 * T, "b": H_in, "t": T},
        {"name": "Frontwand",    "l": B_in, "b": H_in, "t": T},
        {"name": "Rueckwand",    "l": B_in, "b": H_in, "t": T},
    ]

    # Zusammengebautes 3D-Modell auf Basis Innenraum:
    # Innenraum: x=0..L_in, y=0..B_in, z=0..H_in (oben offen)
    # Boden ausserhalb unten,
    # Seiten links/rechts als "langes" paralleles Paar mit +T vorne+hinten,
    # Front/Rueckwand als "kurzes" Paar zwischen den Seiten.
    b_boden = make_box(-T, -T, -T, L_in + T, B_in + T, 0)
    b_sl = make_box(-T, -T, 0, L_in + T, 0, H_in)
    b_sr = make_box(-T, B_in, 0, L_in + T, B_in + T, H_in)
    b_fw = make_box(-T, 0, 0, 0, B_in, H_in)
    b_rw = make_box(L_in, 0, 0, L_in + T, B_in, H_in)
    bretter_3d = [b for b in [b_boden, b_sl, b_sr, b_fw, b_rw] if b is not None]

    # Flat-Layout in XY: kompakte Mehrreihen-Anordnung mit Sicherheitsrand,
    # damit Bemaßungen nicht in andere Bretter laufen.
    flat_panels = []
    dim_offset = max(22.0, GAP * 1.15)
    top_clearance = 26.0
    right_clearance = 28.0

    part_items = []
    for p in parts:
        pl = p["l"]
        pb = p["b"]
        cell_w = pl + dim_offset + right_clearance
        cell_h = pb + dim_offset + top_clearance
        part_items.append({
            "name": p["name"],
            "l": pl,
            "b": pb,
            "t": p["t"],
            "cell_w": cell_w,
            "cell_h": cell_h,
            "sort_key": (max(pl, pb), pl * pb),
        })

    # Groessere Teile zuerst fuer kompaktere, stabilere Anordnung
    part_items.sort(key=lambda it: (it["sort_key"][0], it["sort_key"][1]), reverse=True)

    total_cell_area = sum(it["cell_w"] * it["cell_h"] for it in part_items)
    widest_cell = max(it["cell_w"] for it in part_items)
    target_row_w = max(widest_cell, (total_cell_area ** 0.5) * 1.25)

    x_cursor = 0.0
    y_cursor = 0.0
    row_h = 0.0

    for it in part_items:
        cw = it["cell_w"]
        ch = it["cell_h"]

        if x_cursor > 0.0 and (x_cursor + cw) > target_row_w:
            x_cursor = 0.0
            y_cursor += row_h + GAP
            row_h = 0.0

        px = x_cursor + dim_offset
        py = y_cursor + dim_offset

        panel = {
            "name": it["name"],
            "x": px,
            "y": py,
            "l": it["l"],
            "b": it["b"],
            "t": it["t"],
            "dim_offset": dim_offset,
        }
        flat_panels.append(panel)

        # Flaches Brett als Brep (Dicke in Z)
        bf = make_box(px, py, 0, px + it["l"], py + it["b"], it["t"])
        if bf is not None:
            bretter_flat.append(bf)
            add_rhino_dimensions(panel, mass_kurven, mass_texte, dim_offset)

        x_cursor += cw + GAP
        row_h = max(row_h, ch)

    # Stueckliste gruppieren
    grouped = {}
    for p in parts:
        key = (round(p["t"], 3), round(p["l"], 3), round(p["b"], 3), round(p["t"], 3))
        grouped[key] = grouped.get(key, 0) + 1

    stueckliste.append("=" * 58)
    stueckliste.append("STUECKLISTE")
    stueckliste.append("=" * 58)
    stueckliste.append("{:<5} {:>8} {:>10} {:>10} {:>10}".format("Anz", "Dicke", "Laenge", "Breite", "Hoehe"))
    stueckliste.append("-" * 58)
    total = 0
    for (d, l, b, h), cnt in sorted(grouped.items(), key=lambda kv: (kv[0][1], kv[0][2], kv[0][0])):
        stueckliste.append("{:<5} {:>8.1f} {:>10.1f} {:>10.1f} {:>10.1f}".format(cnt, d, l, b, h))
        total += cnt
    stueckliste.append("-" * 58)
    stueckliste.append("Gesamt: {} Bretter".format(total))
    stueckliste.append("Ausfuehrung: oben offen (kein Deckel), vorne+hinten geschlossen")
    protokoll.append("Innenmasse verwendet: L={:.1f}, B={:.1f}, H={:.1f} mm".format(L_in, B_in, H_in))
    protokoll.append("Flat-Layout kompakt ohne Ueberlappung, Abstand={:.1f} mm".format(GAP))
    protokoll.append("Rhino-Bemassung erzeugt: {} Linien, {} Textpunkte".format(len(mass_kurven), len(mass_texte)))

    if not run_export:
        protokoll.append("Export bereit. Setze export_starten=True fuer PDF auf Desktop/Exportordner.")
    else:
        base_folder, used_fallback = resolve_export_folder(exportordner)
        if not os.path.isdir(base_folder):
            os.makedirs(base_folder)

        base_name = build_base_name(dateiname)
        run_folder = create_export_run_folder(base_folder, base_name)

        if used_fallback:
            protokoll.append("Exportordner nicht gesetzt: Desktop verwendet.")

        pdf_path = os.path.join(run_folder, base_name + "_FlatLayout.pdf")
        write_layout_pdf(pdf_path, base_name + " - Flat Layout", flat_panels)
        pdf_datei = pdf_path
        protokoll.append("PDF geschrieben: " + pdf_path)

        sl_pdf_path = os.path.join(run_folder, base_name + "_Stueckliste.pdf")
        write_text_lines_pdf(sl_pdf_path, base_name + " - Stueckliste", stueckliste)
        stueckliste_pdf = sl_pdf_path
        protokoll.append("Stuecklisten-PDF geschrieben: " + sl_pdf_path)

except Exception as e:
    import traceback
    protokoll.append("FEHLER: " + str(e))
    protokoll.append(traceback.format_exc())
# ---------- end python_3_script ----------
vector_xyz = VectorXYZ(XComponent=0, YComponent=Slider(1000, range=0..1000), ZComponent=0)  # -> Vector, Length
move = Move(
    Geometry=[python_3_script.bretter_flat, python_3_script.mass_kurven, python_3_script.mass_texte],
    Motion=vector_xyz.Vector)  # -> Geometry, Transform
geometry = Geometry(python_3_script.bretter_3d)

# ---- group: Kurven Sprengen
deconstruct_brep = DeconstructBrep(Brep=rectangle.Rectangle)  # -> Faces, Edges, Vertices

# ---- group: Bodenplatte
offset_curve = OffsetCurve(Curve=rectangle.Rectangle, Distance=brettsträkre, Corners=1)
unit_z = UnitZ(Factor=brettsträkre)
boundary_surfaces = BoundarySurfaces(Edges=offset_curve)
negative = Negative(Value=unit_z)
extrude = Extrude(Base=boundary_surfaces, Direction=negative)

# ---- group: Kurven auswählen
number_slider = Slider(0, range=0..10)
number_slider_2 = Slider(2, range=0..10)
addition = Addition(A=number_slider, B=1)
addition_2 = Addition(A=number_slider_2, B=1)
list_item = ListItem(List=flatten(deconstruct_brep.Edges), Index=[number_slider_2, number_slider], Wrap=True)
list_item_2 = ListItem(List=flatten(deconstruct_brep.Edges), Index=[addition_2, addition], Wrap=True)

# ----
panel = Panel(python_3_script.stueckliste)

# ---- group: Kurven Verlängern
extend_curve = ExtendCurve(Curve=list_item, Type=0, Start=brettsträkre, End=brettsträkre)
join_curves = JoinCurves(Curves=extend_curve, Preserve=False)

# ---- group: Kurven Offset
offset_curve_2 = OffsetCurve(Curve=flatten([join_curves, list_item_2]), Distance=brettsträkre, Corners=0)  # -> flatten(Curve)
curve = Curve(flatten([join_curves, list_item_2]))

# ---- group: Liste Sortieren
weave = Weave(Pattern=[0, 1], Stream0=curve, Stream1=offset_curve_2, NullGaps=False)
partition_list = PartitionList(List=weave, Size=Slider(2, range=0..10))

# ---- group: Bretter Erstellen Seiten
unit_z_2 = UnitZ(Factor=höhe)
loft = Loft(Curves=partition_list, Options={Adjust=False, Closed=False, LoftEnds=0, LoftSimp=0, LoftType=0, Rebuild=10, Refit=0.01})
extrude_2 = Extrude(Base=loft, Direction=unit_z_2)

# ----
trim_tree = TrimTree(Tree=extrude_2, Depth=1)

list_item_3 = ListItem(List=trim_tree, Index=Slider(3, range=0..10), Wrap=True)

list_item_4 = ListItem(List=trim_tree, Index=Slider(1, range=0..10), Wrap=True)

deconstruct_brep_2 = DeconstructBrep(Brep=list_item_4)  # -> Faces, Edges, Vertices
list_item_5 = ListItem(List=deconstruct_brep_2.Edges, Index=Slider(7, range=0..10), Wrap=True)
list_item_6 = ListItem(List=deconstruct_brep_2.Edges, Index=Slider(6, range=0..10), Wrap=True)
length = Length(Curve=list_item_6)
end_points = EndPoints(Curve=list_item_5)  # -> Start, End
construct_point = ConstructPoint(XCoordinate=0, YCoordinate=0, ZCoordinate=0)
unit_z_3 = UnitZ(Factor=length)
textgröße = Slider(14, range=0..100)
number_slider_3 = Slider(62, range=0..100)
move_2 = Move(Geometry=construct_point, Motion=unit_z_3)  # -> Geometry, Transform
end_points_2 = EndPoints(Curve=list_item_6)  # -> Start, End
negative_2 = Negative(Value=number_slider_3)
xz_plane = XZPlane(Origin=Point(0, 0, 0))
xy_plane = XYPlane(Origin=move_2.Geometry)
aligned_dimension = AlignedDimension(Plane=xy_plane, PointA=end_points.Start, PointB=end_points.End, Offset=number_slider_3, Text="{0:0.00}", Size=textgröße)
aligned_dimension_2 = AlignedDimension(Plane=xz_plane, PointA=end_points_2.Start, PointB=end_points_2.End, Offset=negative_2, Text="{0:0.00}", Size=textgröße)

deconstruct_brep_3 = DeconstructBrep(Brep=extrude)  # -> Faces, Edges, Vertices
list_item_7 = ListItem(List=deconstruct_brep_3.Edges, Index=0, Wrap=True)
list_item_8 = ListItem(List=deconstruct_brep_3.Edges, Index=Slider(1, range=0..1), Wrap=True)
textgröße_2 = Slider(14, range=0..100)
end_points_3 = EndPoints(Curve=[list_item_7, list_item_8])  # -> Start, End
negative_3 = Negative(Value=Slider(62, range=0..100))
aligned_dimension_3 = AlignedDimension(
    Plane=PlaneXY(0, 0, 0),
    PointA=end_points_3.Start,
    PointB=end_points_3.End,
    Offset=negative_3,
    Text="{0:0.00}",
    Size=textgröße_2)

yz_plane = YZPlane(Origin=Point(0, 0, 0))

deconstruct_brep_4 = DeconstructBrep(Brep=list_item_3)  # -> Faces, Edges, Vertices
list_item_9 = ListItem(List=deconstruct_brep_4.Edges, Index=Slider(7, range=0..10), Wrap=True)
list_item_10 = ListItem(List=deconstruct_brep_4.Edges, Index=Slider(6, range=0..10), Wrap=True)
length_2 = Length(Curve=list_item_10)
end_points_4 = EndPoints(Curve=list_item_9)  # -> Start, End
construct_point_2 = ConstructPoint(XCoordinate=0, YCoordinate=0, ZCoordinate=0)
unit_z_4 = UnitZ(Factor=length_2)
textgröße_3 = Slider(14, range=0..100)
number_slider_4 = Slider(62, range=0..100)
move_3 = Move(Geometry=construct_point_2, Motion=unit_z_4)  # -> Geometry, Transform
end_points_5 = EndPoints(Curve=list_item_10)  # -> Start, End
xy_plane_2 = XYPlane(Origin=move_3.Geometry)
aligned_dimension_4 = AlignedDimension(
    Plane=xy_plane_2,
    PointA=end_points_4.Start,
    PointB=end_points_4.End,
    Offset=number_slider_4,
    Text="{0:0.00}",
    Size=textgröße_3)
aligned_dimension_5 = AlignedDimension(
    Plane=yz_plane,
    PointA=end_points_5.Start,
    PointB=end_points_5.End,
    Offset=number_slider_4,
    Text="{0:0.00}",
    Size=textgröße_3)
