# Grasshopper definition LARGERslicer - Easy Spirals.gh (Grasshopper 1.0.8)
# plug-ins: Heteroptera, Pufferfish, Human, Weaverbird

# ----
# Geometry
geo = Geometry(<extrusion referenced from the Rhino model>)

# ----
# Parameter
resolution = Slider(1, range=0..10)
layer_height = Slider(5, range=0..10)
layer_width = Slider(10, range=0..15)
print_speed_mm_s = Slider(5, range=0..100)
skirt_distance = Slider(30, range=0..100)
skirt_length = Slider(200, range=0..1000)

# ---- group: contour
geometry = Geometry(geo)
contour = Contour(Shape=geometry, Point=Point(0, 0, 0), Direction=Vector(0, 0, 1), Distance=layer_height)  # -> flatten(Contours)
group = Group(Geometry=contour)

# ---- group: position object on build plate
# position on build plate
# (single object)
center = Center(Geometry=group, forall=True)  # -> Center, Dimension
ginger_build_volume = Panel("1000")
project = Project(Geometry=center.Center, Plane=PlaneXY(0, 0, 0))  # -> Geometry, Transform
md_slider = MDSlider(
    SliderMode=0,
    slider_value=Point(0.2544480415, 0.4976387024, 0.5),
    x_domain=Domain(0, 1),
    y_domain=Domain(0, 1),
    z_domain=Domain(0, 1))
Z = UnitZ(Factor=ginger_build_volume)
rectangle = Rectangle(Plane=PlaneXY(0, 0, 0), XSize=ginger_build_volume, YSize=ginger_build_volume, Radius=0)  # -> Rectangle, Length
evalsrf = EvaluateSurface(Surface=reparameterize(rectangle.Rectangle), Point=md_slider)  # -> Point, Normal, UDirection, VDirection, Frame
xy = XYPlane(Origin=Point(0, 0, 0))
extr = Extrude(Base=rectangle.Rectangle, Direction=Z)
move2pt = MoveToPoint(Geometry=group, PointA=project.Geometry, PointB=evalsrf.Point)  # -> Moved, Vector, Transform
wires = BrepWireframe(Brep=extr, Density=-1)

# ----
# position on build plate
# (multiple parts)
number_slider = Slider(150, range=0..1000)
number_slider_2 = Slider(3, range=0..10)
neg = Negative(Value=number_slider)
offset = OffsetCurve(Curve=rectangle.Rectangle, Distance=neg, Corners=1)
sdivide = DivideSurface(Surface=offset, UCount=number_slider_2, VCount=number_slider_2)  # -> Points, Normals, Parameters
split = SplitList(List=flatten(sdivide.Points), Index=Slider(4, range=0..100))  # -> graft(ListA), ListB
flip = FlipMatrix(Data=sdivide.Points)
X = UnitX(Factor=Slider(50, range=0..100))
item = ListItem(List=flip, Index=0, Wrap=True)
move = Move(Geometry=split.ListA, Motion=X)  # -> Geometry, Transform
move2pt_2 = MoveToPoint(Geometry=flatten(group), PointA=project.Geometry, PointB=move.Geometry)  # -> Moved, Vector, Transform
ungroup = Ungroup(Group=move2pt_2.Moved)  # -> simplify(Geometry)

# ----
# Switch
filter = StreamFilter(Gate=0, Stream0=move2pt.Moved)
ungroup_2 = Ungroup(Group=filter)

# ---- group: position seam
pt = ConstructPoint(XCoordinate=Slider(0.5, range=0..1), YCoordinate=Slider(0.44, range=0..1), ZCoordinate=0)

md_slider_2 = MDSlider(
    SliderMode=0,
    slider_value=Point(0.498664856, 1, 0.5),
    x_domain=Domain(0, 1),
    y_domain=Domain(0, 1),
    z_domain=Domain(0, 1))
brec = BoundingRectangle(Geometry=ungroup_2, Plane=PlaneXY(0, 0, 0), Axis=0, Slide=0, Union=True)  # -> Bounding, DimensionX, DimensionY
evalsrf_2 = EvaluateSurface(Surface=reparameterize(brec.Bounding), Point=md_slider_2)  # -> Point, Normal, UDirection, VDirection, Frame
alicrvseams = AlignCurveSeams(Curves=ungroup_2, Guide=evalsrf_2.Point, Snap=invert(False), Iterative=True)  # -> Aligned, Points, R
item_2 = ListItem(List=alicrvseams.Aligned, Index=0, Wrap=True)
flip_2 = FlipCurve(Curve=alicrvseams.Aligned, Guide=item_2)  # -> Curve, Flag

# ---- group: position seam / rhino reference point
dd = Point()

# ---- group: open seam
crv = Curve(flip_2.Curve)
panel = Panel("0")
cull_i = CullIndex(List=crv, Indices=panel, Wrap=True)
crv_2 = Curve(crv)
neg_2 = Negative(Value=layer_height)
ext = ExtendCurve(Curve=crv_2, Type=0, Start="0", End=neg_2)

# ---- group: generate points (resolution)
len = Length(Curve=ext)
division = Division(A=len, B=resolution)
divide = DivideCurve(Curve=ext, Count=division, Kinks=False)  # -> simplify(Points), Tangents, Parameters
trim = TrimTree(Tree=simplify(divide.Points), Depth=1)
pline = PolyLine(Vertices=divide.Points, Closed=False)  # -> simplify(Polyline)
pline_2 = PolyLine(Vertices=flatten(divide.Points), Closed=False)
trim_2 = TrimTree(Tree=simplify(pline), Depth=1)
pline_3 = PolyLine(Vertices=trim, Closed=False)  # -> flatten(Polyline)

# ----
explode = Explode(Curve=pline_2, Recursive=True)  # -> Segments, Vertices

# ---- group: split off first and last layer
# split off first + last layer
tstat = TreeStatistics(Tree=divide.Points)  # -> Paths, Length, Count
panel_2 = Panel("""0
-1""")
item_3 = ListItem(List=tstat.Paths, Index=panel_2, Wrap=True)
cull_i_2 = CullIndex(List=tstat.Paths, Indices=panel_2, Wrap=True)
branch = TreeBranch(Tree=divide.Points, Path=item_3, MaintainPaths=True)
branch_2 = TreeBranch(Tree=divide.Points, Path=cull_i_2, MaintainPaths=True)

# ----
# spiralize vertically
item_4 = ListItem(List=branch_2, Index=0, Wrap=True)  # -> Item1, Item
tstat_2 = TreeStatistics(Tree=item_4.Item1)  # -> Paths, Length, Count
tstat_3 = TreeStatistics(Tree=item_4.Item)  # -> Paths, Length, Count
cull_i_3 = CullIndex(List=tstat_2.Paths, Indices="0", Wrap=True)
cull_i_4 = CullIndex(List=tstat_3.Paths, Indices="-1", Wrap=True)
branch_3 = TreeBranch(Tree=item_4.Item1, Path=cull_i_3, MaintainPaths=False)
branch_4 = TreeBranch(Tree=item_4.Item, Path=cull_i_4, MaintainPaths=True)
pdecon = Deconstruct(Point=branch_3)  # -> XComponent, YComponent, ZComponent
pdecon_2 = Deconstruct(Point=branch_4)  # -> XComponent, YComponent, ZComponent
subtraction = Subtraction(A=pdecon.ZComponent, B=pdecon_2.ZComponent)

createhatch = CreateHatch(Bake=False, Curves=<missing>, HatchPatternName="Solid", HatchScale=1, HatchRotation=0)  # -> HatchGeometry, HatchObjects

# ----
# and move half layer height down
lng = ListLength(List=branch_2)
range = Range(Domain=subtraction, Steps=lng)
division_2 = Division(A=layer_height, B=2)
subtraction_2 = Subtraction(A=range, B=division_2)
Z_2 = UnitZ(Factor=subtraction_2)
cull_i_5 = CullIndex(List=Z_2, Indices="-1", Wrap=True)
move_2 = Move(Geometry=branch_2, Motion=cull_i_5)  # -> Geometry, Transform

previewmat = CustomPreviewMaterials(Geometry=createhatch.HatchGeometry, DiffuseColor=<missing>)
neg_3 = Negative(Value=division_2)

# ---- group: move first layer
# height adjustment
# first and last layer
tstat_4 = TreeStatistics(Tree=branch)  # -> Paths, Length, Count
dispatch = Dispatch(List=tstat_4.Paths, DispatchPattern=[True, False])  # -> ListA, ListB
branch_5 = TreeBranch(Tree=branch, Path=dispatch.ListA, MaintainPaths=True)
branch_6 = TreeBranch(Tree=branch, Path=dispatch.ListB, MaintainPaths=True)
Z_3 = UnitZ(Factor=neg_3)
move_3 = Move(Geometry=branch_6, Motion=Z_3)  # -> Geometry, Transform
merge = Merge(Data1=branch_5, Data2=move_3.Geometry)

# ----
merge_2 = Merge(Data1=simplify(merge), Data2=simplify(move_2.Geometry))

# ----
# spiralize horizontally
item_5 = ListItem(List=move_2.Geometry, Index=0, Wrap=True)  # -> Item1, Item
tstat_5 = TreeStatistics(Tree=item_5.Item)  # -> Paths, Length, Count
tstat_6 = TreeStatistics(Tree=item_5.Item)  # -> Paths, Length, Count
cull_i_6 = CullIndex(List=tstat_5.Paths, Indices="0", Wrap=True)
cull_i_7 = CullIndex(List=tstat_6.Paths, Indices="-1", Wrap=True)
branch_7 = TreeBranch(Tree=item_5.Item, Path=cull_i_6, MaintainPaths=False)
branch_8 = TreeBranch(Tree=item_5.Item, Path=cull_i_7, MaintainPaths=True)
vec2pt = Vector2Pt(PointA=branch_7, PointB=branch_8, Unitize=False)  # -> Vector, Length
devec = DeconstructVector(Vector=vec2pt.Vector)  # -> XComponent, YComponent, ZComponent
vec = VectorXYZ(XComponent=devec.XComponent, YComponent=devec.YComponent, ZComponent=0)  # -> Vector, Length
rev = Reverse(Vector=vec.Vector)

pline_4 = PolyLine(Vertices=flatten(move_2.Geometry), Closed=False)

# ---- group: spiralize
lng_2 = ListLength(List=move_2.Geometry)
range_2 = Range(Domain=vec.Length, Steps=lng_2)
amp = Amplitude(Vector=rev, Amplitude=range_2)
cull_i_8 = CullIndex(List=amp, Indices="-1", Wrap=True)
move_4 = Move(Geometry=move_2.Geometry, Motion=cull_i_8)  # -> Geometry, Transform

# ----
vdisex = VectorDisplayEx(Vector=vec.Vector, Colour=RGB(0, 0, 0), Width=2)
panel_3 = Panel(lng_2)
pline_5 = PolyLine(Vertices=flatten(move_4.Geometry), Closed=False)  # -> flatten(Polyline)
merge_3 = Merge(Data1=simplify(merge), Data2=simplify(move_4.Geometry))

# ---- group: travel move
item_6 = ListItem(List=trim_2, Index=panel, Wrap=True)  # -> flatten(Item)
crv_3 = Curve(item_6)

# ----
# Generate Travel Move between parts
crv_4 = Curve(reverse(pline_3))
end = EndPoints(Curve=crv_4)  # -> Start, End
number_slider_3 = Slider(10, range=0..100)
cull_i_9 = CullIndex(List=end.Start, Indices="0", Wrap=True)
cull_i_10 = CullIndex(List=end.End, Indices="-1", Wrap=True)
line = LineSDL(Start=cull_i_10, Direction=Vector(0, 0, 1), Length=number_slider_3)
pdecon_3 = Deconstruct(Point=cull_i_10)  # -> XComponent, YComponent, ZComponent
pdecon_4 = Deconstruct(Point=cull_i_9)  # -> XComponent, YComponent, ZComponent
end_2 = EndPoints(Curve=line)  # -> Start, End
addition = Addition(A=pdecon_3.ZComponent, B=number_slider_3)
pt_2 = ConstructPoint(XCoordinate=pdecon_4.XComponent, YCoordinate=pdecon_4.YComponent, ZCoordinate=addition)
ln = Line(StartPoint=end_2.End, EndPoint=pt_2)
ln_2 = Line(StartPoint=pt_2, EndPoint=cull_i_9)
merge_4 = Merge(Data1=line, Data2=ln, Data3=ln_2)
join = JoinCurves(Curves=merge_4, Preserve=False)

# ---- group: travel move
# Generate Travel Move between first layers
end_3 = EndPoints(Curve=crv_3)  # -> Start, End
number_slider_4 = Slider(10, range=0..100)
cull_i_11 = CullIndex(List=end_3.Start, Indices="0", Wrap=True)
cull_i_12 = CullIndex(List=end_3.End, Indices="-1", Wrap=True)
line_2 = LineSDL(Start=cull_i_12, Direction=Vector(0, 0, 1), Length=number_slider_4)
pdecon_5 = Deconstruct(Point=cull_i_12)  # -> XComponent, YComponent, ZComponent
pdecon_6 = Deconstruct(Point=cull_i_11)  # -> XComponent, YComponent, ZComponent
end_4 = EndPoints(Curve=line_2)  # -> Start, End
addition_2 = Addition(A=pdecon_5.ZComponent, B=number_slider_4)
pt_3 = ConstructPoint(XCoordinate=pdecon_6.XComponent, YCoordinate=pdecon_6.YComponent, ZCoordinate=addition_2)
ln_3 = Line(StartPoint=end_4.End, EndPoint=pt_3)
ln_4 = Line(StartPoint=pt_3, EndPoint=cull_i_11)
merge_5 = Merge(Data1=line_2, Data2=ln_3, Data3=ln_4)
join_2 = JoinCurves(Curves=merge_5, Preserve=False)

# ---- group: generate skirt
# Generate Skirt
item_7 = ListItem(List=pline_2, Index=0, Wrap=True)
md_slider_3 = MDSlider(
    SliderMode=0,
    slider_value=Point(0.4981745427, 1, 0.5),
    x_domain=Domain(0, 1),
    y_domain=Domain(0, 1),
    z_domain=Domain(0, 1))
brec_2 = BoundingRectangle(Geometry=item_7, Plane=PlaneXY(0, 0, 0), Axis=0, Slide=0, Union=True)  # -> Bounding, DimensionX, DimensionY
end_5 = EndPoints(Curve=item_7)  # -> Start, End
offset_2 = OffsetCurve(Curve=brec_2.Bounding, Distance=skirt_distance, Corners=1)
evalsrf_3 = EvaluateSurface(Surface=reparameterize(offset_2), Point=md_slider_3)  # -> Point, Normal, UDirection, VDirection, Frame
alicrvseams_2 = AlignCurveSeams(Curves=offset_2, Guide=evalsrf_3.Point, Snap=False, Iterative=True)  # -> Aligned, Points, R
len_2 = Length(Curve=alicrvseams_2.Aligned)
subtraction_3 = Subtraction(A=len_2, B=skirt_length)
neg_4 = Negative(Value=subtraction_3)
ext_2 = ExtendCurve(Curve=alicrvseams_2.Aligned, Type=0, Start=neg_4, End="0")
end_6 = EndPoints(Curve=ext_2)  # -> Start, End
ln_5 = Line(StartPoint=end_5.Start, EndPoint=end_6.End)
join_3 = JoinCurves(Curves=[ln_5, ext_2], Preserve=False)

# ----
neg_5 = Negative(Value=Slider(10, range=0..10))
ext_3 = ExtendCurve(Curve=join_3, Type=0, Start="0", End=neg_5)

# ---- group: weave print and travel move
weave = Weave(Pattern=[0, 1], Stream0=crv_4, Stream1=join, NullGaps=False)  # -> simplify(graft(Weave))
item_8 = ListItem(List=flatten(weave), Index=Slider(6, range=0..10), Wrap=True)
explode_2 = Explode(Curve=weave, Recursive=True)  # -> Segments, Vertices

weave_2 = Weave(Pattern=[0, 1], Stream0=crv_3, Stream1=join_2, NullGaps=False)  # -> simplify(graft(Weave))
explode_3 = Explode(Curve=weave_2, Recursive=True)  # -> Segments, Vertices
item_9 = ListItem(List=flatten(weave_2), Index=Slider(2, range=0..10), Wrap=True)

# ---- group: extrusion value
lng_3 = ListLength(List=explode_3.Vertices)
repeat = RepeatData(Data=resolution, Length=lng_3)
replace = ReplaceItems(List=repeat, Item="0", Indices="0", Wrap=False)
smaller = SmallerThan(FirstNumber=flatten(lng_3), SecondNumber=Slider(27, range=0..100))  # -> SmallerThan, OrEqualTo
tstat_7 = TreeStatistics(Tree=replace)  # -> Paths, Length, Count
dispatch_2 = Dispatch(List=tstat_7.Paths, DispatchPattern=invert(smaller.SmallerThan))  # -> ListA, ListB
branch_9 = TreeBranch(Tree=replace, Path=dispatch_2.ListA, MaintainPaths=True)
branch_10 = TreeBranch(Tree=replace, Path=dispatch_2.ListB, MaintainPaths=True)
multiplication = Multiplication(A=branch_10, B="0")
merge_6 = Merge(Data1=branch_9, Data2=multiplication)

lng_4 = ListLength(List=explode_2.Vertices)
repeat_2 = RepeatData(Data=resolution, Length=lng_4)
replace_2 = ReplaceItems(List=repeat_2, Item="0", Indices="0", Wrap=False)
smaller_2 = SmallerThan(FirstNumber=flatten(lng_4), SecondNumber=Slider(27, range=0..100))  # -> SmallerThan, OrEqualTo
tstat_8 = TreeStatistics(Tree=replace_2)  # -> Paths, Length, Count
dispatch_3 = Dispatch(List=tstat_8.Paths, DispatchPattern=invert(smaller_2.SmallerThan))  # -> ListA, ListB
branch_11 = TreeBranch(Tree=replace_2, Path=dispatch_3.ListA, MaintainPaths=True)
branch_12 = TreeBranch(Tree=replace_2, Path=dispatch_3.ListB, MaintainPaths=True)
multiplication_2 = Multiplication(A=branch_12, B="0")
merge_7 = Merge(Data1=branch_11, Data2=multiplication_2)

# ----
entwine = Entwine(Branch1X=explode_3.Vertices, Branch2X=explode_2.Vertices, FlattenInputs=False)
tstat_9 = TreeStatistics(Tree=entwine)  # -> Paths, Length, Count
pline_6 = PolyLine(Vertices=flatten(entwine), Closed=False)
item_10 = ListItem(List=tstat_9.Paths, Index=Slider(10, range=0..10), Wrap=True)
branch_13 = TreeBranch(Tree=entwine, Path=item_10, MaintainPaths=True)
pline_7 = PolyLine(Vertices=branch_13, Closed=False)

# ----
# generate toolpath points
entwine_2 = Entwine(Branch00=ext_3, Branch01=pline_2, FlattenInputs=True)
len_3 = Length(Curve=entwine_2)
division_3 = Division(A=len_3, B=resolution)
divide_2 = DivideCurve(Curve=entwine_2, Count=division_3, Kinks=False)  # -> simplify(Points), Tangents, Parameters

entwine_3 = Entwine(Branch0X=merge_6, Branch1X=merge_7, FlattenInputs=False)

# ----
# move up by
# one layer height
center_2 = Center(Geometry=flatten(divide_2.Points), forall=True, referenceAll=2)  # -> Center, Dimension
Z_4 = UnitZ(Factor=layer_height)
move_5 = Move(Geometry=center_2.Center, Motion=Z_4)  # -> Geometry, Transform
orient = Orient(Geometry=divide_2.Points, Source=center_2.Center, Target=move_5.Geometry)  # -> Geometry, Transform

# ----
# Estimated Print time
pline_8 = PolyLine(Vertices=flatten(divide_2.Points), Closed=False)
len_4 = Length(Curve=pline_8)
division_4 = Division(A=len_4, B=print_speed_mm_s)
division_5 = Division(A=division_4, B="60")
division_6 = Division(A=division_5, B="60")
smtime = ConstructSmoothTime(Days=0, Hours=division_6, Minutes=0, Seconds=0)
panel_4 = Panel(smtime)

# ---- group: Generate Gcode / Generate Extrusion Values
constant_factor_ginger = Panel("0.21")
panel_5 = Panel(layer_height)
panel_6 = Panel(layer_width)
panel_7 = Panel(resolution)
first_move = Panel("0")
height = Multiplication(ConstantFactor=[first_move, constant_factor_ginger], LayerHeight=panel_5, LayerWidth=panel_6, Resolution=panel_7)  # -> simplify(Result)

# ----
first_move_travel = Panel("60")

# ---- group: Generate Gcode
pdecon_7 = Deconstruct(Point=simplify(orient.Geometry))  # -> XComponent, YComponent, ZComponent
multiplication_3 = Multiplication(A=[first_move_travel, print_speed_mm_s], B="60")
concat = Concatenate(
    FragmentH="G1 ",
    FragmentG="F",
    FragmentI=multiplication_3,
    FragmentF=" X",
    FragmentA=pdecon_7.XComponent,
    FragmentB=" Y",
    FragmentC=pdecon_7.YComponent,
    FragmentD=" Z",
    FragmentE=pdecon_7.ZComponent,
    FragmentJ=" E",
    FragmentK=height)  # -> flatten(Result)

# ----
# Add Start + End Gcode
end_gcode = Panel("""; END CODE

; zeta raise
G91
G1 F200 Z50
G90

; deactivate temperature control (pin PC4)
M42 P49 I T1 S1
M42 P49 I T1 S1
G4 P200

; zeta raise
G91
G1 F100 Z30
G90

; safe deactivate temperature control (pin PC4)
M42 P49 I T1 S1
M42 P49 I T1 S1
G4 P200

; X homing
G28 X

; deactivate motors
M84

; let temperature-control activate (pin PC4)
G4 P2000
M42 P49 I T1 S0
M42 P49 I T1 S0
G4 P2000

; finishing tone
M300 P500
G4 P1000
M300 P500
G4 P1000
M300 P1000

; end of end code""")
start_gcode = Panel("""; START CODE

;custom pins declaration
M42 I P49 T1 S0 ;(pin PC4)
M42 I P57 T1 S0 ;(pin PF9)

; let temperature-control activate (pin PC4)
M42 P49 I T1 S0		
M42 P49 I T1 S0

; turn on temperature (pin PF9)
M42 P57 I T1 S1		

G4 P2000

M42 P57 I T1 S0
G4 P200

; set units to mm
G21

; disable cold extrusion
M302 P1

; set mixer values
M163 S0 P1
M163 S1 P0.07
M164

; raise zeta before homing (or probing!)
G91
G1 F200 Z10
G90

; homing
G28 X0 Y0

; enable bed leveling
M420 S1
; bed leveling (set custom area RxB)
; G29 F150 L150 R300 B300

; make sure extruder's ready
M300 P200
G4 P500
M300 P200
M0 Click if EXTR. READY

; homing
G28

; use absolute coordinates
G90

; set a k value for linear advance
; M900 K0.1

; raise zeta axis
G1 F200 Z2

; reset extrusion
G92 E0
; use relative distances for extrusion
M83

; end of start gcode""")
merge_8 = Merge(Data1=flatten(start_gcode), Data2=flatten(concat), Data3=flatten(end_gcode))

# ---- group: G
# Gcode Preview
number_slider_5 = Slider(0.1, range=0..1)
lng_5 = ListLength(List=concat)
multiplication_4 = Multiplication(A=lng_5, B=number_slider_5)
split_2 = SplitList(List=concat, Index=multiplication_4)  # -> ListA, ListB
panel_8 = Panel(split_2.ListA)

# ---- group: Visualize
number_slider_6 = Slider(6, range=0..10)  # disabled
crv_5 = Curve()  # disabled
number_slider_7 = Slider(10, range=0..100)  # disabled
range_3 = Range(Domain=Domain(0, 1), Steps=number_slider_6)  # disabled

# Visualize
# (long calculation)
trim_3 = TrimTree(Tree=crv_5, Depth=1)
bang = ExplodeTree(Data=trim_3)  # -> Branch0, Branch1
division_7 = Division(A=layer_height, B=2)

parampipemsh = ParameterPipeMesh(
    Curve=graft(bang.Branch1),
    Radius=division_7,
    ParametersU=[0, 0.1, 0.2, 0.3, 0.4, 0.5, 0.6, 0.7, 0.8, 0.9, 1],
    ParametersV=range_3,
    Weighted=False,
    Lengths=False,
    Angle=number_slider_7,
    Rotation=0,
    EndType=0,
    Triangulate=False)  # disabled
wbcatmullclark = WeaverbirdsCatmullClarkSubdivision(MeshCurves=parampipemsh, Level=1, SmoothNakedEdges=1)  # -> reverse(flatten(OutputMeshCurves)); disabled
preview = CustomPreview(
    Geometry=wbcatmullclark,
    Material={diffuse=RGB(228, 178, 227), emission=RGB(68, 53, 68), shine=0.5, specular=RGB(255, 254, 255), transparency=0})  # disabled

# Gradient
lng_6 = ListLength(List=wbcatmullclark)  # disabled
series = Series(Start=0, Step=1, Count=lng_6)  # disabled
gradient = Gradient(LowerLimit=0, UpperLimit=lng_6, Parameter=series, stops=[0: RGB(255, 98, 98), 0.503: RGB(255, 244, 229)])  # disabled
preview_2 = CustomPreview(Geometry=wbcatmullclark, Material=reverse(gradient))  # disabled

# ----
# Write File
list = ValueList({"Ginger": 0, "Robot": 1}, selected="Ginger")
file_name = Panel("CLIPS")
filename = Filename()
python_3_script = Python3Script()  # -> out, timestamp
# ---------- python_3_script: Python ----------
"""
Timestamp Komponente mit automatischer Aktualisierung
Outputs:
    timestamp: String
"""

import datetime
import Grasshopper

# Aktuelle Zeit
now = datetime.datetime.now()

# Timestamp Format
timestamp = now.strftime("%y%m%d%H%M_")

# Automatische Neuberechnung
ghdoc = ghenv.Component.OnPingDocument()
ghdoc.ScheduleSolution(1000, lambda doc: ghenv.Component.ExpireSolution(False))
# ---------- end python_3_script ----------
panel_9 = Panel("min")
relay = Relay()
relay_2 = Relay()
relay_3 = Relay()
desired_file_extension = Panel(".gcode")
save_gcode_to_desktop = Button()

desktop_filepath = DesktopFilepath()
stream_filter = StreamFilter(Gate=list, Stream0="/GIN_", Stream1="/DXR_")
text_join = TextJoin(Text=stream_filter)

text_join_2 = TextJoin(Text=flatten([text_join, python_3_script.timestamp, file_name, relay_2, relay_3, relay]))  # -> flatten(Result)
python_3_script_2 = Python3Script(Folder=desktop_filepath, name=text_join_2, ext=desired_file_extension, lines=merge_8, write=save_gcode_to_desktop)  # inputs Folder: String, name: String, ext: String, lines: list of String, write: Boolean
# ---------- python_3_script_2: Python ----------
__author__ = "Moritz Wesseler"
__version__ = "2024.10.23"


import os

file =Folder + name + ext


if write:
    filePath = open(file, "w") # Open the file
    for line in lines: # Iterate through lines
        filePath.write(line + "\n") # Write separate lines
    filePath.close() # Close the file
__author__ = "Moritz Wesseler"
__version__ = "2024.10.23"

import os

# Angenommen, Folder, name, ext und lines kommen von deinen Grasshopper-Inputs
file_path = os.path.join(Folder, name + ext)

if write:
    # Datei mit Kontextmanager öffnen – schließt automatisch
    # encoding angeben, um Unicode-Probleme zu vermeiden
    with open(file_path, "w", encoding="utf-8") as f:
        for line in lines:
            # f-String für saubere Zeilenumbrüche
            f.write(f"{line}\n")
# ---------- end python_3_script_2 ----------

# ==== cluster DesktopFilepath: # Grasshopper Python Component: # This script finds the current user's Desktop folder path cross-platform # and outputs it as the variable 'desktopPath'.
desktop_filepath = Python3Script()  # -> desktopPath
# ---------- desktop_filepath: Python ----------
import os
from pathlib import Path

# Grasshopper Python Component:
# This script finds the current user's Desktop folder path cross-platform
# and outputs it as the variable 'desktopPath'.

# Function to detect Desktop folder
def get_desktop_path():
    # Get home directory
    home = Path.home()
    # Common desktop folder names in various languages
    candidates = ["Desktop", "Schreibtisch", "Escritorio", "Bureau"]
    for name in candidates:
        desk = home / name
        if desk.exists() and desk.is_dir():
            return str(desk)
    # Fallback: return home directory
    return str(home)

# Output variable for Grasshopper
desktopPath = get_desktop_path()

# Print or output desktopPath to Grasshopper
print(f"Desktop path detected: {desktopPath}")
# ---------- end desktop_filepath ----------
desktoppath = ClusterOutput(desktop_filepath)
