# Grasshopper definition UR5slicer - 45 Degree.gh (Grasshopper 1.0.8)

geometry = Geometry(<extrusion referenced from the Rhino model>)

# ---- group: Eckpunkt finden
bounding_box = BoundingBox(Content=geometry, Plane=PlaneXY(0, 0, 0))  # -> Box, Box_2
deconstruct_box = DeconstructBox(Box=bounding_box.Box)  # -> Plane, X, Y, Z
deconstruct_domain = DeconstructDomain(Domain=deconstruct_box.X)  # -> Start, End
deconstruct_domain_2 = DeconstructDomain(Domain=deconstruct_box.Y)  # -> Start, End
deconstruct_domain_3 = DeconstructDomain(Domain=deconstruct_box.Z)  # -> Start, End
construct_point = ConstructPoint(XCoordinate=deconstruct_domain.Start, YCoordinate=deconstruct_domain_2.Start, ZCoordinate=deconstruct_domain_3.Start)

# ---- group: 45° Plane am Eckpunkt
unit_z = UnitZ(Factor=1)
unit_y = UnitY(Factor=1)
addition = Addition(A=unit_z, B=unit_y)
plane_normal = PlaneNormal(Origin=construct_point, ZAxis=addition)

# ---- group: 45° Plane in festem Abstand kopieren
subtraction = Subtraction(A=deconstruct_domain_3.End, B=deconstruct_domain_3.Start)
subtraction_2 = Subtraction(A=deconstruct_domain_2.End, B=deconstruct_domain_2.Start)
smaller_than = SmallerThan(FirstNumber=subtraction, SecondNumber=subtraction_2)  # -> SmallerThan, OrEqualTo
höhe_layer = Slider(2, range=0..10)
stream_filter = StreamFilter(Gate=smaller_than.SmallerThan, Stream0=subtraction, Stream1=subtraction_2)
expression = Expression(x=stream_filter, Expression="Sqrt(x²+x²)")
amplitude = Amplitude(Vector=addition, Amplitude=höhe_layer)
division = Division(A=expression, B=höhe_layer)
linear_array = LinearArray(Geometry=plane_normal, Direction=amplitude, Count=division)  # -> Geometry, Transform

# ---- group: Geometrie mit planes verschneiden
brep_plane = BrepPlane(Brep=geometry, Plane=linear_array.Geometry)  # -> Curves, Points

# ---- group: Ebenen in Punkte teilen
anstand_punkte = Slider(5, range=0..50)
length = Length(Curve=brep_plane.Curves)
division_2 = Division(A=length, B=anstand_punkte)
divide_curve = DivideCurve(Curve=brep_plane.Curves, Count=division_2, Kinks=False)  # -> flatten(Points), Tangents, Parameters

# ----
plane_origin = PlaneOrigin(Base=plane_normal, Origin=divide_curve.Points)
