# Grasshopper definition LARGERslicer - Ginger One Printer Simulation.gh (Grasshopper 1.0.9)
# plug-ins: LARGERslicer

# ---- group: 01. PART AND PRINT SETTINGS
# LARGER.slicer
# PRINTER SIMULATION  -  GINGER ADDITIVE · GINGER ONE (MARLIN)
# A planter printed in flat layers on the Ginger One: G-code, then the print played on the machine
# 01. PART AND PRINT SETTINGS
# INSTRUCTIONS: INSTRUCTIONS
# 
# 1  'Part' is a twisted planter, 220 x 220 x 280 mm, standing in the middle of the Ginger bed (1000 x 1000 mm, origin in the front left corner). Replace it with your own part: in millimetres, standing on Z 0, inside the bed.
# 
# 2  Print Settings: the house standard for the Ginger One with the 3 mm flat nozzle: bead 5 mm, layer 2 mm, 40 mm/s, the first layer at 25 mm/s for adhesion. Machine Profile 'Ginger One' turns the bead volume into E (width x height x length x 0.21).
# 
# 3  Slice, Walls (one wall), Bottom Fill (4 solid layers), Continuous Path (flat layers, one fixed seam), Start and End (skirt, exit). Path Check must say OK.
# 
# 4  Machine: Ginger Additive · Ginger One (Marlin). Machine G-code writes the file: click 'Save G-code' (Desktop, or set File). The panels show the first lines and the totals.
# 
# 5  Printer Simulation plays the G-code on the Ginger One in the Rhino viewport: click Play (and Stop), or drag Pose. Film Length = seconds for the whole print. Check collisions tests head and beam against the printed part, the bed and the frame.
# 
# Speeds are in mm/s (40 mm/s = F2400 in the G-code).
# The planter and the settings of the Ginger One: bead 5 mm, layer 2 mm, 40 mm/s, first layer 25 mm/s.
part = Brep(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)
machine = MachineProfile(Preset=4)  # -> MachineProfile, Info
printset = PrintSettings(
    BeadWidth=5,
    LayerHeight=2,
    Speed=40,
    Flow=1,
    Overlap=0.15,
    MinRadius=0,
    Resolution=2,
    FilamentDiameter=0,
    MinSpeed=5,
    MaxSpeed=200,
    Preview=False,
    MachineProfile=machine.MachineProfile,
    Density=1.25,
    FirstLayerHeight=0,
    Nozzle=0,
    FirstLayerSpeed=25,
    SpeedMmS=True)

# ---- group: 02. SLICE AND PATH
# Flat layers: one wall, four solid bottom layers, one fixed seam, a skirt and an exit move off the part. Path Check must say OK.
settings = Settings(printset)
# 02. SLICE, WALLS, BOTTOM, ONE CONTINUOUS PATH
slice = Slice(
    Geometry=part,
    Settings=settings,
    Plane=PlaneXY(0, 0, 0),
    Angle=0,
    GuideMode=0,
    ToolAxis=0,
    StartEndLayers=0,
    LARGER_Background=True)  # -> Layers, Contours, Info
walls = Walls(Layers=slice.Layers, Settings=settings, Count=1, Position=0)  # -> Layers, Contours, Info
bottom = BottomFill(Layers=walls.Layers, Settings=settings, Count=4, Pattern=0, Angle=0)  # -> Layers, Fill, Info
contpath = ContinuousPath(
    Layers=bottom.Layers,
    Settings=settings,
    Mode=1,
    SeamGap=0,
    Bridge=True,
    SeamMode=0,
    MinLayerTime=0,
    MaxVolumeRate=330,
    ShortLapTime=0,
    LARGER_Background=True)  # -> Toolpath, Info
startend = StartAndEnd(Toolpath=contpath.Toolpath, SkirtLoops=1, SkirtDistance=0, ExitLength=50, ExitLift=20, ExitFlow=0, Brim=0, BrimLoops=3)  # -> Toolpath, Info

# ---- group: 03. MACHINE AND G-CODE - click 'Save G-code'
# 03. G-CODE FOR THE GINGER ONE
# Machine G-code writes the file for the machine chosen in Machine. Click 'Save G-code'. The panels show the totals and the first lines of the G-code.
machine_2 = Machine(Machine=0, Save=False, Kind=0)  # -> Machine, Definition, Info, Model
part_name = Panel("Planter")
g_code = MachineGCode(Toolpath=startend.Toolpath, Machine=machine_2.Machine, Name=part_name, Save=False)  # -> GCode, Info, FileName, Model, Simulation
g_code_info = Panel(g_code.Info)
g_code_2 = Panel(g_code.GCode)

# ---- group: 04. PRINTER SIMULATION - click Play
# 04. PRINTER SIMULATION
# The G-code played on the Ginger One: gantry, beam and head move so the nozzle stands on the path, the part grows. Click Play, or drag Pose.
simulate = PrinterSimulation(Toolpath=g_code.Simulation, Pose=0.7, Play=False, FilmLength=20, CheckCollisions=True)  # -> Model, Printed, Tip, Info, Seconds, Colliding, Collisions
simulation = Panel(simulate.Info)
collisions = Panel(simulate.Collisions)

# ---- group: PATH CHECK
check = PathCheck(Toolpath=startend.Toolpath, MaxOffset=0, MinLayerTime=0)  # -> OK, Report, Unsupported, Offset, Crossings, LayerTimes
path_check = Panel(check.Report)
