# Grasshopper definition LARGERslicer - Surface Patterns.gh (Grasshopper 1.0.9)
# plug-ins: LARGERslicer

# LARGER.slicer  -  SURFACE PATTERNS
# Six vases on one print bed, each with a texture from Surface Pattern: knit pixels, ribs, diagonal waves, hanging loops, a picture and a region drawn on the part.
# Surface Pattern sits between Continuous Path and Start and End. Every layer is a row of points; the points are pulled out of the wall in a rhythm that moves on from layer to layer.
# Path Check after each: crossings must be 0 and there are no travel moves; points that hang over the layer below are the texture itself (Hanging output).
printset = PrintSettings(
    BeadWidth=5,
    LayerHeight=2,
    Speed=50,
    Flow=1,
    Overlap=0.15,
    MinRadius=0,
    Resolution=2,
    FilamentDiameter=0,
    MinSpeed=5,
    MaxSpeed=200,
    Preview=False,
    Density=1.25,
    FirstLayerHeight=0,
    Nozzle=0,
    FirstLayerSpeed=0,
    SpeedMmS=True)

# ---- group: 1 KNIT
# 1  KNIT
# Pixels: out and back every 5 mm, rows alternate.
vase_1 = Brep(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)
settings = Settings(printset)
slice = Slice(
    Geometry=vase_1,
    Settings=settings,
    Plane=PlaneXY(0, 0, 0),
    Angle=0,
    GuideMode=0,
    ToolAxis=0,
    StartEndLayers=0,
    LARGER_Background=True)  # -> Layers, Contours, Info
walls = Walls(Layers=slice.Layers, Settings=settings, Count=1, Position=1)  # -> Layers, Contours, Info
contpath = ContinuousPath(
    Layers=walls.Layers,
    Settings=settings,
    Mode=1,
    SeamGap=0,
    Bridge=True,
    SeamMode=0,
    MinLayerTime=0,
    MaxVolumeRate=0,
    ShortLapTime=0,
    LARGER_Background=True)  # -> Toolpath, Info
pattern = SurfacePattern(
    Toolpath=contpath.Toolpath,
    Pattern=0,
    Amplitude=3,
    Pitch=10,
    LayerPeriod=1,
    PhaseShift=0,
    ZDroop=0,
    ExtraFlow=0,
    Side=0,
    Falloff=10,
    Reach=100,
    Invert=False,
    LARGER_Background=True)  # -> Toolpath, Preview, Hanging, Info
startend = StartAndEnd(Toolpath=pattern.Toolpath, SkirtLoops=1, SkirtDistance=0, ExitLength=50, ExitLift=20, ExitFlow=0, Brim=0, BrimLoops=3)  # -> Toolpath, Info
check = PathCheck(Toolpath=startend.Toolpath, MaxOffset=0, MinLayerTime=0)  # -> OK, Report, Unsupported, Offset, Crossings, LayerTimes
pattern_info = Panel(pattern.Info)
check_2 = Panel(check.Report)

# ---- group: 2 RIBS
# 2  RIBS
# Vertical ribs, the same every layer.
vase_2 = Brep(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)
settings_2 = Settings(printset)
slice_2 = Slice(
    Geometry=vase_2,
    Settings=settings_2,
    Plane=PlaneXY(0, 0, 0),
    Angle=0,
    GuideMode=0,
    ToolAxis=0,
    StartEndLayers=0,
    LARGER_Background=True)  # -> Layers, Contours, Info
walls_2 = Walls(Layers=slice_2.Layers, Settings=settings_2, Count=1, Position=1)  # -> Layers, Contours, Info
contpath_2 = ContinuousPath(
    Layers=walls_2.Layers,
    Settings=settings_2,
    Mode=1,
    SeamGap=0,
    Bridge=True,
    SeamMode=0,
    MinLayerTime=0,
    MaxVolumeRate=0,
    ShortLapTime=0,
    LARGER_Background=True)  # -> Toolpath, Info
pattern_2 = SurfacePattern(
    Toolpath=contpath_2.Toolpath,
    Pattern=1,
    Amplitude=4,
    Pitch=14,
    LayerPeriod=1,
    PhaseShift=0,
    ZDroop=0,
    ExtraFlow=0,
    Side=0,
    Falloff=10,
    Reach=100,
    Invert=False,
    LARGER_Background=True)  # -> Toolpath, Preview, Hanging, Info
startend_2 = StartAndEnd(Toolpath=pattern_2.Toolpath, SkirtLoops=1, SkirtDistance=0, ExitLength=50, ExitLift=20, ExitFlow=0, Brim=0, BrimLoops=3)  # -> Toolpath, Info
check_3 = PathCheck(Toolpath=startend_2.Toolpath, MaxOffset=0, MinLayerTime=0)  # -> OK, Report, Unsupported, Offset, Crossings, LayerTimes
pattern_info_2 = Panel(pattern_2.Info)
check_4 = Panel(check_3.Report)

# ---- group: 3 WAVES
# 3  WAVES
# A sine that moves on a little every layer: diagonal bands.
vase_3 = Brep(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)
settings_3 = Settings(printset)
slice_3 = Slice(
    Geometry=vase_3,
    Settings=settings_3,
    Plane=PlaneXY(0, 0, 0),
    Angle=0,
    GuideMode=0,
    ToolAxis=0,
    StartEndLayers=0,
    LARGER_Background=True)  # -> Layers, Contours, Info
walls_3 = Walls(Layers=slice_3.Layers, Settings=settings_3, Count=1, Position=1)  # -> Layers, Contours, Info
contpath_3 = ContinuousPath(
    Layers=walls_3.Layers,
    Settings=settings_3,
    Mode=1,
    SeamGap=0,
    Bridge=True,
    SeamMode=0,
    MinLayerTime=0,
    MaxVolumeRate=0,
    ShortLapTime=0,
    LARGER_Background=True)  # -> Toolpath, Info
pattern_3 = SurfacePattern(
    Toolpath=contpath_3.Toolpath,
    Pattern=2,
    Amplitude=6,
    Pitch=30,
    LayerPeriod=1,
    PhaseShift=0.04,
    ZDroop=0,
    ExtraFlow=0,
    Side=0,
    Falloff=10,
    Reach=100,
    Invert=False,
    LARGER_Background=True)  # -> Toolpath, Preview, Hanging, Info
startend_3 = StartAndEnd(Toolpath=pattern_3.Toolpath, SkirtLoops=1, SkirtDistance=0, ExitLength=50, ExitLift=20, ExitFlow=0, Brim=0, BrimLoops=3)  # -> Toolpath, Info
check_5 = PathCheck(Toolpath=startend_3.Toolpath, MaxOffset=0, MinLayerTime=0)  # -> OK, Report, Unsupported, Offset, Crossings, LayerTimes
pattern_info_3 = Panel(pattern_3.Info)
check_6 = Panel(check_5.Report)

# ---- group: 4 LOOPS
# 4  LOOPS
# Long pulls that hang down (Z Droop 2 mm, Extra Flow 0.3), two layers per row.
vase_4 = Brep(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)
settings_4 = Settings(printset)
slice_4 = Slice(
    Geometry=vase_4,
    Settings=settings_4,
    Plane=PlaneXY(0, 0, 0),
    Angle=0,
    GuideMode=0,
    ToolAxis=0,
    StartEndLayers=0,
    LARGER_Background=True)  # -> Layers, Contours, Info
walls_4 = Walls(Layers=slice_4.Layers, Settings=settings_4, Count=1, Position=1)  # -> Layers, Contours, Info
contpath_4 = ContinuousPath(
    Layers=walls_4.Layers,
    Settings=settings_4,
    Mode=1,
    SeamGap=0,
    Bridge=True,
    SeamMode=0,
    MinLayerTime=0,
    MaxVolumeRate=0,
    ShortLapTime=0,
    LARGER_Background=True)  # -> Toolpath, Info
pattern_4 = SurfacePattern(
    Toolpath=contpath_4.Toolpath,
    Pattern=5,
    Amplitude=14,
    Pitch=22,
    LayerPeriod=2,
    PhaseShift=0.5,
    ZDroop=2,
    ExtraFlow=0.3,
    Side=0,
    Falloff=10,
    Reach=100,
    Invert=False,
    LARGER_Background=True)  # -> Toolpath, Preview, Hanging, Info
startend_4 = StartAndEnd(Toolpath=pattern_4.Toolpath, SkirtLoops=1, SkirtDistance=0, ExitLength=50, ExitLift=20, ExitFlow=0, Brim=0, BrimLoops=3)  # -> Toolpath, Info
check_7 = PathCheck(Toolpath=startend_4.Toolpath, MaxOffset=0, MinLayerTime=0)  # -> OK, Report, Unsupported, Offset, Crossings, LayerTimes
pattern_info_4 = Panel(pattern_4.Info)
check_8 = Panel(check_7.Report)

# ---- group: 5 IMAGE
# 5  IMAGE
# Knit pixels where the lattice picture next to this file is dark.
vase_5 = Brep(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)
settings_5 = Settings(printset)
slice_5 = Slice(
    Geometry=vase_5,
    Settings=settings_5,
    Plane=PlaneXY(0, 0, 0),
    Angle=0,
    GuideMode=0,
    ToolAxis=0,
    StartEndLayers=0,
    LARGER_Background=True)  # -> Layers, Contours, Info
walls_5 = Walls(Layers=slice_5.Layers, Settings=settings_5, Count=1, Position=1)  # -> Layers, Contours, Info
contpath_5 = ContinuousPath(
    Layers=walls_5.Layers,
    Settings=settings_5,
    Mode=1,
    SeamGap=0,
    Bridge=True,
    SeamMode=0,
    MinLayerTime=0,
    MaxVolumeRate=0,
    ShortLapTime=0,
    LARGER_Background=True)  # -> Toolpath, Info
pattern_5 = SurfacePattern(
    Toolpath=contpath_5.Toolpath,
    Pattern=6,
    Amplitude=3,
    Pitch=8,
    LayerPeriod=1,
    PhaseShift=0,
    ZDroop=0,
    ExtraFlow=0,
    Side=0,
    Falloff=10,
    Reach=100,
    Image="LARGERslicer - Surface Patterns lattice.png",
    Invert=False,
    LARGER_Background=True)  # -> Toolpath, Preview, Hanging, Info
startend_5 = StartAndEnd(Toolpath=pattern_5.Toolpath, SkirtLoops=1, SkirtDistance=0, ExitLength=50, ExitLift=20, ExitFlow=0, Brim=0, BrimLoops=3)  # -> Toolpath, Info
check_9 = PathCheck(Toolpath=startend_5.Toolpath, MaxOffset=0, MinLayerTime=0)  # -> OK, Report, Unsupported, Offset, Crossings, LayerTimes
pattern_info_5 = Panel(pattern_5.Info)
check_10 = Panel(check_9.Report)

# ---- group: 6 REGION
# 6  REGION
# Knit only inside the ellipse drawn on the front of the vase.
vase_6 = Brep(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)
settings_6 = Settings(printset)
slice_6 = Slice(
    Geometry=vase_6,
    Settings=settings_6,
    Plane=PlaneXY(0, 0, 0),
    Angle=0,
    GuideMode=0,
    ToolAxis=0,
    StartEndLayers=0,
    LARGER_Background=True)  # -> Layers, Contours, Info
walls_6 = Walls(Layers=slice_6.Layers, Settings=settings_6, Count=1, Position=1)  # -> Layers, Contours, Info
contpath_6 = ContinuousPath(
    Layers=walls_6.Layers,
    Settings=settings_6,
    Mode=1,
    SeamGap=0,
    Bridge=True,
    SeamMode=0,
    MinLayerTime=0,
    MaxVolumeRate=0,
    ShortLapTime=0,
    LARGER_Background=True)  # -> Toolpath, Info
region_drawn_on_the_part = Curve(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)
pattern_6 = SurfacePattern(
    Toolpath=contpath_6.Toolpath,
    Pattern=0,
    Amplitude=3,
    Pitch=10,
    LayerPeriod=1,
    PhaseShift=0,
    ZDroop=0,
    ExtraFlow=0,
    Side=0,
    Region=region_drawn_on_the_part,
    Falloff=10,
    Reach=100,
    Invert=False,
    LARGER_Background=True)  # -> Toolpath, Preview, Hanging, Info
startend_6 = StartAndEnd(Toolpath=pattern_6.Toolpath, SkirtLoops=1, SkirtDistance=0, ExitLength=50, ExitLift=20, ExitFlow=0, Brim=0, BrimLoops=3)  # -> Toolpath, Info
check_11 = PathCheck(Toolpath=startend_6.Toolpath, MaxOffset=0, MinLayerTime=0)  # -> OK, Report, Unsupported, Offset, Crossings, LayerTimes
pattern_info_6 = Panel(pattern_6.Info)
check_12 = Panel(check_11.Report)

# ----
# INSTRUCTIONS: SURFACE PATTERNS
# 
# Replace a vase (the Brep parameter on the left of each row) with your own part.
# 
# Amplitude up to half the bead width: every bead rests on the one below (fine knit, pixels).
# More: the bead hangs over between the points that rest on the layer below; with Z Droop and Extra Flow it sags into loops.
# 
# Phase Shift 0 = stacked (ribs), 0.5 = every other row in between (woven, knit), 0.05 = slow diagonal.
# Region: draw a closed curve on the part in Rhino and connect it. Image: a grey picture next to this file (dark = pattern).
bed = PrintBed(
    SizeX=1000,
    SizeY=1000,
    Height=1000,
    Toolpath=flatten([startend.Toolpath, startend_2.Toolpath, startend_3.Toolpath, startend_4.Toolpath, startend_5.Toolpath, startend_6.Toolpath]))  # -> Bed, OK, Info
