# Grasshopper definition LARGERSlicerDXRConverter.gh (Grasshopper 1.0.8)
# plug-ins: Heteroptera, Robots, Pufferfish, LARGERslicer, Human, Weaverbird

# ----
# Parameter
first_layer_height = Slider(2, range=0..10)
layer_height = Slider(2, range=0..10)
layer_width = Slider(3.5, range=0..15)
resolution = Slider(1, range=0..10)
skirt_length = Slider(200, range=0..1000)
non_planar_end = BooleanToggle(False)
spiralize = BooleanToggle(True)
skirt = BooleanToggle(False)
first_layer_speed_mm_s = Slider(30, range=0..100)
print_speed_mm_s = Slider(50, range=0..100)
skirt_distance = Slider(100, range=0..100)
minimum_layer_time_s = Slider(30, range=0..100)

# ----
# Geometry
geo = Geometry(<surface referenced from the Rhino model>)

# ----
# visualize overhang
meshsubd = MeshFromSubD(SubD=geo, Density=4)
number_slider = Slider(500, range=0..1000)
mesh = Mesh(meshsubd)
X = UnitX(Factor=number_slider)
Y = UnitY(Factor=number_slider)
move = Move(Geometry=mesh, Motion=X)  # -> Geometry, Transform
demesh = DeconstructMesh(Mesh=move.Geometry)  # -> Vertices, Faces, Colours, Normals
Z = UnitZ(Factor=1)
X_2 = UnitX(Factor=1)
Y_2 = UnitY(Factor=1)
dprod = DotProduct(VectorA=demesh.Normals, VectorB=Z, Unitize=invert(False))
abs = Absolute(Value=dprod)
gradient = Gradient(
    LowerLimit=0,
    UpperLimit=Slider(0.707, range=0..1),
    Parameter=abs,
    stops=[0: RGB(0, 142, 0), 0.5: RGB(254, 251, 0), 1: RGB(255, 127, 0)])
conmesh = ConstructMesh(Vertices=demesh.Vertices, Faces=demesh.Faces, Colours=gradient)

# ----
# Non Planar Contour (Isocurves)
panel = Panel("100")
debox = DeconstructBox(Box=geo)  # -> Plane, X, Y, Z
range = Range(Domain=Domain(0, 1), Steps=panel)
paramsrfiso = ParameterSurfaceIsocurve(Surface=geo, Parameter=range, Direction=True)
len = Length(Curve=paramsrfiso)
sort = SortList(Keys=len, ValuesA=paramsrfiso)  # -> Keys, reverse(ValuesA)
X_3 = UnitX(Factor="-10000")
item = ListItem(List=sort.ValuesA, Index=0, Wrap=True)
yz = YZPlane(Origin=X_3)
project = Project(Geometry=item, Plane=yz)  # -> Geometry, Transform
len_2 = Length(Curve=project.Geometry)
division = Division(A=len_2, B=layer_height)
divide = DivideCurve(Curve=project.Geometry, Count=division, Kinks=False)  # -> Points, Tangents, Parameters
X_4 = UnitX(Factor=1)
project_2 = ProjectPoint(Point=divide.Points, Direction=X_4, Geometry=item)  # -> Point, Index
srf_cp = SurfaceClosestPoint(Point=project_2.Point, Surface=geo)  # -> Point, UVPoint, Distance
iso = IsoCurve(Surface=geo, UVPoint=srf_cp.UVPoint)  # -> UIsocurve, VIsocurve
crv = Curve(flatten(iso.VIsocurve))

range_2 = Range(Domain=Domain(0, 1), Steps="100")
paramsrfiso_2 = ParameterSurfaceIsocurve(Surface=[geo, geo], Parameter=range_2, Direction=invert(True))
area = Area(Geometry=paramsrfiso_2)  # -> Area, Centroid
nurbs = NurbsCurve(Vertices=area.Centroid, Degree=3, Periodic=False)  # -> Curve, Length, Domain
len_3 = Length(Curve=nurbs.Curve)
division_2 = Division(A=len_3, B=layer_height)
x_minus_one = XMinusOne(NumberX=division_2)
range_3 = Range(Domain=Domain(0, 1), Steps=x_minus_one)
paramsrfiso_3 = ParameterSurfaceIsocurve(Surface=[geo, geo], Parameter=range_3, Direction=invert(True))

# ---- group: contour
# Contour
panel_2 = Panel("1.0001")
scale_nu = ScaleNU(Geometry=geo, Plane=PlaneXY(0, 0, 0), ScaleX=1, ScaleY=1, ScaleZ=panel_2)  # -> Geometry, Transform
center = Center(Geometry=scale_nu.Geometry, referenceAll=2)  # -> Center, Dimension
contour = Contour(Shape=scale_nu.Geometry, Point=center.Center, Direction=Vector(0, 0, 1), Distance=layer_height)  # -> flatten(Contours)
join = JoinCurves(Curves=contour, Preserve=False)
cls = Closed(Curve=join)  # -> Closed, Periodic
dispatch = Dispatch(List=join, DispatchPattern=cls.Closed)  # -> ListA, ListB

# ----
entwine = Entwine(FlattenInputs=True)

# ---- group: position object on build plate
# position on build plate
# (single print)
group = Group(Geometry=paramsrfiso_3)
geometry = Geometry(group)
center_2 = Center(Geometry=geometry, forall=True, referenceAll=2)  # -> Center, Dimension
md_slider = MDSlider(
    SliderMode=0,
    slider_value=Point(0.2493545323, 0.5006065369, 0.5),
    x_domain=Domain(0, 1),
    y_domain=Domain(0, 1),
    z_domain=Domain(0, 1))
rectangle = Rectangle(Plane=PlaneXY(0, 0, 0), XSize="1200", YSize="800", Radius=0)  # -> Rectangle, Length
evalsrf = EvaluateSurface(Surface=reparameterize(rectangle.Rectangle), Point=md_slider)  # -> Point, Normal, UDirection, VDirection, Frame
Z_2 = UnitZ(Factor="1200")
extr = Extrude(Base=rectangle.Rectangle, Direction=Z_2)
dam = DataDam(DataA=evalsrf.Point, BufferDelay=10000000, BufferMode=0)
wires = BrepWireframe(Brep=extr, Density=-1)
move2pt = MoveToPoint(Geometry=geometry, PointA=center_2.Center, PointB=dam)  # -> Moved, Vector, Transform

# ----
# position on build plate
# (multiple prints)
number_slider_2 = Slider(150, range=0..1000)  # disabled
number_slider_3 = Slider(3, range=0..10)  # disabled
number_slider_4 = Slider(4, range=0..100)  # disabled
neg = Negative(Value=number_slider_2)  # disabled
offset = OffsetCurve(Curve=rectangle.Rectangle, Distance=neg, Corners=1)  # disabled
sdivide = DivideSurface(Surface=offset, UCount=number_slider_3, VCount=number_slider_3)  # -> Points, Normals, Parameters; disabled
split = SplitList(List=flatten(sdivide.Points), Index=number_slider_4)  # -> graft(ListA), ListB; disabled
number_slider_5 = Slider(50, range=0..100)  # disabled
flip = FlipMatrix(Data=sdivide.Points)  # disabled
X_5 = UnitX(Factor=number_slider_5)  # disabled
item_2 = ListItem(List=flip, Index=0, Wrap=True)  # disabled
move_2 = Move(Geometry=split.ListA, Motion=X_5)  # -> Geometry, Transform; disabled
move2pt_2 = MoveToPoint(Geometry=flatten(move2pt.Moved), PointB=move_2.Geometry)  # -> Moved, Vector, Transform; disabled
ungroup = Ungroup(Group=move2pt_2.Moved)  # -> simplify(Geometry); disabled

# ---- group: multiple parts
# Switch
filter = StreamFilter(Gate=0, Stream0=move2pt.Moved, Stream1=ungroup)
ungroup_2 = Ungroup(Group=filter)

# ---- group: position seam
pt = ConstructPoint(XCoordinate=Slider(0.5, range=0..1), YCoordinate=Slider(0.44, range=0..1), ZCoordinate=0)

# ---- group: position seam / rhino reference point
dd = Point()

# ---- group: Visualize
# 3D Preview (Slow)
division_3 = Division(A=layer_width, B=2)  # disabled

# ---- group: Center of Mass
construct_point = ConstructPoint(
    XCoordinate=Slider(-61, range=-200..200),
    YCoordinate=Slider(-28, range=-200..200),
    ZCoordinate=Slider(113, range=-200..200))
point = Point(construct_point)

# ----
crv_2 = Curve()

construct_point_2 = ConstructPoint(
    XCoordinate=Slider(-460, range=-500..500),
    YCoordinate=Slider(3, range=-500..500),
    ZCoordinate=Slider(108, range=-500..500))

name = Panel("AE20_Extruder")
mesh_2 = Mesh(<mesh referenced from the Rhino model>)
mesh_join = MeshJoin(Meshes=flatten(mesh_2))
weight_in_kg = Slider(46, range=0..100)
yz_plane = YZPlane(Origin=construct_point_2)
create_tool = CreateTool(Name=name, TCP=yz_plane, Weight=weight_in_kg, Centroid=point, Mesh=mesh_join)  # -> Tool, TCP

# ---- group: Other Geometries / Buildplate
mesh_3 = Mesh(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)

# ---- group: Glas
geometry_2 = Geometry([<brep referenced from the Rhino model> x8])
custom_preview = CustomPreview(Geometry=geometry_2, Material=ColourSwatch(SwatchColor=RGBA(191, 191, 191, 21)))

# ---- group: Zaun
geometry_3 = Geometry([<brep referenced from the Rhino model> x93])
custom_preview_2 = CustomPreview(Geometry=geometry_3, Material=ColourSwatch(SwatchColor=RGBA(181, 181, 181, 131)))

# ---- group: Other Geometries / Robot Booster Frame (Foundation)
geometry_4 = Geometry(<brep referenced from the Rhino model>)

# ---- group: Boden
# x Richtung FLasch unten: 460,01
# y richtung 3,33
# z 107,99
rectangle_2 = Rectangle({Plane=PlaneXY(928.6274705, -298.4351476, -163.6683056), Size=Domain2(u=-2653.297612..2653.297612, v=-1769.819738..1769.819738)})
surface = Surface(rectangle_2)
custom_preview_3 = CustomPreview(Geometry=surface, Material=ColourSwatch(SwatchColor=RGBA(245, 245, 245, 232)))

# ---- group: Other Geometries
custom_preview_4 = CustomPreview(Geometry=mesh_3, Material=ColourSwatch(SwatchColor=RGBA(168, 168, 168, 212)))
custom_preview_5 = CustomPreview(Geometry=geometry_4, Material=ColourSwatch(SwatchColor=RGBA(191, 191, 191, 101)))

# ----
pt_2 = Point(<point referenced from the Rhino model>)

list = RobotsLibrary({"KR120_R2700_2"}, selected="KR120_R2700_2", Type=0)
load_robot_system = LoadRobotSystem(Name=list, Base=pt_2)

# ----
# Non Planar End
number_slider_6 = Slider(30, range=0..100)
division_4 = Division(A=number_slider_6, B=layer_height)
series = Series(Start="1", Step=1, Count=division_4)
neg_2 = Negative(Value=series)
move_3 = Move(Motion=Vector(0, 0, 10))  # -> Geometry, Transform
bnd = Bounds(Numbers=flatten(series))
remap = RemapNumbers(Value=series, Source=bnd, Target=Domain(0, 1))  # -> Mapped, Clipped
graph = GraphMapper(remap.Mapped, x0=0, x1=1, y0=0, y1=1, container_name="Sine", Equation_px=[0, 1], Equation_py=[1, 0])
number_slider_7 = Slider(0.5, range=0..100)
neg_3 = Negative(Value=number_slider_7)
dom = ConstructDomain(DomainStart=neg_3, DomainEnd=number_slider_7)

# ---- group: position seam
# seam position
md_slider_2 = MDSlider(SliderMode=0, slider_value=Point(1, 1, 0.5), x_domain=Domain(0, 1), y_domain=Domain(0, 1), z_domain=Domain(0, 1))
brec = BoundingRectangle(Geometry=ungroup_2, Plane=PlaneXY(0, 0, 0), Axis=0, Slide=0, Union=True)  # -> Bounding, DimensionX, DimensionY
evalsrf_2 = EvaluateSurface(Surface=reparameterize(brec.Bounding), Point=md_slider_2)  # -> Point, Normal, UDirection, VDirection, Frame

# ----
dam_2 = DataDam(DataA=evalsrf_2.Point, BufferDelay=10000000, BufferMode=0)

# ---- group: position seam (continued)
alicrvseams = AlignCurveSeams(Curves=ungroup_2, Guide=dam_2, Snap=False, Iterative=True)  # -> Aligned, Points, R
item_3 = ListItem(List=alicrvseams.Aligned, Index=0, Wrap=True)
flip_2 = FlipCurve(Curve=alicrvseams.Aligned, Guide=item_3)  # -> Curve, Flag

# ----
filter_2 = StreamFilter(Gate=non_planar_end, Stream1=flip_2.Curve)
item_4 = ListItem(List=filter_2, Index=0, Wrap=True)  # -> Item1, Item
item_5 = ListItem(List=filter_2, Index=neg_2, Wrap=True)
divide_2 = DivideCurve(Curve=item_4.Item1, Count="3", Kinks=False)  # -> Points, Tangents, Parameters
explode = Explode(Curve=item_5, Recursive=True)  # -> Segments, Vertices
pull = PullPoint(Point=explode.Vertices, Geometry=divide_2.Points, ClosestOnly=True)  # -> ClosestPoint, Distance, Index
bnd_2 = Bounds(Numbers=pull.Distance)
remap_2 = RemapNumbers(Value=pull.Distance, Source=bnd_2, Target=Domain(0, 1))  # -> Mapped, Clipped
graph_2 = GraphMapper(remap_2.Mapped, x0=0, x1=1, y0=0, y1=1, container_name="Sine", Equation_px=[0, 1], Equation_py=[0, 1])
remap_3 = RemapNumbers(Value=graph_2, Source=Domain(0, 1), Target=dom)  # -> Mapped, Clipped
multiplication = Multiplication(A=remap_3.Mapped, B=graft(graph))
Z_3 = UnitZ(Factor=multiplication)
move_4 = Move(Geometry=explode.Vertices, Motion=Z_3)  # -> Geometry, Transform

pline = PolyLine(Vertices=move_4.Geometry, Closed=invert(False))
cull_i = CullIndex(List=filter_2, Indices=neg_2, Wrap=True)

crv_3 = Curve(flatten(pline))

merge = Merge(Data1=flatten(cull_i), Data2=reverse(flatten(crv_3)))

# ---- group: non planar end
# Switch
filter_3 = StreamFilter(Gate=non_planar_end, Stream0=flip_2.Curve, Stream1=merge)

# ---- group: open seam
crv_4 = Curve(filter_3)
panel_3 = Panel("0")
cull_i_2 = CullIndex(List=crv_4, Indices=panel_3, Wrap=True)
crv_5 = Curve(crv_4)
neg_4 = Negative(Value=layer_height)
ext = ExtendCurve(Curve=crv_5, Type=0, Start="0", End=neg_4)

# ----
disc = Discontinuity(Curve=ext, Level=1)  # -> Points, Parameters
shatter = Shatter(Curve=graft(ext), Parameters=disc.Parameters)
trim = TrimTree(Tree=simplify(shatter), Depth=1)

# ---- group: generate points (resolution)
len_4 = Length(Curve=ext)
division_5 = Division(A=len_4, B=resolution)
divide_3 = DivideCurve(Curve=ext, Count=division_5, Kinks=False)  # -> simplify(Points), Tangents, Parameters
pline_2 = PolyLine(Vertices=divide_3.Points, Closed=False)  # -> flatten(Polyline)

len_5 = Length(Curve=ext)
division_6 = Division(A=len_5, B=resolution)
divide_4 = DivideCurve(Curve=ext, Count=division_6, Kinks=False)  # -> simplify(Points), Tangents, Parameters
trim_2 = TrimTree(Tree=divide_4.Points, Depth=1)
pline_3 = PolyLine(Vertices=flatten(divide_4.Points), Closed=False)
pline_4 = PolyLine(Vertices=trim_2, Closed=False)  # -> flatten(Polyline)
pline_5 = PolyLine(Vertices=divide_4.Points, Closed=False)  # -> flatten(Polyline)

# ---- group: split off first and last layer
# split off first + last layer
filter_4 = StreamFilter(Gate=spiralize, Stream1=pline_5)
explode_2 = Explode(Curve=filter_4, Recursive=True)  # -> Segments, Vertices
tstat = TreeStatistics(Tree=explode_2.Vertices)  # -> Paths, Length, Count
panel_4 = Panel("""0
-1""")
item_6 = ListItem(List=tstat.Paths, Index=panel_4, Wrap=True)
cull_i_3 = CullIndex(List=tstat.Paths, Indices=panel_4, Wrap=True)
branch = TreeBranch(Tree=explode_2.Vertices, Path=item_6, MaintainPaths=True)
branch_2 = TreeBranch(Tree=explode_2.Vertices, Path=cull_i_3, MaintainPaths=True)

# ----
# spiralize vertically
item_7 = ListItem(List=branch_2, Index=0, Wrap=True)  # -> Item1, Item
tstat_2 = TreeStatistics(Tree=item_7.Item1)  # -> Paths, Length, Count
tstat_3 = TreeStatistics(Tree=item_7.Item)  # -> Paths, Length, Count
cull_i_4 = CullIndex(List=tstat_2.Paths, Indices="0", Wrap=True)
cull_i_5 = CullIndex(List=tstat_3.Paths, Indices="-1", Wrap=True)
branch_3 = TreeBranch(Tree=item_7.Item1, Path=cull_i_4, MaintainPaths=False)
branch_4 = TreeBranch(Tree=item_7.Item, Path=cull_i_5, MaintainPaths=True)
pdecon = Deconstruct(Point=branch_3)  # -> XComponent, YComponent, ZComponent
pdecon_2 = Deconstruct(Point=branch_4)  # -> XComponent, YComponent, ZComponent
subtraction = Subtraction(A=pdecon.ZComponent, B=pdecon_2.ZComponent)

# ----
# and move half layer height down
lng = ListLength(List=branch_2)
range_4 = Range(Domain=subtraction, Steps=lng)
division_7 = Division(A=layer_height, B=2)
subtraction_2 = Subtraction(A=range_4, B=division_7)
Z_4 = UnitZ(Factor=subtraction_2)
cull_i_6 = CullIndex(List=Z_4, Indices="-1", Wrap=True)
move_5 = Move(Geometry=branch_2, Motion=cull_i_6)  # -> Geometry, Transform

addition = Addition(A=layer_height, B=division_7)
neg_5 = Negative(Value=division_7)

# ---- group: move first layer
# height adjustment
# first and last layer
tstat_4 = TreeStatistics(Tree=branch)  # -> Paths, Length, Count
dispatch_2 = Dispatch(List=tstat_4.Paths, DispatchPattern=[True, False])  # -> ListA, ListB
branch_5 = TreeBranch(Tree=branch, Path=dispatch_2.ListA, MaintainPaths=True)
branch_6 = TreeBranch(Tree=branch, Path=dispatch_2.ListB, MaintainPaths=True)
Z_5 = UnitZ(Factor=neg_5)
move_6 = Move(Geometry=branch_6, Motion=Z_5)  # -> Geometry, Transform
merge_2 = Merge(Data1=branch_5, Data2=move_6.Geometry)

# ----
merge_3 = Merge(Data1=simplify(merge_2), Data2=simplify(move_5.Geometry))  # -> simplify(Result)
pline_6 = PolyLine(Vertices=flatten(merge_3), Closed=False)
pline_7 = PolyLine(Vertices=merge_2, Closed=False)
tstat_5 = TreeStatistics(Tree=merge_3)  # -> Paths, Length, Count
cull_i_7 = CullIndex(List=tstat_5.Paths, Indices="0", Wrap=True)
item_8 = ListItem(List=tstat_5.Paths, Index="0", Wrap=True)
branch_7 = TreeBranch(Tree=merge_3, Path=cull_i_7, MaintainPaths=True)
branch_8 = TreeBranch(Tree=merge_3, Path=item_8, MaintainPaths=True)

# ----
# spiralize horizontally
item_9 = ListItem(List=branch_7, Index=0, Wrap=True)  # -> Item1, Item
tstat_6 = TreeStatistics(Tree=item_9.Item)  # -> Paths, Length, Count
tstat_7 = TreeStatistics(Tree=item_9.Item)  # -> Paths, Length, Count
cull_i_8 = CullIndex(List=tstat_6.Paths, Indices="0", Wrap=True)
cull_i_9 = CullIndex(List=tstat_7.Paths, Indices="-1", Wrap=True)
branch_9 = TreeBranch(Tree=item_9.Item, Path=cull_i_8, MaintainPaths=False)
branch_10 = TreeBranch(Tree=item_9.Item, Path=cull_i_9, MaintainPaths=True)
vec2pt = Vector2Pt(PointA=branch_9, PointB=branch_10, Unitize=False)  # -> Vector, Length
devec = DeconstructVector(Vector=vec2pt.Vector)  # -> XComponent, YComponent, ZComponent
vec = VectorXYZ(XComponent=devec.XComponent, YComponent=devec.YComponent, ZComponent=0)  # -> Vector, Length
rev = Reverse(Vector=vec.Vector)

pline_8 = PolyLine(Vertices=flatten(branch_7), Closed=False)
data = Data(branch_7)

# ---- group: spiralize
branch_11 = TreeBranch(Tree=branch_7, Path=cull_i_9, MaintainPaths=True)
lng_2 = ListLength(List=data)
range_5 = Range(Domain=vec.Length, Steps=lng_2)
amp = Amplitude(Vector=rev, Amplitude=range_5)
cull_i_10 = CullIndex(List=amp, Indices="-1", Wrap=True)
move_7 = Move(Geometry=data, Motion=cull_i_10)  # -> Geometry, Transform

# ----
panel_5 = Panel(lng_2)
pline_9 = PolyLine(Vertices=branch_8, Closed=False)  # -> flatten(Polyline)

merge_4 = Merge(Data1=simplify(branch_8), Data2=simplify(move_7.Geometry))
pline_10 = PolyLine(Vertices=merge_4, Closed=False)  # -> flatten(Polyline)

pline_11 = PolyLine(Vertices=flatten(move_7.Geometry), Closed=False)  # -> flatten(Polyline)

# ----
# Generate Travel Move between parts
trim_3 = TrimTree(Tree=simplify(divide_3.Points), Depth=1)
pline_12 = PolyLine(Vertices=trim_3, Closed=False)  # -> flatten(Polyline)
crv_6 = Curve(reverse(pline_12))  # disabled
end = EndPoints(Curve=crv_6)  # -> Start, End; disabled
number_slider_8 = Slider(10, range=0..100)  # disabled
panel_6 = Panel("0")  # disabled
panel_7 = Panel("-1")  # disabled
cull_i_11 = CullIndex(List=end.Start, Indices=panel_6, Wrap=True)  # disabled
cull_i_12 = CullIndex(List=end.End, Indices=panel_7, Wrap=True)  # disabled
line = LineSDL(Start=cull_i_12, Direction=Vector(0, 0, 1), Length=number_slider_8)  # disabled
pdecon_3 = Deconstruct(Point=cull_i_12)  # -> XComponent, YComponent, ZComponent; disabled
pdecon_4 = Deconstruct(Point=cull_i_11)  # -> XComponent, YComponent, ZComponent; disabled
end_2 = EndPoints(Curve=line)  # -> Start, End; disabled
addition_2 = Addition(A=pdecon_3.ZComponent, B=number_slider_8)  # disabled
pt_3 = ConstructPoint(XCoordinate=pdecon_4.XComponent, YCoordinate=pdecon_4.YComponent, ZCoordinate=addition_2)  # disabled
ln = Line(StartPoint=end_2.End, EndPoint=pt_3)  # disabled
ln_2 = Line(StartPoint=pt_3, EndPoint=cull_i_11)  # disabled
merge_5 = Merge(Data1=line, Data2=ln, Data3=ln_2)  # disabled
join_2 = JoinCurves(Curves=merge_5, Preserve=False)  # disabled

# ---- group: travel move
trim_4 = TrimTree(Tree=simplify(pline_2), Depth=1)
item_10 = ListItem(List=trim_4, Index=panel_3, Wrap=True)  # -> flatten(Item); disabled
crv_7 = Curve(item_10)  # disabled

# ---- group: spiralize
# Switch
filter_5 = StreamFilter(Gate=spiralize, Stream0=pline_2, Stream1=pline_10)

# ---- group: travel move
# Generate Travel Move between first layers
end_3 = EndPoints(Curve=crv_7)  # -> Start, End; disabled
number_slider_9 = Slider(10, range=0..100)  # disabled
panel_8 = Panel("0")  # disabled
panel_9 = Panel("-1")  # disabled
cull_i_13 = CullIndex(List=end_3.Start, Indices=panel_8, Wrap=True)  # disabled
cull_i_14 = CullIndex(List=end_3.End, Indices=panel_9, Wrap=True)  # disabled
line_2 = LineSDL(Start=cull_i_14, Direction=Vector(0, 0, 1), Length=number_slider_9)  # disabled
pdecon_5 = Deconstruct(Point=cull_i_14)  # -> XComponent, YComponent, ZComponent; disabled
pdecon_6 = Deconstruct(Point=cull_i_13)  # -> XComponent, YComponent, ZComponent; disabled
end_4 = EndPoints(Curve=line_2)  # -> Start, End; disabled
addition_3 = Addition(A=pdecon_5.ZComponent, B=number_slider_9)  # disabled
pt_4 = ConstructPoint(XCoordinate=pdecon_6.XComponent, YCoordinate=pdecon_6.YComponent, ZCoordinate=addition_3)  # disabled
ln_3 = Line(StartPoint=end_4.End, EndPoint=pt_4)  # disabled
ln_4 = Line(StartPoint=pt_4, EndPoint=cull_i_13)  # disabled
merge_6 = Merge(Data1=line_2, Data2=ln_3, Data3=ln_4)  # disabled
join_3 = JoinCurves(Curves=merge_6, Preserve=False)  # disabled

# ---- group: generate skirt
# Generate Skirt
item_11 = ListItem(List=pline_2, Index=0, Wrap=True)
md_slider_3 = MDSlider(
    SliderMode=0,
    slider_value=Point(1, 0.5365936902, 0.5),
    x_domain=Domain(0, 1),
    y_domain=Domain(0, 1),
    z_domain=Domain(0, 1))
brec_2 = BoundingRectangle(Geometry=item_11, Plane=PlaneXY(0, 0, 0), Axis=0, Slide=0, Union=True)  # -> Bounding, DimensionX, DimensionY
end_5 = EndPoints(Curve=item_11)  # -> Start, End
offset_2 = OffsetCurve(Curve=brec_2.Bounding, Distance=skirt_distance, Corners=1)
evalsrf_3 = EvaluateSurface(Surface=reparameterize(offset_2), Point=md_slider_3)  # -> Point, Normal, UDirection, VDirection, Frame
alicrvseams_2 = AlignCurveSeams(Curves=offset_2, Guide=evalsrf_3.Point, Snap=False, Iterative=True)  # -> Aligned, Points, R
neg_6 = Negative(Value="1")
ext_2 = ExtendCurve(Curve=alicrvseams_2.Aligned, Type=0, Start=neg_6, End="0")
end_6 = EndPoints(Curve=ext_2)  # -> Start, End
number_slider_10 = Slider(20, range=0..100)
ln_5 = Line(StartPoint=end_5.Start, EndPoint=end_6.End)
join_4 = JoinCurves(Curves=[ln_5, ext_2], Preserve=False)
len_6 = Length(Curve=join_4)
subtraction_3 = Subtraction(A=len_6, B=skirt_length, C=number_slider_10)
neg_7 = Negative(Value=subtraction_3)
neg_8 = Negative(Value=number_slider_10)
panel_10 = Panel("0")
ext_3 = ExtendCurve(Curve=join_4, Type=0, Start=neg_7, End=neg_8)
fillet = Fillet(Curve=ext_3, Radius=number_slider_10)

# ---- group: weave print and travel move
number_slider_11 = Slider(6, range=0..10)  # disabled
weave = Weave(Pattern=[0, 1], Stream0=crv_6, Stream1=join_2, NullGaps=False)  # -> simplify(graft(Weave)); disabled
item_12 = ListItem(List=flatten(weave), Index=number_slider_11, Wrap=True)  # disabled
explode_3 = Explode(Curve=weave, Recursive=True)  # -> Segments, Vertices; disabled

# ----
len_7 = Length(Curve=ext_3)

# ---- group: weave print and travel move
number_slider_12 = Slider(2, range=0..10)  # disabled
weave_2 = Weave(Pattern=[0, 1], Stream0=crv_7, Stream1=join_3, NullGaps=False)  # -> simplify(graft(Weave)); disabled
explode_4 = Explode(Curve=weave_2, Recursive=True)  # -> Segments, Vertices; disabled
item_13 = ListItem(List=flatten(weave_2), Index=number_slider_12, Wrap=True)  # disabled

# ----
division_8 = Division(A=len_7, B=Slider(10, range=0..10))
divide_5 = DivideCurve(Curve=ext_3, Count=division_8, Kinks=False)  # -> Points, Tangents, Parameters
explode_5 = Explode(Curve=ext_3, Recursive=True)  # -> Segments, Vertices
pline_13 = PolyLine(Vertices=divide_5.Points, Closed=False)

# ----
# generate toolpath points
entwine_2 = Entwine(Branch00=pline_13, Branch01=filter_5, FlattenInputs=True)
len_8 = Length(Curve=entwine_2)
division_9 = Division(A=len_8, B=resolution)
divide_6 = DivideCurve(Curve=entwine_2, Count=division_9, Kinks=False)  # -> simplify(Points), Tangents, Parameters

explode_6 = Explode(Curve=entwine_2, Recursive=True)  # -> Segments, Vertices

# ---- group: extrusion value
number_slider_13 = Slider(27, range=0..100)  # disabled
lng_3 = ListLength(List=explode_4.Vertices)  # disabled
repeat = RepeatData(Data=resolution, Length=lng_3)  # disabled
panel_11 = Panel("0")  # disabled
replace = ReplaceItems(List=repeat, Item=panel_11, Indices=panel_11, Wrap=False)  # disabled
smaller = SmallerThan(FirstNumber=flatten(lng_3), SecondNumber=number_slider_13)  # -> SmallerThan, OrEqualTo; disabled
tstat_8 = TreeStatistics(Tree=replace)  # -> Paths, Length, Count; disabled
dispatch_3 = Dispatch(List=tstat_8.Paths, DispatchPattern=invert(smaller.SmallerThan))  # -> ListA, ListB; disabled
branch_12 = TreeBranch(Tree=replace, Path=dispatch_3.ListA, MaintainPaths=True)  # disabled
branch_13 = TreeBranch(Tree=replace, Path=dispatch_3.ListB, MaintainPaths=True)  # disabled
multiplication_2 = Multiplication(A=branch_13, B=panel_11)  # disabled
merge_7 = Merge(Data1=branch_12, Data2=multiplication_2)  # disabled

number_slider_14 = Slider(27, range=0..100)  # disabled
lng_4 = ListLength(List=explode_3.Vertices)  # disabled
repeat_2 = RepeatData(Data=resolution, Length=lng_4)  # disabled
panel_12 = Panel("0")  # disabled
replace_2 = ReplaceItems(List=repeat_2, Item=panel_12, Indices=panel_12, Wrap=False)  # disabled
smaller_2 = SmallerThan(FirstNumber=flatten(lng_4), SecondNumber=number_slider_14)  # -> SmallerThan, OrEqualTo; disabled
tstat_9 = TreeStatistics(Tree=replace_2)  # -> Paths, Length, Count; disabled
dispatch_4 = Dispatch(List=tstat_9.Paths, DispatchPattern=invert(smaller_2.SmallerThan))  # -> ListA, ListB; disabled
branch_14 = TreeBranch(Tree=replace_2, Path=dispatch_4.ListA, MaintainPaths=True)  # disabled
branch_15 = TreeBranch(Tree=replace_2, Path=dispatch_4.ListB, MaintainPaths=True)  # disabled
multiplication_3 = Multiplication(A=branch_15, B=panel_12)  # disabled
merge_8 = Merge(Data1=branch_14, Data2=multiplication_3)  # disabled

# ----
cull_i_15 = CullIndex(List=explode_6.Vertices, Indices="0", Wrap=True)

filter_6 = StreamFilter(Gate=spiralize, Stream1=cull_i_15)
pline_14 = PolyLine(Vertices=filter_6, Closed=False)

entwine_3 = Entwine(Branch1X=explode_4.Vertices, Branch2X=explode_3.Vertices, FlattenInputs=False)  # disabled
number_slider_15 = Slider(10, range=0..10)  # disabled
tstat_10 = TreeStatistics(Tree=entwine_3)  # -> Paths, Length, Count; disabled
pline_15 = PolyLine(Vertices=flatten(entwine_3), Closed=False)  # disabled
item_14 = ListItem(List=tstat_10.Paths, Index=number_slider_15, Wrap=True)  # disabled
branch_16 = TreeBranch(Tree=entwine_3, Path=item_14, MaintainPaths=True)  # disabled
pline_16 = PolyLine(Vertices=branch_16, Closed=False)  # disabled

explode_7 = Explode(Curve=pline_14, Recursive=True)  # -> Segments, simplify(Vertices); disabled
crv_8 = Curve(flatten(pline_14))
panel_13 = Panel("""0
1""")
tstat_11 = TreeStatistics(Tree=explode_7.Vertices)  # -> Paths, Length, Count; disabled
cull_i_16 = CullIndex(List=crv_8, Indices=panel_13, Wrap=True)
panel_14 = Panel("""0
-1""")  # disabled
item_15 = ListItem(List=tstat_11.Paths, Index=panel_14, Wrap=True)  # disabled
cull_i_17 = CullIndex(List=tstat_11.Paths, Indices=panel_14, Wrap=True)  # disabled
branch_17 = TreeBranch(Tree=explode_7.Vertices, Path=cull_i_17, MaintainPaths=True)  # disabled
branch_18 = TreeBranch(Tree=explode_7.Vertices, Path=item_15, MaintainPaths=True)  # disabled
lng_5 = ListLength(List=branch_18)  # disabled
pull_2 = PullPoint(Point=branch_17, Geometry=graft(cull_i_16), ClosestOnly=True)  # -> ClosestPoint, Distance, Index; disabled
repeat_3 = RepeatData(Data=layer_height, Length=lng_5)  # -> simplify(Data); disabled
data_2 = Data(pull_2.Distance)  # disabled
panel_15 = Panel(data_2)  # disabled
merge_9 = Merge(Data1=data_2, Data2=repeat_3)  # disabled

# ----
# orient to first layer height
center_3 = Center(Geometry=flatten(cull_i_15), forall=True, referenceAll=2)  # -> Center, Dimension
project_3 = Project(Geometry=center_3.Center, Plane=PlaneXY(0, 0, 0))  # -> Geometry, Transform
Z_6 = UnitZ(Factor=first_layer_height)
move_8 = Move(Geometry=project_3.Geometry, Motion=Z_6)  # -> Geometry, Transform
orient = Orient(Geometry=cull_i_15, Source=center_3.Center, Target=move_8.Geometry)  # -> Geometry, Transform
clean = CleanTree(RemoveNulls=True, RemoveInvalid=True, RemoveEmpty=False, Tree=orient.Geometry)

entwine_4 = Entwine(Branch0X=merge_7, Branch1X=merge_8, FlattenInputs=False)  # disabled

# ----
# DAM
dam_3 = DataDam(DataA=clean, BufferDelay=10000000, BufferMode=0)  # -> simplify(DataA)
pline_17 = PolyLine(Vertices=flatten(clean), Closed=False)

pline_18 = PolyLine(Vertices=dam_3, Closed=False)
len_9 = Length(Curve=pline_18)

pline_19 = PolyLine(Vertices=flatten(dam_3), Closed=False)

tstat_12 = TreeStatistics(Tree=dam_3)  # -> Paths, Length, Count
cull_i_18 = CullIndex(List=tstat_12.Paths, Indices="0", Wrap=True)
item_16 = ListItem(List=tstat_12.Paths, Index=0, Wrap=True)
branch_19 = TreeBranch(Tree=dam_3, Path=cull_i_18, MaintainPaths=True)

branch_20 = TreeBranch(Tree=dam_3, Path=item_16, MaintainPaths=True)

pt_5 = Point(branch_19)
cull_i_19 = CullIndex(List=pt_5, Indices="-1", Wrap=True)
cull_i_20 = CullIndex(List=pt_5, Indices="0", Wrap=True)
vec2pt_2 = Vector2Pt(PointA=cull_i_19, PointB=cull_i_20, Unitize=False)  # -> Vector, Length
vdisex = VectorDisplayEx(Point=cull_i_19, Vector=vec2pt_2.Vector, Colour=RGB(0, 0, 0), Width=2)
pl = ConstructPlane(Origin=pt_5, XAxis=vec2pt_2.Vector, YAxis=Vector(0, 1, 0))

lng_6 = ListLength(List=flatten(pline_18))
repeat_4 = RepeatData(Data=print_speed_mm_s, Length=lng_6)
panel_16 = Panel("""0
1""")
replace_3 = ReplaceItems(List=repeat_4, Item=first_layer_speed_mm_s, Indices=panel_16, Wrap=False)
unflatten = UnflattenTree(Tree=replace_3, Guide=pline_18)

# ----
# calculate speeds for min. layer time
division_10 = Division(A=len_9, B=unflatten)
data_3 = Data(flatten(division_10))
smaller_3 = SmallerThan(FirstNumber=data_3, SecondNumber=minimum_layer_time_s)  # -> SmallerThan, OrEqualTo
dispatch_5 = Dispatch(List=flatten(data_3), DispatchPattern=smaller_3.SmallerThan)  # -> ListA, ListB
lng_7 = ListLength(List=dispatch_5.ListA)
repeat_5 = RepeatData(Data=minimum_layer_time_s, Length=lng_7)
weave_3 = Weave(Pattern=smaller_3.SmallerThan, Stream0=dispatch_5.ListB, Stream1=repeat_5, NullGaps=False)
unflatten_2 = UnflattenTree(Tree=weave_3, Guide=division_10)
division_11 = Division(A=len_9, B=unflatten_2)
panel_17 = Panel(division_11)

xy = XYPlane(Origin=branch_20)
trim_5 = TrimTree(Tree=pl, Depth=1)

# ----
# Non Planar Target Planes
panel_18 = Panel("1")
range_6 = Range(Domain=Domain(0, 1), Steps=panel_18)
paramloftmsh = ParameterLoftMesh(
    Sections=pline_2,
    ParametersU=range_6,
    ParametersV=range_6,
    Weighted=False,
    Lengths=invert(False),
    Angle=0,
    Closed=False,
    Triangulate=False)
mesh_4 = Mesh(paramloftmsh)
meshcp = MeshClosestPoint(Point=branch_19, Mesh=mesh_4)  # -> Point, Index, Parameter
meval = MeshEval(Mesh=mesh_4, Parameter=meshcp.Parameter)  # -> Point, Normal, Colour
cull_i_21 = CullIndex(List=branch_19, Indices="0", Wrap=True)
cull_i_22 = CullIndex(List=branch_19, Indices="-1", Wrap=True)
vec2pt_3 = Vector2Pt(PointA=cull_i_22, PointB=cull_i_21, Unitize=False)  # -> Vector, Length
vdisex_2 = VectorDisplayEx(Point=branch_19, Vector=vec2pt_3.Vector, Colour=RGB(0, 0, 0), Width=2)
pl_2 = ConstructPlane(Origin=Point(0, 0, 0), XAxis=meval.Normal, YAxis=vec2pt_3.Vector)
vdisex_3 = VectorDisplayEx(Point=branch_19, Vector=pl_2, Colour=RGB(0, 0, 0), Width=2)
xy_2 = XYPlane(Origin=trim_5)
orient_2 = OrientDirection(Geometry=xy_2, PointA=xy_2, DirectionA=xy_2, PointB=xy_2, DirectionB=pl_2)  # -> Geometry, Transform
twn2plns = TweenTwoPlanes(PlaneA=xy_2, PlaneB=orient_2.Geometry, Factor=Slider(1, range=0..1), Quaternion=True)
vdisex_4 = VectorDisplayEx(Point=branch_19, Vector=twn2plns, Colour=RGB(0, 0, 0), Width=2)

multiplication_4 = Multiplication(A=division_11, B="60")
round = Round(Number=multiplication_4)  # -> Nearest, Floor, Ceiling

merge_10 = Merge(Data1=xy, Data2=twn2plns)

lng_8 = ListLength(List=dam_3)
repeat_6 = RepeatData(Data=round.Nearest, Length=lng_8)
item_17 = ListItem(List=repeat_6, Index=0, Wrap=True)
panel_19 = Panel(item_17)

# ----
# estimate print time
panel_20 = Panel("60")
division_12 = Division(A=len_9, B=division_11)
division_13 = Division(A=division_12, B=panel_20)
# estimate print time
division_14 = Division(A=division_13, B=panel_20)
ma = MassAddition(Input=flatten(division_14))  # -> Result, PartialResults
smtime = ConstructSmoothTime(Days=0, Hours=ma.Result, Minutes=0, Seconds=0)
print_time = Panel(smtime)

# ---- group: Travel Move Extrusion
trim_6 = TrimTree(Tree=dam_3, Depth=1)
bool = Boolean(True)
lng_9 = ListLength(List=trim_6)
repeat_7 = RepeatData(Data=bool, Length=lng_9)
panel_21 = Panel("0")
replace_4 = ReplaceItems(List=repeat_7, Item=panel_21, Indices=panel_21, Wrap=False)
unflatten_3 = UnflattenTree(Tree=replace_4, Guide=dam_3)

# ---- group: Travel Move Speed
equals = Equality(FirstNumber=unflatten_3, SecondNumber=panel_21)  # -> Equality, Inequality
dispatch_6 = Dispatch(List=unflatten_3, DispatchPattern=equals.Equality)  # -> ListA, ListB
multiplication_5 = Multiplication(A=Slider(200, range=0..1000), B="60")
index = ItemIndex(List=unflatten_3, Item=dispatch_6.ListA)
replace_5 = ReplaceItems(List=repeat_6, Item=multiplication_5, Indices=index, Wrap=False)

# ---- group: Visualize
dam_4 = DataDam(DataA=dam_3, BufferDelay=10000000, BufferMode=0)  # disabled
pline_20 = PolyLine(Vertices=dam_3, Closed=invert(False))  # disabled
number_slider_16 = Slider(6, range=0..10)  # disabled
number_slider_17 = Slider(1.1, range=0..10)  # disabled
number_slider_18 = Slider(10, range=0..100)  # disabled
range_7 = Range(Domain=Domain(0, 1), Steps=number_slider_16)  # disabled
multiplication_6 = Multiplication(A=division_3, B=number_slider_17)  # disabled
parampipemsh = ParameterPipeMesh(
    Curve=graft(pline_20),
    Radius=multiplication_6,
    ParametersU=[0, 0.1, 0.2, 0.3, 0.4, 0.5, 0.6, 0.7, 0.8, 0.9, 1],
    ParametersV=range_7,
    Weighted=False,
    Lengths=False,
    Angle=number_slider_18,
    Rotation=0,
    EndType=0,
    Triangulate=False)  # disabled
wbcatmullclark = WeaverbirdsCatmullClarkSubdivision(MeshCurves=parampipemsh, Level=1, SmoothNakedEdges=1)  # -> reverse(flatten(OutputMeshCurves)); disabled
division_15 = Division(A=layer_height, B=layer_width)  # disabled
center_4 = Center(Geometry=wbcatmullclark)  # -> Center, Dimension; disabled
scale_nu_2 = ScaleNU(Geometry=wbcatmullclark, Plane=center_4.Center, ScaleX=1, ScaleY=1, ScaleZ=division_15)  # -> Geometry, Transform; disabled
preview = CustomPreview(
    Geometry=wbcatmullclark,
    Material={diffuse=RGB(228, 178, 227), emission=RGB(68, 53, 68), shine=0.5, specular=RGB(255, 254, 255), transparency=0})  # disabled

# ----
len_10 = Length(Curve=explode_6.Segments)
ins = InsertItems(List=len_10, Item="0", Indices="0", Wrap=True)

# ---- group: Visualize
lng_10 = ListLength(List=scale_nu_2.Geometry)  # disabled
series_2 = Series(Start=0, Step=1, Count=lng_10)  # disabled
gradient_2 = Gradient(LowerLimit=0, UpperLimit=lng_10, Parameter=series_2, stops=[0.376: RGB(255, 255, 255), 1: RGB(255, 98, 98)])  # disabled
preview_2 = CustomPreview(Geometry=scale_nu_2.Geometry, Material=reverse(gradient_2))  # disabled

# ---- group: F-Values
data_4 = Data(flatten(repeat_6))  # disabled

# ----
tstat_13 = TreeStatistics(Tree=pline_14)  # -> Paths, Length, Count

tstat_14 = TreeStatistics(Tree=filter_6)  # -> Paths, Length, Count
lastdex = LastIndex(List=tstat_14.Paths)

# ----
# Spiralize E-value
merge_11 = Merge(Data1="2", Data2=lastdex)  # -> flatten(Result)

subtraction_4 = Subtraction(A=merge_11, B="1")
item_18 = ListItem(List=tstat_13.Paths, Index=flatten(subtraction_4), Wrap=True)
branch_21 = TreeBranch(Tree=pline_14, Path=item_18, MaintainPaths=True)

item_19 = ListItem(List=tstat_14.Paths, Index=flatten(merge_11), Wrap=True)
branch_22 = TreeBranch(Tree=filter_6, Path=item_19, MaintainPaths=True)

crv_cp = CurveClosestPoint(Point=branch_22, Curve=branch_21)  # -> Point, Parameter, Distance
vec2pt_4 = Vector2Pt(PointA=branch_22, PointB=crv_cp.Point, Unitize=False)  # -> Vector, Length
devec_2 = DeconstructVector(Vector=vec2pt_4.Vector)  # -> XComponent, YComponent, ZComponent
vec_2 = VectorXYZ(XComponent=0, YComponent=0, ZComponent=devec_2.ZComponent)  # -> Vector, Length

cull_i_23 = CullIndex(List=tstat_14.Paths, Indices=merge_11, Wrap=True)
branch_23 = TreeBranch(Tree=filter_6, Path=cull_i_23, MaintainPaths=True)
lng_11 = ListLength(List=branch_23)
repeat_8 = RepeatData(Data=layer_height, Length=lng_11)
trim_7 = TrimTree(Tree=repeat_8, Depth=1)
merge_12 = Merge(Data1=vec_2.Length, Data2=trim_7)

# ---- group: first layer e-value
tstat_15 = TreeStatistics(Tree=merge_12)  # -> Paths, Length, Count
panel_22 = Panel("""0
1""")
item_20 = ListItem(List=tstat_15.Paths, Index=panel_22, Wrap=True)
cull_i_24 = CullIndex(List=tstat_15.Paths, Indices=panel_22, Wrap=True)
branch_24 = TreeBranch(Tree=merge_12, Path=item_20, MaintainPaths=True)
branch_25 = TreeBranch(Tree=merge_12, Path=cull_i_24, MaintainPaths=True)
lng_12 = ListLength(List=branch_24)
repeat_9 = RepeatData(Data=first_layer_height, Length=lng_12)
trim_8 = TrimTree(Tree=repeat_9, Depth=1)
merge_13 = Merge(Data1=trim_8, Data2=branch_25)

# ---- group: inspect
number_slider_19 = Slider(2, range=0..10)
tstat_16 = TreeStatistics(Tree=merge_13)  # -> Paths, Length, Count
neg_9 = Negative(Value=number_slider_19)
item_21 = ListItem(List=tstat_16.Paths, Index=number_slider_19, Wrap=True)
branch_26 = TreeBranch(Tree=merge_13, Path=item_21, MaintainPaths=True)
panel_23 = Panel(branch_26)

# ---- group: Generate Gcode / Generate Extrusion Values
panel_24 = Panel(layer_height)
filter_7 = StreamFilter(Gate=spiralize, Stream0=panel_24, Stream1=merge_13)
number_slider_20 = Slider(1, range=0..10)
constant_factor_ginger = Panel("0.2")
panel_25 = Panel(resolution)
panel_26 = Panel(layer_width)
height = Multiplication(
    ConstantFactor=Slider(1, range=0..1),
    LayerHeight=filter_7,
    LayerWidth=panel_26,
    Resolution=len_10,
    TravelMoveBoolean=unflatten_3)  # -> simplify(Result)

# ---- group: E-Values
data_5 = Data(flatten(height))  # disabled

# ----
data_6 = Data(flatten(merge_10))
lastdex_2 = LastIndex(List=flatten(data_6))
item_22 = ListItem(List=flatten(data_6), Index=lastdex_2, Wrap=True)
Z_7 = UnitZ(Factor=Slider(200, range=0..200))

xy_3 = XYPlane(Origin=item_22)

move_9 = Move(Geometry=xy_3, Motion=Z_7)  # -> Geometry, Transform
replace_6 = ReplaceItems(List=data_6, Item=move_9.Geometry, Indices=lastdex_2, Wrap=False)
unflatten_4 = UnflattenTree(Tree=replace_6, Guide=merge_10)

pline_21 = PolyLine(Vertices=flatten(unflatten_4), Closed=False)

# ---- group: Generate Gcode
# Write GCODE
pdecon_7 = Deconstruct(Point=simplify(unflatten_4))  # -> XComponent, YComponent, ZComponent
concat = Concatenate(
    FragmentH="G1 ",
    FragmentG="F",
    FragmentI=replace_5,
    FragmentF=" X",
    FragmentA=pdecon_7.XComponent,
    FragmentB=" Y",
    FragmentC=pdecon_7.YComponent,
    FragmentD=" Z",
    FragmentE=pdecon_7.ZComponent,
    FragmentJ=" E",
    FragmentK=height)  # -> flatten(Result); disabled
data_7 = Data(flatten(concat))

# ----
# Preview Snippet
number_slider_21 = Slider(0.05, range=0..1)  # disabled
lng_13 = ListLength(List=data_7)  # disabled
multiplication_7 = Multiplication(A=lng_13, B=number_slider_21)  # disabled
split_2 = SplitList(Index=multiplication_7)  # -> ListA, ListB; disabled
panel_27 = Panel(split_2.ListA)  # disabled

# ----
# Start + End GCODE
end_gcode = Panel("""; END CODE

; zeta raise
G91
G1 F200 Z50
G90

; deactivate temperature control (pin PC4)
M42 P49 I T1 S1
M42 P49 I T1 S1
G4 P200

; zeta raise
G91
G1 F100 Z30
G90

; safe deactivate temperature control (pin PC4)
M42 P49 I T1 S1
M42 P49 I T1 S1
G4 P200

; X homing
G28 X

; deactivate motors
M84

; let temperature-control activate (pin PC4)
G4 P2000
M42 P49 I T1 S0
M42 P49 I T1 S0
G4 P2000

; finishing tone
M300 P500
G4 P1000
M300 P500
G4 P1000
M300 P1000

; end of end code""")  # disabled
start_gcode = Panel("""; START CODE

;custom pins declaration
M42 I P49 T1 S0 ;(pin PC4)
M42 I P57 T1 S0 ;(pin PF9)

; let temperature-control activate (pin PC4)
M42 P49 I T1 S0		
M42 P49 I T1 S0

; turn on temperature (pin PF9)
M42 P57 I T1 S1		

G4 P2000

M42 P57 I T1 S0
G4 P200

; set units to mm
G21

; disable cold extrusion
M302 P1

; set mixer values
M163 S0 P1
M163 S1 P0.07
M164

; raise zeta before homing (or probing!)
G91
G1 F200 Z10
G90

; homing
G28 X0 Y0

; enable bed leveling
M420 S1
; bed leveling (set custom area RxB)
; G29 F150 L150 R300 B300

; make sure extruder's ready
M300 P200
G4 P500
M300 P200
M0 Click if EXTR. READY

; homing
G28

; use absolute coordinates
G90

; set a k value for linear advance
; M900 K0.1

; raise zeta axis
G1 F200 Z2

; reset extrusion
G92 E0
; use relative distances for extrusion
M83

; end of start gcode""")  # disabled
merge_14 = Merge(Data1=flatten(start_gcode), Data2=flatten(data_7), Data3=flatten(end_gcode))  # disabled

flatten = FlattenTree(Tree=unflatten_4, Path="{0}")
plane = Plane(flatten)
yz_plane_2 = YZPlane(Origin=Point(0, 0, 0))
rotate_3d = Rotate3D(Geometry=plane, Angle=degrees(Slider(0, range=-45..45)), Center=plane, Axis=yz_plane_2)  # -> Geometry, Transform

panel_28 = Panel(rotate_3d.Geometry)

speed_mm_s = Slider(30, range=0..100)
list_2 = FlagFields({"Shoulder": 1, "Elbow": 2, "Wrist": 4}, selected="Wrist")
list_3 = ValueList({"Joint", "Linear"}, selected="Joint")
create_target = CreateTarget(Plane=rotate_3d.Geometry, RobConf=list_2, Motion=list_3, Tool=create_tool.Tool, Speed=speed_mm_s, IsCartesian=True)

create_program = CreateProgram(Name="DefaultProgram", RobotSystem=load_robot_system, Targets=create_target, StepSize=1)  # -> Program, Code, Duration, Warnings, Errors

machine_settings = MachineSettings(
    BedTemperature=Slider(60, range=0..100),
    NozzleTemperature=Slider(210, range=0..1000),
    CoolingFan=Slider(60, range=0..100))  # -> MachineSettings, SettingsInfo
dxr_generator = DXRGenerator(
    RobotPath=create_program.Code,
    ExtrusionAmount=height,
    PrintSpeed=replace_5,
    MachineSettings=machine_settings.MachineSettings)  # -> DXRFile, ProcessInfo
panel_29 = Panel(dxr_generator.DXRFile)

panel_30 = Panel(create_program.Warnings)

check_collisions = CheckCollisions(
    Program=create_program.Program,
    FirstSet=7,
    SecondSet=4,
    EnvironmentPlane=-1,
    LinearStepSize=100,
    AngularStepSize=0.7853981634)  # -> CollisionFound, TargetIndex, CollidedMeshes
panel_31 = Panel(check_collisions.CollisionFound)

program_simulation = ProgramSimulation(Program=create_program.Program, Time=Slider(0.5, range=0..1), Normalized=True)  # -> SystemMeshes, JointRotations, Plane, Index, Time, Program, Errors

# ---- group: Robot Booster Frame (Foundation)
geometry_5 = Geometry(program_simulation.SystemMeshes)

# ----
custom_preview_6 = CustomPreview(Geometry=geometry_5, Material=ColourSwatch(SwatchColor=RGB(5, 2, 2)))

# ----
# Export File
list_4 = ValueList({"Ginger": 0, "Robot": 1}, selected="Ginger")  # disabled
file_name = Panel("cylinder test")  # disabled
filename = Filename()  # disabled
python_3_script = Python3Script()  # -> out, timestamp; disabled
# ---------- python_3_script: Python ----------
"""
Timestamp Komponente mit automatischer Aktualisierung
Outputs:
    timestamp: String
"""

import datetime
import Grasshopper

# Aktuelle Zeit
now = datetime.datetime.now()

# Timestamp Format
timestamp = now.strftime("%y%m%d%H%M_")

# Automatische Neuberechnung
ghdoc = ghenv.Component.OnPingDocument()
ghdoc.ScheduleSolution(1000, lambda doc: ghenv.Component.ExpireSolution(False))
# ---------- end python_3_script ----------
panel_32 = Panel("min")  # disabled
relay = Relay()  # disabled
relay_2 = Relay()  # disabled
relay_3 = Relay()  # disabled
save_gcode_to_desktop = Button()  # disabled
text_join = TextJoin(Text=flatten(file_name))  # -> flatten(Result); disabled
desired_file_extension = Panel(".gcode")  # disabled

panel_33 = Panel("/DXR_")  # disabled
panel_34 = Panel("/GIN_")  # disabled
desktop_filepath = DesktopFilepath()  # disabled
stream_filter = StreamFilter(Gate=list_4, Stream0=panel_34, Stream1=panel_33)  # disabled
text_join_2 = TextJoin(Text=stream_filter)  # disabled

python_3_script_2 = Python3Script(Folder=desktop_filepath, name=text_join, ext=desired_file_extension, lines=data_7, write=save_gcode_to_desktop)  # inputs Folder: String, name: String, ext: String, lines: list of String, write: Boolean; disabled
# ---------- python_3_script_2: Python ----------
__author__ = "Moritz Wesseler"
__version__ = "2024.10.23"


import os

file =Folder + name + ext


if write:
    filePath = open(file, "w") # Open the file
    for line in lines: # Iterate through lines
        filePath.write(line + "\n") # Write separate lines
    filePath.close() # Close the file
__author__ = "Moritz Wesseler"
__version__ = "2024.10.23"

import os

# Angenommen, Folder, name, ext und lines kommen von deinen Grasshopper-Inputs
file_path = os.path.join(Folder, name + ext)

if write:
    # Datei mit Kontextmanager öffnen – schließt automatisch
    # encoding angeben, um Unicode-Probleme zu vermeiden
    with open(file_path, "w", encoding="utf-8") as f:
        for line in lines:
            # f-String für saubere Zeilenumbrüche
            f.write(f"{line}\n")
# ---------- end python_3_script_2 ----------

deconstruct_program_targets = DeconstructProgramTargets(Program=program_simulation.Program)  # -> Planes, Joints, Configuration, DeltaTime

list_item = ListItem(List=deconstruct_program_targets.Planes, Index=Slider(7, range=0..10), Wrap=True)  # -> flatten(Item)
split_list = SplitList(List=list_item, Index=program_simulation.Index)  # -> ListA, ListB
interpolate = Interpolate(Vertices=flatten(split_list.ListA), Degree=3, Periodic=False, KnotStyle=1)  # -> Curve, Length, Domain

pline_22 = PolyLine(Vertices=split_list.ListA, Closed=False)

custom_preview_lineweights = CustomPreviewLineweights(
    Geometry=pline_22,
    Shader=ColourSwatch(SwatchColor=RGB(255, 162, 0)),
    Thickness=Slider(2, range=0.1..100),
    Absolute=False)

# ==== cluster DesktopFilepath: # Grasshopper Python Component: # This script finds the current user's Desktop folder path cross-platform # and outputs it as the variable 'desktopPath'.
desktop_filepath = Python3Script()  # -> desktopPath
# ---------- desktop_filepath: Python ----------
import os
from pathlib import Path

# Grasshopper Python Component:
# This script finds the current user's Desktop folder path cross-platform
# and outputs it as the variable 'desktopPath'.

# Function to detect Desktop folder
def get_desktop_path():
    # Get home directory
    home = Path.home()
    # Common desktop folder names in various languages
    candidates = ["Desktop", "Schreibtisch", "Escritorio", "Bureau"]
    for name in candidates:
        desk = home / name
        if desk.exists() and desk.is_dir():
            return str(desk)
    # Fallback: return home directory
    return str(home)

# Output variable for Grasshopper
desktopPath = get_desktop_path()

# Print or output desktopPath to Grasshopper
print(f"Desktop path detected: {desktopPath}")
# ---------- end desktop_filepath ----------
desktoppath = ClusterOutput(desktop_filepath)
