# Grasshopper definition UR5slicer.gh (Grasshopper 1.0.8)
# Copyright: MIT
# plug-ins: Robots, LARGERslicer

# ---- group: 3D Printing / simple slicer
number_of_bottom_layers = Slider(2, range=0..3)
bottom_layer_linewidth = Slider(6, range=0.1..15)
zigzag_thickness = Slider(15, range=0..50)
nth_layer_height = Slider(2.5, range=0..10)
# UR5.slicer
# ROBOT CLAY PRINTING AND MOVEMENT ALGORITHM
# BY FABIO KOCZULA AND TORBEN KURZHALS - FH MÜNSTER 2025
# 
# Based on Robots Plugin bei Visose
# 
# Further Contributors
# Moritz Wesseler
# Clay 3D Printing
_1st_layerheight = Slider(2, range=0..10)
point_distance = Slider(50, range=0..50)
zigzag = BooleanToggle(False)
geometry = Geometry()
# BUGS: Bugs
# 
# - Make Nozzle Length Adjustable
# - Implenet Plane Rotation for Pen Holder
simple_slicer = SimpleSlicer(
    geometry=geometry,
    layerheight_start=_1st_layerheight,
    layerheight_end=nth_layer_height,
    point_distance=point_distance,
    zigzag=zigzag,
    zigzag_thickness=zigzag_thickness,
    number_of_bottom_layers=number_of_bottom_layers,
    bottom_layer_linewidth=bottom_layer_linewidth)  # -> planes, curves, geometry_2, center, bottom_layer_planes, bottom_layer_curves

# ----
# creating Target
# Way points
curve = Curve(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)
deconstruct_brep = DeconstructBrep(Brep=curve)  # -> Faces, Edges, Vertices
divide_curve = DivideCurve(Curve=deconstruct_brep.Edges, Count=Slider(20, range=0..100), Kinks=False)  # -> Points, Tangents, Parameters
flip_matrix = FlipMatrix(Data=divide_curve.Points)
xy_plane = XYPlane(Origin=flatten(flip_matrix))
flip_plane = FlipPlane(Plane=xy_plane, ReverseX=False, ReverseY=False, SwapAxes=True)

# ---- group: 2D Drawing / Example Pattern
height_of_robot_rise_between_lines = Slider(15, range=0..100)
steps = Slider(34, range=1..50)

# ---- group: 2D Drawing / Example Pattern / Connect Input Curves Here
# 2D Robot Drawing
curve_2 = Curve(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)
curve_3 = Curve(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)
curve_4 = Curve(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)

# ---- group: 2D Drawing / Example Pattern / Cluster
line_pattern = LinePattern(curve_a=curve_2, curve_b=curve_3, curve_c=curve_4, uplift_height=height_of_robot_rise_between_lines, steps=steps)

# ---- group: 2D Drawing / Simple Curve Tool for Pen Application
precision_in_mm = Slider(5, range=0..100)
rotate_planar = Slider(263, range=0..360)
rotate_3d = Slider(0, range=0..360)
curve_5 = Curve(line_pattern)
robotic_drawing = RoboticDrawing(curve=curve_5, precision=precision_in_mm, plane_rotate_planar=degrees(rotate_planar), plane_rotate_3d=degrees(rotate_3d))
plane = Plane(robotic_drawing)

# ---- group: 3D Printing / worksurface
worksurface_height = ValueList({"Backblech": 7, "1cm": 10, "1.2cm": 12, "1.8cm": 18, "2.4cm": 24}, selected="1.8cm")
width = Slider(300, range=0..1500)
length = Slider(330, range=0..1500)
# QUICK NETWORK SETUP: ## Network Setup
# 
# 1. **Wired Connection Only**
#    Connect your laptop’s Ethernet port directly to the UR5’s network adapter.
# 
# 2. **Configure Static IP (Laptop)**
#    1. Open **Network Settings**.
#    2. Select **USB-C Dock Ethernet** → **Details**.
#    3. Under **TCP/IP**, set **Configure IPv4** to **Manual** and enter:
#       - **IP Address:** `192.168.1.44`
#       - **Subnet Mask:** `255.255.255.0`
# 
# 3. **Robot IP** (default in Grasshopper):
#    ```
#    192.168.1.66
#    ```
# 
# 4. **Verify Connection**
#    ```bash
#    ping 192.168.1.66
#    ```
worksurface = Worksurface(
    planes=simple_slicer.planes,
    curves=simple_slicer.curves,
    geometry=simple_slicer.geometry_2,
    center=simple_slicer.center,
    distance1=Slider(594, range=0..1000),
    distance2=Slider(180, range=0..1000),
    width=width,
    length=length,
    height=worksurface_height)  # -> planes_2, curves_2
# Connect planes here
plane_2 = Plane(worksurface.planes_2)

# ---- group: 2D Drawing / A3 Sized Paper 33cm away from Robot Center
curve_6 = Curve([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])

# ----
# README LINK: README:
# 
# https://github.com/Moeewe/LARGER.slicer/blob/main/PRINTER/00%20-%20UNIVERSAL%20ROBOTS%20-%20UR5/README%20UR5%2000%20QUICK%20START%20GUIDE.md
readme = Panel("""# UR5 3D-Printing & Drawing Slicer

**File:** `UR5.slicer.gh`  
**Version:** Work-In-Progress  
**By:** Moritz Wesseler  
**Contributors:** Fabio Koczula & Torben Kurzhals – FH Münster 2025  

> **Robot Clay Printing and Movement Algorithm**  
> Based on the Robots plugin by Visose  

---

## Quick Start Guide

1. Connect UR5 via Ethernet (IP: `192.168.1.44`)
2. Open Rhino & load `UR5.slicer.gh`
3. Configure robot orientation in Input Cf and plane flips
4. Test full animation before upload
5. Upload & execute program on UR5 pendant

---

## Prerequisites

### Required Software
- Rhino 3D
- Grasshopper
- Robots plugin by Visose
- MeshEdit plugin

### Hardware Setup
- UR5 Robot
- Ethernet connection
- Compatible tools (pen holder, clay extruder, etc.)

---

## Table of Contents

1. [Network Setup](#network-setup)
2. [Software Setup](#software-setup)
3. [Working with the Definition](#working-with-the-definition)
4. [Robot Configuration](#robot-configuration)
5. [Practical Tips & Best Practices](#practical-tips--best-practices)
6. [Troubleshooting](#troubleshooting)
7. [Future Tutorials](#future-tutorials)
8. [Credits](#credits)

---

## Network Setup

1. **Wired Connection Only**  
   Connect your laptop's Ethernet port directly to the UR5's network adapter.

2. **Configure Static IP (Laptop)**  
   1. Open **Network Settings**  
   2. Select **USB-C Dock Ethernet** → **Details**  
   3. Under **TCP/IP**, set **Configure IPv4** to **Manual** and enter:  
      - **IP Address:** `192.168.1.44`  
      - **Subnet Mask:** `255.255.255.0`  

3. **Robot IP** (default in Grasshopper):  
   ```
   192.168.1.66
   ```

4. **Robot Access Passwords**  
   If prompted for Admin, Master, or Safety password, try:  
   ```
   Alwin  
   alwin
   ```
   *(Robot nickname)*

5. **Verify Connection**  
   ```bash
   ping 192.168.1.66
   ```

> **Troubleshooting Tips**  
> - If the Grasshopper upload hangs, disconnect the Ethernet cable, verify your IP settings and cable connection, then reconnect.  
> - Always **save** your Grasshopper definition before uploading to prevent crashes.  
> - When the connection succeeds, the UR5 pendant will display **Abort | Execute or Continue Script** – select **Execute** to start the job.  

---

## Software Setup

### Rhino & Grasshopper Installation
1. **Open Rhino** → load your `.3dm` scene  
2. In Rhino's command line, type `Grasshopper` → press Enter  
3. Install required plugins via **_Tools → PackageManager_**:
   - Robots
   - MeshEdit

### Loading the Definition
- **Drag & drop** `UR5.slicer.gh` into the Grasshopper canvas  
- Wait for all clusters to load—no red components should remain  
- If prompted, unlock clusters with the provided password  

---

## Working with the Definition

### Geometry Pipeline & Simple Slicer
- **Inputs**:  
  - Geometry  
  - First layer height, nth-layer height  
  - Point distance, zigzag toggle & thickness  
  - Number of bottom layers, bottom layer linewidth  
- **Outputs**:  
  - `planes`, `curves` for each slice  
  - `geometry`, `center`, bottom-layer curves & points  

### Worksurface Mapper
- **Inputs**:  
  - `planes`, `curves`, original geometry  
  - `animation %`, workspace `center`  
  - Distances 1 & 2, workspace `width`, `length`, `height`  
- **Outputs**:  
  - Transformed `planes` & `curves` positioned over your build surface  

### Tool Components
- **Pen/Brush Tool**:  
  - Planar `curve`  
  - `Precision (mm)`, `Rotate Planar`, `Rotate 3D`  
  - Oriented `planes` for tool attachment  

---

## Robot Configuration

### Important Configuration Steps
1. **Robot Configuration (Input Cf)**
   - Double-click to toggle checkboxes for Shoulder, Elbow, and Wrist configurations
   - These settings affect the robot's joint orientations and are crucial for different tools
   - Adjust these settings until the robot's pose matches your needs

2. **Pre-Upload Animation Check**
   - ALWAYS run through the complete animation using the animation slider before uploading
   - This helps identify potential collisions or unreachable positions
   - Check that all movements are smooth and feasible

3. **Flip Button Usage**
   - Only use the Flip button if the robot tries to approach paths "from below"
   - This is specifically for cases where the simulation shows the robot colliding with the table or print area
   - Different from joint configuration settings (Shoulder, Elbow, Wrist)

### Simulation & Export Settings
- **Inputs**:  
  - `planes`  
  - Toggles: `flip planes`, `rotate planes`, `ironing`  
  - Joint‐limits: shoulder, elbow, wrist  
  - Motion mode dropdown (e.g. Joint/Linear)  
  - `speed [mm/s]`, `animation %`  
  - Buttons: `Upload`, `Play`, `Pause`  
  - `Tool Selection` (e.g. Pen Holder, Clay Nozzle)  
- **Outputs**:  
  - `program` (URScript text)  
  - `Warnings`, `Errors` panels  

---

## Practical Tips & Best Practices

### 1. Curve Direction Awareness
Robots follow curve directions from start to end. If multiple curves are connected without adjusting direction, the robot might zigzag between start points. Important considerations:
- Incorrect curve directions can lead to unnecessary empty movements or direction changes
- For parallel lines (e.g., in infill patterns), flip every second curve for efficient back-and-forth movement
- Use the `Flip Curve` component in Grasshopper, controlled by index or layer
- This significantly reduces print time and improves quality by minimizing travel movements

### 2. Tool Lifting (e.g., Brush or Pen)
When working with sensitive tools like brushes or paste extruders, proper tool lifting is crucial:
- Add lifting points with Z-offset (10–30 mm upwards) BEFORE the start point
- Add lifting points AFTER the end point to prevent smearing
- Implement this through additional points with a "Move" command in Z-direction
- For drawing or brushing applications, these lifting movements prevent:
  - Material dragging across the surface
  - Tool damage from lateral movements
  - Unwanted marks or strokes

### 3. Consistent Point Spacing
Use `Divide Curve` instead of `Evaluate Curve` for consistent spacing, especially across multiple curves. For optimal results:
- `Divide Curve` guarantees points at start and end
- Calculate division count based on curve length and desired spacing
- Use formula: `round(curve.Length / desired_spacing)`
- This ensures uniform extrusion rates and consistent material flow
- Particularly important for:
  - Clay printing
  - Material extrusion
  - Brush applications with varying pressure

### 4. Robot Orientation & Collision Avoidance
In the Robots plugin, proper configuration of the robot's orientation is crucial:
- Use the Robot Configuration (Input Cf) component to adjust joint orientations
- Double-click to toggle Shoulder, Elbow, and Wrist checkboxes for different tool setups
- These settings determine the robot's default pose and joint configurations
- The Flip button should only be used if the robot tries to approach paths "from below" and would collide with the work surface
- Always check the simulation preview for:
  - Natural arm movements
  - Potential self-collisions
  - Optimal working angles
  - Reachability of all points
- Adjust orientation settings until you achieve smooth, collision-free movements

### 5. TCP & Tool Orientation
The starting angles of each joint vary significantly depending on the TCP (Tool Center Point):
- Vertical tools (e.g., 3D print head) require different configurations than horizontal tools (e.g., pen holder)
- When switching tools:
  - Check and adjust the default robot pose
  - Verify tool orientation matches the physical setup
  - Test movements in simulation before running
  - Consider the approach angles for different operations
- Each tool might need its own saved configuration for optimal results

### 6. Tool Length Settings
Tool length must match the physical setup precisely:
- Lengths are defined in:
  - Tool definition clusters
  - Robot component settings
- Incorrect settings can cause:
  - Tool collision with the work surface
  - Insufficient contact pressure
  - Damage to tools or work surface
- Always double-check measurements when:
  - Creating new tools
  - Adjusting the physical setup
  - Changing tool attachments
- Consider using a tool offset variable for quick adjustments

### 7. Unexpected Lifting Movements
Some clusters automatically insert lifting movements between paths or even inside single paths:
- Check the Grasshopper definition for automated safety movements
- These are usually grouped and labeled clearly
- Common locations for automatic lifts:
  - Between individual paths
  - At layer changes
  - During tool operations
- Can be disabled or edited if:
  - The movements are unnecessary
  - You need continuous contact
  - You want to optimize print time
- Consider keeping safety movements for:
  - Initial testing
  - Complex geometries
  - Areas with high collision risk

---

## Troubleshooting

- **No network link**: verify static IP and cable
- **Red components**: install missing GH plugins or unlock clusters
- **Upload fails**: ensure UR5 firmware matches your GH Robots plugin version
- **Password prompts**: If asked for Admin, Master, or Safety password, try `Alwin` or `alwin` (robot nickname)
- **Multiple overlapping robots in simulation**: This usually indicates that your input planes are not flattened. Check if your planes are in nested lists/branches - they should be in a single, flat list. Use the Flatten component to resolve this issue, as separate branches will create individual robot programs.

---

## Future Tutorials

- **Clay 3D-Print Workflow** (detailed layering & drying)  
- **Pen & Brush Drawing Workflow** (multi-color, pressure control)  

*(Coming soon)*

---

## Credits

**Authors:**  
— Moritz Wesseler  

**Further Contributors:**  
— Fabio Koczula & Torben Kurzhals, FH Münster 2025  

© All rights reserved.""")
tool_length = Slider(97, range=0..1000)

# ----
# Tool Selection Hint: Play with Shoulder, Wrist and Elbow, when Choosing different tools.
speed_mm_s = Slider(30, range=0..500)
animation = Slider(0.877, range=0..1)
tool_selection = ValueList({"Clay Printing": 0, "Pen Holder": 1, "Wool Spinner": 2}, selected="Wool Spinner")
plane_3 = Plane(flip_plane)
rotate_planes = BooleanToggle(False)
flip_planes = BooleanToggle(False)
upload = Button()
ironing = BooleanToggle(False)
pause = Button()
play = Button()
list = FlagFields({"Shoulder": 1, "Elbow": 2, "Wrist": 4}, selected="Shoulder")
list_2 = ValueList({"Joint", "Linear"}, selected="Linear")
# INSTALL ROBOT TO MAKE IT WORK!: Double-click the component, then select the red subcomponent "Load Robot System" inside, click librabries button, choose Universal Robots as supplier, and click Install. After that, the program will work.
robot = ClayPrinter(
    planes=plane_3,
    flip=flip_planes,
    rotate=rotate_planes,
    ironing=ironing,
    cf=list,
    M=list_2,
    speed_parameter=speed_mm_s,
    time=animation,
    upload=upload,
    play=play,
    pause=pause,
    tool_selection=tool_selection,
    tool_lenght=tool_length)  # -> warnings, errors, program
panel = Panel(robot.errors)
panel_2 = Panel(robot.warnings)

desktop_path = DesktopPath()  # -> DesktopPath, Info
panel_3 = Panel(robot.program)
save_program = SaveProgram(Program=robot.program, Folder=desktop_path.DesktopPath)

# ==== cluster ClayPrinter: creates a program and sends it to a robot arm using a wired network connection
planes = ClusterInput()
flip = ClusterInput()
rotate = ClusterInput()
ironing = ClusterInput()  # run the last layer a second time with extrusion turned off
cf = ClusterInput()
M = ClusterInput()
speed_parameter = ClusterInput()
time = ClusterInput()
upload = ClusterInput()
play = ClusterInput()
pause = ClusterInput()
tool_selection = ClusterInput()

# ---- group: CLAY PRINTING TOOL
unit_x = UnitX(Factor=Slider(10, range=0..100))
point = Point(Point(181, -2.478366146, 54.49999392))
subtraction = Subtraction(A=point, B=unit_x)
yz_plane = YZPlane(Origin=subtraction)

# ----
construct_point = ConstructPoint(XCoordinate=0, YCoordinate=0, ZCoordinate=Slider(97, range=0..100))
mesh = Mesh(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)
xy_plane = XYPlane(Origin=construct_point)
create_tool = CreateTool(Name="Faden_Nozzle", TCP=xy_plane, Weight="0.1", Mesh=mesh)  # -> Tool, TCP

# ----
# table volume
panel = Panel("-845")
negative = Negative(Value="637.5")
construct_point_2 = ConstructPoint(XCoordinate=panel, YCoordinate="637.5", ZCoordinate="-18")
negative_2 = Negative(Value=panel)
multiplication = Multiplication(A=negative, B=2)
domain_box = DomainBox(Base=construct_point_2, X=negative_2, Y=multiplication, Z="-700")
custom_preview = CustomPreview(Geometry=domain_box, Material=ColourSwatch(SwatchColor=RGB(191, 191, 191)))

panel_2 = Panel("Create tool")
tool_lenght = ClusterInput()
panel_3 = Panel("0")  # disabled
panel_4 = Panel("30")  # disabled
construct_point_3 = ConstructPoint(XCoordinate=0, YCoordinate=0, ZCoordinate=tool_lenght)

# ---- group: PEN HOLDER TOOL
geometry = Geometry([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])
solid_union = SolidUnion(Breps=geometry)
volume = Volume(Geometry=solid_union)  # -> Volume, Centroid
create_tool_2 = CreateTool(Name="PenHolder", TCP=construct_point_3, Weight="0.15", Centroid=volume.Centroid, Mesh=solid_union)  # -> Tool, TCP

# ---- group: CLAY PRINTING TOOL
brep = Brep(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)
volume_2 = Volume(Geometry=brep)  # -> Volume, Centroid
mesh_brep = MeshBrep(
    Brep=brep,
    Settings={GridMaxCount=0, GridMinCount=16, JaggedSeams=False, MaxEdgeLength=0, MinEdgeLength=0.0001, MinTolerance=0, Refine=True, RefineAngle=0, RelativeTolerance=0.65, SimplePlanes=True, Tolerance=0})

panel_5 = Panel("Lehmextruder_V2")
panel_6 = Panel("2.5")

# ----
yz_plane_2 = YZPlane(Origin=construct_point_3)

# ---- group: CLAY PRINTING TOOL
create_tool_3 = CreateTool(Name=panel_5, TCP=yz_plane, Weight=panel_6, Centroid=volume_2.Centroid, Mesh=mesh_brep)  # -> Tool, TCP

# ---- group: Create Robot
robots_library = RobotsLibrary({"UR3e", "UR5e", "UR10e", "UR16e", "UR3", "UR5", "UR10", "UR20", "UR30", "KR120_R2700_2"}, selected="UR5", Type=0)
load_robot_system = LoadRobotSystem(Name=robots_library, Base=PlaneXY(0, 0, 0))
panel_7 = Panel("ur5code")

# ---- group: Create Speed
speed_parameter_2 = SpeedParameter(speed_parameter)
zone_parameter = ZoneParameter("1")

# ---- group: Create Planes
cluster = Cluster(planes=planes, flip=flip, rotate=rotate, split=0)  # -> planes_1, planes_2

# ----
stream_filter = StreamFilter(Gate=tool_selection, Stream0=create_tool_3.Tool, Stream1=create_tool_2.Tool, Stream2=create_tool.Tool)

create_target = CreateTarget(
    Plane=cluster.planes_1,
    RobConf=cf,
    Motion=M,
    Tool=stream_filter,
    Speed=speed_parameter_2,
    Zone=zone_parameter,
    IsCartesian=True)

# ---- group: Commands for Clay
panel_8 = Panel("popup(\"Bitte kontrolliere, ob die Druckluft eingeschaltet ist!\", \"Druckluft an?\", warning=False, error=False, blocking=True)")
custom_command = CustomCommand(Name="CustomCommand", Manufacturer="UR", Code=panel_8)
set_do = SetDO(DO=Slider(0, range=0..3), Value=Slider(0, range=0..1))
set_do_2 = SetDO(DO=Slider(1, range=0..3), Value=Slider(0, range=0..1))
merge = Merge(Data1=custom_command, Data2=set_do, Data3=set_do_2)

# ----
stream_filter_2 = StreamFilter(Gate=ironing, Stream1=planes)
deconstruct = Deconstruct(Point=stream_filter_2)  # -> XComponent, YComponent, ZComponent
number_slider = Slider(2, range=0..10)
min_max = MinMax(Number=deconstruct.ZComponent)  # -> Minimum, Maximum
round_to_decimal_place = RoundToDecimalPlace(NumberX=deconstruct.ZComponent, DecimalPlace=number_slider, RoundType=0)  # -> Rounded, Difference
round_to_decimal_place_2 = RoundToDecimalPlace(NumberX=min_max.Maximum, DecimalPlace=number_slider, RoundType=0)  # -> Rounded, Difference
equality = Equality(FirstNumber=round_to_decimal_place.Rounded, SecondNumber=round_to_decimal_place_2.Rounded)  # -> Equality, Inequality
mass_addition = MassAddition(Input=equality.Equality)  # -> Result, PartialResults

create_program = CreateProgram(Name=panel_7, RobotSystem=load_robot_system, Targets=create_target, InitCommands=merge, StepSize=1)  # -> Program, Code, Duration, Warnings, Errors

last_index = LastIndex(List=create_program.Code)
split_list = SplitList(List=flatten(create_program.Code), Index=expr("x-1", last_index))  # -> ListA, ListB

program_simulation = ProgramSimulation(Program=create_program.Program, Time=time, Normalized=True)  # -> SystemMeshes, JointRotations, Plane, Index, Time, Program, Errors

custom_preview_2 = CustomPreview(Geometry=program_simulation.SystemMeshes, Material=ColourSwatch(SwatchColor=RGB(181, 181, 181)))

list_length = ListLength(List=split_list.ListA)
subtraction_2 = Subtraction(A=list_length, B=mass_addition.Result)
series = Series(Start=subtraction_2, Step=1, Count=mass_addition.Result)
list_item = ListItem(List=split_list.ListA, Index=series, Wrap=True)

split_list_2 = SplitList(List=flatten(split_list.ListA), Index=expr("x-1", Slider(12, range=0..100)))  # -> ListA, ListB

off = Panel("""set_digital_out(0,False)
set_digital_out(1,True)""")
on = Panel("""set_digital_out(1,False)
set_digital_out(0,True)""")

merge_2 = Merge(
    Data1=flatten(split_list_2.ListA),
    Data2=flatten(on),
    Data3=flatten(split_list_2.ListB),
    Data4=flatten(off),
    Data5=flatten(list_item),
    Data6=flatten(split_list.ListB))
custom_code = CustomCode(Program=create_program.Program, Code=merge_2)

# ----
# ## Network Setup
# 
# 1. **Wired Connection Only**
#    Connect your laptop’s Ethernet port directly to the UR5’s network adapter.
# 
# 2. **Configure Static IP (Laptop)**
#    1. Open **Network Settings**.
#    2. Select **USB-C Dock Ethernet** → **Details**.
#    3. Under **TCP/IP**, set **Configure IPv4** to **Manual** and enter:
#       - **IP Address:** `192.168.1.44`
#       - **Subnet Mask:** `255.255.255.0`
# 
# 3. **Robot IP** (default in Grasshopper):
#    ```
#    192.168.1.66
#    ```
# 
# 4. **Verify Connection**
#    ```bash
#    ping 192.168.1.66
#    ```
panel_9 = Panel("192.168.1.66")
remote_connection = RemoteConnection(Program=custom_code, IP=panel_9, Upload=upload, Play=play, Pause=pause)

warnings = ClusterOutput(create_program.Warnings)
errors = ClusterOutput(create_program.Errors)
program = ClusterOutput(create_program.Program)

# ---- group: Tool und Papier
value_list = ValueList({"Pinsel": 194, "Marker": 197, "Bleistift": 179}, selected="Pinsel")  # disabled
value_list_2 = ValueList({"Leinwand": 0, "A3": 1, "A2": 2}, selected="A3")  # disabled
leinwand = Curve(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)  # disabled
a3 = Curve(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)  # disabled
a2 = Curve(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)  # disabled
stream_filter_3 = StreamFilter(Gate=value_list_2, Stream0=panel_4, Stream1=panel_3, Stream2=panel_3)  # disabled
stream_filter_4 = StreamFilter(Gate=value_list_2, Stream0=leinwand, Stream1=a3, Stream2=a2)  # disabled
custom_curve_preview = CustomCurvePreview(Curve=stream_filter_4, Colour=RGB(0, 0, 0))  # disabled

# ----
addition = Addition(A=value_list, B=stream_filter_3)  # disabled

# ---- group: Tool und Papier (continued)
construct_point_4 = ConstructPoint(XCoordinate=0, YCoordinate=0, ZCoordinate=addition)  # disabled
create_tool_4 = CreateTool(Name="DefaultGHTool", TCP=construct_point_4, Weight=0)  # -> Tool, TCP; disabled

# ==== cluster SimpleSlicer: slice an object for using adaptive layer heights
geometry = ClusterInput()
layerheight_start = ClusterInput()
layerheight_end = ClusterInput()
point_distance = ClusterInput()
zigzag = ClusterInput()
zigzag_thickness = ClusterInput()
number_of_bottom_layers = ClusterInput()
bottom_layer_linewidth = ClusterInput()

# ----
# geometry bounding size
bounding_size = BoundingSize(geometry=geometry)  # -> x, y, z
average = Average(Input=[layerheight_end, layerheight_start])
division = Division(A=bounding_size.z, B=average)

# ----
# bottom centerpoint
bounding_box = BoundingBox(Content=geometry, Plane=PlaneXY(0, 0, 0))  # -> Box, Box_2
unit_z = UnitZ(Factor=expr("x/2", bounding_size.z))
volume = Volume(Geometry=bounding_box.Box)  # -> Volume, Centroid
subtraction = Subtraction(A=volume.Centroid, B=unit_z)
deconstruct = Deconstruct(Point=subtraction)  # -> XComponent, YComponent, ZComponent

multiplication = Multiplication(A=2, B=number_of_bottom_layers)
center = ClusterOutput(subtraction)

# ----
# create layers
construct_domain = ConstructDomain(DomainStart=layerheight_start, DomainEnd=layerheight_end)
range = Range(Domain=construct_domain, Steps=division)
mass_addition = MassAddition(Input=range)  # -> Result, PartialResults
smaller_than = SmallerThan(FirstNumber=mass_addition.PartialResults, SecondNumber=bounding_size.z)  # -> SmallerThan, OrEqualTo
cull_pattern = CullPattern(List=mass_addition.PartialResults, CullPattern=smaller_than.OrEqualTo)
addition = Addition(A=cull_pattern, B=deconstruct.ZComponent)
construct_point = ConstructPoint(XCoordinate=0, YCoordinate=0, ZCoordinate=addition)
xy_plane = XYPlane(Origin=construct_point)
brep_plane = BrepPlane(Brep=geometry, Plane=xy_plane)  # -> flatten(Curves), Points

stream_gate = StreamGate(Stream=brep_plane.Curves, Gate=zigzag)  # -> Target0, Target1

# ----
# divide every curve
length = Length(Curve=stream_gate.Target0)
division_2 = Division(A=length, B=point_distance)

# ----
# divide first curve (even number)
list_item = ListItem(List=stream_gate.Target1, Index=0, Wrap=True)
length_2 = Length(Curve=list_item)
division_3 = Division(A=length_2, B=point_distance)
round_and_even = RoundAndEven(number=division_3)

stream_filter = StreamFilter(Gate=zigzag, Stream0=division_2, Stream1=round_and_even)
stream_gate_2 = StreamGate(Stream=stream_filter, Gate=zigzag)  # -> Target0, Target1

divide_curve = DivideCurve(Curve=brep_plane.Curves, Count=[stream_gate_2.Target1, stream_gate_2.Target0], Kinks=False)  # -> flatten(Points), flatten(Tangents), Parameters

stream_filter_2 = StreamFilter(Gate=zigzag, Stream1=divide_curve.Points)

# ----
# divide 2nd time
unit_z_2 = UnitZ(Factor=1)
cross_product = CrossProduct(VectorA=divide_curve.Tangents, VectorB=unit_z_2, Unitize=False)  # -> Vector, Length
amplitude = Amplitude(Vector=cross_product.Vector, Amplitude=zigzag_thickness)
move = Move(Geometry=stream_filter_2, Motion=amplitude)  # -> Geometry, Transform

series = Series(Start=0, Step=stream_gate_2.Target1, Count=division)
duplicate_data = DuplicateData(Data="1", Number=stream_gate_2.Target1, Order=False)
merge = Merge(Data1=flatten(duplicate_data), Data2="0")  # -> flatten(Result)
addition_2 = Addition(A=stream_gate_2.Target1, B=1)
multiplication_2 = Multiplication(A=addition_2, B=multiplication)
series_2 = Series(Start=0, Step=1, Count=multiplication_2)
stream_filter_3 = StreamFilter(Gate=zigzag, Stream0=brep_plane.Curves)
loft = Loft(Curves=stream_filter_3, Options={Adjust=False, Closed=False, LoftEnds=0, LoftSimp=0, LoftType=0, Rebuild=10, Refit=0.01})

# ----
# bottom layers
series_3 = Series(Start=0, Step=1, Count=number_of_bottom_layers)
stream_gate_3 = StreamGate(Stream=series_3, Gate=zigzag)  # -> Target0, Target1
negative = Negative(Value=bottom_layer_linewidth)
list_item_2 = ListItem(List=brep_plane.Curves, Index=stream_gate_3.Target0, Wrap=True)

# ----
# sort points
dispatch = Dispatch(List=stream_filter_2, DispatchPattern=[True, False])  # -> ListA, ListB
dispatch_2 = Dispatch(List=move.Geometry, DispatchPattern=[True, False])  # -> ListA, ListB
panel = Panel("""1
0""")
weave = Weave(Pattern=panel, Stream0=dispatch.ListB, Stream1=dispatch_2.ListA, NullGaps=False)
weave_2 = Weave(Pattern=panel, Stream0=dispatch_2.ListB, Stream1=dispatch.ListA, NullGaps=False)
duplicate_data_2 = DuplicateData(Data=panel, Number=expr("x+1", stream_gate_2.Target1), Order=False)

# ----
# create curves and geometry
partition_list = PartitionList(List=weave, Size=stream_gate_2.Target1)
partition_list_2 = PartitionList(List=weave_2, Size=stream_gate_2.Target1)
polyline = PolyLine(Vertices=partition_list, Closed=True)  # -> flatten(Polyline)
polyline_2 = PolyLine(Vertices=partition_list_2, Closed=True)  # -> flatten(Polyline)
number_slider = Slider(1, range=0..10)
merge_2 = Merge(Data1=polyline, Data2=polyline_2)
fillet = Fillet(Curve=polyline, Radius=number_slider)
fillet_2 = Fillet(Curve=polyline_2, Radius=number_slider)
loft_2 = Loft(Curves=fillet, Options={Adjust=False, Closed=False, LoftEnds=0, LoftSimp=0, LoftType=0, Rebuild=10, Refit=0.01})
loft_3 = Loft(Curves=fillet_2, Options={Adjust=False, Closed=False, LoftEnds=0, LoftSimp=0, LoftType=0, Rebuild=10, Refit=0.01})

list_item_3 = ListItem(List=weave, Index=series, Wrap=True)
list_item_4 = ListItem(List=weave_2, Index=series, Wrap=True)
weave_3 = Weave(Pattern=flatten(merge), Stream0=list_item_4, Stream1=weave_2, NullGaps=False)
weave_4 = Weave(Pattern=flatten(merge), Stream0=list_item_3, Stream1=weave, NullGaps=False)
list_item_5 = ListItem(List=weave_3, Index=Slider(248, range=0..258), Wrap=True)

weave_5 = Weave(Pattern=duplicate_data_2, Stream0=weave_4, Stream1=weave_3, NullGaps=False)

cull_index = CullIndex(List=weave_5, Indices=series_2, Wrap=True)
stream_filter_4 = StreamFilter(Gate=zigzag, Stream0=divide_curve.Points, Stream1=cull_index)
xy_plane_2 = XYPlane(Origin=stream_filter_4)
stream_filter_5 = StreamFilter(Gate=zigzag, Stream0=brep_plane.Curves, Stream1=merge_2)
list_item_6 = ListItem(List=xy_plane_2, Index=Slider(909, range=0..1000), Wrap=True)
planes = ClusterOutput(xy_plane_2)
curves = ClusterOutput(stream_filter_5)

list_item_7 = ListItem(List=polyline, Index=stream_gate_3.Target1, Wrap=True)  # -> graft(Item)
list_item_8 = ListItem(List=polyline_2, Index=stream_gate_3.Target1, Wrap=True)  # -> graft(Item)

region_union = RegionUnion(Curves=[list_item_7, list_item_8])  # -> flatten(Result)

# ----
# calculate number of offsets
area = Area(Geometry=[region_union, list_item_2])  # -> Area, Centroid
curve_closest_point = CurveClosestPoint(Point=area.Centroid, Curve=[region_union, list_item_2])  # -> Point, Parameter, Distance
min_max = MinMax(Number=curve_closest_point.Distance)  # -> Minimum, Maximum
division_4 = Division(A=min_max.Maximum, B=bottom_layer_linewidth)

list_length = ListLength(List=region_union)
stream_filter_6 = StreamFilter(Gate=zigzag, Stream0=list_item_2, Stream1=region_union)
list_item_9 = ListItem(List=stream_filter_6, Index=0, Wrap=True)
boundary_surfaces = BoundarySurfaces(Edges=list_item_9)
flatten_tree = FlattenTree(Tree=[loft_3, loft_2, loft, boundary_surfaces], Path="{0}")
geometry_2 = ClusterOutput(flatten_tree)

series_4 = Series(Start=negative, Step=negative, Count=division_4)
offset_curve = OffsetCurve(Curve=graft([list_item_2, region_union]), Distance=series_4, Corners=1)

list_length_2 = ListLength(List=flatten(offset_curve))
division_5 = Division(A=list_length_2, B=list_length)
duplicate_data_3 = DuplicateData(Data="1", Number=expr("x-1", division_5), Order=True)
merge_3 = Merge(Data1=flatten("0"), Data2=flatten(duplicate_data_3))  # -> flatten(Result)
weave_6 = Weave(Pattern=merge_3, Stream0=region_union, Stream1=flatten(offset_curve), NullGaps=False)
stream_gate_4 = StreamGate(Stream=weave_6, Gate=zigzag)  # -> Target0, Target1
length_3 = Length(Curve=stream_gate_4.Target0)
explode = Explode(Curve=stream_gate_4.Target1, Recursive=True)  # -> flatten(Segments), flatten(Vertices)
division_6 = Division(A=length_3, B=point_distance)
bottom_layer_curves = ClusterOutput(weave_6)

divide_curve_2 = DivideCurve(Curve=stream_gate_4.Target0, Count=division_6, Kinks=False)  # -> flatten(Points), Tangents, Parameters

point = Point([divide_curve_2.Points, explode.Vertices])

xy_plane_3 = XYPlane(Origin=point)

bottom_layer_planes = ClusterOutput(xy_plane_3)

# ==== cluster Worksurface: define the location and size of the printable worksurface
distance1 = ClusterInput()
distance2 = ClusterInput()
planes = ClusterInput()
curves = ClusterInput()
geometry = ClusterInput()  # lofted geometry
animation = ClusterInput()
center = ClusterInput()
width = ClusterInput()
length = ClusterInput()
height = ClusterInput()

# ----
# printbed placement
negative = Negative(Value=distance2)
negative_2 = Negative(Value=distance1)
construct_point = ConstructPoint(XCoordinate=negative_2, YCoordinate=expr("-x", negative), ZCoordinate=0)
addition = Addition(B=construct_point)

# ----
# printbed volume
negative_3 = Negative(Value=length)
domain_box = DomainBox(Base=addition, X=width, Y=negative_3, Z=height)
equality = Equality(FirstNumber=height, SecondNumber=7)  # -> Equality, Inequality
stream_filter = StreamFilter(
    Gate=equality.Equality,
    Stream0=ColourSwatch(SwatchColor=RGB(230, 201, 158)),
    Stream1=ColourSwatch(SwatchColor=RGB(56, 56, 56)))
custom_preview = CustomPreview(Geometry=domain_box, Material=stream_filter)

# ----
# move to center
unit_z = UnitZ(Factor=expr("x/2", height))
volume = Volume(Geometry=domain_box)  # -> Volume, Centroid
addition_2 = Addition(A=volume.Centroid, B=unit_z)
vector_2pt = Vector2Pt(PointA=center, PointB=addition_2, Unitize=False)  # -> Vector, Length

move = Move(Geometry=planes, Motion=vector_2pt.Vector)  # -> Geometry, Transform
move_2 = Move(Geometry=curves, Motion=vector_2pt.Vector)  # -> Geometry, Transform
move_3 = Move(Geometry=geometry, Motion=vector_2pt.Vector)  # -> Geometry, Transform
planes_2 = ClusterOutput(move.Geometry)
curves_2 = ClusterOutput(move_2.Geometry)

# ----
# trim at tool height
equality_2 = Equality(FirstNumber=animation, SecondNumber=0)  # -> Equality, Inequality
addition_3 = Addition(A=animation, B=0)
addition_4 = Addition(A=addition_3, B=equality_2.Equality)
larger_than = LargerThan(FirstNumber=addition_4, SecondNumber=0)  # -> LargerThan, OrEqualTo
stream_filter_2 = StreamFilter(Gate=larger_than.LargerThan, Stream1=geometry)
list_item = ListItem(List=stream_filter_2, Index=0, Wrap=True)
bounding_size = BoundingSize(geometry=list_item)  # -> x, y, z
multiplication = Multiplication(A=bounding_size.z, B=animation)
construct_point_2 = ConstructPoint(XCoordinate=0, YCoordinate=0, ZCoordinate=multiplication)
xy_plane = XYPlane(Origin=construct_point_2)

stream_gate = StreamGate(Stream=move_3.Geometry, Gate=larger_than.LargerThan)  # -> Target0, Target1

trim_with_plane = TrimWithPlane(Brep=stream_gate.Target1, Plane=xy_plane, PlaneDirection=True, Cap=True, Tolerance=0.001)  # -> flatten(TrimmedBreps)

custom_preview_2 = CustomPreview(Geometry=[stream_gate.Target0, trim_with_plane], Material=ColourSwatch(SwatchColor=RGB(204, 179, 135)))

# ==== cluster RoboticDrawing: Creates drawable paths fors for robotic drawings.

# ---- group: Sort Multiple Curves / Cluster Input
curve = ClusterInput()

# ---- group: Sort Multiple Curves
curve_2 = Curve(curve)
end_points = EndPoints(Curve=curve_2)  # -> Start, End
point = Point(end_points.End)
deconstruct = Deconstruct(Point=point)  # -> XComponent, YComponent, ZComponent
sort_list = SortList(Keys=deconstruct.XComponent, ValuesValuesA=curve_2)  # -> Keys, ValuesValuesA
curve_3 = Curve(sort_list.ValuesValuesA)
dispatch = Dispatch(List=curve_3, DispatchPattern=[True, False])  # -> ListA, ListB
flip_curve = FlipCurve(Curve=dispatch.ListB)  # -> Curve, Flag
weave = Weave(Pattern=[0, 1], Stream0=dispatch.ListA, Stream1=flip_curve.Curve, NullGaps=False)

# ---- group: Adjust Planes / Cluster Input
precision = ClusterInput()

plane_rotate_planar = ClusterInput()

plane_rotate_3d = ClusterInput()

# ---- group: Adjust Planes
length = Length(Curve=weave)
division = Division(A=length, B=precision)
divide_curve = DivideCurve(Curve=weave, Count=division, Kinks=False)  # -> Points, Tangents, Parameters
plane = Plane(divide_curve.Points)
xy_plane = XYPlane(Origin=Point(0, 0, 0))
xz_plane = XZPlane(Origin=Point(0, 0, 0))
rotate_3d = Rotate3D(Geometry=plane, Angle=degrees(plane_rotate_planar), Center=plane, Axis=xy_plane)  # -> Geometry, Transform
rotate_3d_2 = Rotate3D(Geometry=rotate_3d.Geometry, Angle=degrees(plane_rotate_3d), Center=rotate_3d.Geometry, Axis=xz_plane)  # -> Geometry, Transform

# ---- group: Move Endpoints
move_start_endpoint_up_mm = Slider(19, range=0..100)
move_endpoints = MoveEndpoints(planes=rotate_3d_2.Geometry, endpoints_move_mm=move_start_endpoint_up_mm)
planes = ClusterOutput(move_endpoints)

# ==== cluster LinePattern: Creates a simple line pattern for robotic drawing.

# ---- group: Connectable Curves / Cluster Input
curve_c = ClusterInput()

curve_a = ClusterInput()

curve_b = ClusterInput()

# ---- group: Create Tween Pattern / Cluster Input
steps = ClusterInput()

# ---- group: Create Tween Pattern
construct_domain = ConstructDomain(DomainStart=Slider(0, range=0..1), DomainEnd=Slider(1, range=0..1))
range = Range(Domain=construct_domain, Steps=steps)
tween_curve = TweenCurve(CurveA=curve_a, CurveB=curve_b, Factor=range, BlendType=0)
tween_curve_2 = TweenCurve(CurveA=curve_b, CurveB=curve_c, Factor=range, BlendType=0)

# ---- group: Curves
curve = Curve([tween_curve, tween_curve_2])

# ---- group: Sort Curves
end_points = EndPoints(Curve=curve)  # -> Start, End
deconstruct = Deconstruct(Point=end_points.End)  # -> XComponent, YComponent, ZComponent
sort_list = SortList(Keys=deconstruct.XComponent, ValuesValuesA=curve)  # -> Keys, ValuesValuesA

# ---- group: Check Curve order
list_item = ListItem(List=curve, Index=Slider(42, range=0..100), Wrap=True)

# ---- group: Check Curve Order
list_item_2 = ListItem(List=sort_list.ValuesValuesA, Index=Slider(21, range=0..100), Wrap=True)

# ---- group: Flip Every Second Curve for good Curve order
dispatch = Dispatch(List=sort_list.ValuesValuesA, DispatchPattern=[True, False])  # -> ListA, ListB
curve_2 = Curve(dispatch.ListB)
flip_curve = FlipCurve(Curve=curve_2)  # -> Curve, Flag
weave = Weave(Pattern=[0, 1], Stream0=dispatch.ListA, Stream1=flip_curve.Curve, NullGaps=False)
curve_3 = Curve(weave)

# ---- group: Create Points
precision = Slider(5, range=0..10)
length = Length(Curve=curve_3)
division = Division(A=length, B=precision)
divide_curve = DivideCurve(Curve=curve_3, Count=division, Kinks=False)  # -> simplify(Points), Tangents, Parameters

# ---- group: Create Robot Rise between Curve / Cluster Input
uplift_height = ClusterInput()

# ---- group: Create Robot Rise between Curve
lastdex = LastIndex(List=divide_curve.Points)
item = ListItem(List=divide_curve.Points, Index=0, Wrap=True)
item_2 = ListItem(List=divide_curve.Points, Index=lastdex, Wrap=True)
Z = UnitZ(Factor=uplift_height)
move = Move(Geometry=item, Motion=Z)  # -> Geometry, Transform
move_2 = Move(Geometry=item_2, Motion=Z)  # -> Geometry, Transform
merge = Merge(Data1=move.Geometry, Data2=divide_curve.Points, Data3=move_2.Geometry)
point = Point(merge)
polyline = PolyLine(Vertices=flatten(point), Closed=False)

# ---- group: Output
curve_4 = Curve(polyline)

# ---- group: Output / Cluster Output
curve_5 = ClusterOutput(curve_4)

# ==== cluster Cluster
planes = ClusterInput()
flip = ClusterInput()
stream_gate = StreamGate(Stream=planes, Gate=flip)  # -> Target0, Target1
rotate = ClusterInput()
flip_plane = FlipPlane(Plane=stream_gate.Target1, ReverseX=False, ReverseY=False, SwapAxes=True)
split = ClusterInput()
stream_gate_2 = StreamGate(Stream=[stream_gate.Target0, flip_plane], Gate=rotate)  # -> Target0, Target1
rotate_2 = Rotate(Geometry=stream_gate_2.Target1, Angle=degrees(Slider(180, range=0..1000)), Plane=stream_gate_2.Target1)  # -> Geometry, Transform
stream_gate_3 = StreamGate(Stream=[stream_gate_2.Target0, rotate_2.Geometry], Gate=split)  # -> Target0, Target1
last_index = LastIndex(List=stream_gate_3.Target1)
split_list = SplitList(List=stream_gate_3.Target1, Index=expr("x/2", last_index))  # -> ListA, ListB
last_index_2 = LastIndex(List=split_list.ListB)
last_index_3 = LastIndex(List=[stream_gate_3.Target0, split_list.ListA])
list_item = ListItem(List=split_list.ListB, Index=last_index_2, Wrap=True)
list_item_2 = ListItem(List=[stream_gate_3.Target0, split_list.ListA], Index=last_index_3, Wrap=True)
number_slider = Slider(75, range=0..100)
unit_z = UnitZ(Factor=number_slider)
unit_z_2 = UnitZ(Factor=number_slider)
move = Move(Geometry=list_item_2, Motion=unit_z)  # -> Geometry, Transform
move_2 = Move(Geometry=list_item, Motion=unit_z_2)  # -> Geometry, Transform

merge = Merge(Data1=[stream_gate_3.Target0, split_list.ListA], Data2=move.Geometry)
planes_1 = ClusterOutput(merge)

merge_2 = Merge(Data1=list_item_2, Data2=split_list.ListB, Data3=move_2.Geometry)
planes_2 = ClusterOutput(merge_2)

# ==== cluster RoundAndEven: round a number to the nearest even number
number = ClusterInput()  # input number to round and even
modulus = Modulus(A=number, B=2)
larger_than = LargerThan(FirstNumber=modulus, SecondNumber=1)  # -> LargerThan, OrEqualTo
subtraction = Subtraction(A=2, B=modulus)
addition = Addition(A=number, B=subtraction)
subtraction_2 = Subtraction(A=number, B=modulus)
stream_filter = StreamFilter(Gate=larger_than.LargerThan, Stream0=subtraction_2, Stream1=addition)
number_2 = ClusterOutput(stream_filter)  # rounded even number

# ==== cluster BoundingSize: calculate x, y & z dimensions of input geometry
geometry = ClusterInput()
bounding_box = BoundingBox(Content=geometry, Plane=PlaneXY(0, 0, 0))  # -> Box, Box_2
deconstruct_box = DeconstructBox(Box=bounding_box.Box)  # -> Plane, X, Y, Z
number = Number(deconstruct_box.X)
number_2 = Number(deconstruct_box.Y)
number_3 = Number(deconstruct_box.Z)
x = ClusterOutput(number)
y = ClusterOutput(number_2)
z = ClusterOutput(number_3)

# ==== cluster MoveEndpoints

# ---- group: Cluster Input
planes = ClusterInput()

endpoints_move_mm = ClusterInput()

# ---- group: Move Up First and Last Point
plane = Plane(planes)

list_item = ListItem(List=plane, Index=Slider(-1, range=-1..1), Wrap=True)
unit_z = UnitZ(Factor=endpoints_move_mm)
move = Move(Geometry=list_item, Motion=unit_z)  # -> Geometry, Transform

list_item_2 = ListItem(List=plane, Index=0, Wrap=True)
unit_z_2 = UnitZ(Factor=endpoints_move_mm)
move_2 = Move(Geometry=list_item_2, Motion=unit_z_2)  # -> Geometry, Transform

merge = Merge(Data1=move_2.Geometry, Data2=plane, Data3=move.Geometry)  # -> flatten(Result)

# ---- group: Cluster Output
planes_2 = ClusterOutput(merge)
