# Grasshopper definition Bottom line Tests.gh (Grasshopper 1.0.8)
# plug-ins: LARGERslicer, Nautilus

number_slider = Slider(0, range=0..10)
number_slider_2 = Slider(0.01, range=0..0.01)
number_slider_3 = Slider(83, range=0..100)
number_slider_4 = Slider(5, range=0..10)
number_slider_5 = Slider(27, range=0..100)
curve = Curve(<curve referenced from the Rhino model>)
number_slider_6 = Slider(3, range=0..10)
number_slider_7 = Slider(2, range=0..10)
infill_spiral = InfillSpiral(Curve=curve, LineSpacing=2, BoundaryOffset=Slider(2, range=0..10), Clockwise=True, MinRadius=0)  # -> Path, Segments, PathPoints, Stats
infill_lines = InfillLines(Curve=curve, LineSpacing=2, BoundaryOffset=0, Angle=number_slider_5, OptimizeOrder=True)  # -> Path, Segments, PathPoints, Stats
infill_grid = InfillGrid(Curve=curve, LineSpacing=2, BoundaryOffset=0, SpacingY=2, Angle=number_slider_5, StartLeft=True)  # -> Path, Segments, PathPoints, Stats
infill_fermat_spirals = InfillFermatSpirals(Curve=curve, LineSpacing=2, BoundaryOffset=0, MinRadius=0.5, MaxRegionSize=50, SubdivideRegions=True)  # -> Path, Segments, PathPoints, Stats
infill_contour = InfillContour(Curve=curve, LineSpacing=number_slider_7, BoundaryOffset=number_slider_7, RandomBridges=True, BridgeDensity=0.3)  # -> Path, Segments, PathPoints, Stats
infill_hilbert = InfillHilbert(Curve=curve, LineSpacing=2, BoundaryOffset=0, Order=4)  # -> Path, Segments, PathPoints, Stats
continuous_infill = ContinuousInfill(
    Boundary=curve,
    Spacing=Slider(4.5, range=0.1..10),
    BoundaryOffset=0,
    HandleUndercuts=False,
    UseArcWelder=False,
    ArcTolerance=0.1,
    MinArcRadius=0.1)  # -> Path, Segments, Points, Info
continuous_toolpath = ContinuousToolpath(
    Curve=curve,
    LineSpacing=2,
    BoundaryOffset=number_slider_7,
    RandomBridges=True,
    BridgeDensity=Slider(2, range=0..10),
    HandleUndercuts=False)  # -> Path, Segments, PathPoints, Stats
eulerian_path = EulerianPath(
    Boundary=curve,
    PatternType=Slider(0, range=0..10),
    LineSpacing=2,
    Angle=0,
    Tolerance=0.01,
    AddBridges=False,
    FixOverlaps=False,
    OverlapOffset=Slider(3, range=0..10))  # -> Path, PatternSegments, Bridges, Duplicates, Info
infill_fermat_spirals_2 = InfillFermatSpirals(Curve=curve, LineSpacing=2, BoundaryOffset=0, MinRadius=0.5, MaxRegionSize=50, SubdivideRegions=False)  # -> Path, Segments, PathPoints, Stats
continuous_path_from_boundary = ContinuousPathFromBoundary(Curve=curve, LineSpacing=2, BoundaryOffset=0, Angle=0, RandomBridges=True, BridgeDensity=0.3)  # -> Path, Segments, PathPoints, Stats
curve_2 = Curve(<curve referenced from the Rhino model>)
continuous_path_from_boundary_2 = ContinuousPathFromBoundary(Curve=curve_2, LineSpacing=5, BoundaryOffset=0, Angle=0, RandomBridges=True, BridgeDensity=0.3)  # -> Path, Segments, PathPoints, Stats
infill_euler_transformation = InfillEulerTransformation(Curve=curve_2, LineSpacing=5, BoundaryOffset=0, OffsetDistance=2.5, PatchOddVertices=False, UseConcentricTraversal=False)  # -> Path, Segments, PathPoints, Stats
suppress_self_intersections = SuppressSelfIntersections(Curve=infill_spiral.Path, Tolerance=0.01, SplitSegments=False)  # -> HealedCurves, Intersections, Info
infill_spiral_2 = InfillSpiral(Curve=curve_2, LineSpacing=5, BoundaryOffset=0, Clockwise=True, MinRadius=0)  # -> Path, Segments, PathPoints, Stats
optimized_toolpath = OptimizedToolpath(
    Curves=curve_2,
    StartPoint=Point(0, 0, 0),
    Spacing=Slider(2, range=0..10),
    RemoveSelfIntersections=False,
    OptimizeOrder=False,
    AddConnections=False,
    MaxGapDistance=Slider(5, range=0..10))  # -> OptimizedPath, Connections, Info
curve_3 = Curve(infill_euler_transformation.Path)
curve_4 = Curve(infill_spiral_2.Path)
infill_spiral_3 = InfillSpiral(Curve=curve_2, LineSpacing=5, BoundaryOffset=0, Clockwise=True, MinRadius=0)  # -> Path, Segments, PathPoints, Stats
infill_spiral_4 = InfillSpiral(LineSpacing=5, BoundaryOffset=0, Clockwise=True, MinRadius=0)  # -> Path, Segments, PathPoints, Stats
curve_5 = Curve([<curve referenced from the Rhino model> x7])
bridge_curves = BridgeCurves(Curves=curve_5, BridgeDensity=0.3, BridgeLength=10, Random=True, Seed=42)  # -> Path, Bridges, OriginalCurves, Info
align_curves = AlignCurves(Curves=curve_5, ReferenceIndex=0, Reverse=False)  # -> AlignedCurves, Flipped, Info
alternate_curves = AlternateCurves(Curves=curve_5, StartLeft=False, GroupSize=1)  # -> AlternatedCurves, Flipped, Info
join_open_contours = JoinOpenContours(Contours=alternate_curves.AlternatedCurves, Tolerance=0.01, OptimizeOrder=True, TransitionType=0)  # -> Path, Contours, Transitions, Info
single_line_fill_with_zigzags = SingleLineFillWithZigzags(
    PrintWidth=1,
    RelativeBridgeWidth=0.5,
    PatternLengthFactor=2,
    PatternHeightFactor=1,
    UseBorderCurves=True,
    SmoothFactor=0,
    RelativeSearchDistance=1.1,
    Tolerance=0.1,
    ParallelCalculation=True)  # -> Polylines, Planes, PatternsClosed, PatternsOpened, Bridges, SingleLineFill
single_line_fill_with_sinus = SingleLineFillWithSinus(
    PrintWidth=1,
    RelativeBridgeWidth=0.5,
    PatternLengthFactor=2,
    PatternHeightFactor=1,
    UseBorderCurves=True,
    SmoothFactor=0,
    RelativeSearchDistance=1.1,
    Tolerance=0.1,
    ParallelCalculation=True)  # -> Polylines, Planes, PatternsClosed, PatternsOpened, Bridges, SingleLineFill
single_path_fill_with_lines = SinglePathFillWithLines(
    PrintWidth=1,
    RelativeBridgeWidth=0.5,
    UseBorderCurves=True,
    SmoothFactor=0,
    RelativeSearchDistance=1.1,
    Tolerance=0.1,
    ParallelCalculation=True)  # -> Polylines, Planes, PatternsClosed, PatternsOpened, Bridges, SingleLineFill
single_line_fill_with_spiral = SingleLineFillWithSpiral(
    PrintWidth=1,
    RelativeBridgeWidth=0.5,
    UseBorderCurves=True,
    SmoothFactor=0,
    RelativeSearchDistance=1.1,
    Tolerance=0.1,
    ParallelCalculation=True)  # -> Polylines, Planes, PatternsClosed, PatternsOpened, Bridges, SingleLineFill
panel = Panel(bridge_curves.Info)
single_line_fill_with_offsets = SingleLineFillWithOffsets(
    PrintWidth=1,
    RelativeBridgeWidth=0.5,
    SmoothFactor=0,
    RelativeSearchDistance=1.1,
    Tolerance=0.1,
    ParallelCalculation=True)  # -> Polylines, Planes, SingleLineFill
single_line_fill_with_hexagons = SingleLineFillWithHexagons(
    HexagonSize=10,
    HexagonAngle=30,
    PrintWidth=1,
    RelativeBridgeWidth=0.5,
    UseBorderCurves=True,
    RelativeSearchDistance=1.1,
    Tolerance=0.1,
    Parallel_Calculation=True)  # -> Polylines, Planes, PatternsClosed, PatternsOpened, Bridges, SingleLineFill
bridge_curves_2 = BridgeCurves(Plane=PlaneXY(0, 0, 0), BridgeWidth=1, Factor=1.1, Tolerance=0.1, Recursive=False)  # -> SingleLineFill, Bridges
suppress_self_intersections_2 = SuppressSelfIntersections(Distance=0.1, Tolerance=0.01, MaxNumberOfRecursion=1000)
join_with_a_shift_closed_curves_stacked = JoinWithAShiftClosedCurvesStacked(DeparturePoint=Point(0, 0, 0), Gap=0.1, Shift=0.1, Tolerance=0.01)
join_closed_curves_stacked = JoinClosedCurvesStacked(DeparturePoint=Point(0, 0, 0), Gap=0.1, Tolerance=0.01)
