# Grasshopper definition ZündHGPL PLT MSA.gh (Grasshopper 1.0.8)

links_starten = BooleanToggle(False)
abtastschritte = Slider(1, range=0..10)
erweiterung_der_bounding_box = Slider(1, range=0..1)
rasterpitch = Slider(0.6, range=0..1)

tool = ValueList({"Fräser": 31}, selected="Fräser")
vacuum = BooleanToggle(False)
underlay = BooleanToggle(False)
vorschub_mm_s = Slider(7, range=0..100)
eilgang_mm_s = Slider(100, range=0..100)
sicherheitsabstand = Slider(0, range=0..10)

plt_schreiben = BooleanToggle(True)
geometry = Geometry(<brep referenced from the Rhino model>)
header_mode = ValueList({"Simple": SIMPLE, "Extended": EXTENDED}, selected="Simple")
python_3_script = Python3Script(
    Geo=geometry,
    dx=abtastschritte,
    dy=rasterpitch,
    Margin=erweiterung_der_bounding_box,
    StartLeft=links_starten,
    MakePLT=plt_schreiben,
    VW=vorschub_mm_s,
    VF=eilgang_mm_s,
    Zup=sicherheitsabstand,
    Tool=tool,
    Vacuum=vacuum,
    Underlay=underlay,
    HeaderMode=header_mode)  # -> out, Path, Segments, PLT, Stats; inputs Geo: Mesh
# ---------- python_3_script: Python ----------
# Boustrophedon-Toolpath + Zünd-PLT (VS/VU, SIMPLE/EXTENDED Header) — GhPython
# Inputs:
#   Geo, dx, dy, Margin, StartLeft, MakePLT,
#   VW(mm/s, VS), VF(mm/s, VU), Zup(mm), Tool, Vacuum, Underlay, HeaderMode("SIMPLE"/"EXTENDED")
# Outputs:
#   Path(Curve), Segments(List<Curve>), PLT(string), Stats(string)
#
# SIMPLE  Header/Trailer (wie Sample):
#   PB2,1;
#   ZT1;MA;
#   VS<mm/s>;
#   VU<mm/s>;
#
#   PU..., MW..., ...
#
#   ZT0;
#   PU250000,0;
#   PB2,0;
#
# EXTENDED fügt SP/XX/ZP/AS-Schalter hinzu.

import Rhino
import Rhino.Geometry as rg

# ---------- Helpers ----------
def UU(mm):
    """mm -> 1/100 mm (Zünd Units)"""
    return int(round(float(mm) * 100.0))

def ensure_mesh(geo):
    """Geo (Mesh/Brep/Surface) -> sauberes Mesh"""
    if isinstance(geo, rg.Mesh):
        m = geo.DuplicateMesh()
        m.UnifyNormals(); m.Normals.ComputeNormals()
        return m
    if isinstance(geo, (rg.Brep, rg.Extrusion)):
        meshes = rg.Mesh.CreateFromBrep(geo, rg.MeshingParameters.QualityRenderMesh)
        if not meshes: return None
        m = rg.Mesh()
        for x in meshes: m.Append(x)
        m.UnifyNormals(); m.Normals.ComputeNormals()
        return m
    if isinstance(geo, rg.Surface):
        return ensure_mesh(geo.ToBrep())
    return None

def z_at_xy_mesh(mesh, x, y, zmin, zmax):
    """Vertikale Linie durch (x,y), nimm höchsten Schnittpunkt als Z"""
    a = rg.Point3d(x, y, zmax + 1.0)
    b = rg.Point3d(x, y, zmin - 1.0)
    line = rg.Line(a, b)
    pts = Rhino.Geometry.Intersect.Intersection.MeshLine(mesh, line)
    if pts and len(pts) > 0:
        return max(pts, key=lambda P: P.Z).Z
    return None

def boustrophedon_path(mesh, bbox, dx, dy, start_left=True):
    """
    Scanlinien in Y, pro Linie X-Samples; Z via Mesh-Sampling.
    Verbinder am Rand zwischen den Linien (Z neu gesampelt).
    """
    xmin, xmax = bbox.Min.X, bbox.Max.X
    ymin, ymax = bbox.Min.Y, bbox.Max.Y
    zmin, zmax = bbox.Min.Z, bbox.Max.Z

    dx = max(float(dx), 1e-6)
    dy = max(float(dy), 1e-6)

    # Y-Reihen
    y_vals, y = [], ymin
    while y <= ymax + 1e-9:
        y_vals.append(y)
        y += dy

    segments = []   # Liste: [ [Point3d,...], ... ]
    for row, yy in enumerate(y_vals):
        # X-Samples
        xs, x = [], xmin
        while x <= xmax + 1e-9:
            xs.append(x)
            x += dx
        # Boustrophedon-Richtung
        fwd = (start_left and (row % 2 == 0)) or ((not start_left) and (row % 2 == 1))
        Xseq = xs if fwd else list(reversed(xs))

        pts = []
        for xx in Xseq:
            z = z_at_xy_mesh(mesh, xx, yy, zmin, zmax)
            if z is None:
                if len(pts) >= 2:
                    segments.append(pts)
                pts = []
                continue
            pts.append(rg.Point3d(xx, yy, z))
        if len(pts) >= 2:
            segments.append(pts)

    # Segmente zu einer durchgehenden Punktliste verbinden
    path_pts = []
    for i, seg in enumerate(segments):
        if i == 0:
            path_pts.extend(seg)
            continue
        prev = path_pts[-1]
        first = seg[0]
        # Verbinder entlang Y am Rand-X = first.X
        dy_abs = abs(first.Y - prev.Y)
        steps = max(int(dy_abs / max(dx, 1e-6)), 1)
        for t in range(1, steps + 1):
            tt = float(t) / steps
            xi = first.X
            yi = prev.Y + tt * (first.Y - prev.Y)
            zi = z_at_xy_mesh(mesh, xi, yi, zmin, zmax)
            if zi is None:
                zi = prev.Z
            path_pts.append(rg.Point3d(xi, yi, zi))
        path_pts.extend(seg)

    return segments, path_pts

def build_PLT_from_path(path_pts,
                        feed_mm_s,   # VS (mm/s)
                        rapid_mm_s,  # VU (mm/s)
                        zup_mm,
                        tool,        # SPxx optional (nur EXTENDED)
                        vacuum,      # PB9 optional (nur EXTENDED)
                        underlay,    # XX308 optional (nur EXTENDED)
                        park_xy_mm=(2500.0, 0.0),  # Park: PU250000,0
                        mode="SIMPLE"):
    """
    SIMPLE:
      PB2,1; ZT1;MA; VS..; VU..; (leerzeile)
      PU...; MW...; MW...; ...
      ZT0; PU<Park>; PB2,0;
    EXTENDED: wie SIMPLE + SP/XX/ZP/AS/XX-Schalter
    """
    VS = float(feed_mm_s)
    VU = float(rapid_mm_s)

    lines = []
    # --- Header (Sample-kompatibel) ---
    lines.append("PB2,1;")
    lines.append("ZT1;MA;")
    lines.append("VS{:.6g};".format(VS))   # Vorschub (mm/s)
    lines.append("VU{:.6g};".format(VU))   # Eilgang (mm/s)
    lines.append("")                       # Leerzeile wie im Sample (optional)

    if mode and str(mode).upper() == "EXTENDED":
        if vacuum:   lines.append("PB9,1;")      # Vakuum EIN
        if underlay: lines.append("XX308,1;")    # Unterlage EIN
        if int(tool) > 0:
            lines.append("SP%d;" % int(tool))    # Werkzeug wählen
        lines.append("XX62;")                    # Continuous Path
        lines.append("ZP%d,%d;" % (UU(zup_mm), 0))
        lines.append("XX81;")
        lines.append("AS2,4;")
        lines.append("XX82;")

    # --- Pfad ---
    if not path_pts:
        lines.append("ZT0;")
        if park_xy_mm is not None:
            lines.append("PU%d,%d;" % (UU(park_xy_mm[0]), UU(park_xy_mm[1])))
        lines.append("PB2,0;")
        return "\n".join(lines)

    p0 = path_pts[0]
    lines.append("PU%d,%d;" % (UU(p0.X), UU(p0.Y)))
    # Sample beginnt direkt mit MW (Zustellen), kein MF erforderlich
    lines.append("MW%d,%d,%d;" % (UU(p0.X), UU(p0.Y), UU(p0.Z)))

    for p in path_pts[1:]:
        lines.append("MW%d,%d,%d;" % (UU(p.X), UU(p.Y), UU(p.Z)))

    # --- Trailer ---
    # Kein künstliches Absenken mehr! (kein MW ... , -318)
    lines.append("ZT0;")
    if park_xy_mm is not None:
        lines.append("PU%d,%d;" % (UU(park_xy_mm[0]), UU(park_xy_mm[1])))
    lines.append("PB2,0;")

    return "\n".join(lines)

# ---------- MAIN ----------
mesh = ensure_mesh(Geo)
if mesh is None:
    Path = None
    Segments = []
    PLT = ""
    Stats = "ERROR: Geo konnte nicht zu Mesh konvertiert werden."
else:
    # Arbeitsbereich + Margin
    bb = mesh.GetBoundingBox(True)
    bb.Inflate(float(Margin), float(Margin), 0.0)

    # Pfad erzeugen
    segs, pts = boustrophedon_path(mesh, bb, dx, dy, bool(StartLeft))

    # Geometrie-Outputs
    Segments = [rg.PolylineCurve(rg.Polyline(s)) for s in segs if len(s) >= 2]
    Path = rg.PolylineCurve(rg.Polyline(pts)) if len(pts) >= 2 else None

    total_len = sum([rg.Polyline(s).Length for s in segs]) if segs else 0.0
    Stats = "Segments=%d | Points=%d | Length=%.2f mm | dx=%.3f, dy=%.3f | VS=%.3f mm/s, VU=%.3f mm/s | Mode=%s" % (
        len(segs), len(pts), total_len, float(dx), float(dy), float(VW), float(VF), str(HeaderMode)
    )

    # PLT erzeugen (VS/VU = mm/s)
    if bool(MakePLT):
        park_xy = (2500.0, 0.0)  # PU250000,0 wie im Sample
        PLT = build_PLT_from_path(
            path_pts=pts,
            feed_mm_s=float(VW),   # VS
            rapid_mm_s=float(VF),  # VU
            zup_mm=float(Zup),
            tool=int(Tool),
            vacuum=bool(Vacuum),
            underlay=bool(Underlay),
            park_xy_mm=park_xy,
            mode=str(HeaderMode)
        )
    else:
        PLT = ""
# ---------- end python_3_script ----------
panel = Panel(python_3_script.PLT)

# ----
# Sehr gern – hier eine kompakte Dokumentation, die du dir als Panel oder Scribble neben die GhPython-Komponente hängen kannst.
# Sie erklärt Inputs, Outputs, Workflow und Tipps für den Zünd-Export.
# 
# ⸻
# 
# 📄 Dokumentation – Boustrophedon Toolpath Generator (GhPython)
# 
# Funktion:
# Erzeugt einen durchgehenden Werkzeugpfad im „Boustrophedon“-Muster (links ↔ rechts ↔ links …).
# Die XY-Linien laufen gerade durch, die Z-Höhe wird direkt aus der Geometrie gesampelt.
# Optional wird eine Zünd-PLT-Datei mit PU / MF / MW Befehlen erstellt.
# 
# ⸻
# 
# 🔹 Inputs
# 	•	Geo (Mesh/Brep/Surface) → Geometrie, die gefräst werden soll
# 	•	dx (Number) → Abtastschritt in X (mm), z. B. 0.5
# 	•	dy (Number) → Rasterpitch in Y (mm), z. B. 1.5
# 	•	Margin (Number) → Erweiterung der BoundingBox (mm), z. B. 2.0
# 	•	StartLeft (Bool) → True = erste Bahn von links nach rechts, False = umgekehrt
# 	•	MakePLT (Bool) → True = erzeugt Zünd-PLT-Code
# 	•	VW (Number) → Vorschub (cm/s) für Arbeitsbewegungen
# 	•	VF (Number) → Vorschub (cm/s) für Eilgang
# 	•	Zup (Number) → Sicherheits-Z in mm (z. B. 10)
# 	•	Tool (Int) → Werkzeugnummer (z. B. 31 für Fräser)
# 	•	Vacuum (Bool) → Absaugung ein/aus (PB9,1)
# 	•	Underlay (Bool) → Unterlage an/aus (XX308,1)
# 
# ⸻
# 
# 🔹 Outputs
# 	•	Path (Curve) → eine durchgehende PolylineCurve (gesamter Fräspfad)
# 	•	Segments (List) → Einzelsegmente (jede Scanline) zur Kontrolle
# 	•	PLT (String) → kompletter Zünd-PLT-Text (kann direkt gespeichert oder gesendet werden)
# 	•	Stats (String) → Info: Anzahl Segmente, Punkte, Gesamtlänge, aktuelle Parameter
# 
# ⸻
# 
# 🔹 Workflow
# 	1.	Geometrie (Mesh oder Surface/Brep) an Geo anschließen.
# 	2.	dx und dy einstellen (abhängig vom Werkzeugdurchmesser, dy ≈ 40–60 % vom Fräser-Ø).
# 	3.	Mit Path und Segments visuell kontrollieren, ob der Pfad korrekt ist.
# 	4.	Bei MakePLT = True werden Header/Trailer + Bewegungen als PLT-Text ausgegeben.
# 	•	PLT in eine .plt-Datei speichern oder per TCP an die Zünd senden.
# 
# ⸻
# 
# 🔹 Tipps
# 	•	Einheiten: Alles in mm; PLT wird automatisch in 1/100 mm umgerechnet.
# 	•	dx kleiner → glattere Z-Abtastung, aber größere Dateigröße.
# 	•	dy kleiner → dichteres Raster, bessere Oberflächenqualität, aber längere Fräszeit.
# 	•	Margin sorgt dafür, dass der Pfad sicher etwas übersteht.
# 	•	Für Reliefs/Texturen funktioniert das Verfahren gut, für steile Wände ggf. nachbearbeiten.
# 
# ⸻
# 
# 👉 Soll ich dir zusätzlich noch eine kleine Beispiel-Definition (.gh) bauen, wo ein Mesh + Parameter angeschlossen sind, sodass du sofort einen Pfad und PLT bekommst?
number_slider = Slider(31, range=0..100)
panel_2 = Panel("""%
(Quadrat-Testprogramm für Zünd-Interpreter)
G21         ; Einheiten in mm
G90         ; Absolutmodus
G17         ; XY-Ebene

T31 M6      ; Werkzeug 31 auswählen (z. B. Fräser)
S18000 M3   ; Spindel an mit 18000 U/min

F1200       ; Vorschub 1200 mm/min
G0 Z5       ; Rapid hoch auf Sicherheits-Z
G0 X10 Y10  ; Rapid zum Startpunkt

G1 Z-2 F300 ; Zustellen 2 mm tief
G1 X50 Y10  ; Kante 1
G1 X50 Y50  ; Kante 2
G1 X10 Y50  ; Kante 3
G1 X10 Y10  ; Kante 4

G0 Z5       ; Abheben

M5          ; Spindel aus
M30         ; Programmende""")
panel_3 = Panel("""PB2,1;
ZT1;MA;
VS7;
VU100;

PU2607,27470;
MW2607,27470,688;
MW2607,27094,633;
MW2607,26840,606;
MW2607,26535,588;
MW2607,26027,582;
MW2607,25417,582;
MW2607,25163,582;
MW2607,24757,595;
MW2607,24401,627;
MW2607,24046,681;
MW2607,23741,744;
MW2607,23436,824;
MW2607,23030,954;
MW2607,21963,1334;
MW2607,21556,1458;
MW2607,21201,1544;
MW2607,20845,1607;
MW2607,20540,1643;
MW2607,20388,1635;
MW2607,20032,1587;
MW2607,19677,1518;
MW2607,19321,1427;
MW2607,18915,1297;
MW2607,17950,946;
MW2607,17696,861;
MW2607,17391,773;
MW2607,17086,703;
MW2607,16781,650;
MW2607,16426,608;
MW2607,16070,587;
MW2607,15511,581;
MW2607,14597,582;
MW2607,14190,595;
MW2607,13886,623;
MW2607,13581,670;
MW2607,13327,725;
MW2607,13022,810;
MW2607,12717,915;
MW2607,11803,1272;
MW2607,11447,1394;
MW2607,11142,1480;
MW2607,10787,1558;
MW2607,10482,1608;
MW2607,10126,1646;
MW2607,10025,1651;
MW2607,9720,1625;
MW2607,9364,1574;
MW2607,9009,1499;
MW2607,8704,1414;
MW2607,8399,1309;
MW2607,7536,967;
MW2607,7282,875;
MW2607,6977,784;
MW2607,6672,712;
MW2607,6367,658;
MW2607,6012,617;
MW2607,5656,592;
MW2607,5250,582;
MW2607,4234,582;
MW2607,4030,590;
MW2607,3827,609;
MW2607,3573,650;
MW2607,3268,716;
MW2607,2916,812;
MW2621,2863,819;
MW2636,2817,826;
MW2667,2727,838;
MW2667,3167,718;
MW2667,3522,641;
MW2667,3827,598;
MW2667,4081,583;
MW2667,5300,584;
MW2667,5707,600;
MW2667,6062,631;
MW2667,6367,674;
MW2667,6672,733;
MW2667,6977,811;
MW2667,7282,908;
MW2667,7688,1063;
MW2667,8348,1326;
MW2667,8653,1428;
MW2667,8958,1510;
MW2667,9263,1573;
MW2667,9618,1624;
MW2667,9872,1649;
MW2667,9974,1650;
MW2667,10228,1627;
MW2667,10533,1585;
MW2667,10838,1529;
MW2667,11142,1455;
MW2667,11447,1363;
MW2667,11803,1236;
MW2667,12666,898;
MW2667,13022,781;
MW2667,13327,703;
MW2667,13581,653;
MW2667,13886,613;
MW2667,14190,590;
MW2667,14597,581;
MW2667,15664,582;
MW2667,16121,594;
MW2667,16476,623;
MW2667,16781,665;
MW2667,17086,723;
MW2667,17391,799;
MW2667,17746,909;
MW2667,18305,1110;
MW2667,18915,1330;
MW2667,19270,1439;
MW2667,19626,1528;
MW2667,19931,1586;
MW2667,20286,1635;
MW2667,20439,1643;
MW2667,20642,1621;
MW2667,20896,1583;
MW2667,21201,1522;
MW2667,21506,1445;
MW2667,21861,1336;
MW2667,23080,904;
MW2667,23436,797;
MW2667,23741,722;
MW2667,24046,664;
MW2667,24401,617;
MW2667,24757,591;
MW2667,25112,582;
MW2667,25519,582;
MW2667,26078,582;
MW2667,26535,592;
MW2667,26890,620;
MW2667,27246,669;
MW2667,27470,711;
MW2727,27470,726;
MW2727,27043,651;
MW2727,26687,609;
MW2727,26332,587;
MW2727,25773,582;
MW2727,25366,582;
MW2727,24960,582;
MW2727,24554,596;
MW2727,24198,628;
MW2727,23893,673;
MW2727,23588,734;
MW2727,23233,827;
MW2727,22826,957;
MW2727,21760,1338;
MW2727,21353,1461;
MW2727,20998,1546;
MW2727,20642,1609;
MW2727,20388,1640;
MW2727,20286,1642;
MW2727,20032,1616;
MW2727,19728,1568;
MW2727,19423,1504;
MW2727,19067,1408;
MW2727,18712,1293;
MW2727,17746,943;
MW2727,17442,843;
MW2727,17137,758;
MW2727,16832,691;
MW2727,16527,641;
MW2727,16222,607;
MW2727,15867,587;
MW2727,15308,581;
MW2727,14444,581;
MW2727,14038,593;
MW2727,13682,625;
MW2727,13378,672;
MW2727,13124,727;
MW2727,12819,814;
MW2727,12514,918;
MW2727,11600,1276;
MW2727,11244,1397;
MW2727,10939,1483;
MW2727,10584,1560;
MW2727,10279,1609;
MW2727,9923,1647;
MW2727,9771,1649;
MW2727,9415,1611;
MW2727,9060,1553;
MW2727,8755,1483;
MW2727,8501,1410;
MW2727,8145,1286;
MW2727,7383,982;
MW2727,7078,872;
MW2727,6774,781;
MW2727,6469,710;
MW2727,6164,657;
MW2727,5808,616;
MW2727,5453,592;
MW2727,5046,582;
MW2727,4030,582;
MW2727,3827,591;
MW2727,3624,611;
MW2727,3370,652;
MW2727,3065,719;
MW2727,2659,830;
MW2727,2608,845;
MW2727,2586,852;
MW2787,2470,858;
MW2787,2811,761;
MW2787,3116,685;
MW2787,3370,634;
MW2787,3624,599;
MW2787,3878,583;
MW2787,5097,583;
MW2787,5504,599;
MW2787,5859,630;
MW2787,6164,672;
MW2787,6469,730;
MW2787,6774,807;
MW2787,7078,904;
MW2787,7485,1059;
MW2787,8145,1322;
MW2787,8450,1425;
MW2787,8755,1508;
MW2787,9060,1571;
MW2787,9415,1623;
MW2787,9720,1651;
MW2787,9923,1639;
MW2787,10279,1596;
MW2787,10584,1542;
MW2787,10888,1472;
MW2787,11244,1367;
MW2787,11600,1240;
MW2787,12514,883;
MW2787,12819,784;
MW2787,13124,705;
MW2787,13378,655;
MW2787,13682,614;
MW2787,13987,590;
MW2787,14394,581;
MW2787,15460,581;
MW2787,15918,593;
MW2787,16222,616;
MW2787,16578,663;
MW2787,16883,721;
MW2787,17188,796;
MW2787,17543,905;
MW2787,18102,1106;
MW2787,18712,1326;
MW2787,19067,1437;
MW2787,19423,1526;
MW2787,19728,1585;
MW2787,20083,1633;
MW2787,20236,1644;
MW2787,20439,1623;
MW2787,20693,1585;
MW2787,20998,1525;
MW2787,21302,1449;
MW2787,21658,1340;
MW2787,22877,907;
MW2787,23233,800;
MW2787,23588,714;
MW2787,23893,657;
MW2787,24198,618;
MW2787,24503,593;
MW2787,24909,582;
MW2787,25925,582;
MW2787,26332,591;
MW2787,26687,618;
MW2787,26992,658;
MW2787,27348,725;
MW2787,27470,753;
MW2822,27470,767;
MW2847,27470,771;
MW2847,27348,747;
MW2847,27144,702;
MW2847,26840,649;
MW2847,26535,612;
MW2847,26179,588;
MW2847,25671,582;
MW2847,24757,582;
MW2847,24350,596;
MW2847,23995,630;
MW2847,23690,675;
MW2847,23385,737;
MW2847,23080,815;
MW2847,22674,943;
MW2847,21556,1342;
MW2847,21150,1464;
MW2847,20794,1548;
MW2847,20490,1603;
MW2847,20185,1642;
MW2847,20083,1643;
MW2847,19829,1614;
MW2847,19524,1566;
MW2847,19220,1501;
MW2847,18915,1421;
MW2847,18559,1308;
MW2847,17594,957;
MW2847,17340,870;
MW2847,16984,768;
MW2847,16680,698;
MW2847,16375,646;
MW2847,16070,610;
MW2847,15714,588;
MW2847,15206,581;
MW2847,14241,581;
MW2847,13835,593;
MW2847,13479,626;
MW2847,13225,665;
MW2847,12971,717;
MW2847,12666,801;
MW2847,12311,923;
MW2847,11396,1280;
MW2847,11041,1401;
MW2847,10736,1486;
MW2847,10431,1553;
MW2847,10126,1604;
MW2847,9771,1644;
MW2847,9618,1652;
MW2847,9212,1610;
MW2847,8907,1561;
MW2847,8602,1494;
MW2847,8298,1407;
MW2847,7993,1302;
MW2847,7180,978;
MW2847,6926,884;
MW2847,6621,791;
MW2847,6316,717;
MW2847,6012,662;
MW2847,5656,619;
MW2847,5300,593;
MW2847,4894,582;
MW2847,3827,582;
MW2847,3573,595;
MW2847,3268,635;
MW2847,2913,709;
MW2847,2456,833;
MW2847,2371,859;
MW2907,2284,850;
MW2907,2405,819;
MW2907,2862,698;
MW2907,3167,636;
MW2907,3421,600;
MW2907,3675,583;
MW2907,4945,584;
MW2907,5351,602;
MW2907,5656,629;
MW2907,6012,679;
MW2907,6316,739;
MW2907,6570,804;
MW2907,6875,900;
MW2907,7282,1055;
MW2907,7942,1318;
MW2907,8298,1437;
MW2907,8602,1517;
MW2907,8907,1578;
MW2907,9212,1622;
MW2907,9517,1651;
MW2907,9669,1645;
MW2907,10076,1597;
MW2907,10431,1533;
MW2907,10736,1460;
MW2907,11041,1370;
MW2907,11447,1225;
MW2907,12311,887;
MW2907,12666,772;
MW2907,12920,707;
MW2907,13225,649;
MW2907,13530,610;
MW2907,13835,589;
MW2907,14241,581;
MW2907,15257,581;
MW2907,15714,592;
MW2907,16070,620;
MW2907,16375,661;
MW2907,16680,718;
MW2907,16984,793;
MW2907,17340,902;
MW2907,17899,1102;
MW2907,18508,1323;
MW2907,18915,1448;
MW2907,19220,1524;
MW2907,19575,1591;
MW2907,19880,1633;
MW2907,20032,1644;
MW2907,20134,1637;
MW2907,20490,1587;
MW2907,20794,1528;
MW2907,21150,1437;
MW2907,21506,1326;
MW2907,22674,911;
MW2907,23030,803;
MW2907,23385,716;
MW2907,23690,659;
MW2907,24046,614;
MW2907,24350,591;
MW2907,24757,582;
MW2907,25366,582;
MW2907,25773,582;
MW2907,26179,593;
MW2907,26535,623;
MW2907,26840,665;
MW2907,27144,722;
MW2907,27449,796;
MW2907,27470,809;
MW2967,27470,823;
MW2967,26992,711;
MW2967,26636,648;
MW2967,26332,612;
MW2967,25976,588;
MW2967,25468,582;
MW2967,24452,584;
MW2967,24096,601;
MW2967,23792,631;
MW2967,23487,677;
MW2967,23182,740;
MW2967,22826,834;
MW2967,22471,947;
MW2967,21404,1328;
MW2967,20998,1453;
MW2967,20642,1540;
MW2967,20286,1604;
MW2967,19982,1642;
MW2967,19880,1641;
MW2967,19626,1613;
MW2967,19321,1563;
MW2967,19016,1498;
MW2967,18712,1417;
MW2967,18356,1304;
MW2967,17391,953;
MW2967,17086,852;
MW2967,16781,766;
MW2967,16476,697;
MW2967,16172,645;
MW2967,15867,610;
MW2967,15511,588;
MW2967,14952,581;
MW2967,14038,582;
MW2967,13632,594;
MW2967,13327,621;
MW2967,13022,667;
MW2967,12717,733;
MW2967,12463,804;
MW2967,12108,927;
MW2967,11193,1284;
MW2967,10838,1404;
MW2967,10533,1488;
MW2967,10228,1555;
MW2967,9872,1612;
MW2967,9517,1649;
MW2967,9415,1650;
MW2967,9060,1615;
MW2967,8704,1559;
MW2967,8399,1491;
MW2967,8094,1403;
MW2967,7790,1297;
MW2967,6977,974;
MW2967,6672,865;
MW2967,6418,789;
MW2967,6113,716;
MW2967,5808,661;
MW2967,5453,618;
MW2967,5097,593;
MW2967,4691,582;
MW2967,3573,584;
MW2967,3319,601;
MW2967,3065,637;
MW2967,2710,712;
MW2967,2303,821;
MW2967,2207,849;
MW3027,2137,838;
MW3027,2659,701;
MW3027,2964,638;
MW3027,3218,602;
MW3027,3472,584;
MW3027,4742,584;
MW3027,5148,602;
MW3027,5504,634;
MW3027,5808,677;
MW3027,6113,737;
MW3027,6418,816;
MW3027,6723,915;
MW3027,7129,1071;
MW3027,7739,1314;
MW3027,8094,1433;
MW3027,8399,1514;
MW3027,8704,1576;
MW3027,9060,1626;
MW3027,9314,1650;
MW3027,9466,1645;
MW3027,9872,1599;
MW3027,10228,1536;
MW3027,10533,1463;
MW3027,10838,1373;
MW3027,11244,1229;
MW3027,12108,891;
MW3027,12412,790;
MW3027,12717,710;
MW3027,13022,650;
MW3027,13327,611;
MW3027,13632,589;
MW3027,14038,581;
MW3027,15054,581;
MW3027,15511,592;
MW3027,15867,619;
MW3027,16222,668;
MW3027,16527,728;
MW3027,16832,805;
MW3027,17188,916;
MW3027,17746,1117;
MW3027,18356,1336;
MW3027,18712,1445;
MW3027,19067,1532;
MW3027,19372,1589;
MW3027,19728,1636;
MW3027,19829,1643;
MW3027,19982,1632;
MW3027,20286,1589;
MW3027,20591,1530;
MW3027,20947,1440;
MW3027,21302,1330;
MW3027,22471,914;
MW3027,22826,806;
MW3027,23182,718;
MW3027,23487,661;
MW3027,23842,615;
MW3027,24147,592;
MW3027,24503,582;
MW3027,24706,582;
MW3027,25519,582;
MW3027,25976,593;
MW3027,26332,622;
MW3027,26636,663;
MW3027,26992,732;
MW3027,27297,807;
MW3027,27449,851;
MW3027,27470,857;
MW3076,27470,881;
MW3087,27470,880;
MW3087,27348,850;
MW3087,27043,766;
MW3087,26738,699;
MW3087,26433,647;
MW3087,26078,607;
MW3087,25773,588;
MW3087,25265,582;
MW3087,24401,582;
MW3087,23995,595;
MW3087,23639,626;
MW3087,23284,679;
MW3087,22979,742;
MW3087,22674,821;
MW3087,22268,950;
MW3087,21201,1331;
MW3087,20794,1456;
MW3087,20439,1542;
MW3087,20083,1606;
MW3087,19778,1642;
MW3087,19677,1641;
MW3087,19423,1611;
MW3087,19118,1561;
MW3087,18813,1496;
MW3087,18508,1414;
MW3087,18153,1300;
MW3087,17188,949;
MW3087,16883,848;
MW3087,16578,763;
MW3087,16273,695;
MW3087,15968,644;
MW3087,15664,609;
MW3087,15308,587;
MW3087,14749,581;
MW3087,13886,581;
MW3087,13479,592;
MW3087,13124,622;
MW3087,12819,669;
MW3087,12565,723;
MW3087,12260,807;
MW3087,11904,931;
MW3087,10990,1288;
MW3087,10634,1407;
MW3087,10330,1491;
MW3087,10025,1557;
MW3087,9720,1607;
MW3087,9364,1646;
MW3087,9212,1650;
MW3087,8856,1614;
MW3087,8501,1557;
MW3087,8196,1488;
MW3087,7891,1400;
MW3087,7586,1293;
MW3087,6774,970;
MW3087,6469,862;
MW3087,6164,773;
MW3087,5859,704;
MW3087,5554,653;
MW3087,5250,617;
MW3087,4894,593;
MW3087,4437,582;
MW3087,3827,582;
MW3087,3522,582;
MW3087,3319,586;
MW3087,3065,608;
MW3087,2811,648;
MW3087,2506,714;
MW3087,2073,831;
MW3147,2015,820;
MW3147,2456,703;
MW3147,2811,631;
MW3147,3065,597;
MW3147,3319,582;
MW3147,4538,584;
MW3147,4945,601;
MW3147,5300,632;
MW3147,5605,675;
MW3147,5910,734;
MW3147,6164,798;
MW3147,6469,893;
MW3147,6875,1046;
MW3147,7586,1329;
MW3147,7891,1431;
MW3147,8196,1512;
MW3147,8501,1575;
MW3147,8806,1620;
MW3147,9110,1650;
MW3147,9212,1650;
MW3147,9466,1626;
MW3147,9720,1593;
MW3147,10025,1538;
MW3147,10330,1467;
MW3147,10634,1378;
MW3147,11041,1233;
MW3147,11904,894;
MW3147,12260,778;
MW3147,12514,712;
MW3147,12819,652;
MW3147,13073,617;
MW3147,13378,592;
MW3147,13784,581;
MW3147,14902,582;
MW3147,15308,591;
MW3147,15664,618;
MW3147,15968,658;
MW3147,16273,714;
MW3147,16578,787;
MW3147,16934,894;
MW3147,17492,1094;
MW3147,18153,1333;
MW3147,18508,1442;
MW3147,18813,1519;
MW3147,19169,1588;
MW3147,19474,1630;
MW3147,19626,1644;
MW3147,19728,1639;
MW3147,20083,1591;
MW3147,20388,1533;
MW3147,20744,1443;
MW3147,21099,1333;
MW3147,22268,917;
MW3147,22674,795;
MW3147,22979,720;
MW3147,23284,662;
MW3147,23588,620;
MW3147,23944,592;
MW3147,24350,582;
MW3147,25366,582;
MW3147,25773,592;
MW3147,26128,621;
MW3147,26433,661;
MW3147,26789,729;
MW3147,27094,804;
MW3147,27449,910;
MW3147,27470,917;
MW3207,27470,942;
MW3207,27398,925;
MW3207,27043,817;
MW3207,26738,740;
MW3207,26484,687;
MW3207,26230,645;
MW3207,25925,610;
MW3207,25570,588;
MW3207,25062,582;
MW3207,24198,582;
MW3207,23792,595;
MW3207,23436,627;
MW3207,23131,671;
MW3207,22826,732;
MW3207,22471,825;
MW3207,22115,936;
MW3207,20998,1335;
MW3207,20591,1459;
MW3207,20236,1544;
MW3207,19931,1600;
MW3207,19575,1644;
MW3207,19474,1640;
MW3207,19220,1610;
MW3207,18966,1569;
MW3207,18661,1506;
MW3207,18305,1411;
MW3207,17950,1296;
MW3207,17035,963;
MW3207,16730,860;
MW3207,16426,773;
MW3207,16121,702;
MW3207,15816,649;
MW3207,15460,608;
MW3207,15105,587;
MW3207,14546,581;
MW3207,13632,581;
MW3207,13225,595;
MW3207,12920,624;
MW3207,12666,661;
MW3207,12362,725;
MW3207,12108,795;
MW3207,11752,915;
MW3207,10838,1273;
MW3207,10482,1395;
MW3207,10177,1481;
MW3207,9872,1549;
MW3207,9517,1608;
MW3207,9161,1647;
MW3207,9060,1652;
MW3207,8755,1625;
MW3207,8399,1574;
MW3207,8044,1499;
MW3207,7739,1413;
MW3207,7383,1289;
MW3207,6621,985;
MW3207,6316,874;
MW3207,6012,783;
MW3207,5707,711;
MW3207,5402,658;
MW3207,5097,620;
MW3207,4742,594;
MW3207,4284,582;
MW3207,3827,582;
MW3207,3268,582;
MW3207,3065,590;
MW3207,2862,610;
MW3207,2608,650;
MW3207,2303,717;
MW3207,1962,803;
MW3267,1914,794;
MW3267,2303,694;
MW3267,2608,633;
MW3267,2862,598;
MW3267,3116,583;
MW3267,4335,584;
MW3267,4742,600;
MW3267,5097,631;
MW3267,5402,673;
MW3267,5707,732;
MW3267,6012,810;
MW3267,6316,907;
MW3267,6723,1062;
MW3267,7383,1325;
MW3267,7739,1442;
MW3267,8044,1521;
MW3267,8348,1581;
MW3267,8653,1624;
MW3267,8958,1652;
MW3267,9161,1638;
MW3267,9517,1594;
MW3267,9872,1529;
MW3267,10177,1455;
MW3267,10482,1364;
MW3267,10838,1237;
MW3267,11701,898;
MW3267,12057,781;
MW3267,12362,703;
MW3267,12616,654;
MW3267,12920,613;
MW3267,13225,590;
MW3267,13632,581;
MW3267,14698,582;
MW3267,15156,593;
MW3267,15460,617;
MW3267,15816,664;
MW3267,16121,723;
MW3267,16426,799;
MW3267,16781,908;
MW3267,17340,1109;
MW3267,17950,1329;
MW3267,18305,1439;
MW3267,18661,1528;
MW3267,18966,1586;
MW3267,19321,1635;
MW3267,19474,1643;
MW3267,19677,1621;
MW3267,19931,1584;
MW3267,20236,1523;
MW3267,20591,1431;
MW3267,20947,1319;
MW3267,22115,905;
MW3267,22471,798;
MW3267,22826,712;
MW3267,23131,656;
MW3267,23436,617;
MW3267,23792,591;
MW3267,24147,582;
MW3267,25163,582;
MW3267,25570,591;
MW3267,25925,619;
MW3267,26281,668;
MW3267,26586,727;
MW3267,26890,801;
MW3267,27297,923;
MW3267,27449,975;
MW3267,27470,989;
MW3327,27470,1008;
MW3327,27398,991;
MW3327,27043,873;
MW3327,26687,774;
MW3327,26382,704;
MW3327,26078,651;
MW3327,25722,609;
MW3327,25366,587;
MW3327,24858,582;
MW3327,24046,582;
MW3327,23639,593;
MW3327,23284,623;
MW3327,22928,674;
MW3327,22623,735;
MW3327,22268,828;
MW3327,21912,940;
MW3327,20794,1339;
MW3327,20388,1461;
MW3327,20032,1546;
MW3327,19728,1601;
MW3327,19423,1640;
MW3327,19321,1642;
MW3327,19067,1615;
MW3327,18762,1567;
MW3327,18458,1503;
MW3327,18153,1423;
MW3327,17746,1292;
MW3327,16832,960;
MW3327,16527,857;
MW3327,16222,770;
MW3327,15918,700;
MW3327,15613,648;
MW3327,15257,607;
MW3327,14902,587;
MW3327,14343,581;
MW3327,13479,581;
MW3327,13073,593;
MW3327,12717,625;
MW3327,12412,673;
MW3327,12158,728;
MW3327,11854,814;
MW3327,11549,919;
MW3327,10634,1277;
MW3327,10279,1398;
MW3327,9974,1483;
MW3327,9669,1551;
MW3327,9314,1609;
MW3327,8958,1647;
MW3327,8806,1649;
MW3327,8450,1611;
MW3327,8145,1562;
MW3327,7840,1496;
MW3327,7536,1410;
MW3327,7231,1304;
MW3327,6418,981;
MW3327,6113,871;
MW3327,5808,780;
MW3327,5504,709;
MW3327,5199,657;
MW3327,4843,616;
MW3327,4488,592;
MW3327,4081,582;
MW3327,3776,582;
MW3327,3116,582;
MW3327,2862,591;
MW3327,2659,611;
MW3327,2405,652;
MW3327,2100,720;
MW3327,1869,778;
MW3387,1828,761;
MW3387,2252,664;
MW3387,2506,619;
MW3387,2710,595;
MW3387,2913,583;
MW3387,4183,585;
MW3387,4538,599;
MW3387,4894,630;
MW3387,5199,671;
MW3387,5504,730;
MW3387,5808,807;
MW3387,6113,904;
MW3387,6520,1058;
MW3387,7180,1321;
MW3387,7536,1439;
MW3387,7840,1519;
MW3387,8145,1579;
MW3387,8450,1623;
MW3387,8755,1651;
MW3387,8907,1644;
MW3387,9314,1596;
MW3387,9669,1531;
MW3387,9974,1458;
MW3387,10279,1367;
MW3387,10634,1241;
MW3387,11498,902;
MW3387,11854,785;
MW3387,12158,705;
MW3387,12412,655;
MW3387,12717,614;
MW3387,13022,591;
MW3387,13428,581;
MW3387,14495,582;
MW3387,14952,593;
MW3387,15308,622;
MW3387,15613,663;
MW3387,15918,721;
MW3387,16222,796;
MW3387,16578,905;
MW3387,17137,1105;
MW3387,17746,1326;
MW3387,18102,1436;
MW3387,18458,1525;
MW3387,18813,1592;
MW3387,19118,1633;
MW3387,19270,1643;
MW3387,19474,1623;
MW3387,19728,1585;
MW3387,20032,1525;
MW3387,20388,1434;
MW3387,20744,1323;
MW3387,21912,908;
MW3387,22268,801;
MW3387,22623,714;
MW3387,22928,658;
MW3387,23233,618;
MW3387,23588,591;
MW3387,23944,582;
MW3387,24960,582;
MW3387,25366,591;
MW3387,25722,618;
MW3387,26078,666;
MW3387,26382,724;
MW3387,26738,813;
MW3387,27094,920;
MW3387,27449,1042;
MW3387,27470,1049;
MW3431,27470,1075;
MW3447,27470,1076;
MW3447,27398,1058;
MW3447,26890,885;
MW3447,26535,784;
MW3447,26179,702;
MW3447,25874,649;
MW3447,25519,608;
MW3447,25163,587;
MW3447,24554,582;
MW3447,23893,582;
MW3447,23538,589;
MW3447,23284,605;
MW3447,22979,637;
MW3447,22674,685;
MW3447,22369,750;
MW3447,22064,831;
MW3447,21709,944;
MW3447,20642,1325;
MW3447,20286,1436;
MW3447,19982,1515;
MW3447,19728,1568;
MW3447,19474,1610;
MW3447,19220,1641;
MW3447,19118,1643;
MW3447,18864,1614;
MW3447,18559,1565;
MW3447,18254,1501;
MW3447,17950,1420;
MW3447,17543,1289;
MW3447,16629,956;
MW3447,16324,854;
MW3447,16019,768;
MW3447,15714,698;
MW3447,15410,646;
MW3447,15054,606;
MW3447,14698,587;
MW3447,14089,581;
MW3447,13276,581;
MW3447,12870,593;
MW3447,12514,626;
MW3447,12209,675;
MW3447,11955,731;
MW3447,11650,818;
MW3447,11346,923;
MW3447,10431,1281;
MW3447,10076,1401;
MW3447,9771,1486;
MW3447,9466,1553;
MW3447,9110,1611;
MW3447,8755,1648;
MW3447,8653,1651;
MW3447,8298,1616;
MW3447,7942,1560;
MW3447,7637,1493;
MW3447,7332,1406;
MW3447,7028,1300;
MW3447,6215,977;
MW3447,5910,868;
MW3447,5605,778;
MW3447,5300,707;
MW3447,4996,655;
MW3447,4640,615;
MW3447,4284,591;
MW3447,3878,582;
MW3447,2811,583;
MW3447,2557,600;
MW3447,2252,644;
MW3447,1897,722;
MW3447,1790,751;
MW3493,1763,738;
MW3507,1755,734;
MW3507,1998,677;
MW3507,2252,628;
MW3507,2506,596;
MW3507,2760,582;
MW3507,3218,582;
MW3507,3776,582;
MW3507,4183,591;
MW3507,4488,610;
MW3507,4742,635;
MW3507,5046,678;
MW3507,5300,727;
MW3507,5605,803;
MW3507,5910,900;
MW3507,6316,1054;
MW3507,6977,1318;
MW3507,7332,1436;
MW3507,7637,1517;
MW3507,7942,1578;
MW3507,8247,1622;
MW3507,8552,1652;
MW3507,8704,1645;
MW3507,9110,1598;
MW3507,9466,1534;
MW3507,9771,1461;
MW3507,10076,1371;
MW3507,10431,1245;
MW3507,11346,888;
MW3507,11650,787;
MW3507,11955,707;
MW3507,12209,657;
MW3507,12514,615;
MW3507,12819,591;
MW3507,13225,581;
MW3507,14292,581;
MW3507,14749,592;
MW3507,15105,620;
MW3507,15410,661;
MW3507,15714,718;
MW3507,16019,793;
MW3507,16375,901;
MW3507,16934,1101;
MW3507,17543,1322;
MW3507,17899,1433;
MW3507,18254,1523;
MW3507,18610,1591;
MW3507,18915,1632;
MW3507,19067,1645;
MW3507,19169,1637;
MW3507,19524,1588;
MW3507,19829,1528;
MW3507,20134,1452;
MW3507,20490,1344;
MW3507,21709,911;
MW3507,22064,803;
MW3507,22420,716;
MW3507,22725,659;
MW3507,23030,619;
MW3507,23385,592;
MW3507,23741,582;
MW3507,24808,582;
MW3507,25214,593;
MW3507,25570,623;
MW3507,25874,664;
MW3507,26179,722;
MW3507,26535,810;
MW3507,26890,916;
MW3507,27449,1111;
MW3507,27470,1119;
MW3567,27470,1146;
MW3567,27398,1128;
MW3567,26840,932;
MW3567,26535,837;
MW3567,26281,768;
MW3567,25976,700;
MW3567,25671,648;
MW3567,25366,612;
MW3567,25011,588;
MW3567,24503,582;
MW3567,23944,582;
MW3567,23588,582;
MW3567,23182,597;
MW3567,22877,625;
MW3567,22522,677;
MW3567,22217,740;
MW3567,21912,819;
MW3567,21506,947;
MW3567,20439,1329;
MW3567,20032,1454;
MW3567,19677,1540;
MW3567,19321,1605;
MW3567,19016,1643;
MW3567,18915,1641;
MW3567,18661,1612;
MW3567,18356,1563;
MW3567,18051,1498;
MW3567,17746,1417;
MW3567,17391,1303;
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""")
python_3_script_2 = Python3Script(Text=panel_3)  # -> out, Curves, Points, Stats, Cmds; inputs Text: list
# ---------- python_3_script_2: Python ----------
import re
import Rhino.Geometry as rg

def parse_plt(lines):
    moves=[]
    pu_count=0; mw_count=0
    minx=miny=minz=10**9
    maxx=maxy=maxz=-10**9
    
    for raw in lines:
        if raw is None: continue
        s=raw.strip()
        if not s: continue
        
        # PU X,Y;
        m=re.match(r'^PU\s*(-?\d+)\s*,\s*(-?\d+)\s*;', s, re.I)
        if m:
            x=int(m.group(1)); y=int(m.group(2))
            moves.append(("PU",x,y,None)); pu_count+=1
            minx=min(minx,x); maxx=max(maxx,x)
            miny=min(miny,y); maxy=max(maxy,y)
            continue
        
        # MW X,Y,Z;
        m=re.match(r'^MW\s*(-?\d+)\s*,\s*(-?\d+)\s*,\s*(-?\d+)\s*;', s, re.I)
        if m:
            x=int(m.group(1)); y=int(m.group(2)); z=int(m.group(3))
            moves.append(("MW",x,y,z)); mw_count+=1
            minx=min(minx,x); maxx=max(maxx,x)
            miny=min(miny,y); maxy=max(maxy,y)
            minz=min(minz,z); maxz=max(maxz,z)
            continue
    
    stats={
        "PU":pu_count,"MW":mw_count,
        "x":(minx,maxx),"y":(miny,maxy),"z":(minz,maxz)
    }
    return moves,stats

def build_geometry(moves):
    curves=[]
    points=[]
    pl=None
    for cmd,x,y,z in moves:
        if cmd=="PU":
            if pl and len(pl)>1:
                curves.append(rg.PolylineCurve(pl))
            pl=rg.Polyline()
            # Startpunkt bei PU auf Z=0 mm
            pl.Add(rg.Point3d(x/100.0,y/100.0,0.0))
            points.append(rg.Point3d(x/100.0,y/100.0,0.0))
        elif cmd=="MW":
            if pl is None: pl=rg.Polyline()
            p=rg.Point3d(x/100.0,y/100.0,z/100.0)
            pl.Add(p)
            points.append(p)
    if pl and len(pl)>1:
        curves.append(rg.PolylineCurve(pl))
    return curves,points

# -------------------- Grasshopper IO ---------------------
if isinstance(Text,(list,tuple)):
    lines=[str(s) for s in Text if s]
elif isinstance(Text,str):
    lines=Text.replace("\r\n","\n").replace("\r","\n").split("\n")
else:
    lines=[]

moves,stats=parse_plt(lines)
Curves,Points=build_geometry(moves)

Stats="PU=%d, MW=%d | X=%.2f..%.2f mm | Y=%.2f..%.2f mm | Z=%.2f..%.2f mm" % (
    stats["PU"],stats["MW"],
    stats["x"][0]/100.0,stats["x"][1]/100.0,
    stats["y"][0]/100.0,stats["y"][1]/100.0,
    stats["z"][0]/100.0,stats["z"][1]/100.0
)
# ---------- end python_3_script_2 ----------
python_3_script_3 = Python3Script(
    G=panel_2,
    ArcTol=Slider(0.5, range=0..1),
    VF=Slider(100, range=0..100),
    Zup=Slider(10, range=0..10),
    Vacuum=Toggle(True),
    Underlay=Toggle(True),
    DefaultTool=number_slider)  # -> out, HPGL, Moves, Notes; inputs G: list of String, ArcTol: String, VF: Int32, Vacuum: Boolean, Underlay: Boolean, DefaultTool: Int32, Send: Boolean, IP: Int32, Port: Int32, SavePath: String
# ---------- python_3_script_3: Python ----------
# GCODE → ZÜND HPGL (MF/MW 3D) — GhPython
# Unterstützt: G0/G1, G2/G3 (XY), G90/G91, G20/G21, F, S, T, M3/M5
# Annahmen:
#  - Rhino/Grasshopper-Einheit = mm
#  - Z=0 = Unterlage (Zünd Auto-Init)
#  - VW (cm/s) = F(mm/min) / 600

import math

def UU(mm):
    return int(round(mm * 100.0))

def to_mm(v, units_mm):
    return v if units_mm else v * 25.4

class Writer(object):
    def __init__(self):
        self.lines = []
        self.move_count = 0
    def L(self, s): self.lines.append(s)
    def header(self, vacuum, underlay, tool, vw_cm_s, vf_cm_s, zup_uu, zdown_uu, rpm):
        self.L("CO Programstart;")
        if vacuum:  self.L("PB9,1;")
        if underlay:self.L("XX308,1;")
        self.L("SP%d;" % tool)
        self.L("XX62;")
        self.L("VW%g;" % vw_cm_s)
        self.L("VF%g;" % vf_cm_s)
        self.L("ZP%d,%d;" % (zup_uu, zdown_uu))
        self.L("XX81;")
        self.L("AS2,4;")
        self.L("XX150,%d;" % max(0, rpm))
        self.L("XX82;")
        self.L("MA;")
    def MF(self, x,y,z):
        self.L("MF%d,%d,%d;" % (x,y,z)); self.move_count+=1
    def MW(self, x,y,z):
        self.L("MW%d,%d,%d;" % (x,y,z)); self.move_count+=1
    def trailer(self,vacuum,underlay):
        self.L("XX95;")
        self.L("PK;")
        if underlay:self.L("XX308,0;")
        if vacuum: self.L("PB9,0;")
    def text(self): return "\n".join(self.lines)

class State(object):
    def __init__(self, tool, zsafe):
        self.units_mm = True
        self.absolute = True
        self.feed_mm_min = 1200.0
        self.rpm = 0
        self.tool = tool
        self.spindle_on = False
        self.x = self.y = self.z = 0.0
        self.zsafe = zsafe
        self.notes = []

def tokenize(line):
    s = line
    while True:
        a = s.find("(")
        if a<0: break
        b = s.find(")", a+1)
        if b<0: s = s[:a]; break
        s = s[:a]+s[b+1:]
    sc = s.find(";")
    if sc>=0: s=s[:sc]
    return s.strip().split() if s.strip() else []

def apply_modal(moves, st, rapid, X,Y,Z):
    nx,ny,nz = st.x, st.y, st.z
    if st.absolute:
        if X is not None: nx=X
        if Y is not None: ny=Y
        if Z is not None: nz=Z
    else:
        if X is not None: nx+=X
        if Y is not None: ny+=Y
        if Z is not None: nz+=Z
    moves.append((nx,ny,nz,rapid))
    st.x,st.y,st.z = nx,ny,nz

def arc_xy(st,cw,X,Y,I,J,R,arc_tol_mm):
    sx,sy,sz = st.x,st.y,st.z
    ex,ey = sx,sy
    if X is not None: ex = X if st.absolute else sx+X
    if Y is not None: ey = Y if st.absolute else sy+Y
    cx=cy=radius=None
    if I is not None or J is not None:
        ii, jj = I or 0.0, J or 0.0
        cx = ii if st.absolute else sx+ii
        cy = jj if st.absolute else sy+jj
        radius = math.hypot(sx-cx, sy-cy)
    elif R is not None:
        r=abs(R); dx,dy=ex-sx, ey-sy; chord=math.hypot(dx,dy)
        if chord<1e-9: return []
        h2=r*r-(chord*chord)/4.0; h2=max(h2,0); h=math.sqrt(h2)
        mx,my=(sx+ex)/2.0,(sy+ey)/2.0; nx_=-dy/chord; ny_=dx/chord
        cx=mx+ (1 if R>=0 else -1)*nx_*h; cy=my+ (1 if R>=0 else -1)*ny_*h; radius=r
    else: return []
    a0,a1=math.atan2(sy-cy,sx-cx), math.atan2(ey-cy,ex-cx); da=a1-a0
    if cw: 
        if da>=0: da-=2*math.pi
    else:
        if da<=0: da+=2*math.pi
    arc_len=abs(da)*radius; step=max(arc_tol_mm,0.05)
    steps=max(int(math.ceil(arc_len/step)),1)
    out=[]
    for i in range(1,steps+1):
        t=i/float(steps); ang=a0+da*t
        px=cx+radius*math.cos(ang); py=cy+radius*math.sin(ang)
        out.append((px,py,sz,False))
    out.append((ex,ey,sz,False)); st.x,st.y,st.z=ex,ey,sz
    return out

def main(G, ArcTol, VF, Zup, Vacuum, Underlay, DefaultTool, Send, IP, Port, SavePath):
    # Input normalisieren
    if isinstance(G,(list,tuple)): Gtext="\n".join([g for g in G if g]); 
    elif isinstance(G,str): Gtext=G
    else: Gtext=""
    if not Gtext.strip():
        return "",0,"Empty input."

    st=State(DefaultTool,Zup); w=Writer(); moves=[]
    vw_cm_s=st.feed_mm_min/600.0; vf_cm_s=max(1.0,float(VF))

    # Erste relevante Werte merken
    first_tool = st.tool
    first_rpm  = None
    first_vw   = None
    spindle_armed = False

    lines=Gtext.replace("\r\n","\n").replace("\r","\n").split("\n")

    for raw in lines:
        toks=tokenize(raw)
        if not toks: continue
        hasG=False; gcode=-1
        X=Y=Z=I=J=R=None; F=S=T=None; m3=m5=False
        for tok in toks:
            u=tok.upper(); idx=0; L=len(u)
            while idx<L:
                c=u[idx]
                if c in "GMXYZIJRFSTN":
                    j=idx+1
                    while j<L and (u[j].isdigit() or u[j] in "+-."): j+=1
                    key=u[idx]; val=u[idx+1:j] if j>idx+1 else ""; idx=j
                    try:
                        if key=="G": hasG=True; gcode=int(val)
                        elif key=="M":
                            mv=int(val)
                            if mv==3: m3=True
                            elif mv==5: m5=True
                        elif key=="X": X=to_mm(float(val),st.units_mm)
                        elif key=="Y": Y=to_mm(float(val),st.units_mm)
                        elif key=="Z": Z=to_mm(float(val),st.units_mm)
                        elif key=="I": I=to_mm(float(val),st.units_mm)
                        elif key=="J": J=to_mm(float(val),st.units_mm)
                        elif key=="R": R=to_mm(float(val),st.units_mm)
                        elif key=="F": F=to_mm(float(val),st.units_mm)
                        elif key=="S": S=int(float(val))
                        elif key=="T": T=int(float(val))
                    except: pass
                else: idx+=1
        # Modal anwenden + erste Werte merken
        if T is not None: 
            st.tool=T
            if first_tool is None: first_tool=T
        if S is not None:
            st.rpm=S
            if spindle_armed and first_rpm is None: first_rpm=S
        if F is not None:
            st.feed_mm_min=F; vw_cm_s=F/600.0
            if first_vw is None: first_vw=vw_cm_s
        if m3:
            st.spindle_on=True; spindle_armed=True
            if first_rpm is None and st.rpm>0: first_rpm=st.rpm
        if m5:
            st.spindle_on=False
            # st.rpm=0  # nicht Header-relevant
        if hasG:
            if gcode==0: apply_modal(moves,st,True,X,Y,Z)
            elif gcode==1: apply_modal(moves,st,False,X,Y,Z)
            elif gcode in (2,3): moves.extend(arc_xy(st,gcode==2,X,Y,I,J,R,ArcTol))
            elif gcode==20: st.units_mm=False
            elif gcode==21: st.units_mm=True
            elif gcode==90: st.absolute=True
            elif gcode==91: st.absolute=False
            elif gcode in (18,19): st.notes.append("Warnung: G%d ignoriert"%gcode)

    # Moves bereinigen (Z-only Startbewegungen entfernen)
    clean=[]; last=None
    for (x,y,z,isRapid) in moves:
        if last is None: last=(x,y,z,isRapid); continue
        lx,ly,lz,lr=last
        if x==lx and y==ly:  # nur Z
            last=(x,y,z,isRapid and lr); continue
        clean.append(last); last=(x,y,z,isRapid)
    if last is not None: clean.append(last)
    while clean and clean[0][0]==0 and clean[0][1]==0 and clean[0][3] and clean[0][2]>=Zup:
        clean.pop(0)
    moves=clean

    # Header-Werte setzen
    vw=max(0.1,float(first_vw if first_vw is not None else vw_cm_s))
    vf=max(1.0,float(vf_cm_s))
    hdr_tool=first_tool if first_tool is not None else st.tool
    hdr_rpm =first_rpm if first_rpm is not None else (st.rpm if spindle_armed else 0)

    zup_uu=UU(Zup); zdown_uu=0
    w.header(Vacuum,Underlay,hdr_tool,vw,vf,zup_uu,zdown_uu,hdr_rpm)

    first=True
    for (x,y,z,isRapid) in moves:
        Xuu,Yuu=UU(x),UU(y)
        if first: w.MF(Xuu,Yuu,zup_uu); first=False
        if isRapid:
            w.MF(Xuu,Yuu,zup_uu)
            if z<Zup: w.MW(Xuu,Yuu,UU(z))
        else:
            zielZ=UU(z) if z<=Zup else zdown_uu
            w.MW(Xuu,Yuu,zielZ)

    w.trailer(Vacuum,Underlay)
    hpgl=w.text()
    notes="Units=%s | Mode=%s | F=%.1f mm/min → VW=%.2f cm/s | Tool=%d | RPM=%d | Moves=%d" % \
          ("mm" if st.units_mm else "inch","G90" if st.absolute else "G91",
           st.feed_mm_min,vw,hdr_tool,hdr_rpm,w.move_count)
    if st.notes: notes+="\n"+"\n".join(st.notes)
    return hpgl,w.move_count,notes

# ---- Grasshopper Outputs ----
HPGL,Moves,Notes = main(G,ArcTol,VF,Zup,Vacuum,Underlay,DefaultTool,Send,IP,Port,SavePath)
# ---------- end python_3_script_3 ----------
panel_4 = Panel(python_3_script_3.HPGL)
panel_5 = Panel(python_3_script_3.Notes)
panel_6 = Panel(python_3_script_3.Moves)
curve = Curve(python_3_script_2.Curves)
list_item = ListItem(List=curve, Index=Slider(0, range=0..10), Wrap=True)
panel_7 = Panel(python_3_script_2.Stats)
