# Grasshopper definition LARGERslicer - Paper Walls.gh (Grasshopper 1.0.8)
# plug-ins: Heteroptera, Pufferfish, Human, Weaverbird

# ----
# Insert Surface
geo = Geometry(<brep referenced from the Rhino model>)

# ----
# Parameter
resolution = Slider(1, range=0..10)
layer_height = Slider(2, range=0..10)
layer_width = Slider(3.5, range=0..15)
print_speed_mm_s = Slider(30, range=0..100)
skirt_distance = Slider(30, range=0..100)
skirt_length = Slider(200, range=0..1000)

# ---- group: contour
geometry = Geometry(geo)
contour = Contour(Shape=geometry, Point=Point(0, 0, 0), Direction=Vector(0, 0, 1), Distance=layer_height)  # -> flatten(Contours)

# ---- group: position object on build plate
# position on build plate
# (single object)
center = Center(Geometry=geo)  # -> Center, Dimension
ginger_build_volume = Panel("1000")
project = Project(Geometry=center.Center, Plane=PlaneXY(0, 0, 0))  # -> Geometry, Transform
md_slider = MDSlider(
    SliderMode=0,
    slider_value=Point(0.2544480415, 0.4976387024, 0.5),
    x_domain=Domain(0, 1),
    y_domain=Domain(0, 1),
    z_domain=Domain(0, 1))
Z = UnitZ(Factor=ginger_build_volume)
rectangle = Rectangle(Plane=PlaneXY(0, 0, 0), XSize=ginger_build_volume, YSize=ginger_build_volume, Radius=0)  # -> Rectangle, Length
evalsrf = EvaluateSurface(Surface=reparameterize(rectangle.Rectangle), Point=md_slider)  # -> Point, Normal, UDirection, VDirection, Frame
xy = XYPlane(Origin=Point(0, 0, 0))
extr = Extrude(Base=rectangle.Rectangle, Direction=Z)
move2pt = MoveToPoint(Geometry=geometry, PointA=project.Geometry, PointB=evalsrf.Point)  # -> Moved, Vector, Transform
wires = BrepWireframe(Brep=extr, Density=-1)

# ----
# position on build plate
# (multiple parts)
number_slider = Slider(150, range=0..1000)
number_slider_2 = Slider(3, range=0..10)
neg = Negative(Value=number_slider)
offset = OffsetCurve(Curve=rectangle.Rectangle, Distance=neg, Corners=1)
sdivide = DivideSurface(Surface=offset, UCount=number_slider_2, VCount=number_slider_2)  # -> Points, Normals, Parameters
split = SplitList(List=flatten(sdivide.Points), Index=Slider(4, range=0..100))  # -> graft(ListA), ListB
flip = FlipMatrix(Data=sdivide.Points)
X = UnitX(Factor=Slider(50, range=0..100))
item = ListItem(List=flip, Index=0, Wrap=True)
move = Move(Geometry=split.ListA, Motion=X)  # -> Geometry, Transform
group = Group(Geometry=contour)
move2pt_2 = MoveToPoint(Geometry=group, PointA=project.Geometry, PointB=move.Geometry)  # -> Moved, Vector, Transform
ungroup = Ungroup(Group=move2pt_2.Moved)

# ---- group: position seam
pt = ConstructPoint(XCoordinate=Slider(0.5, range=0..1), YCoordinate=Slider(0.44, range=0..1), ZCoordinate=0)

md_slider_2 = MDSlider(
    SliderMode=0,
    slider_value=Point(0.503200531, 0.3813171387, 0.5),
    x_domain=Domain(0, 1),
    y_domain=Domain(0, 1),
    z_domain=Domain(0, 1))
brec = BoundingRectangle(Geometry=ungroup, Plane=PlaneXY(0, 0, 0), Axis=0, Slide=0, Union=True)  # -> Bounding, DimensionX, DimensionY
evalsrf_2 = EvaluateSurface(Surface=reparameterize(brec.Bounding), Point=pt)  # -> Point, Normal, UDirection, VDirection, Frame
alicrvseams = AlignCurveSeams(Curves=ungroup, Guide=evalsrf_2.Point, Snap=False, Iterative=True)  # -> Aligned, Points, R

# ---- group: position seam / rhino reference point
dd = Point()

# ----
createhatch = CreateHatch(Bake=False, Curves=<missing>, HatchPatternName="Solid", HatchScale=1, HatchRotation=0)  # -> HatchGeometry, HatchObjects
previewmat = CustomPreviewMaterials(Geometry=createhatch.HatchGeometry, DiffuseColor=<missing>)

# ---- group: open seam
crv = Curve(alicrvseams.Aligned)
panel = Panel("0")
cull_i = CullIndex(List=crv, Indices=panel, Wrap=True)
crv_2 = Curve(cull_i)
neg_2 = Negative(Value=layer_height)
ext = ExtendCurve(Curve=crv_2, Type=0, Start="0", End=neg_2)

# ---- group: generate points (resolution)
len = Length(Curve=ext)
division = Division(A=len, B=resolution)
divide = DivideCurve(Curve=ext, Count=division, Kinks=False)  # -> Points, Tangents, Parameters
trim = TrimTree(Tree=simplify(divide.Points), Depth=1)
pline = PolyLine(Vertices=divide.Points, Closed=False)  # -> simplify(Polyline)
pline_2 = PolyLine(Vertices=flatten(divide.Points), Closed=False)
trim_2 = TrimTree(Tree=simplify(pline), Depth=1)
pline_3 = PolyLine(Vertices=trim, Closed=False)  # -> flatten(Polyline)

# ---- group: travel move
item_2 = ListItem(List=trim_2, Index=panel, Wrap=True)  # -> flatten(Item)
crv_3 = Curve(item_2)

# ----
# Generate Travel Move between parts
crv_4 = Curve(reverse(pline_3))
end = EndPoints(Curve=crv_4)  # -> Start, End
number_slider_3 = Slider(10, range=0..100)
cull_i_2 = CullIndex(List=end.Start, Indices="0", Wrap=True)
cull_i_3 = CullIndex(List=end.End, Indices="-1", Wrap=True)
line = LineSDL(Start=cull_i_3, Direction=Vector(0, 0, 1), Length=number_slider_3)
pdecon = Deconstruct(Point=cull_i_3)  # -> XComponent, YComponent, ZComponent
pdecon_2 = Deconstruct(Point=cull_i_2)  # -> XComponent, YComponent, ZComponent
end_2 = EndPoints(Curve=line)  # -> Start, End
addition = Addition(A=pdecon.ZComponent, B=number_slider_3)
pt_2 = ConstructPoint(XCoordinate=pdecon_2.XComponent, YCoordinate=pdecon_2.YComponent, ZCoordinate=addition)
ln = Line(StartPoint=end_2.End, EndPoint=pt_2)
ln_2 = Line(StartPoint=pt_2, EndPoint=cull_i_2)
merge = Merge(Data1=line, Data2=ln, Data3=ln_2)
join = JoinCurves(Curves=merge, Preserve=False)

# ---- group: travel move
# Generate Travel Move between first layers
end_3 = EndPoints(Curve=crv_3)  # -> Start, End
number_slider_4 = Slider(10, range=0..100)
cull_i_4 = CullIndex(List=end_3.Start, Indices="0", Wrap=True)
cull_i_5 = CullIndex(List=end_3.End, Indices="-1", Wrap=True)
line_2 = LineSDL(Start=cull_i_5, Direction=Vector(0, 0, 1), Length=number_slider_4)
pdecon_3 = Deconstruct(Point=cull_i_5)  # -> XComponent, YComponent, ZComponent
pdecon_4 = Deconstruct(Point=cull_i_4)  # -> XComponent, YComponent, ZComponent
end_4 = EndPoints(Curve=line_2)  # -> Start, End
addition_2 = Addition(A=pdecon_3.ZComponent, B=number_slider_4)
pt_3 = ConstructPoint(XCoordinate=pdecon_4.XComponent, YCoordinate=pdecon_4.YComponent, ZCoordinate=addition_2)
ln_3 = Line(StartPoint=end_4.End, EndPoint=pt_3)
ln_4 = Line(StartPoint=pt_3, EndPoint=cull_i_4)
merge_2 = Merge(Data1=line_2, Data2=ln_3, Data3=ln_4)
join_2 = JoinCurves(Curves=merge_2, Preserve=False)

# ---- group: generate skirt
# Generate Skirt
item_3 = ListItem(List=pline_3, Index=0, Wrap=True)
brec_2 = BoundingRectangle(Geometry=item_3, Plane=PlaneXY(0, 0, 0), Axis=0, Slide=0, Union=True)  # -> Bounding, DimensionX, DimensionY
end_5 = EndPoints(Curve=item_3)  # -> Start, End
md_slider_3 = MDSlider(
    SliderMode=0,
    slider_value=Point(0.5033405583, 0, 0.5),
    x_domain=Domain(0, 1),
    y_domain=Domain(0, 1),
    z_domain=Domain(0, 1))
offset_2 = OffsetCurve(Curve=brec_2.Bounding, Distance=skirt_distance, Corners=1)
evalsrf_3 = EvaluateSurface(Surface=reparameterize(offset_2), Point=md_slider_3)  # -> Point, Normal, UDirection, VDirection, Frame
alicrvseams_2 = AlignCurveSeams(Curves=offset_2, Guide=evalsrf_3.Point, Snap=False, Iterative=True)  # -> Aligned, Points, R
len_2 = Length(Curve=alicrvseams_2.Aligned)
subtraction = Subtraction(A=len_2, B=skirt_length)
neg_3 = Negative(Value=subtraction)
ext_2 = ExtendCurve(Curve=alicrvseams_2.Aligned, Type=0, Start=neg_3, End="0")
end_6 = EndPoints(Curve=ext_2)  # -> Start, End
ln_5 = Line(StartPoint=end_5.Start, EndPoint=end_6.End)
join_3 = JoinCurves(Curves=[ln_5, ext_2], Preserve=False)

# ---- group: weave print and travel move
weave = Weave(Pattern=[0, 1], Stream0=crv_4, Stream1=join, NullGaps=False)  # -> simplify(graft(Weave))
item_4 = ListItem(List=flatten(weave), Index=Slider(6, range=0..10), Wrap=True)
explode = Explode(Curve=weave, Recursive=True)  # -> Segments, Vertices

weave_2 = Weave(Pattern=[0, 1], Stream0=crv_3, Stream1=join_2, NullGaps=False)  # -> simplify(graft(Weave))
explode_2 = Explode(Curve=weave_2, Recursive=True)  # -> Segments, Vertices
item_5 = ListItem(List=flatten(weave_2), Index=Slider(2, range=0..10), Wrap=True)

# ---- group: extrusion value
lng = ListLength(List=explode_2.Vertices)
repeat = RepeatData(Data=resolution, Length=lng)
replace = ReplaceItems(List=repeat, Item="0", Indices="0", Wrap=False)
smaller = SmallerThan(FirstNumber=flatten(lng), SecondNumber=Slider(27, range=0..100))  # -> SmallerThan, OrEqualTo
tstat = TreeStatistics(Tree=replace)  # -> Paths, Length, Count
dispatch = Dispatch(List=tstat.Paths, DispatchPattern=invert(smaller.SmallerThan))  # -> ListA, ListB
branch = TreeBranch(Tree=replace, Path=dispatch.ListA, MaintainPaths=True)
branch_2 = TreeBranch(Tree=replace, Path=dispatch.ListB, MaintainPaths=True)
multiplication = Multiplication(A=branch_2, B="0")
merge_3 = Merge(Data1=branch, Data2=multiplication)

lng_2 = ListLength(List=explode.Vertices)
repeat_2 = RepeatData(Data=resolution, Length=lng_2)
replace_2 = ReplaceItems(List=repeat_2, Item="0", Indices="0", Wrap=False)
smaller_2 = SmallerThan(FirstNumber=flatten(lng_2), SecondNumber=Slider(27, range=0..100))  # -> SmallerThan, OrEqualTo
tstat_2 = TreeStatistics(Tree=replace_2)  # -> Paths, Length, Count
dispatch_2 = Dispatch(List=tstat_2.Paths, DispatchPattern=invert(smaller_2.SmallerThan))  # -> ListA, ListB
branch_3 = TreeBranch(Tree=replace_2, Path=dispatch_2.ListA, MaintainPaths=True)
branch_4 = TreeBranch(Tree=replace_2, Path=dispatch_2.ListB, MaintainPaths=True)
multiplication_2 = Multiplication(A=branch_4, B="0")
merge_4 = Merge(Data1=branch_3, Data2=multiplication_2)

# ----
entwine = Entwine(Branch1X=explode_2.Vertices, Branch2X=explode.Vertices, FlattenInputs=False)
tstat_3 = TreeStatistics(Tree=entwine)  # -> Paths, Length, Count
pline_4 = PolyLine(Vertices=flatten(entwine), Closed=False)
item_6 = ListItem(List=tstat_3.Paths, Index=Slider(10, range=0..10), Wrap=True)
branch_5 = TreeBranch(Tree=entwine, Path=item_6, MaintainPaths=True)
pline_5 = PolyLine(Vertices=branch_5, Closed=False)

entwine_2 = Entwine(Branch0X=merge_3, Branch1X=merge_4, FlattenInputs=False)

# ----
# Estimated Print time
pline_6 = PolyLine(Vertices=flatten(entwine), Closed=False)
len_3 = Length(Curve=pline_6)
division_2 = Division(A=len_3, B=print_speed_mm_s)
division_3 = Division(A=division_2, B="60")
division_4 = Division(A=division_3, B="60")
smtime = ConstructSmoothTime(Days=0, Hours=division_4, Minutes=0, Seconds=0)
panel_2 = Panel(smtime)

# ---- group: Generate Gcode / Generate Extrusion Values
constant_factor_ginger = Panel("0.21")
height = Multiplication(
    ConstantFactor=constant_factor_ginger,
    LayerHeight=layer_height,
    LayerWidth=layer_width,
    Resolution=entwine_2,
    TravelMoveBoolean=resolution)  # -> simplify(Result)

# ---- group: Generate Gcode
pdecon_5 = Deconstruct(Point=simplify(entwine))  # -> XComponent, YComponent, ZComponent
multiplication_3 = Multiplication(A=print_speed_mm_s, B="60")
concat = Concatenate(
    FragmentH="G1 ",
    FragmentG="F",
    FragmentI=multiplication_3,
    FragmentF=" X",
    FragmentA=pdecon_5.XComponent,
    FragmentB=" Y",
    FragmentC=pdecon_5.YComponent,
    FragmentD=" Z",
    FragmentE=pdecon_5.ZComponent,
    FragmentJ=" E",
    FragmentK=height)  # -> flatten(Result)

# ----
# Add Start + End Gcode
end_gcode = Panel("""; END CODE

; zeta raise
G91
G1 F200 Z50
G90

; deactivate temperature control (pin PC4)
M42 P49 I T1 S1
M42 P49 I T1 S1
G4 P200

; zeta raise
G91
G1 F100 Z30
G90

; safe deactivate temperature control (pin PC4)
M42 P49 I T1 S1
M42 P49 I T1 S1
G4 P200

; X homing
G28 X

; deactivate motors
M84

; let temperature-control activate (pin PC4)
G4 P2000
M42 P49 I T1 S0
M42 P49 I T1 S0
G4 P2000

; finishing tone
M300 P500
G4 P1000
M300 P500
G4 P1000
M300 P1000

; end of end code""")
start_gcode = Panel("""; START CODE

;custom pins declaration
M42 I P49 T1 S0 ;(pin PC4)
M42 I P57 T1 S0 ;(pin PF9)

; let temperature-control activate (pin PC4)
M42 P49 I T1 S0		
M42 P49 I T1 S0

; turn on temperature (pin PF9)
M42 P57 I T1 S1		

G4 P2000

M42 P57 I T1 S0
G4 P200

; set units to mm
G21

; disable cold extrusion
M302 P1

; set mixer values
M163 S0 P1
M163 S1 P0.07
M164

; raise zeta before homing (or probing!)
G91
G1 F200 Z10
G90

; homing
G28 X0 Y0

; enable bed leveling
M420 S1
; bed leveling (set custom area RxB)
; G29 F150 L150 R300 B300

; make sure extruder's ready
M300 P200
G4 P500
M300 P200
M0 Click if EXTR. READY

; homing
G28

; use absolute coordinates
G90

; set a k value for linear advance
; M900 K0.1

; raise zeta axis
G1 F200 Z2

; reset extrusion
G92 E0
; use relative distances for extrusion
M83

; end of start gcode""")
merge_5 = Merge(Data1=flatten(start_gcode), Data2=flatten(concat), Data3=flatten(end_gcode))

# ---- group: G
# Gcode Preview
number_slider_5 = Slider(0.1, range=0..1)
lng_3 = ListLength(List=concat)
multiplication_4 = Multiplication(A=lng_3, B=number_slider_5)
split_2 = SplitList(List=concat, Index=multiplication_4)  # -> ListA, ListB
panel_3 = Panel(split_2.ListA)

# ---- group: Visualize
number_slider_6 = Slider(6, range=0..10)  # disabled
crv_5 = Curve()  # disabled
number_slider_7 = Slider(10, range=0..100)  # disabled
range = Range(Domain=Domain(0, 1), Steps=number_slider_6)  # disabled

# Visualize
# (long calculation)
trim_3 = TrimTree(Tree=crv_5, Depth=1)
bang = ExplodeTree(Data=trim_3)  # -> Branch0, Branch1
division_5 = Division(A=layer_height, B=2)

parampipemsh = ParameterPipeMesh(
    Curve=graft(bang.Branch1),
    Radius=division_5,
    ParametersU=[0, 0.1, 0.2, 0.3, 0.4, 0.5, 0.6, 0.7, 0.8, 0.9, 1],
    ParametersV=range,
    Weighted=False,
    Lengths=False,
    Angle=number_slider_7,
    Rotation=0,
    EndType=0,
    Triangulate=False)  # disabled
wbcatmullclark = WeaverbirdsCatmullClarkSubdivision(MeshCurves=parampipemsh, Level=1, SmoothNakedEdges=1)  # -> reverse(flatten(OutputMeshCurves)); disabled
preview = CustomPreview(
    Geometry=wbcatmullclark,
    Material={diffuse=RGB(228, 178, 227), emission=RGB(68, 53, 68), shine=0.5, specular=RGB(255, 254, 255), transparency=0})  # disabled

# Gradient
lng_4 = ListLength(List=wbcatmullclark)  # disabled
series = Series(Start=0, Step=1, Count=lng_4)  # disabled
gradient = Gradient(LowerLimit=0, UpperLimit=lng_4, Parameter=series, stops=[0: RGB(255, 98, 98), 0.503: RGB(255, 244, 229)])  # disabled
preview_2 = CustomPreview(Geometry=wbcatmullclark, Material=reverse(gradient))  # disabled

# ----
# Write File
list = ValueList({"Ginger": 0, "Robot": 1}, selected="Ginger")
file_name = Panel("CLIPS")
filename = Filename()
python_3_script = Python3Script()  # -> out, timestamp
# ---------- python_3_script: Python ----------
"""
Timestamp Komponente mit automatischer Aktualisierung
Outputs:
    timestamp: String
"""

import datetime
import Grasshopper

# Aktuelle Zeit
now = datetime.datetime.now()

# Timestamp Format
timestamp = now.strftime("%y%m%d%H%M_")

# Automatische Neuberechnung
ghdoc = ghenv.Component.OnPingDocument()
ghdoc.ScheduleSolution(1000, lambda doc: ghenv.Component.ExpireSolution(False))
# ---------- end python_3_script ----------
panel_4 = Panel("min")
relay = Relay()
relay_2 = Relay()
relay_3 = Relay()
desired_file_extension = Panel(".gcode")
save_gcode_to_desktop = Button()

desktop_filepath = DesktopFilepath()
stream_filter = StreamFilter(Gate=list, Stream0="/GIN_", Stream1="/DXR_")
text_join = TextJoin(Text=stream_filter)

text_join_2 = TextJoin(Text=flatten([text_join, python_3_script.timestamp, file_name, relay_2, relay_3, relay]))  # -> flatten(Result)
python_3_script_2 = Python3Script(Folder=desktop_filepath, name=text_join_2, ext=desired_file_extension, lines=merge_5, write=save_gcode_to_desktop)  # inputs Folder: String, name: String, ext: String, lines: list of String, write: Boolean
# ---------- python_3_script_2: Python ----------
__author__ = "Moritz Wesseler"
__version__ = "2024.10.23"


import os

file =Folder + name + ext


if write:
    filePath = open(file, "w") # Open the file
    for line in lines: # Iterate through lines
        filePath.write(line + "\n") # Write separate lines
    filePath.close() # Close the file
__author__ = "Moritz Wesseler"
__version__ = "2024.10.23"

import os

# Angenommen, Folder, name, ext und lines kommen von deinen Grasshopper-Inputs
file_path = os.path.join(Folder, name + ext)

if write:
    # Datei mit Kontextmanager öffnen – schließt automatisch
    # encoding angeben, um Unicode-Probleme zu vermeiden
    with open(file_path, "w", encoding="utf-8") as f:
        for line in lines:
            # f-String für saubere Zeilenumbrüche
            f.write(f"{line}\n")
# ---------- end python_3_script_2 ----------

# ==== cluster DesktopFilepath: # Grasshopper Python Component: # This script finds the current user's Desktop folder path cross-platform # and outputs it as the variable 'desktopPath'.
desktop_filepath = Python3Script()  # -> desktopPath
# ---------- desktop_filepath: Python ----------
import os
from pathlib import Path

# Grasshopper Python Component:
# This script finds the current user's Desktop folder path cross-platform
# and outputs it as the variable 'desktopPath'.

# Function to detect Desktop folder
def get_desktop_path():
    # Get home directory
    home = Path.home()
    # Common desktop folder names in various languages
    candidates = ["Desktop", "Schreibtisch", "Escritorio", "Bureau"]
    for name in candidates:
        desk = home / name
        if desk.exists() and desk.is_dir():
            return str(desk)
    # Fallback: return home directory
    return str(home)

# Output variable for Grasshopper
desktopPath = get_desktop_path()

# Print or output desktopPath to Grasshopper
print(f"Desktop path detected: {desktopPath}")
# ---------- end desktop_filepath ----------
desktoppath = ClusterOutput(desktop_filepath)
