# Grasshopper definition LARGERslicer - Non Planar.gh (Grasshopper 1.0.8)
# plug-ins: Pufferfish

pt = Point(Point(-9.657679484, -8.480290249, 96.52359572))
portrait = Mesh(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)
layer_height = Slider(2, range=0..10)
layer_width = Slider(4, range=0..10)
offset_start = Slider(0.7, range=0..2)
non_planar_slicer = NonPlanarSlicer(S=portrait, P=pt, B_3=layer_height, D=layer_height, B_2=layer_height, B=layer_height)

# ---- group: Brim
first_bottom_layers = Slider(1, range=0..10)
infill_bottom_layers = Slider(10, range=0..10)
path_manager = PathManager(L=non_planar_slicer, i=infill_bottom_layers, i_2=first_bottom_layers, N=layer_width)

# ---- group: Layer Heigth Brim
subtraction = Subtraction(A=layer_height, B=offset_start)
Z = UnitZ(Factor=subtraction)
neg = Negative(Value=Z)
move = Move(Geometry=path_manager, Motion=neg)  # -> Geometry, Transform
flip = FlipCurve(Curve=move.Geometry)  # -> Curve, Flag

# ----
cp = ControlPoints(Curve=flip.Curve)  # -> Points, Weights, Knots
cluster = Cluster(layer_width=layer_width, layer_height=layer_height, brim=flip.Curve, curve=non_planar_slicer)  # -> e_value, segments, curve_2
lng = ListLength(List=flatten(cp.Points))
relay = Relay()

# ---- group: Layer Height
repeat = RepeatData(Data=offset_start, Length=lng)
merge = Merge(Data1=flatten(repeat), Data2=flatten(cluster.e_value))

# ----
merge_2 = Merge(Data1=flatten(flip.Curve), Data2=flatten(cluster.segments))
clean = CleanTree(RemoveNulls=True, RemoveInvalid=True, RemoveEmpty=True, Tree=merge_2)
number_slider = Slider(0, range=0..100)
bbox = BoundingBox(Content=clean, Plane=PlaneXY(0, 0, 0), UnionBox=True)  # -> Box, Box_2
debrep = DeconstructBrep(Brep=bbox.Box)  # -> Faces, Edges, Vertices
pt_2 = ConstructPoint(XCoordinate=number_slider, YCoordinate=number_slider, ZCoordinate=offset_start)
item = ListItem(List=debrep.Vertices, Index=0, Wrap=True)
move2pt = MoveToPoint(Geometry=clean, PointA=item, PointB=pt_2)  # -> Moved, Vector, Transform

# ---- group: Multiply Prints
number_slider_2 = Slider(257, range=0..1000)
number_slider_3 = Slider(1, range=0..10)
vec = VectorXYZ(XComponent=number_slider_2, YComponent=number_slider_2, ZComponent=0)  # -> Vector, Length
arrlinear = LinearArray(Geometry=move2pt.Moved, Direction=vec.Vector, Count=number_slider_3)  # -> Geometry, Transform
flip_2 = FlipMatrix(Data=arrlinear.Geometry)
flatten = FlattenTree(Tree=flip_2, Path="{0}")

# ---- group: Layer Feedrate
layer_time = LayerTime(relay=cluster.curve_2)
first_layers_feedrate = Slider(1500, range=0..10000)
lng_2 = ListLength(List=cluster.e_value)
repeat_2 = RepeatData(Data=first_layers_feedrate, Length=lng)  # -> flatten(Data)
repeat_3 = RepeatData(Data=layer_time, Length=lng_2)  # -> flatten(Data)
merge_3 = Merge(Data1=repeat_2, Data2=repeat_3)
dup = DuplicateData(Data=merge_3, Number=number_slider_3, Order=True)

# ---- group: Layer Height
lastdex = LastIndex(List=merge)
replace = ReplaceItems(List=merge, Item=Slider(0, range=0..100), Indices=lastdex, Wrap=False)
dup_2 = DuplicateData(Data=replace, Number=number_slider_3, Order=True)

# ----
gcode_v11_beta = GCODEV11BETA(
    curve_2=flip_2,
    material="rPETG",
    bed_temperature=Slider(90, range=0..100),
    curve=flatten,
    feed_rate=dup,
    layer_height=dup_2,
    layer_thickness=layer_width,
    flow=Slider(80, range=0..100),
    travel_feed_rate=Slider(10000, range=0..10000),
    A=Slider(330, range=0..1000),
    name="unikat head x3",
    write=Button(),
    gcode_folder="C:\Users\david\OneDrive - Politecnico di Milano\ginger\oggetti\gcode export\")  # -> polyline, gcode_klipper, estimated_time, estimated_mass_grams
panel = Panel(gcode_v11_beta.gcode_klipper)
panel_2 = Panel(gcode_v11_beta.estimated_time)
show_path = PathShower(relay=gcode_v11_beta.polyline, B=Slider(0, range=0..1))

# ==== cluster PathShower: fa vedere il percorso
relay = ClusterInput()
B = ClusterInput()
len = Length(Curve=relay)
multiplication = Multiplication(A=len, B=B)
ext = ExtendCurve(Curve=relay, Type=0, Start=0, End=expr("-x", multiplication))
C = ClusterOutput(ext)

# ==== cluster PathManager
L = ClusterInput()
i = ClusterInput()
i_2 = ClusterInput()
N = ClusterInput()
split = SplitList(List=flatten(L), Index=i)  # -> ListA, ListB
cpl = CurvePlanarizer(Curve=split.ListA)  # -> PlanarCurve, Plane, Deviation
split_2 = SplitList(List=cpl.PlanarCurve, Index=i_2)  # -> graft(ListA), ListB
area = Area(Geometry=split_2.ListA)  # -> Area, Centroid
crv_cp = CurveClosestPoint(Point=area.Centroid, Curve=split_2.ListA)  # -> Point, Parameter, Distance
division = Division(A=crv_cp.Distance, B=N)
series = Series(Start=Slider(0.1, range=0..1), Step=N, Count=Slider(8, range=0..10))
polyoffset = PolylineOffset(
    Polylines=split_2.ListA,
    Distance=series,
    Plane=Plane(origin=(0, 0, 0), x=(0, 0, 0), y=(0, 0, 0)),
    Tolerance=0.01,
    ClosedFillet=1,
    OpenFillet=1,
    Miter=2)  # -> flatten(Contour), Holes
end = EndPoints(Curve=split_2.ListA)  # -> Start, End
crv = Curve(flatten(polyoffset.Contour))
cir = Circle(Plane=PlaneXY(0, 0, 0), Radius=Slider(19, range=0..100))
number_slider = Slider(2, range=0..10)
brim = AlignCurveSeams(Curves=crv, Guide=end.Start, Snap=False, Iterative=True)  # -> Aligned, Points, R
curve_filter = CurveFilter(crv=brim.Aligned, B=cir)  # -> flatten(A)
open_seam = OPENSEAM(C=curve_filter, lenght_start=number_slider, lenght_end=number_slider)
connect = ConnectCurves(Curves=open_seam, Continuity=0, Close=False, Bulge=1)
topoly = CurveToPolyline(Curve=connect, ToleranceDistance=Slider(0.2, range=0..1), ToleranceAngle=0)  # -> Polyline, Segments
P = ClusterOutput(topoly.Polyline)

# ==== cluster LayerTime
relay = ClusterInput()
flatten = FlattenTree(Tree=relay, Path="{0}")
extremums = MinMax(Number=flatten(flatten))  # -> Minimum, Maximum
layer_time_s = Slider(35, range=0..100)
number_slider = Slider(40, range=0..100)
dom = ConstructDomain(DomainStart=extremums.Minimum, DomainEnd=extremums.Maximum)
slideindom = SlideWithinDomain(Domain=dom, Factor=Slider(0.7464, range=0..1))
len = Length(Curve=flatten)
larger = LargerThan(FirstNumber=len, SecondNumber=slideindom)  # -> LargerThan, OrEqualTo
dispatch = Dispatch(List=flatten, DispatchPattern=larger.LargerThan)  # -> ListA, ListB
crv = Curve(dispatch.ListB)
crv_2 = Curve(dispatch.ListA)
subtraction = Subtraction(A=number_slider, B=layer_time_s)
lng = ListLength(List=crv_2)
series = Series(Start=layer_time_s, Step=1, Count=subtraction)
repeat = RepeatData(Data=layer_time_s, Length=lng)
lastdex = LastIndex(List=repeat)
lng_2 = ListLength(List=series)
lng_3 = ListLength(List=series)
rev = ReverseList(List=series)
series_2 = Series(Start=lastdex, Step=expr("-1", 1), Count=lng_2)
series_3 = Series(Start=0, Step=1, Count=lng_3)
merge = Merge(Data1=rev, Data2=rev)
merge_2 = Merge(Data1=series_3, Data2=series_2)
replace = ReplaceItems(List=repeat, Item=merge, Indices=merge_2, Wrap=False)
len_2 = Length(Curve=crv_2)
len_3 = Length(Curve=crv)
division = Division(A=replace, B=60)
division_2 = Division(A=number_slider, B=60)
division_3 = Division(A=len_2, B=division)  # -> flatten(Result)
division_4 = Division(A=len_3, B=division_2)  # -> flatten(Result)
weave = Weave(Pattern=larger.LargerThan, Stream0=division_4, Stream1=division_3, NullGaps=False)
unflatten = UnflattenTree(Tree=weave, Guide=relay)
T = ClusterOutput(unflatten)

# ==== cluster GCODEV11BETA: GCODE PER KLIPPER
layer_thickness = ClusterInput()
layer_height = ClusterInput()
feed_rate = ClusterInput()
flow = ClusterInput()
marlin_0_21_klipper_1 = Slider(0.21, range=0..1)
curve = ClusterInput()
cross_section = Multiplication(LayerHeight=layer_height, LayerThickness=layer_thickness)
control_points = ControlPoints(Curve=curve)  # -> flatten(Points), Weights, Knots
explode = Explode(Curve=curve, Recursive=True)  # -> Segments, Vertices
multiplication = Multiplication(A=cross_section, B=marlin_0_21_klipper_1)
pcent = Percentage(Number=multiplication, Percent=flow)
length = Length(Curve=explode.Segments)
pline = PolyLine(Vertices=control_points.Points, Closed=False)
deconstruct = Deconstruct(Point=control_points.Points)  # -> XComponent, YComponent, ZComponent
polyline = ClusterOutput(pline)
insert_items = InsertItems(List=length, Item="0", Indices="0", Wrap=True)  # -> flatten(List)
travel_feed_rate = ClusterInput()
A = ClusterInput()
multiplication_2 = Multiplication(A=A, B=marlin_0_21_klipper_1)
multiplication_3 = Multiplication(A=insert_items, Multiplier1=pcent)
curve_2 = ClusterInput()
number_slider = Slider(100, range=0..100)
control_points_2 = ControlPoints(Curve=curve_2)  # -> Points, Weights, Knots
equals = Equality(ExtrusionRate=multiplication_3, SecondNumber=Slider(0, range=0..100))  # -> Equality, Inequality
trim = TrimTree(Tree=control_points_2.Points, Depth=1)
lng = ListLength(List=trim)
multiplication_4 = Multiplication(A=lng, B=Slider(0.18127, range=0..1))
multiplication_5 = Multiplication(A=lng, B=Slider(1, range=0..1))
multiplication_6 = Multiplication(FeedRate=feed_rate, B=equals.Inequality)
panel = Panel("""M107
M106 S140""")
multiplication_7 = Multiplication(TravelFeedRate=travel_feed_rate, B=equals.Equality)
subtraction = Subtraction(A=multiplication_5, B=Slider(2, range=0..10))
multiplication_8 = Multiplication(MaxMm3S=multiplication_2, B=Slider(60, range=0..100))
int = Integer(multiplication_4)
item = ListItem(List=trim, Index=multiplication_4, Wrap=True)
mm3_m = Multiplication(A=multiplication_6, B=multiplication)
int_2 = Integer(subtraction)
merge = Merge(Data1=int_2, Data2=int)
larger = LargerThan(FirstNumber=mm3_m, SecondNumber=multiplication_8)  # -> LargerThan, OrEqualTo
panel_2 = Panel(merge)
mm2 = Dispatch(List=multiplication, DispatchPattern=larger.LargerThan)  # -> ListA, ListB
dispatch = Dispatch(List=multiplication_6, DispatchPattern=larger.LargerThan)  # -> ListA, ListB
division = Division(A=multiplication_8, B=mm2.ListA)
weave = Weave(Pattern=larger.LargerThan, Stream0=dispatch.ListB, Stream1=division, NullGaps=False)
feed_rate_2 = Addition(A=multiplication_7, B=weave)
bed_temperature = ClusterInput()
concatenate = Concatenate(
    FragmentH="G1",
    FragmentG=" F",
    FragmentJ=feed_rate_2,
    FragmentA=" X",
    FragmentB=deconstruct.XComponent,
    FragmentC=" Y",
    FragmentD=deconstruct.YComponent,
    FragmentE=" Z",
    FragmentF=deconstruct.ZComponent,
    FragmentI=" E",
    FragmentK=multiplication_3)
unflatten = UnflattenTree(Tree=concatenate, Guide=trim)
ins = InsertItems(List=unflatten, Item=panel, Indices=merge, Wrap=True)
material = ClusterInput()
extremums = MinMax(Number=feed_rate_2)  # -> Minimum, Maximum
subtraction_2 = Subtraction(A=bed_temperature, B=Slider(10, range=0..10))
addition = Addition(A=bed_temperature, B=Slider(20, range=0..100))
panel_3 = Panel(" KAMP_LEVELING=0 PURGE_LAYER_HEIGHT=2 PURGE_PARKING_SPEED=12000 PURGE_LENGHT=300 PURGE_SPEED=500 PURGE_MATERIAL_QUANTITY=3000")
concat = Concatenate(FragmentA=" BED_TEMPERATURE=", BEDTEMPERATURE=bed_temperature)
concat_2 = Concatenate(FragmentA=" BED_TEMPERATURE_MIN=", BEDTEMPERATURE=subtraction_2)
concat_3 = Concatenate(FragmentA=" BED_TEMPERATURE_MAX=", BEDTEMPERATURE=addition)
concat_4 = Concatenate(FragmentA=" MATERIAL=", FragmentB=material)
extremums_2 = MinMax(Number=deconstruct.ZComponent)  # -> Minimum, Maximum
mm3 = Multiplication(A=insert_items, B=multiplication)
pcent_2 = Percentage(Number=flatten(feed_rate_2), Percent=Slider(100, range=0..1000))
g_cm3 = Slider(1.24, range=0..10)
ma = MassAddition(Input=mm3)  # -> Mm3TOTALI, PartialResults
addition_2 = Addition(A=extremums_2.Maximum, ZHope=Slider(30, range=0..100))
division_2 = Division(A=flatten(insert_items), B=pcent_2)
number_slider_2 = Slider(0, range=0..100)
concat_5 = Concatenate(A="START_PRINT", MATERIAL=concat_4, BED_TEMPERATURE=concat, B=concat_2, C=concat_3, D=panel_3)
z_raise = Concatenate(FragmentA="G1", FragmentB=" F", FragmentC=Slider(2000, range=0..10000), FragmentD=" Z", FragmentE=addition_2)
start_code = ClusterInput()
ma_2 = MassAddition(Input=division_2)  # -> Result, PartialResults
end_code = ClusterInput()
cm3 = Division(A=ma.Mm3TOTALI, B=Slider(1000, range=0..1000))
g = Multiplication(A=cm3, B=g_cm3)
time = ConstructTime(Hour=number_slider_2, Minute=ma_2.Result, Second=number_slider_2)
start_code_2 = FilePath(start_code)
end_code_2 = FilePath(end_code)
merge_2 = Merge(Data1=flatten(concat_5), Data2=flatten(ins), Data3=flatten(z_raise), Data4=flatten("END_PRINT"))
estimated_time = ClusterOutput(time)
file = ReadFile(File=start_code_2, PerLineParse=True)
file_2 = ReadFile(File=end_code_2, PerLineParse=True)
estimated_mass_grams = ClusterOutput(g)
merge_3 = Merge(Data1=flatten(file), Data2=flatten(ins), Data3=flatten(z_raise), Data4=flatten(file_2))
desired_file_extension = Panel(".gcode")
gcode_klipper = ClusterOutput(merge_2)
gcode_folder = ClusterInput()
name = ClusterInput()
write = ClusterInput()
gcode_folder_2 = FilePath(gcode_folder)
panel_4 = Panel(gcode_folder_2)
data = Data(merge_3)
python = FileCreator(Folder=panel_4, name=name, ext=desired_file_extension, lines=data, write=write)  # inputs lines: list, write: Boolean
# ---------- python: Python ----------
__author__ = "Matteo Lomaglio"
__version__ = "2022.06.23"


import os

file =Folder + name + ext


if write:
    filePath = open(file, "w") # Open the file
    for line in lines: # Iterate through lines
        filePath.write(line + "\n") # Write separate lines
    filePath.close() # Close the file
# ---------- end python ----------

# ==== cluster NonPlanarSlicer
S = ClusterInput()
P = ClusterInput()
D = ClusterInput()
B = ClusterInput()
B_2 = ClusterInput()
B_3 = ClusterInput()
contour = Contour(Shape=S, Point=P, Direction=Vector(0, 0, 1), Distance=D)

# ---- group: Choose Correct Curves
sort = SortList(Keys=contour, ValuesA=contour)  # -> Keys, reverse(ValuesA)
join_curves = JoinCurves(Curves=sort.ValuesA, Preserve=False)
item = ListItem(List=join_curves, Index=0, Wrap=True)

# ---- group: Polyline from Curve
number_slider = Slider(0.1, range=0..0.1)
topoly = CurveToPolyline(Curve=item, ToleranceDistance=number_slider, ToleranceAngle=number_slider)  # -> flatten(Polyline), Segments

# ---- group: Guide
cir = Circle(Plane=PlaneXY(0, 0, 0), Radius=1)

# ---- group: Sort and Align Curves I
flip = FlipCurve(Curve=topoly.Polyline, Guide=cir)  # -> Curve, Flag
join_curves_2 = JoinCurves(Curves=flip.Curve, Preserve=False)
close_curve = CloseCurve(Curve=join_curves_2, CloseType=0, Bulge=0.5, Tolerance=0)  # -> Closed, ResultBoolean
alicrvseams = AlignCurveSeams(Curves=close_curve.Closed, Guide=cir, Snap=False, Iterative=True)  # -> Aligned, Points, R

# ---- group: Sort and Align Curves II
area = Area(Geometry=alicrvseams.Aligned)  # -> Area, Centroid
deconstruct = Deconstruct(Point=area.Centroid)  # -> XComponent, YComponent, ZComponent
sort_list = SortList(Keys=deconstruct.ZComponent, ValuesValuesA=alicrvseams.Aligned)  # -> Keys, ValuesValuesA
alicrvseams_2 = AlignCurveSeams(Curves=sort_list.ValuesValuesA, Guide=cir, Snap=False, Iterative=True)  # -> Aligned, Points, R

# ----
divide = DivideCurve(Curve=alicrvseams_2.Aligned, Count=Slider(100, range=0..1000), Kinks=False)  # -> simplify(Points), Tangents, Parameters
flip_2 = FlipMatrix(Data=divide.Points)
pline = PolyLine(Vertices=flip_2, Closed=False)
sort_2 = SortList(Keys=flatten(pline), ValuesA=flatten(pline))  # -> Keys, ValuesA
item_2 = ListItem(List=reverse(sort_2.ValuesA), Index=0, Wrap=True)
len = Length(Curve=item_2)
division = Division(A=len, B=B)
divide_2 = DivideCurve(Curve=pline, Count=division, Kinks=False)  # -> Points, Tangents, Parameters
flip_3 = FlipMatrix(Data=divide_2.Points)
pline_2 = PolyLine(Vertices=flip_3, Closed=True)
smoothpline = SmoothPolyline(Polyline=pline_2, Strength=Slider(0.5, range=0..1), Times=Slider(30, range=0..30))
divide_3 = DivideCurve(Curve=smoothpline, Count=Slider(200, range=0..1000), Kinks=False)  # -> Points, Tangents, Parameters
flip_4 = FlipMatrix(Data=divide_3.Points)
pline_3 = PolyLine(Vertices=flip_4, Closed=False)
sort_3 = SortList(Keys=flatten(pline_3), ValuesA=flatten(pline_3))  # -> Keys, ValuesA
item_3 = ListItem(List=reverse(sort_3.ValuesA), Index=0, Wrap=True)
len_2 = Length(Curve=item_3)
division_2 = Division(A=len_2, B=B_2)
divide_4 = DivideCurve(Curve=pline_3, Count=division_2, Kinks=False)  # -> Points, Tangents, Parameters
flip_5 = FlipMatrix(Data=divide_4.Points)
number_slider_2 = Slider(20, range=0..100)
pline_4 = PolyLine(Vertices=flip_5, Closed=True)
len_3 = Length(Curve=pline_4)
division_3 = Division(A=len_3, B=B_3)
addition = Addition(A=division_3, B=Slider(10, range=0..10))
divide_5 = DivideCurve(Curve=pline_4, Count=addition, Kinks=False)  # -> Points, Tangents, Parameters
pline_5 = PolyLine(Vertices=divide_5.Points, Closed=True)  # -> flatten(Polyline)

pl = ClusterOutput(pline_5)

# ==== cluster Cluster
curve = ClusterInput()
brim = ClusterInput()
layer_height = ClusterInput()
spiral_v3_1 = SpiralV3(curve=curve)  # -> reverse(spiralized_points)
flatten = FlattenTree(Tree=spiral_v3_1, Path="{0}")
number_slider = Slider(160, range=0..1000)
lastdex = LastIndex(List=flatten)
item = ListItem(List=flatten, Index=lastdex, Wrap=True)
vec = VectorXYZ(XComponent=number_slider, YComponent=number_slider, ZComponent=Slider(10, range=0..10))  # -> Vector, Length
move = Move(Geometry=item, Motion=vec.Vector)  # -> Geometry, Transform
replace = ReplaceItems(List=flatten, Item=move.Geometry, Indices=lastdex, Wrap=False)
unflatten = UnflattenTree(Tree=replace, Guide=spiral_v3_1)
pline = PolyLine(Vertices=unflatten, Closed=False)
multiplication = Multiplication(A=layer_height, B=Slider(1.1, range=0..10))
open_seam = OPENSEAM(C=pline, lenght_start=multiplication, lenght_end=Slider(0, range=0..100))
cp = ControlPoints(Curve=open_seam)  # -> Points, Weights, Knots
pline_2 = PolyLine(Vertices=cp.Points, Closed=False)  # -> simplify(Polyline)
pline_3 = PolyLine(Vertices=flatten(cp.Points), Closed=False)
shift = ShiftList(List=flatten(pline_2), Shift=-1, Wrap=True)
replace_2 = ReplaceItems(List=shift, Item=brim, Indices=Slider(0, range=0..100), Wrap=False)
cp_2 = ControlPoints(Curve=pline_2)  # -> Points, Weights, Knots
unflatten_2 = UnflattenTree(Tree=replace_2, Guide=pline_2)
crv_cp = CurveClosestPoint(Point=cp_2.Points, Curve=unflatten_2)  # -> Point, Parameter, Distance
panel = Panel(crv_cp.Distance)
ln = Line(StartPoint=cp_2.Points, EndPoint=crv_cp.Point)
layer_width = ClusterInput()
segments = ClusterOutput(pline_3)
curve_2 = ClusterOutput(pline_2)

vec2pt = Vector2Pt(PointA=cp_2.Points, PointB=crv_cp.Point, Unitize=False)  # -> Vector, Length
devec = DeconstructVector(Vector=vec2pt.Vector)  # -> XComponent, YComponent, ZComponent
vec_2 = VectorXYZ(XComponent=devec.XComponent, YComponent=devec.YComponent, ZComponent=0)  # -> Vector, Length
angle = Angle(VectorA=vec2pt.Vector, VectorB=vec_2.Vector)  # -> Angle, Reflex
deg = Degrees(Radians=angle.Angle)
expression = Expression(a=angle.Angle, h=crv_cp.Distance, w=layer_width, Expression="(h/w)*(1-sin(a))*((w/h)-cos(a))")
nullrep = ReplaceNulls(Items=expression, Replacements=Slider(0, range=0..100))  # -> Items, Count
subtraction = Subtraction(A=Slider(1, range=0..1), B=nullrep.Items)
multiplication_2 = Multiplication(A=crv_cp.Distance, B=subtraction)  # -> simplify(Result)
panel_2 = Panel(subtraction)
e_value = ClusterOutput(multiplication_2)

# ==== cluster OPENSEAM
lenght_start = ClusterInput()
lenght_end = ClusterInput()
C = ClusterInput()
G = ClusterInput()
neg = Negative(LenghtStart=lenght_start)
neg_2 = Negative(LenghtEnd=lenght_end)
alicrvseams = AlignCurveSeams(Curves=C, Guide=G, Snap=False, Iterative=True)  # -> Aligned, Points, R
seam = Seam(Curve=reparameterize(alicrvseams.Aligned), Seam=Slider(0, range=0..100))
ext = ExtendCurve(Curve=seam, Type=0, Start=neg, End=neg_2)
C_2 = ClusterOutput(ext)

# ==== cluster CurveFilter: elimina le curve sotto una certa lunghezza
crv = ClusterInput()
crv_2 = Curve(crv)
B = ClusterInput()
len = Length(Curve=crv_2)
larger = LargerThan(FirstNumber=len, SecondNumber=B)  # -> LargerThan, OrEqualTo
dispatch = Dispatch(List=crv_2, DispatchPattern=larger.LargerThan)  # -> ListA, ListB
A = ClusterOutput(dispatch.ListA)

# ==== cluster SpiralV3
curve = ClusterInput()
curve_2 = Curve(flatten(curve))
lastdex = LastIndex(List=curve_2)
shift = ShiftList(List=curve_2, Shift=1, Wrap=True)
item = ListItem(List=curve_2, Index=lastdex, Wrap=True)
lastdex_2 = LastIndex(List=curve_2)
item_2 = ListItem(List=curve_2, Index=0, Wrap=True)
item_3 = ListItem(List=curve_2, Index=lastdex_2, Wrap=True)
lastdex_3 = LastIndex(List=shift)
ins = InsertItems(List=curve_2, Item=item_2, Indices=Slider(0, range=0..100), Wrap=True)
ins_2 = InsertItems(List=curve_2, Item=item_3, Indices=lastdex_2, Wrap=True)
replace = ReplaceItems(List=shift, Item=item, Indices=lastdex_3, Wrap=False)
cp = ControlPoints(Curve=ins_2)  # -> Points, Weights, Knots
crv_cp = CurveClosestPoint(Point=cp.Points, Curve=graft(ins))  # -> Point, Parameter, Distance
lng = ListLength(List=cp.Points)
ln = Line(StartPoint=cp.Points, EndPoint=crv_cp.Point)
range = Range(Domain=Domain(0, 1), Steps=expr("x-1", lng))
vec2pt = Vector2Pt(PointA=cp.Points, PointB=crv_cp.Point, Unitize=False)  # -> Vector, Length
multiplication = Multiplication(A=vec2pt.Vector, B=range)
move = Move(Geometry=cp.Points, Motion=multiplication)  # -> SpiralizedPoints, Transform
spiralized_points = ClusterOutput(move.SpiralizedPoints)
