# Grasshopper definition UR5slicer.gh (Grasshopper 1.0.8)
# Copyright: MIT
# plug-ins: Robots, Bifocals

# ---- group: 3D Printing / simple slicer
number_of_bottom_layers = Slider(2, range=0..3)
bottom_layer_linewidth = Slider(6, range=0.1..15)
zigzag_thickness = Slider(15, range=0..50)
nth_layer_height = Slider(2.5, range=0..10)
# UR5.slicer
# ROBOT CLAY PRINTING AND MOVEMENT ALGORITHM
# BY FABIO KOCZULA AND TORBEN KURZHALS - FH MÜNSTER 2025
# 
# Based on Robots Plugin bei Visose
# 
# Further Contributors
# Moritz Wesseler
_1st_layerheight = Slider(2, range=0..10)
point_distance = Slider(50, range=0..50)
zigzag = BooleanToggle(False)
geometry = Geometry(<extrusion referenced from the Rhino model>)
simple_slicer = SimpleSlicer(
    geometry=geometry,
    layerheight_start=_1st_layerheight,
    layerheight_end=nth_layer_height,
    point_distance=point_distance,
    zigzag=zigzag,
    zigzag_thickness=zigzag_thickness,
    number_of_bottom_layers=number_of_bottom_layers,
    bottom_layer_linewidth=bottom_layer_linewidth)  # -> planes, curves, geometry_2, center, bottom_layer_planes, bottom_layer_curves

# ---- group: Simple Curve Tool for Pen Application
rotate_planar = Slider(0, range=0..360)
precision_in_mm = Slider(5, range=0..100)
rotate_3d = Slider(0, range=0..360)
curve = Curve(<curve referenced from the Rhino model>)
robotic_drawing = RoboticDrawing(curve=curve, precision=precision_in_mm, plane_rotate_planar=degrees(rotate_planar), plane_rotate_3d=degrees(rotate_3d))
plane = Plane(robotic_drawing)

# ---- group: 3D Printing / worksurface
worksurface_height = ValueList({"Backblech": 7, "1cm": 10, "1.2cm": 12, "1.8cm": 18, "2.4cm": 24}, selected="1.8cm")
width = Slider(300, range=0..1500)
length = Slider(330, range=0..1500)
# BUGS: Bugs
# 
# - Make Nozzle Length Adjustable
# - Implenet Plane Rotation for Pen Holder
worksurface = Worksurface(
    planes=simple_slicer.planes,
    curves=simple_slicer.curves,
    geometry=simple_slicer.geometry_2,
    center=simple_slicer.center,
    distance1="120",
    distance2="550",
    width=width,
    length=length,
    height=worksurface_height)  # -> planes_2, curves_2
plane_2 = Plane(worksurface.planes_2)

# ----
# Tool Selection Hint: Play with Shoulder, Wrist and Elbow, when Choosing different tools.
speed_mm_s = Slider(100, range=0..500)
animation = Slider(1, range=0..1)
plane_3 = Plane(worksurface.planes_2)
tool_selection = ValueList({"Clay Printing": 0, "Pen Holder": 1}, selected="Pen Holder")
rotate_planes = BooleanToggle(False)
flip_planes = BooleanToggle(False)
upload = Button()
ironing = BooleanToggle(False)
pause = Button()
play = Button()
list = FlagFields({"Shoulder": 1, "Elbow": 2, "Wrist": 4}, selected=["Shoulder", "Wrist"])
list_2 = ValueList({"Joint", "Linear"}, selected="Joint")
clay_printer = ClayPrinter(
    planes=plane_3,
    flip=flip_planes,
    rotate=rotate_planes,
    ironing=ironing,
    cf=list,
    M=list_2,
    speed_parameter=speed_mm_s,
    time=animation,
    upload=upload,
    play=play,
    pause=pause,
    tool_selection=tool_selection)  # -> warnings, errors, program
panel = Panel(clay_printer.warnings)
panel_2 = Panel(clay_printer.errors)

construct_domain = ConstructDomain(DomainStart=Slider(0, range=0..1), DomainEnd=Slider(1, range=0..1))
construct_domain_2 = ConstructDomain(DomainStart=Slider(0, range=0..1), DomainEnd=Slider(1, range=0..1))
range = Range(Domain=construct_domain, Steps=Slider(49, range=0..100))
curve_2 = Curve(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)
range_2 = Range(Domain=construct_domain_2, Steps=Slider(15, range=0..100))
curve_3 = Curve(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)
curve_4 = Curve(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)
curve_5 = Curve(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)
flip_curve = FlipCurve(Curve=curve_2, Guide=curve_3)  # -> Curve, Flag
tween_curve = TweenCurve(CurveA=curve_3, CurveB=flip_curve.Curve, Factor=range, BlendType=0)
tween_curve_2 = TweenCurve(CurveA=curve_2, CurveB=flip_curve.Curve, Factor=range, BlendType=0)
tween_curve_3 = TweenCurve(CurveA=curve_4, CurveB=curve_3, Factor=range_2, BlendType=0)

construct_domain_3 = ConstructDomain(DomainStart=Slider(0, range=0..1), DomainEnd=Slider(1, range=0..1))
range_3 = Range(Domain=construct_domain_3, Steps=Slider(11, range=0..100))
tween_curve_4 = TweenCurve(CurveA=curve_4, CurveB=curve_5, Factor=range_3, BlendType=0)

curve_6 = Curve(flatten([tween_curve, tween_curve_3, tween_curve_4]))
split_list = SplitList(List=curve_6, Index=Slider(29, range=0..100))  # -> ListA, ListB

# ==== cluster ClayPrinter: creates a program and sends it to a robot arm using a wired network connection
planes = ClusterInput()
flip = ClusterInput()
rotate = ClusterInput()
ironing = ClusterInput()  # run the last layer a second time with extrusion turned off
cf = ClusterInput()
M = ClusterInput()
speed_parameter = ClusterInput()
time = ClusterInput()
upload = ClusterInput()
play = ClusterInput()
pause = ClusterInput()
tool_selection = ClusterInput()

# ---- group: CLAY PRINTING TOOL
unit_x = UnitX(Factor=Slider(10, range=0..100))
point = Point(Point(181, -2.478366146, 54.49999392))
subtraction = Subtraction(A=point, B=unit_x)
yz_plane = YZPlane(Origin=subtraction)

# ---- group: PEN HOLDER TOOL
geometry = Geometry([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])
solid_union = SolidUnion(Breps=geometry)
panel = Panel("0,0,145")
volume = Volume(Geometry=solid_union)  # -> Volume, Centroid
create_tool = CreateTool(Name="PenHolder", TCP=panel, Weight="0.15", Centroid=volume.Centroid, Mesh=solid_union)  # -> Tool, TCP

# ----
# table volume
panel_2 = Panel("637.5")
negative = Negative(Value=panel_2)
construct_point = ConstructPoint(XCoordinate="-845", YCoordinate=panel_2, ZCoordinate="-18")
negative_2 = Negative(Value="-845")
multiplication = Multiplication(A=negative, B=2)
domain_box = DomainBox(Base=construct_point, X=negative_2, Y=multiplication, Z="-700")
custom_preview = CustomPreview(Geometry=domain_box, Material=ColourSwatch(SwatchColor=RGB(191, 191, 191)))

# ---- group: CLAY PRINTING TOOL
brep = Brep(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)
volume_2 = Volume(Geometry=brep)  # -> Volume, Centroid
mesh_brep = MeshBrep(
    Brep=brep,
    Settings={GridMaxCount=0, GridMinCount=16, JaggedSeams=False, MaxEdgeLength=0, MinEdgeLength=0.0001, MinTolerance=0, Refine=True, RefineAngle=0, RelativeTolerance=0.65, SimplePlanes=True, Tolerance=0})

panel_3 = Panel("Lehmextruder_V2")
panel_4 = Panel("2.5")

# ----
yz_plane_2 = YZPlane(Origin=panel)

# ---- group: CLAY PRINTING TOOL
create_tool_2 = CreateTool(Name=panel_3, TCP=yz_plane, Weight=panel_4, Centroid=volume_2.Centroid, Mesh=mesh_brep)  # -> Tool, TCP

# ---- group: Create Robot
list = RobotsLibrary({"KR120_R2700_2", "UR3e", "UR5e", "UR10e", "UR16e", "UR3", "UR5", "UR10", "UR20", "UR30"}, selected="UR5", Type=0)
load_robot_system = LoadRobotSystem(Name=list, Base=PlaneXY(0, 0, 0))
panel_5 = Panel("Lehmdruck")

# ---- group: Create Speed
speed_parameter_2 = SpeedParameter(speed_parameter)
zone_parameter = ZoneParameter("1")

# ---- group: Create Planes
cluster = Cluster(planes=planes, flip=flip, rotate=rotate, split=0)  # -> planes_1, planes_2

# ----
stream_filter = StreamFilter(Gate=tool_selection, Stream0=create_tool_2.Tool, Stream1=create_tool.Tool)

create_target = CreateTarget(
    Plane=cluster.planes_1,
    RobConf=cf,
    Motion=M,
    Tool=stream_filter,
    Speed=speed_parameter_2,
    Zone=zone_parameter,
    IsCartesian=True)

# ---- group: Commands for Clay
panel_6 = Panel("popup(\"Bitte kontrolliere, ob die Druckluft eingeschaltet ist!\", \"Druckluft an?\", warning=False, error=False, blocking=True)")
custom_command = CustomCommand(Name="CustomCommand", Manufacturer="UR", Code=panel_6)
set_do = SetDO(DO=Slider(0, range=0..3), Value=Slider(0, range=0..1))
set_do_2 = SetDO(DO=Slider(1, range=0..3), Value=Slider(0, range=0..1))
merge = Merge(Data1=custom_command, Data2=set_do, Data3=set_do_2)

# ----
stream_filter_2 = StreamFilter(Gate=ironing, Stream1=planes)
deconstruct = Deconstruct(Point=stream_filter_2)  # -> XComponent, YComponent, ZComponent
number_slider = Slider(2, range=0..10)
min_max = MinMax(Number=deconstruct.ZComponent)  # -> Minimum, Maximum
round_to_decimal_place = RoundToDecimalPlace(NumberX=deconstruct.ZComponent, DecimalPlace=number_slider, RoundType=0)  # -> Rounded, Difference
round_to_decimal_place_2 = RoundToDecimalPlace(NumberX=min_max.Maximum, DecimalPlace=number_slider, RoundType=0)  # -> Rounded, Difference
equality = Equality(FirstNumber=round_to_decimal_place.Rounded, SecondNumber=round_to_decimal_place_2.Rounded)  # -> Equality, Inequality
mass_addition = MassAddition(Input=equality.Equality)  # -> Result, PartialResults

create_program = CreateProgram(Name=panel_5, RobotSystem=load_robot_system, Targets=create_target, InitCommands=merge, StepSize=1)  # -> Program, Code, Duration, Warnings, Errors

last_index = LastIndex(List=create_program.Code)
split_list = SplitList(List=flatten(create_program.Code), Index=expr("x-1", last_index))  # -> ListA, ListB

program_simulation = ProgramSimulation(Program=create_program.Program, Time=time, Normalized=True)  # -> SystemMeshes, JointRotations, Plane, Index, Time, Program, Errors

custom_preview_2 = CustomPreview(Geometry=program_simulation.SystemMeshes, Material=ColourSwatch(SwatchColor=RGB(181, 181, 181)))

list_length = ListLength(List=split_list.ListA)
subtraction_2 = Subtraction(A=list_length, B=mass_addition.Result)
series = Series(Start=subtraction_2, Step=1, Count=mass_addition.Result)
list_item = ListItem(List=split_list.ListA, Index=series, Wrap=True)

split_list_2 = SplitList(List=flatten(split_list.ListA), Index=expr("x-1", Slider(12, range=0..100)))  # -> ListA, ListB

off = Panel("""set_digital_out(0,False)
set_digital_out(1,True)""")
on = Panel("""set_digital_out(1,False)
set_digital_out(0,True)""")

merge_2 = Merge(
    Data1=flatten(split_list_2.ListA),
    Data2=flatten(on),
    Data3=flatten(split_list_2.ListB),
    Data4=flatten(off),
    Data5=flatten(list_item),
    Data6=flatten(split_list.ListB))
custom_code = CustomCode(Program=create_program.Program, Code=merge_2)

remote_connection = RemoteConnection(Program=custom_code, IP="192.168.1.66", Upload=upload, Play=play, Pause=pause)

warnings = ClusterOutput(create_program.Warnings)
errors = ClusterOutput(create_program.Errors)
program = ClusterOutput(create_program.Program)

# ==== cluster SimpleSlicer: slice an object for using adaptive layer heights
geometry = ClusterInput()
layerheight_start = ClusterInput()
layerheight_end = ClusterInput()
point_distance = ClusterInput()
zigzag = ClusterInput()
zigzag_thickness = ClusterInput()
number_of_bottom_layers = ClusterInput()
bottom_layer_linewidth = ClusterInput()

# ----
# geometry bounding size
bounding_size = BoundingSize(geometry=geometry)  # -> x, y, z
average = Average(Input=[layerheight_end, layerheight_start])
division = Division(A=bounding_size.z, B=average)

# ----
# bottom centerpoint
bounding_box = BoundingBox(Content=geometry, Plane=PlaneXY(0, 0, 0))  # -> Box, Box_2
unit_z = UnitZ(Factor=expr("x/2", bounding_size.z))
volume = Volume(Geometry=bounding_box.Box)  # -> Volume, Centroid
subtraction = Subtraction(A=volume.Centroid, B=unit_z)
deconstruct = Deconstruct(Point=subtraction)  # -> XComponent, YComponent, ZComponent

multiplication = Multiplication(A=2, B=number_of_bottom_layers)
center = ClusterOutput(subtraction)

# ----
# create layers
construct_domain = ConstructDomain(DomainStart=layerheight_start, DomainEnd=layerheight_end)
range = Range(Domain=construct_domain, Steps=division)
mass_addition = MassAddition(Input=range)  # -> Result, PartialResults
smaller_than = SmallerThan(FirstNumber=mass_addition.PartialResults, SecondNumber=bounding_size.z)  # -> SmallerThan, OrEqualTo
cull_pattern = CullPattern(List=mass_addition.PartialResults, CullPattern=smaller_than.OrEqualTo)
addition = Addition(A=cull_pattern, B=deconstruct.ZComponent)
construct_point = ConstructPoint(XCoordinate=0, YCoordinate=0, ZCoordinate=addition)
xy_plane = XYPlane(Origin=construct_point)
brep_plane = BrepPlane(Brep=geometry, Plane=xy_plane)  # -> flatten(Curves), Points

stream_gate = StreamGate(Stream=brep_plane.Curves, Gate=zigzag)  # -> Target0, Target1

# ----
# divide every curve
length = Length(Curve=stream_gate.Target0)
division_2 = Division(A=length, B=point_distance)

# ----
# divide first curve (even number)
list_item = ListItem(List=stream_gate.Target1, Index=0, Wrap=True)
length_2 = Length(Curve=list_item)
division_3 = Division(A=length_2, B=point_distance)
round_and_even = RoundAndEven(number=division_3)

stream_filter = StreamFilter(Gate=zigzag, Stream0=division_2, Stream1=round_and_even)
stream_gate_2 = StreamGate(Stream=stream_filter, Gate=zigzag)  # -> Target0, Target1

divide_curve = DivideCurve(Curve=brep_plane.Curves, Count=[stream_gate_2.Target1, stream_gate_2.Target0], Kinks=False)  # -> flatten(Points), flatten(Tangents), Parameters

stream_filter_2 = StreamFilter(Gate=zigzag, Stream1=divide_curve.Points)

# ----
# divide 2nd time
unit_z_2 = UnitZ(Factor=1)
cross_product = CrossProduct(VectorA=divide_curve.Tangents, VectorB=unit_z_2, Unitize=False)  # -> Vector, Length
amplitude = Amplitude(Vector=cross_product.Vector, Amplitude=zigzag_thickness)
move = Move(Geometry=stream_filter_2, Motion=amplitude)  # -> Geometry, Transform

series = Series(Start=0, Step=stream_gate_2.Target1, Count=division)
duplicate_data = DuplicateData(Data="1", Number=stream_gate_2.Target1, Order=False)
merge = Merge(Data1=flatten(duplicate_data), Data2="0")  # -> flatten(Result)
addition_2 = Addition(A=stream_gate_2.Target1, B=1)
multiplication_2 = Multiplication(A=addition_2, B=multiplication)
series_2 = Series(Start=0, Step=1, Count=multiplication_2)
stream_filter_3 = StreamFilter(Gate=zigzag, Stream0=brep_plane.Curves)
loft = Loft(Curves=stream_filter_3, Options={Adjust=False, Closed=False, LoftEnds=0, LoftSimp=0, LoftType=0, Rebuild=10, Refit=0.01})

# ----
# bottom layers
series_3 = Series(Start=0, Step=1, Count=number_of_bottom_layers)
stream_gate_3 = StreamGate(Stream=series_3, Gate=zigzag)  # -> Target0, Target1
negative = Negative(Value=bottom_layer_linewidth)
list_item_2 = ListItem(List=brep_plane.Curves, Index=stream_gate_3.Target0, Wrap=True)

# ----
# sort points
dispatch = Dispatch(List=stream_filter_2, DispatchPattern=[True, False])  # -> ListA, ListB
dispatch_2 = Dispatch(List=move.Geometry, DispatchPattern=[True, False])  # -> ListA, ListB
panel = Panel("""1
0""")
weave = Weave(Pattern=panel, Stream0=dispatch.ListB, Stream1=dispatch_2.ListA, NullGaps=False)
weave_2 = Weave(Pattern=panel, Stream0=dispatch_2.ListB, Stream1=dispatch.ListA, NullGaps=False)
duplicate_data_2 = DuplicateData(Data=panel, Number=expr("x+1", stream_gate_2.Target1), Order=False)

# ----
# create curves and geometry
partition_list = PartitionList(List=weave, Size=stream_gate_2.Target1)
partition_list_2 = PartitionList(List=weave_2, Size=stream_gate_2.Target1)
polyline = PolyLine(Vertices=partition_list, Closed=True)  # -> flatten(Polyline)
polyline_2 = PolyLine(Vertices=partition_list_2, Closed=True)  # -> flatten(Polyline)
number_slider = Slider(1, range=0..10)
merge_2 = Merge(Data1=polyline, Data2=polyline_2)
fillet = Fillet(Curve=polyline, Radius=number_slider)
fillet_2 = Fillet(Curve=polyline_2, Radius=number_slider)
loft_2 = Loft(Curves=fillet, Options={Adjust=False, Closed=False, LoftEnds=0, LoftSimp=0, LoftType=0, Rebuild=10, Refit=0.01})
loft_3 = Loft(Curves=fillet_2, Options={Adjust=False, Closed=False, LoftEnds=0, LoftSimp=0, LoftType=0, Rebuild=10, Refit=0.01})

list_item_3 = ListItem(List=weave, Index=series, Wrap=True)
list_item_4 = ListItem(List=weave_2, Index=series, Wrap=True)
weave_3 = Weave(Pattern=flatten(merge), Stream0=list_item_4, Stream1=weave_2, NullGaps=False)
weave_4 = Weave(Pattern=flatten(merge), Stream0=list_item_3, Stream1=weave, NullGaps=False)
list_item_5 = ListItem(List=weave_3, Index=Slider(248, range=0..258), Wrap=True)

weave_5 = Weave(Pattern=duplicate_data_2, Stream0=weave_4, Stream1=weave_3, NullGaps=False)

cull_index = CullIndex(List=weave_5, Indices=series_2, Wrap=True)
stream_filter_4 = StreamFilter(Gate=zigzag, Stream0=divide_curve.Points, Stream1=cull_index)
xy_plane_2 = XYPlane(Origin=stream_filter_4)
stream_filter_5 = StreamFilter(Gate=zigzag, Stream0=brep_plane.Curves, Stream1=merge_2)
list_item_6 = ListItem(List=xy_plane_2, Index=Slider(909, range=0..1000), Wrap=True)
planes = ClusterOutput(xy_plane_2)
curves = ClusterOutput(stream_filter_5)

list_item_7 = ListItem(List=polyline, Index=stream_gate_3.Target1, Wrap=True)  # -> graft(Item)
list_item_8 = ListItem(List=polyline_2, Index=stream_gate_3.Target1, Wrap=True)  # -> graft(Item)

region_union = RegionUnion(Curves=[list_item_7, list_item_8])  # -> flatten(Result)

# ----
# calculate number of offsets
area = Area(Geometry=[region_union, list_item_2])  # -> Area, Centroid
curve_closest_point = CurveClosestPoint(Point=area.Centroid, Curve=[region_union, list_item_2])  # -> Point, Parameter, Distance
min_max = MinMax(Number=curve_closest_point.Distance)  # -> Minimum, Maximum
division_4 = Division(A=min_max.Maximum, B=bottom_layer_linewidth)

list_length = ListLength(List=region_union)
stream_filter_6 = StreamFilter(Gate=zigzag, Stream0=list_item_2, Stream1=region_union)
list_item_9 = ListItem(List=stream_filter_6, Index=0, Wrap=True)
boundary_surfaces = BoundarySurfaces(Edges=list_item_9)
flatten_tree = FlattenTree(Tree=[loft_3, loft_2, loft, boundary_surfaces], Path="{0}")
geometry_2 = ClusterOutput(flatten_tree)

series_4 = Series(Start=negative, Step=negative, Count=division_4)
offset_curve = OffsetCurve(Curve=graft([list_item_2, region_union]), Distance=series_4, Corners=1)

list_length_2 = ListLength(List=flatten(offset_curve))
division_5 = Division(A=list_length_2, B=list_length)
duplicate_data_3 = DuplicateData(Data="1", Number=expr("x-1", division_5), Order=True)
merge_3 = Merge(Data1=flatten("0"), Data2=flatten(duplicate_data_3))  # -> flatten(Result)
weave_6 = Weave(Pattern=merge_3, Stream0=region_union, Stream1=flatten(offset_curve), NullGaps=False)
stream_gate_4 = StreamGate(Stream=weave_6, Gate=zigzag)  # -> Target0, Target1
length_3 = Length(Curve=stream_gate_4.Target0)
explode = Explode(Curve=stream_gate_4.Target1, Recursive=True)  # -> flatten(Segments), flatten(Vertices)
division_6 = Division(A=length_3, B=point_distance)
bottom_layer_curves = ClusterOutput(weave_6)

divide_curve_2 = DivideCurve(Curve=stream_gate_4.Target0, Count=division_6, Kinks=False)  # -> flatten(Points), Tangents, Parameters

point = Point([divide_curve_2.Points, explode.Vertices])

xy_plane_3 = XYPlane(Origin=point)

bottom_layer_planes = ClusterOutput(xy_plane_3)

# ==== cluster Worksurface: define the location and size of the printable worksurface
planes = ClusterInput()
curves = ClusterInput()
geometry = ClusterInput()  # lofted geometry
animation = ClusterInput()
center = ClusterInput()
distance1 = ClusterInput()
distance2 = ClusterInput()
width = ClusterInput()
length = ClusterInput()
height = ClusterInput()

# ----
# printbed placement
construct_point = ConstructPoint(XCoordinate=distance1, YCoordinate=expr("-x", distance2), ZCoordinate=0)
addition = Addition(B=construct_point)

# ----
# printbed volume
negative = Negative(Value=length)
domain_box = DomainBox(Base=addition, X=width, Y=negative, Z=height)
equality = Equality(FirstNumber=height, SecondNumber=7)  # -> Equality, Inequality
stream_filter = StreamFilter(
    Gate=equality.Equality,
    Stream0=ColourSwatch(SwatchColor=RGB(230, 201, 158)),
    Stream1=ColourSwatch(SwatchColor=RGB(56, 56, 56)))
custom_preview = CustomPreview(Geometry=domain_box, Material=stream_filter)

# ----
# move to center
unit_z = UnitZ(Factor=expr("x/2", height))
volume = Volume(Geometry=domain_box)  # -> Volume, Centroid
addition_2 = Addition(A=volume.Centroid, B=unit_z)
vector_2pt = Vector2Pt(PointA=center, PointB=addition_2, Unitize=False)  # -> Vector, Length

move = Move(Geometry=planes, Motion=vector_2pt.Vector)  # -> Geometry, Transform
move_2 = Move(Geometry=curves, Motion=vector_2pt.Vector)  # -> Geometry, Transform
move_3 = Move(Geometry=geometry, Motion=vector_2pt.Vector)  # -> Geometry, Transform
planes_2 = ClusterOutput(move.Geometry)
curves_2 = ClusterOutput(move_2.Geometry)

# ----
# trim at tool height
equality_2 = Equality(FirstNumber=animation, SecondNumber=0)  # -> Equality, Inequality
addition_3 = Addition(A=animation, B=0)
addition_4 = Addition(A=addition_3, B=equality_2.Equality)
larger_than = LargerThan(FirstNumber=addition_4, SecondNumber=0)  # -> LargerThan, OrEqualTo
stream_filter_2 = StreamFilter(Gate=larger_than.LargerThan, Stream1=geometry)
list_item = ListItem(List=stream_filter_2, Index=0, Wrap=True)
bounding_size = BoundingSize(geometry=list_item)  # -> x, y, z
multiplication = Multiplication(A=bounding_size.z, B=animation)
construct_point_2 = ConstructPoint(XCoordinate=0, YCoordinate=0, ZCoordinate=multiplication)
xy_plane = XYPlane(Origin=construct_point_2)

stream_gate = StreamGate(Stream=move_3.Geometry, Gate=larger_than.LargerThan)  # -> Target0, Target1

trim_with_plane = TrimWithPlane(Brep=stream_gate.Target1, Plane=xy_plane, PlaneDirection=True, Cap=True, Tolerance=0.001)  # -> flatten(TrimmedBreps)

custom_preview_2 = CustomPreview(Geometry=[stream_gate.Target0, trim_with_plane], Material=ColourSwatch(SwatchColor=RGB(204, 179, 135)))

# ==== cluster RoboticDrawing: Creates drawable paths fors for robotic drawings.

# ---- group: Sort Multiple Curves / Cluster Input
curve = ClusterInput()

# ---- group: Sort Multiple Curves
curve_2 = Curve(curve)
end_points = EndPoints(Curve=curve_2)  # -> Start, End
point = Point(end_points.End)
deconstruct = Deconstruct(Point=point)  # -> XComponent, YComponent, ZComponent
sort_list = SortList(Keys=deconstruct.XComponent, ValuesValuesA=curve_2)  # -> Keys, ValuesValuesA
curve_3 = Curve(sort_list.ValuesValuesA)
dispatch = Dispatch(List=curve_3, DispatchPattern=[True, False])  # -> ListA, ListB
flip_curve = FlipCurve(Curve=dispatch.ListB)  # -> Curve, Flag
weave = Weave(Pattern=[0, 1], Stream0=dispatch.ListA, Stream1=flip_curve.Curve, NullGaps=False)

# ---- group: Adjust Planes / Cluster Input
precision = ClusterInput()

plane_rotate_planar = ClusterInput()

plane_rotate_3d = ClusterInput()

# ---- group: Adjust Planes
divide_distance = DivideDistance(Curve=weave, Distance=precision)  # -> Points, Tangents, Parameters
plane = Plane(divide_distance.Points)
flip_plane = FlipPlane(Plane=plane, FlipX=False, FlipY=False, FlipZ=True)  # -> Flipped, ResultBoolean
xy_plane = XYPlane(Origin=Point(0, 0, 0))
xz_plane = XZPlane(Origin=Point(0, 0, 0))
rotate_3d = Rotate3D(Geometry=flip_plane.Flipped, Angle=degrees(plane_rotate_planar), Center=flip_plane.Flipped, Axis=xy_plane)  # -> Geometry, Transform
rotate_3d_2 = Rotate3D(Geometry=rotate_3d.Geometry, Angle=degrees(plane_rotate_3d), Center=rotate_3d.Geometry, Axis=xz_plane)  # -> Geometry, Transform

# ---- group: Move Endpoints
move_start_endpoint_up_mm = Slider(19, range=0..100)
move_endpoints = MoveEndpoints(planes=rotate_3d_2.Geometry, endpoints_move_mm=move_start_endpoint_up_mm)
planes = ClusterOutput(move_endpoints)

# ==== cluster Cluster
planes = ClusterInput()
flip = ClusterInput()
stream_gate = StreamGate(Stream=planes, Gate=flip)  # -> Target0, Target1
rotate = ClusterInput()
flip_plane = FlipPlane(Plane=stream_gate.Target1, ReverseX=False, ReverseY=False, SwapAxes=True)
split = ClusterInput()
stream_gate_2 = StreamGate(Stream=[stream_gate.Target0, flip_plane], Gate=rotate)  # -> Target0, Target1
rotate_2 = Rotate(Geometry=stream_gate_2.Target1, Angle=degrees(Slider(180, range=0..1000)), Plane=stream_gate_2.Target1)  # -> Geometry, Transform
stream_gate_3 = StreamGate(Stream=[stream_gate_2.Target0, rotate_2.Geometry], Gate=split)  # -> Target0, Target1
last_index = LastIndex(List=stream_gate_3.Target1)
split_list = SplitList(List=stream_gate_3.Target1, Index=expr("x/2", last_index))  # -> ListA, ListB
last_index_2 = LastIndex(List=split_list.ListB)
last_index_3 = LastIndex(List=[stream_gate_3.Target0, split_list.ListA])
list_item = ListItem(List=split_list.ListB, Index=last_index_2, Wrap=True)
list_item_2 = ListItem(List=[stream_gate_3.Target0, split_list.ListA], Index=last_index_3, Wrap=True)
number_slider = Slider(75, range=0..100)
unit_z = UnitZ(Factor=number_slider)
unit_z_2 = UnitZ(Factor=number_slider)
move = Move(Geometry=list_item_2, Motion=unit_z)  # -> Geometry, Transform
move_2 = Move(Geometry=list_item, Motion=unit_z_2)  # -> Geometry, Transform

merge = Merge(Data1=[stream_gate_3.Target0, split_list.ListA], Data2=move.Geometry)
planes_1 = ClusterOutput(merge)

merge_2 = Merge(Data1=list_item_2, Data2=split_list.ListB, Data3=move_2.Geometry)
planes_2 = ClusterOutput(merge_2)

# ==== cluster RoundAndEven: round a number to the nearest even number
number = ClusterInput()  # input number to round and even
modulus = Modulus(A=number, B=2)
larger_than = LargerThan(FirstNumber=modulus, SecondNumber=1)  # -> LargerThan, OrEqualTo
subtraction = Subtraction(A=2, B=modulus)
addition = Addition(A=number, B=subtraction)
subtraction_2 = Subtraction(A=number, B=modulus)
stream_filter = StreamFilter(Gate=larger_than.LargerThan, Stream0=subtraction_2, Stream1=addition)
number_2 = ClusterOutput(stream_filter)  # rounded even number

# ==== cluster BoundingSize: calculate x, y & z dimensions of input geometry
geometry = ClusterInput()
bounding_box = BoundingBox(Content=geometry, Plane=PlaneXY(0, 0, 0))  # -> Box, Box_2
deconstruct_box = DeconstructBox(Box=bounding_box.Box)  # -> Plane, X, Y, Z
number = Number(deconstruct_box.X)
number_2 = Number(deconstruct_box.Y)
number_3 = Number(deconstruct_box.Z)
x = ClusterOutput(number)
y = ClusterOutput(number_2)
z = ClusterOutput(number_3)

# ==== cluster MoveEndpoints

# ---- group: Cluster Input
planes = ClusterInput()

endpoints_move_mm = ClusterInput()

# ---- group: Move Up First and Last Point
plane = Plane(planes)

list_item = ListItem(List=plane, Index=Slider(-1, range=-1..1), Wrap=True)
unit_z = UnitZ(Factor=endpoints_move_mm)
move = Move(Geometry=list_item, Motion=unit_z)  # -> Geometry, Transform

list_item_2 = ListItem(List=plane, Index=0, Wrap=True)
unit_z_2 = UnitZ(Factor=endpoints_move_mm)
move_2 = Move(Geometry=list_item_2, Motion=unit_z_2)  # -> Geometry, Transform

merge = Merge(Data1=move_2.Geometry, Data2=plane, Data3=move.Geometry)  # -> flatten(Result)

# ---- group: Cluster Output
planes_2 = ClusterOutput(merge)
